# Grasshopper definition Canopy Grasshopper V8 (Taper both sides of column - Flat opening)_Type 1.gh (Grasshopper 1.0.7)
# plug-ins: BH.UI.Grasshopper

getinfo = GetInfo(Component="{ .GetInfo")
bhom_version_used_to_create = Panel("5.3")
# <Script name>
project_number = Panel("")
setprojectid = SetProjectID(ProjectID=project_number, Component="{ .SetProjectID")
# Create input at start detailing the canopy
# number - this inputs the respective radii and
# translation values
# Canopy Group 1: Inital Pre-DD:
# Primary 8000
# Opening 4000
# Edge 16000
# Column 6000
# Max Depth 1500
# Min Depth 500
# Arrival Building Canopy 4&5: Inital Pre-DD:
# Primary 5775
# Opening 4150
# Edge 16000
# Column 5000
# Max Depth 1500
# Min Depth 500
# Arrival Building Canopy 7&8: Inital Pre-DD:
# Primary 7000
# Opening 5000
# Edge 21500
# Column 6000
# Max Depth 2500
# Min Depth 1000
# Canopy Group 2: Inital Pre-DD:
# Primary 8000
# Opening 4000
# Edge 16000
# Column 9000
# Max Depth 1500
# Min Depth 500
# Canopy Group 4: Inital Pre-DD:
# Primary 11000
# Opening 6000
# Edge 21500
# Column 11500
# Max Depth 2500
# Min Depth 1000
bhom_version_currently_installed = Panel(getinfo)

panel = Panel("Input Revit Column extraction here")
# Radial Bay defining ring position
# Extract Radius from Revit column position - or set radius
panel_2 = Panel("0,0")
canopy_center_point = Data(panel_2)
column_top = Data(panel)
line = Line(StartPoint=canopy_center_point, EndPoint=column_top)
length = Length(Curve=line)

# ----
# Inputs
# Split Ring Truss
number_slider = Slider(2, range=0..4)
# Truss Depth
number_slider_2 = Slider(1500, range=0..10000)
# Radius
number_slider_3 = Slider(7200, range=0..11000)
# No. Radial Members
number_slider_4 = Slider(2, range=0..10)
number_slider_5 = Slider(4, range=0..10)
# No. Sides
number_slider_6 = Slider(12, range=0..100)

division = Division(A=number_slider_2, B="1000")
division_2 = Division(A=Slider(600, range=0..1000), B="1000")
division_3 = Division(A=Slider(800, range=0..1000), B="1000")
division_4 = Division(A=Slider(6000, range=0..12000), B="1000")
division_5 = Division(A=number_slider_3, B="1000")
division_6 = Division(A=Slider(3400, range=0..10000), B="1000")
division_7 = Division(A=Slider(21000, range=0..100000), B="1000")
negative = Negative(Value=division)
negative_2 = Negative(Value=division_2)
negative_3 = Negative(Value=division_3)
unit_z = UnitZ(Factor=negative)
unit_z_2 = UnitZ(Factor=negative_2)
unit_z_3 = UnitZ(Factor=negative_3)
min_truss_depth_center = Data(unit_z_3)

# ---- group: Use when extracting columns from Revit
column_top_2 = Data(panel)

# ----
min_truss_depth_center_2 = Data(unit_z_3)

# ---- group: Use when extracting columns from Revit
column_top_3 = Data(panel)

# ----
no_radial_members_opening_primary = Data(number_slider_4)
addition = Addition(A=no_radial_members_opening_primary, B=Slider(1, range=0..1))

# ---- group: not working with BHoM elements
# Canopy #4 Translation
# Canopy #5 Translation
panel_3 = Panel("{34.034, 34.867, 28.150}")
radians = Radians(Degrees="30.11004210")
radians_2 = Radians(Degrees="72.74429881")
canopy_4_translation = Data("{60.604, 36.393, 20.9}")
canopy_5_translation = Data(panel_3)
canopy_4_rotation = Data(radians)
canopy_5_rotation = Data(radians_2)

# ---- group: Fabricated sections not pushing
number_slider_7 = Slider(0.02, range=0..0.1)
number_slider_8 = Slider(0.3, range=0..1)
fabricatedsteelboxsection = FabricatedSteelBoxSection(
    Height=number_slider_8,
    Width=number_slider_8,
    WebThickness=number_slider_7,
    FlangeThickness=number_slider_7,
    WeldSize=0,
    Name="SHS 300x300x20",
    Component="{ .FabricatedSteelBoxSection")

# ----
shs = SHS(
    {"SHS 40x40x2.9": 0, "SHS 40x40x3.0": 1, "SHS 40x40x3.2": 2, "SHS 40x40x3.6": 3, "SHS 40x40x4.0": 4, "SHS 40x40x5.0": 5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}, selected="SHS 300x300x14.2": 162,
    Component="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",
    Selection=162)
shs_2 = SHS(
    {"SHS 40x40x2.9": 0, "SHS 40x40x3.0": 1, "SHS 40x40x3.2": 2, "SHS 40x40x3.6": 3, "SHS 40x40x4.0": 4, "SHS 40x40x5.0": 5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}, selected="SHS 250x250x16.0": 146,
    Component="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",
    Selection=146)
shs_3 = SHS(
    {"SHS 40x40x2.9": 0, "SHS 40x40x3.0": 1, "SHS 40x40x3.2": 2, "SHS 40x40x3.6": 3, "SHS 40x40x4.0": 4, "SHS 40x40x5.0": 5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}, selected="SHS 200x200x10.0": 124,
    Component="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",
    Selection=124)
shs_4 = SHS(
    {"SHS 40x40x2.9": 0, "SHS 40x40x3.0": 1, "SHS 40x40x3.2": 2, "SHS 40x40x3.6": 3, "SHS 40x40x4.0": 4, "SHS 40x40x5.0": 5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}, selected="SHS 180x180x10.0": 113,
    Component="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",
    Selection=113)
shs_5 = SHS(
    {"SHS 40x40x2.9": 0, "SHS 40x40x3.0": 1, "SHS 40x40x3.2": 2, "SHS 40x40x3.6": 3, "SHS 40x40x4.0": 4, "SHS 40x40x5.0": 5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}, selected="SHS 300x300x14.2": 162,
    Component="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",
    Selection=162)
shs_6 = SHS(
    {"SHS 40x40x2.9": 0, "SHS 40x40x3.0": 1, "SHS 40x40x3.2": 2, "SHS 40x40x3.6": 3, "SHS 40x40x4.0": 4, "SHS 40x40x5.0": 5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}, selected="SHS 250x250x14.2": 145,
    Component="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",
    Selection=145)
shs_7 = SHS(
    {"SHS 40x40x2.9": 0, "SHS 40x40x3.0": 1, "SHS 40x40x3.2": 2, "SHS 40x40x3.6": 3, "SHS 40x40x4.0": 4, "SHS 40x40x5.0": 5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}, selected="SHS 250x250x12.5": 144,
    Component="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",
    Selection=144)
shs_8 = SHS(
    {"SHS 40x40x2.9": 0, "SHS 40x40x3.0": 1, "SHS 40x40x3.2": 2, "SHS 40x40x3.6": 3, "SHS 40x40x4.0": 4, "SHS 40x40x5.0": 5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}, selected="SHS 300x300x14.2": 162,
    Component="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",
    Selection=162)
hss = HSS(
    {"HSS24X12X3/4": 0, "HSS24X12X5/8": 1, "HSS24X12X1/2": 2, "HSS22X22X7/8": 3, "HSS22X22X3/4": 4, "HSS20X20X7/8": 5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}, selected="HSS24X12X3/4",
    Component="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",
    Selection=0)
hss_2 = HSS(
    {"HSS24X12X3/4": 0, "HSS24X12X5/8": 1, "HSS24X12X1/2": 2, "HSS22X22X7/8": 3, "HSS22X22X3/4": 4, "HSS20X20X7/8": 5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}, selected="HSS24X12X3/4",
    Component="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",
    Selection=0)
shs_9 = SHS(
    {"SHS 40x40x2.9": 0, "SHS 40x40x3.0": 1, "SHS 40x40x3.2": 2, "SHS 40x40x3.6": 3, "SHS 40x40x4.0": 4, "SHS 40x40x5.0": 5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}, selected="SHS 150x150x12.5": 95,
    Component="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",
    Selection=95)

# ---- group: not working with BHoM elements
# Canopy #4 Translation
# Canopy #5 Translation
panel_4 = Panel("{34.034, 34.867, 28.150}")
radians_3 = Radians(Degrees="30.11004210")
radians_4 = Radians(Degrees="72.74429881")
canopy_4_translation_2 = Data("{60.604, 36.393, 20.9}")
canopy_5_translation_2 = Data(panel_4)
canopy_4_rotation_2 = Data(radians_3)
canopy_5_rotation_2 = Data(radians_4)

# ----
pushtype = PushType(
    {"FullPush": 0, "CreateOnly": 1, "CreateNonExisting": 2, "UpdateOnly": 3, "UpdateOrCreateOnly": 4, "DeleteThenCreate": 5, "AdapterDefault": 6}, selected="FullPush",
    Component="BH.oM.Adapter.PushType",
    Selection=0)

# ---- group: Fabricated sections not pushing
number_slider_9 = Slider(0.02, range=0..0.1)
number_slider_10 = Slider(0.4, range=0..1)
fabricatedsteelboxsection_2 = FabricatedSteelBoxSection(
    Height=number_slider_10,
    Width=number_slider_10,
    WebThickness=number_slider_9,
    FlangeThickness=number_slider_9,
    WeldSize=0,
    Name="SHS 400x400x16",
    Component="{ .FabricatedSteelBoxSection")

# ---- group: Turn to TRUE to push
boolean_toggle = BooleanToggle(False)
button = Button()

boolean_toggle_2 = BooleanToggle(False)

boolean_toggle_3 = BooleanToggle(False)

# ----
# Initial Information
primary_ring_radius = Data(division_5)
opening_radius = Data(division_6)
# Look into having this position optimised
edge_radius = Data(division_7)
no_radial_members_primary_secondary = Data(number_slider_5)
no_radial_members_opening_primary_2 = Data(number_slider_4)
no_radial_members_secondary_edge = Data(Slider(3, range=0..10))
no_of_polygon_sides = Data(number_slider_6)
max_truss_depth = Data(unit_z)
no_opening_ring_bays = Data(number_slider)
no_primary_ring_bays = Data(Slider(2, range=0..4))
min_truss_depth = Data(unit_z_2)
no_secondary_ring_bays = Data(Slider(4, range=0..4))

# ----
# Define Ring Radius and Radial Bay Spacing
no_radial_members_primary_secondary_2 = Data(no_radial_members_primary_secondary)
edge_radius_2 = Data(edge_radius)
primary_ring_radius_2 = Data(primary_ring_radius)
opening_radius_2 = Data(opening_radius)
primary_ring_radius_3 = Data(primary_ring_radius)
multiplication = Multiplication(A=no_radial_members_primary_secondary_2, B="2")
no_radial_members_opening_primary_3 = Data(no_radial_members_opening_primary_2)
subtraction = Subtraction(A=primary_ring_radius_2, B=opening_radius_2)
addition_2 = Addition(A=primary_ring_radius_3, B=multiplication)
secondary_ring_radius = Data(addition_2)
subtraction_2 = Subtraction(A=edge_radius_2, B=secondary_ring_radius)
division_8 = Division(A=subtraction, B=no_radial_members_opening_primary_3)
panel_5 = Panel(addition_2)
radial_truss_spacing = Panel(division_8)
determined_main_radial_bay_spacing = Data(division_8)
determined_main_radial_bay_spacing_2 = Data(determined_main_radial_bay_spacing)
determined_main_radial_bay_spacing_3 = Data(determined_main_radial_bay_spacing)
integer_division = IntegerDivision(A=subtraction_2, B=determined_main_radial_bay_spacing_3)
division_9 = Division(A=subtraction_2, B=determined_main_radial_bay_spacing_3)
determined_main_radial_bay_spacing_4 = Data(determined_main_radial_bay_spacing)
note_of_actual_division = Panel(division_9)
multiplication_2 = Multiplication(A=determined_main_radial_bay_spacing_4, B=integer_division)
panel_6 = Panel(multiplication_2)
subtraction_3 = Subtraction(A=subtraction_2, B=multiplication_2)
determined_main_radial_bay_spacing_5 = Data(determined_main_radial_bay_spacing)
ghpython_script = GhPythonScript(x=subtraction_3, y=determined_main_radial_bay_spacing_5)  # -> out, a
# ---------- ghpython_script: Python ----------
if x > 0:
    a = x
else:
    a = y

import rhinoscriptsyntax as rs
# ---------- end ghpython_script ----------
panel_7 = Panel(ghpython_script.a)
secondary_ring_radius_2 = Data(addition_2)
end_radial_bay_spacing = Data(ghpython_script.a)

# ---- group: Background
no_of_polygon_sides_2 = Data(no_of_polygon_sides)
secondary_ring_radius_3 = Data(secondary_ring_radius_2)
no_of_polygon_sides_3 = Data(no_of_polygon_sides)
no_of_polygon_sides_4 = Data(no_of_polygon_sides)
no_of_polygon_sides_5 = Data(no_of_polygon_sides)
primary_ring_radius_4 = Data(primary_ring_radius)
opening_radius_3 = Data(opening_radius)
edge_radius_3 = Data(edge_radius)
polygon = Polygon(Plane=PlaneXY(0, 0, 0), Radius=edge_radius_3, Segments=no_of_polygon_sides_2, FilletRadius=0)  # -> Polygon, Length
polygon_2 = Polygon(Plane=PlaneXY(0, 0, 0), Radius=opening_radius_3, Segments=no_of_polygon_sides_3, FilletRadius=0)  # -> Polygon, Length
polygon_3 = Polygon(Plane=PlaneXY(0, 0, 0), Radius=secondary_ring_radius_3, Segments=no_of_polygon_sides_4, FilletRadius=0)  # -> Polygon, Length
polygon_4 = Polygon(Plane=PlaneXY(0, 0, 0), Radius=primary_ring_radius_4, Segments=no_of_polygon_sides_5, FilletRadius=0)  # -> Polygon, Length
secondary_polygon = Data(polygon_3.Polygon)
primary_polygon = Data(polygon_4.Polygon)
edge_polygon = Data(polygon.Polygon)
opening_polygon = Data(polygon_2.Polygon)
explode = Explode(Curve=polygon_2.Polygon, Recursive=True)  # -> Segments, Vertices
explode_2 = Explode(Curve=polygon_4.Polygon, Recursive=True)  # -> Segments, Vertices
explode_3 = Explode(Curve=polygon_3.Polygon, Recursive=True)  # -> Segments, Vertices
explode_4 = Explode(Curve=polygon.Polygon, Recursive=True)  # -> Segments, Vertices
cull_index = CullIndex(List=explode_4.Vertices, Indices=-1, Wrap=True)
cull_index_2 = CullIndex(List=explode.Vertices, Indices=-1, Wrap=True)
cull_index_3 = CullIndex(List=explode_2.Vertices, Indices=-1, Wrap=True)
cull_index_4 = CullIndex(List=explode_3.Vertices, Indices=-1, Wrap=True)
canopy_edge_points = Data(cull_index)
primary_ring_points = Data(cull_index_3)
secondary_ring_points = Data(cull_index_4)
canopy_opening_top = Data(explode.Segments)
primary_ring_top = Data(explode_2.Segments)
secondary_ring_top = Data(explode_3.Segments)
canopy_opening_points = Data(cull_index_2)

# ----
primary_ring_points_2 = Data(cull_index_3)

opening_polygon_2 = Data(polygon_2.Polygon)
edge_polygon_2 = Data(polygon.Polygon)
canopy_opening_points_2 = Data(canopy_opening_points)
canopy_edge_points_2 = Data(canopy_edge_points)
panel_8 = Panel(Outlines=[edge_polygon_2, opening_polygon_2], Tolerance=1e-06, Component="{ .Panel")
line_2 = Line(StartPoint=canopy_opening_points_2, EndPoint=canopy_edge_points_2)
surface_split = SurfaceSplit(Surface=panel_8, Curves=line_2)
canopy_panel = Data(surface_split)

max_truss_depth_2 = Data(max_truss_depth)
move = Move(Geometry=primary_ring_points_2, Motion=max_truss_depth_2)  # -> Geometry, Transform
opening_ring_bottom_points = Data(move.Geometry)
no_radial_members_secondary_edge_2 = Data(no_radial_members_secondary_edge)

# ---- group: Points on Radial Trusses
secondary_ring_points_2 = Data(explode_3.Vertices)
canopy_edge_points_3 = Data(explode_4.Vertices)
canopy_opening_points_3 = Data(explode.Vertices)
primary_ring_points_3 = Data(explode_2.Vertices)

# ----
# Panel
canopy_panel_2 = Data(canopy_panel)

# ----
# Panel
canopy_panel_3 = Data(canopy_panel)

# ----
# Columns - look into extracting location from etabs
panel_9 = Panel("""True
False
False
False""")

# ----
# Radial Diagonals
# Ring Truss Diagonals
# Opening Truss
# Opening Truss
# Need to make more responsive to parametric changes
# Primary Truss
# Primary Truss
# Secondary Truss
# Secondary Truss
no_radial_members_opening_primary_4 = Data(number_slider_4)
number_slider_11 = Slider(2, range=0..3)
addition_3 = Addition(A=no_radial_members_opening_primary_4, B=Slider(1, range=0..1))
number_slider_12 = Slider(3, range=0..5)
number_slider_13 = Slider(3, range=0..5)
number_slider_14 = Slider(2, range=0..3)
panel_10 = Panel("""False
True""")
no_radial_members_primary_secondary_3 = Data(number_slider_5)
series = Series(Start=number_slider_11, Step=number_slider_11, Count=2)
series_2 = Series(Start=number_slider_14, Step=number_slider_14, Count=2)

# ---- group: Background
canopy_opening_points_4 = Data(canopy_opening_points)
canopy_edge_points_4 = Data(canopy_edge_points)
min_truss_depth_2 = Data(min_truss_depth)
move_2 = Move(Geometry=canopy_edge_points_4, Motion=min_truss_depth_2)  # -> Geometry, Transform
move_3 = Move(Geometry=canopy_opening_points_4, Motion=min_truss_depth_center_2)  # -> Geometry, Transform
opening_ring_bottom_points_2 = Data(move_3.Geometry)
edge_bottom_points = Data(move_2.Geometry)
line_3 = Line(StartPoint=opening_ring_bottom_points_2, EndPoint=opening_ring_bottom_points)
unit_z_4 = UnitZ(Factor="-1")

# ----
line_4 = Line(StartPoint=opening_ring_bottom_points, EndPoint=edge_bottom_points)

# ----
# Define Horizontal Bracing
canopy_edge_points_5 = Data(canopy_edge_points_3)
secondary_ring_points_3 = Data(secondary_ring_points_2)
primary_ring_points_4 = Data(primary_ring_points_3)
shift_list = ShiftList(List=secondary_ring_points_3, Shift=1, Wrap=True)
line_5 = Line(StartPoint=shift_list, EndPoint=canopy_edge_points_5)
line_6 = Line(StartPoint=primary_ring_points_4, EndPoint=shift_list)
panel_11 = Panel("""True
False""")
panel_12 = Panel("""True
False""")
shift_list_2 = ShiftList(List=secondary_ring_points_3, Shift=-1, Wrap=True)
cull_index_5 = CullIndex(List=line_6, Indices=-1, Wrap=True)
cull_pattern = CullPattern(List=line_5, CullPattern=panel_11)
line_7 = Line(StartPoint=shift_list_2, EndPoint=canopy_edge_points_5)
line_8 = Line(StartPoint=primary_ring_points_4, EndPoint=shift_list_2)
panel_13 = Panel("""False
True""")
cull_index_6 = CullIndex(List=line_8, Indices=0, Wrap=True)
panel_14 = Panel("""False
True""")
cull_pattern_2 = CullPattern(List=line_7, CullPattern=panel_13)
primary_to_secondary_hz_bracing_top = Line([cull_index_5, cull_index_6])

point_list = PointList(Points=shift_list, Size=Slider(1, range=0..1))
cull_index_7 = CullIndex(List=cull_pattern, Indices=-1, Wrap=True)

canopy_opening_points_5 = Data(canopy_opening_points)
canopy_edge_points_6 = Data(canopy_edge_points)
line_9 = Line(StartPoint=canopy_opening_points_5, EndPoint=canopy_edge_points_6)

# ----
# Columns - look into extracting location from etabs
panel_15 = Panel("""True
False
False
False""")

# ----
# Top & Bottom Chords
boolean_toggle_4 = BooleanToggle(False)
no_radial_members_opening_primary_5 = Data(number_slider_4)
no_radial_members_opening_primary_6 = Data(number_slider_4)
no_radial_members_primary_secondary_4 = Data(number_slider_5)
no_radial_members_primary_secondary_5 = Data(number_slider_5)

# ----
# Bottom Chord
# Radial Bottom Chord
# Ring Bottom Chords
# Currently has duplicated points at ring beams - might be useful further on so keep for now.
radial_bottom_chord = Line([line_3, line_4])
no_radial_members_primary_secondary_6 = Data(number_slider_5)
no_radial_members_opening_primary_7 = Data(number_slider_4)
opening_ring_bottom_points_3 = Data(move_3.Geometry)
canopy_edge_bottom_points = Data(move_2.Geometry)
no_radial_members_opening_primary_8 = Data(number_slider_4)
addition_4 = Addition(A=no_radial_members_opening_primary_7, B=no_radial_members_primary_secondary_6)
polyline = PolyLine(Vertices=canopy_edge_bottom_points, Closed=Toggle(True))
polyline_2 = PolyLine(Vertices=opening_ring_bottom_points_3, Closed=Toggle(True))
no_of_polygon_sides_6 = Data(no_of_polygon_sides)
no_of_polygon_sides_7 = Data(no_of_polygon_sides)
explode_5 = Explode(Curve=polyline, Recursive=True)  # -> Segments, Vertices
explode_6 = Explode(Curve=polyline_2, Recursive=True)  # -> Segments, Vertices
canopy_edge_bottom = Data(explode_5.Segments)
canopy_opening_bottom = Data(explode_6.Segments)

# ----
# Define Horizontal Bracing
panel_16 = Panel("""True
False""")
panel_17 = Panel("""True
False""")
panel_18 = Panel("""False
True""")
panel_19 = Panel("""False
True""")

# ----
# Diagonals
planesrf = PlaneSurface(Plane=PlaneXY(0, 0, 0), XSize=Domain(-10, 10), YSize=Domain(-10, 10))

# ---- group: Taper Top & Bottom
# Verticals
planesrf_2 = PlaneSurface(Plane=PlaneXY(0, 0, 0), XSize=Domain(-10, 10), YSize=Domain(-10, 10))
no_radial_members_opening_primary_9 = Data(number_slider_4)
no_radial_members_primary_secondary_7 = Data(number_slider_5)

# ----
# Radial Verticals
# Radial
# Ring Verticals
# Opening Truss
# Primary Truss
# Secondary Truss
no_radial_members_primary_secondary_8 = Data(number_slider_5)
no_radial_members_opening_primary_10 = Data(number_slider_4)
no_radial_members_opening_primary_11 = Data(number_slider_4)
addition_5 = Addition(A=no_radial_members_opening_primary_10, B=no_radial_members_primary_secondary_8)
data = Data(["0", no_radial_members_opening_primary_11, addition_5])

panel_20 = Panel(addition_5)

# ----
# Top Chord
# Ring Top Chords
# Radial Top Chord
# Currently has duplicated points at ring beams
# - might be useful further on so keep for now.
# Duplicated removed at next stage.
secondary_ring_points_4 = Data(secondary_ring_points)
primary_ring_points_5 = Data(primary_ring_points)
canopy_edge_points_7 = Data(canopy_edge_points)
canopy_opening_points_6 = Data(canopy_opening_points)
line_10 = Line(StartPoint=canopy_opening_points_6, EndPoint=primary_ring_points_5)
line_11 = Line(StartPoint=primary_ring_points_5, EndPoint=secondary_ring_points_4)
line_12 = Line(StartPoint=secondary_ring_points_4, EndPoint=canopy_edge_points_7)
determined_main_radial_bay_spacing_6 = Data(determined_main_radial_bay_spacing)
determined_main_radial_bay_spacing_7 = Data(determined_main_radial_bay_spacing)
divide_distance = DivideDistance(Curve=line_10, Distance=determined_main_radial_bay_spacing_6)  # -> Points, Tangents, Parameters
divide_distance_2 = DivideDistance(Curve=line_11, Distance="2")  # -> Points, Tangents, Parameters
polyline_3 = PolyLine(Vertices=divide_distance.Points, Closed=False)
polyline_4 = PolyLine(Vertices=divide_distance_2.Points, Closed=False)
explode_7 = Explode(Curve=polyline_3, Recursive=True)  # -> Segments, Vertices
explode_8 = Explode(Curve=polyline_4, Recursive=True)  # -> Segments, Vertices
opening_to_primary_top = Line(explode_7.Segments)
primary_to_secondary_top = Line(explode_8.Segments)

opening_to_primary_top_points = Data(explode_7.Vertices)
shift_list_3 = ShiftList(List=opening_to_primary_top_points, Shift=1, Wrap=Toggle(False))
divide_curve = DivideCurve(Curve=line_12, Count=no_radial_members_secondary_edge_2, Kinks=False)  # -> Points, Tangents, Parameters

polyline_5 = PolyLine(Vertices=divide_curve.Points, Closed=False)
explode_9 = Explode(Curve=polyline_5, Recursive=True)  # -> Segments, Vertices
secondary_to_edge_top = Line(explode_9.Segments)
radial_truss_top_chord = Line([opening_to_primary_top, primary_to_secondary_top, secondary_to_edge_top])

# ---- group: Background (continued)
top_radial_points = Data([explode_7.Vertices, explode_8.Vertices, explode_9.Vertices])
project_point = ProjectPoint(Point=top_radial_points, Direction=unit_z_4, Geometry=radial_bottom_chord)  # -> Point, Index
bottom_radial_points = Point(project_point.Point)

# ----
opening_to_primary_top_points_2 = Data(explode_7.Vertices)
primary_to_secondary_top_points = Data(explode_8.Vertices)
secondary_to_edge_top_points = Data(explode_9.Vertices)

bottom_radial_points_2 = Point(bottom_radial_points)
top_radial_points_2 = Data(top_radial_points)
cull_duplicates = CullDuplicates(Points=top_radial_points_2, Tolerance=0.1, CullMode=3)  # -> Points, Indices, Valence
cull_duplicates_2 = CullDuplicates(Points=bottom_radial_points_2, Tolerance=0.1, CullMode=3)  # -> Points, Indices, Valence
top_radial_points_no_duplicates = Point(cull_duplicates.Points)
bottom_radial_points_no_duplicates = Point(cull_duplicates_2.Points)
line_13 = Line(StartPoint=cull_duplicates.Points, EndPoint=cull_duplicates_2.Points)
all_radial_verticals = Data(line_13)
cull_index_8 = CullIndex(List=all_radial_verticals, Indices=data, Wrap=True)
radial_verticals = Data(cull_index_8)

bottom_radial_points_3 = Point(cull_duplicates_2.Points)
split_list = SplitList(List=bottom_radial_points_3, Index=addition)  # -> ListA, ListB
cull_index_9 = CullIndex(List=split_list.ListA, Indices=-1, Wrap=True)
line_14 = Line(StartPoint=shift_list_3, EndPoint=cull_index_9)
radial_diagonals_opening_to_primary = Line(line_14)

# ----
# Correct Taper
all_radial_verticals_2 = Data(line_13)
canopy_5_translation_3 = Data(canopy_5_translation)
canopy_5_rotation_3 = Data(canopy_5_rotation)
shs_10 = SHS(
    {"SHS 40x40x2.9": 0, "SHS 40x40x3.0": 1, "SHS 40x40x3.2": 2, "SHS 40x40x3.6": 3, "SHS 40x40x4.0": 4, "SHS 40x40x5.0": 5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}, selected="SHS 400x400x16.0": 177,
    Component="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",
    Selection=177)

opening_to_primary_top_points_3 = Data(explode_7.Vertices)
bottom_radial_points_4 = Point(cull_duplicates_2.Points)
primary_to_secondary_top_points_2 = Data(explode_8.Vertices)
split_list_2 = SplitList(List=bottom_radial_points_4, Index=addition_3)  # -> ListA, ListB
secondary_to_edge_top_points_2 = Data(explode_9.Vertices)
shift_list_4 = ShiftList(List=opening_to_primary_top_points_3, Shift=1, Wrap=Toggle(False))
radial_bottom_points_after_primary = Data(split_list_2.ListB)
cull_index_10 = CullIndex(List=secondary_to_edge_top_points_2, Indices=-1, Wrap=True)
split_list_3 = SplitList(List=radial_bottom_points_after_primary, Index=no_radial_members_primary_secondary_3)  # -> ListA, ListB
radial_bottom_points_secondary_to_edge = Data(split_list_3.ListB)
radial_bottom_points_secondary_to_edge_2 = Data(radial_bottom_points_secondary_to_edge)
line_15 = Line(StartPoint=cull_index_10, EndPoint=radial_bottom_points_secondary_to_edge_2)
radial_bottom_points_primary_to_secondar = Data(split_list_3.ListA)  # "Radial Bottom Points - Primary to Secondary"
radial_bottom_points_primary_to_secondar_2 = Data(radial_bottom_points_primary_to_secondar)  # "Radial Bottom Points - Primary to Secondary"
radial_diagonals_secondary_to_edge = Line(line_15)

cull_index_11 = CullIndex(List=primary_to_secondary_top_points_2, Indices=-1, Wrap=True)
cull_index_12 = CullIndex(List=split_list_2.ListA, Indices=-1, Wrap=True)

# ---- group: Taper Top & Bottom (continued)
radial_verticals_2 = Data(cull_index_8)

# ----
line_16 = Line(StartPoint=shift_list_4, EndPoint=cull_index_12)
line_17 = Line(StartPoint=cull_index_11, EndPoint=radial_bottom_points_primary_to_secondar_2)
radial_diagonals_primary_to_secondary = Line(line_17)
radial_diagonals_opening_to_primary_2 = Line(line_16)

secondary_to_edge_hz_bracing_top = Line([cull_pattern_2, cull_index_7])

radial_verticals_3 = Data(all_radial_verticals)
radial_verticals_4 = Data(all_radial_verticals)
length_2 = Length(Curve=radial_verticals_3)
length_3 = Length(Curve=radial_verticals_4)
list_item = ListItem(List=length_2, Index=addition_4, Wrap=True)  # -> flatten(Item)
list_item_2 = ListItem(List=length_3, Index=no_radial_members_opening_primary_8, Wrap=True)  # -> flatten(Item)

list_item_3 = ListItem(List=list_item, Index=0, Wrap=True)
list_item_4 = ListItem(List=list_item_2, Index=0, Wrap=True)

negative_4 = Negative(Value=list_item_3)
negative_5 = Negative(Value=list_item_4)
unit_z_5 = UnitZ(Factor=negative_4)
unit_z_6 = UnitZ(Factor=negative_5)
polygon_5 = Polygon(Plane=unit_z_5, Radius=secondary_ring_radius_2, Segments=no_of_polygon_sides_6, FilletRadius=0)  # -> Polygon, Length
polygon_6 = Polygon(Plane=unit_z_6, Radius=primary_ring_radius, Segments=no_of_polygon_sides_7, FilletRadius=0)  # -> Polygon, Length
explode_10 = Explode(Curve=polygon_6.Polygon, Recursive=True)  # -> Segments, Vertices
explode_11 = Explode(Curve=polygon_5.Polygon, Recursive=True)  # -> Segments, Vertices
secondary_ring_bottom_points = Data(explode_11.Vertices)
secondary_ring_bottom = Data(explode_11.Segments)
primary_ring_bottom_points = Data(explode_10.Vertices)
primary_ring_bottom = Data(explode_10.Segments)

# ---- group: Points on Radial Trusses
opening_ring_bottom_points_4 = Data(move_3.Geometry)
primary_ring_bottom_points_2 = Data(explode_10.Vertices)
secondary_ring_bottom_points_2 = Data(explode_11.Vertices)
canopy_edge_bottom_points_2 = Data(move_2.Geometry)

# ----
secondary_ring_bottom_points_3 = Data(secondary_ring_bottom_points_2)
primary_ring_bottom_points_3 = Data(primary_ring_bottom_points_2)
canopy_edge_bottom_points_3 = Data(canopy_edge_bottom_points_2)
shift_list_5 = ShiftList(List=secondary_ring_bottom_points_3, Shift=1, Wrap=True)
line_18 = Line(StartPoint=shift_list_5, EndPoint=canopy_edge_bottom_points_3)
line_19 = Line(StartPoint=primary_ring_bottom_points_3, EndPoint=shift_list_5)
cull_index_13 = CullIndex(List=line_19, Indices=-1, Wrap=True)
shift_list_6 = ShiftList(List=secondary_ring_bottom_points_3, Shift=-1, Wrap=True)
cull_pattern_3 = CullPattern(List=line_18, CullPattern=panel_12)
line_20 = Line(StartPoint=primary_ring_bottom_points_3, EndPoint=shift_list_6)
line_21 = Line(StartPoint=shift_list_6, EndPoint=canopy_edge_bottom_points_3)
cull_index_14 = CullIndex(List=cull_pattern_3, Indices=-1, Wrap=True)
cull_index_15 = CullIndex(List=line_20, Indices=0, Wrap=True)
cull_pattern_4 = CullPattern(List=line_21, CullPattern=panel_14)
primary_to_secondary_hz_bracing_bottom = Line([cull_index_13, cull_index_15])
secondary_to_edge_hz_bracing_top_2 = Line([cull_pattern_4, cull_index_14])

# ----
# HZ Bracing Results
primary_to_secondary_hz_bracing_top_2 = Line(primary_to_secondary_hz_bracing_top)
secondary_to_edge_hz_bracing_top_3 = Line(secondary_to_edge_hz_bracing_top)
primary_to_secondary_hz_bracing_bottom_2 = Line(primary_to_secondary_hz_bracing_bottom)
secondary_to_edge_hz_bracing_top_4 = Line(secondary_to_edge_hz_bracing_top_2)

# ----
# Bottom Chord Results
radial_bottom_chord_2 = Line(line_3)
secondary_ring_bottom_2 = Data(explode_11.Segments)
primary_ring_bottom_2 = Data(explode_10.Segments)
canopy_opening_bottom_2 = Data(explode_6.Segments)

# ----
# Split Ring Trusses
no_opening_ring_bays_2 = Data(no_opening_ring_bays)
canopy_opening_top_2 = Data(explode.Segments)
canopy_opening_bottom_3 = Data(canopy_opening_bottom)
no_secondary_ring_bays_2 = Data(no_secondary_ring_bays)
no_primary_ring_bays_2 = Data(no_primary_ring_bays)
primary_ring_bottom_3 = Data(primary_ring_bottom_2)
secondary_ring_bottom_3 = Data(secondary_ring_bottom_2)
secondary_ring_top_2 = Data(explode_3.Segments)
primary_ring_top_2 = Data(explode_2.Segments)
divide_curve_2 = DivideCurve(Curve=secondary_ring_top_2, Count=no_secondary_ring_bays_2, Kinks=False)  # -> Points, Tangents, Parameters
divide_curve_3 = DivideCurve(Curve=canopy_opening_top_2, Count=no_opening_ring_bays_2, Kinks=False)  # -> Points, Tangents, Parameters
divide_curve_4 = DivideCurve(Curve=secondary_ring_bottom_3, Count=no_secondary_ring_bays_2, Kinks=False)  # -> Points, Tangents, Parameters
divide_curve_5 = DivideCurve(Curve=canopy_opening_bottom_3, Count=no_opening_ring_bays_2, Kinks=False)  # -> Points, Tangents, Parameters
divide_curve_6 = DivideCurve(Curve=primary_ring_top_2, Count=no_primary_ring_bays_2, Kinks=False)  # -> Points, Tangents, Parameters
divide_curve_7 = DivideCurve(Curve=primary_ring_bottom_3, Count=no_primary_ring_bays_2, Kinks=False)  # -> Points, Tangents, Parameters
polyline_6 = PolyLine(Vertices=divide_curve_2.Points, Closed=False)
polyline_7 = PolyLine(Vertices=divide_curve_3.Points, Closed=False)
polyline_8 = PolyLine(Vertices=divide_curve_4.Points, Closed=False)
polyline_9 = PolyLine(Vertices=divide_curve_5.Points, Closed=False)
polyline_10 = PolyLine(Vertices=divide_curve_6.Points, Closed=False)
polyline_11 = PolyLine(Vertices=divide_curve_7.Points, Closed=False)
explode_12 = Explode(Curve=polyline_6, Recursive=True)  # -> Segments, Vertices
explode_13 = Explode(Curve=polyline_7, Recursive=True)  # -> Segments, Vertices
explode_14 = Explode(Curve=polyline_8, Recursive=True)  # -> Segments, Vertices
explode_15 = Explode(Curve=polyline_9, Recursive=True)  # -> Segments, Vertices
explode_16 = Explode(Curve=polyline_10, Recursive=True)  # -> Segments, Vertices
explode_17 = Explode(Curve=polyline_11, Recursive=True)  # -> Segments, Vertices
opening_truss_bottom_chord = Line(explode_15.Segments)
opening_truss_bottom_points = Data(explode_15.Vertices)
opening_truss_top_chord = Line(explode_13.Segments)
opening_truss_top_points = Data(explode_13.Vertices)
secondary_truss_top_chord = Line(explode_12.Segments)
secondary_truss_top_points = Data(explode_12.Vertices)
secondary_truss_bottom_chord = Line(explode_14.Segments)
secondary_truss_bottom_points = Data(explode_14.Vertices)
primary_truss_top_chord = Line(explode_16.Segments)
primary_truss_top_points = Data(explode_16.Vertices)
primary_truss_bottom_chord = Line(explode_17.Segments)
primary_truss_bottom_points = Data(explode_17.Vertices)

point_list_2 = PointList(Points=[explode_15.Vertices, explode_13.Vertices], Size=Slider(0, range=0..1))

# ----
# Top Chord Points Results
top_radial_points_no_duplicates_2 = Point(top_radial_points_no_duplicates)
opening_to_primary_top_points_4 = Data(explode_7.Vertices)
# Geometry Results
top_radial_points_3 = Data(cull_duplicates.Points)
primary_to_secondary_top_points_3 = Data(explode_8.Vertices)
secondary_to_edge_top_points_3 = Data(explode_9.Vertices)
primary_truss_top_points_2 = Data(explode_16.Vertices)
secondary_truss_top_points_2 = Data(explode_12.Vertices)
opening_truss_top_points_2 = Data(explode_13.Vertices)

# ----
# Bottom Chord Points Results
bottom_radial_points_no_duplicates_2 = Point(bottom_radial_points_no_duplicates)
secondary_truss_bottom_points_2 = Data(explode_14.Vertices)
bottom_radial_points_5 = Point(cull_duplicates_2.Points)
opening_truss_bottom_points_2 = Data(explode_15.Vertices)
primary_truss_bottom_points_2 = Data(explode_17.Vertices)

opening_truss_bottom_points_3 = Data(opening_truss_bottom_points_2)
primary_truss_bottom_points_3 = Data(primary_truss_bottom_points_2)
opening_truss_top_points_3 = Data(opening_truss_top_points_2)
secondary_truss_bottom_points_3 = Data(secondary_truss_bottom_points_2)
primary_truss_top_points_3 = Data(primary_truss_top_points_2)
secondary_truss_top_points_3 = Data(secondary_truss_top_points_2)
line_22 = Line(StartPoint=opening_truss_top_points_3, EndPoint=opening_truss_bottom_points_3)
line_23 = Line(StartPoint=secondary_truss_top_points_3, EndPoint=secondary_truss_bottom_points_3)
line_24 = Line(StartPoint=primary_truss_top_points_3, EndPoint=primary_truss_bottom_points_3)
opening_truss_vertical_members = Line(line_22)
primary_truss_vertical_members = Line(line_24)
secondary_truss_vertical_members = Line(line_23)

primary_truss_bottom_points_4 = Data(primary_truss_bottom_points_2)
secondary_truss_bottom_points_4 = Data(secondary_truss_bottom_points_2)
primary_truss_top_points_4 = Data(primary_truss_top_points_2)
secondary_truss_top_points_4 = Data(secondary_truss_top_points_2)
opening_truss_bottom_points_4 = Data(opening_truss_bottom_points_2)
opening_truss_top_points_4 = Data(opening_truss_top_points_2)
list_length = ListLength(List=secondary_truss_bottom_points_4)
list_length_2 = ListLength(List=primary_truss_bottom_points_4)
cull_pattern_5 = CullPattern(List=opening_truss_top_points_4, CullPattern=panel_10)
cull_index_16 = CullIndex(List=opening_truss_bottom_points_4, Indices=1, Wrap=True)
division_10 = Division(A=list_length, B=number_slider_12)
division_11 = Division(A=list_length_2, B=number_slider_13)
line_25 = Line(StartPoint=cull_pattern_5, EndPoint=cull_index_16)
series_3 = Series(Start=number_slider_12, Step=number_slider_12, Count=division_10)
series_4 = Series(Start=number_slider_13, Step=number_slider_13, Count=division_11)
list_item_5 = ListItem(List=secondary_truss_bottom_points_4, Index=series_3, Wrap=Toggle(True))
list_item_6 = ListItem(List=primary_truss_bottom_points_4, Index=series_4, Wrap=Toggle(True))
list_item_7 = ListItem(List=secondary_truss_top_points_4, Index=series, Wrap=Toggle(True))
data_2 = Data(list_item_5)
data_3 = Data(list_item_6)
list_item_8 = ListItem(List=primary_truss_top_points_4, Index=series_2, Wrap=Toggle(True))
data_4 = Data(list_item_7)
data_5 = Data(list_item_8)
list_item_9 = ListItem(List=data_5, Index=1, Wrap=True)
list_item_10 = ListItem(List=data_3, Index=1, Wrap=True)
sort_points = SortPoints(Points=list_item_10)  # -> Points, Indices
list_item_11 = ListItem(List=data_4, Index=1, Wrap=True)
list_item_12 = ListItem(List=data_2, Index=1, Wrap=True)
sort_points_2 = SortPoints(Points=list_item_9)  # -> Points, Indices
line_26 = Line(StartPoint=list_item_9, EndPoint=list_item_10)
explode_tree = ExplodeTree(Data=list_item_10)  # -> _00000, _00100, _00200, _00300, _00400, _00500, _00600, _00700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
# Need to adjust this when bays in
# Primary ring turss >2
explode_tree_2 = ExplodeTree(Data=list_item_9)  # -> _0000, _0010, _0020, _0030, _0040, _0050, _0060, _0070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
explode_tree_3 = ExplodeTree(Data=list_item_12)  # -> _00000, _00100, _00200, _00300, _00400, _00500, _00600, _00700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
explode_tree_4 = ExplodeTree(Data=list_item_11)  # -> _0000, _0010, _0020, _0030, _0040, _0050, _0060, _0070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
point = Point([explode_tree_2._0010, explode_tree_2._0020, explode_tree_2._0030, explode_tree_2._0040, explode_tree_2._0050, explode_tree_2._0060, explode_tree_2._0070, explode_tree_2._0080, explode_tree_2._0090, explode_tree_2._00100, explode_tree_2._0000])
point_2 = Point([explode_tree._00100, explode_tree._00200, explode_tree._00300, explode_tree._00400, explode_tree._00500, explode_tree._00600, explode_tree._00700, explode_tree._00800, explode_tree._00900, explode_tree._001000, explode_tree._001100])
point_3 = Point([explode_tree_4._0010, explode_tree_4._0020, explode_tree_4._0030, explode_tree_4._0040, explode_tree_4._0050, explode_tree_4._0060, explode_tree_4._0070, explode_tree_4._0080, explode_tree_4._0090, explode_tree_4._00100, explode_tree_4._0000])
point_4 = Point([explode_tree_3._00100, explode_tree_3._00200, explode_tree_3._00300, explode_tree_3._00400, explode_tree_3._00500, explode_tree_3._00600, explode_tree_3._00700, explode_tree_3._00800, explode_tree_3._00900, explode_tree_3._001000, explode_tree_3._001100])
line_27 = Line(StartPoint=explode_tree_2._00110, EndPoint=explode_tree._00000)
line_28 = Line(StartPoint=point, EndPoint=point_2)
line_29 = Line(StartPoint=explode_tree_4._00110, EndPoint=explode_tree_3._00000)
line_30 = Line(StartPoint=point_3, EndPoint=point_4)
insert_items = InsertItems(List=data_2, Item=data_4, Indices=1, Wrap=Toggle(True))
insert_items_2 = InsertItems(List=data_3, Item=data_5, Indices=1, Wrap=Toggle(False))
data_6 = Data(insert_items)
data_7 = Data(insert_items_2)
sort_points_3 = SortPoints(Points=data_6)  # -> Points, Indices
sort_points_4 = SortPoints(Points=data_7)  # -> Points, Indices
polyline_12 = PolyLine(Vertices=sort_points_3.Points, Closed=False)
polyline_13 = PolyLine(Vertices=sort_points_4.Points, Closed=False)
explode_18 = Explode(Curve=polyline_12, Recursive=True)  # -> Segments, Vertices
explode_19 = Explode(Curve=polyline_13, Recursive=True)  # -> Segments, Vertices
opening_truss_diagonals = Line(line_25)
primary_truss_diagonals = Line([line_30, line_29, explode_18.Segments])
primary_truss_diagonals_2 = Line([line_26, line_27, line_28])

# ---- group: Taper Top & Bottom (continued)
secondary_truss_vertical_members_2 = Line(line_23)
opening_truss_vertical_members_2 = Line(line_22)
primary_truss_vertical_members_2 = Line(line_24)
entwine = Entwine(
    Branch0X=all_radial_verticals_2,
    Branch1X=opening_truss_vertical_members_2,
    Branch2X=primary_truss_vertical_members_2,
    Branch3X=secondary_truss_vertical_members_2,
    FlattenInputs=False)  # -> simplify(Result)
curve_middle = CurveMiddle(Curve=entwine)
pt = Point(curve_middle)
project = Project(Geometry=pt, Plane=planesrf_2)  # -> Geometry, Transform
vec2pt = Vector2Pt(PointA=pt, PointB=project.Geometry, Unitize=False)  # -> Vector, Length
move_4 = Move(Geometry=entwine, Motion=vec2pt.Vector)  # -> Geometry, Transform
centered_verticals = Geometry(move_4.Geometry)
split_tree = SplitTree(Data=centered_verticals, Masks=flatten("{0;*;*}"))  # -> Positive, Negative
split_tree_2 = SplitTree(Data=centered_verticals, Masks=flatten("{1;*;*}"))  # -> Positive, Negative
split_tree_3 = SplitTree(Data=centered_verticals, Masks=flatten("{3;*;*}"))  # -> Positive, Negative
split_tree_4 = SplitTree(Data=centered_verticals, Masks=flatten("{2;*;*}"))  # -> Positive, Negative
all_centered_radial_verticals = Data(simplify(split_tree.Positive))
centered_secondary_truss_vertical_member = Line(simplify(split_tree_3.Positive))  # "Centered Secondary Truss Vertical Members"
centered_opening_truss_vertical_members = Line(simplify(split_tree_2.Positive))
centered_primary_truss_vertical_members = Line(simplify(split_tree_4.Positive))
split_list_4 = SplitList(List=all_centered_radial_verticals, Index=no_radial_members_opening_primary_9)  # -> ListA, ListB
vertical_after_primary = Line(split_list_4.ListB)
split_list_5 = SplitList(List=vertical_after_primary, Index=no_radial_members_primary_secondary_7)  # -> ListA, ListB
cull_index_17 = CullIndex(List=split_list_5.ListA, Indices=0, Wrap=True)
cull_index_18 = CullIndex(List=split_list_5.ListB, Indices=0, Wrap=True)
between_secondary_and_edge = Data(cull_index_18)
between_primary_and_secondary = Data(cull_index_17)

# ----
# Column Height
centered_primary_truss_vertical_members_2 = Line(simplify(split_tree_4.Positive))
list_item_13 = ListItem(List=centered_primary_truss_vertical_members_2, Index=0, Wrap=True)
length_4 = Length(Curve=list_item_13)
division_12 = Division(A=length_4, B="2")
subtraction_4 = Subtraction(A=division_4, B=division_12)

column_height = Data(subtraction_4)

primary_ring_bottom_points_4 = Data(explode_10.Vertices)
cull_pattern_6 = CullPattern(List=primary_ring_bottom_points_4, CullPattern=panel_9)
column_height_2 = Data(column_height)
line_sdl = LineSDL(Start=cull_pattern_6, Direction="0,0,-1", Length=column_height_2)
columns = Line(line_sdl)

list_item_14 = ListItem(List=between_secondary_and_edge, Index=-1, Wrap=True)
edge_verticals = Data(list_item_14)
end_points = EndPoints(Curve=edge_verticals)  # -> flatten(Start), End
polyline_14 = PolyLine(Vertices=end_points.Start, Closed=True)
explode_20 = Explode(Curve=polyline_14, Recursive=True)  # -> Segments, Vertices
edge_dummy_member = Data(explode_20.Segments)

centered_secondary_truss_vertical_member_2 = Line(simplify(split_tree_3.Positive))  # "Centered Secondary Truss Vertical Members"
centered_opening_truss_vertical_members_2 = Line(simplify(split_tree_2.Positive))
centered_primary_truss_vertical_members_3 = Line(simplify(split_tree_4.Positive))
centered_radial_verticals = Data(simplify(split_tree.Positive))
end_points_2 = EndPoints(Curve=centered_radial_verticals)  # -> Start, End
end_points_3 = EndPoints(Curve=centered_opening_truss_vertical_members_2)  # -> Start, End
end_points_4 = EndPoints(Curve=centered_primary_truss_vertical_members_3)  # -> Start, End
end_points_5 = EndPoints(Curve=centered_secondary_truss_vertical_member_2)  # -> Start, End
bottom = Point(end_points_2.End)
top = Point(end_points_2.Start)
bottom_2 = Point(end_points_3.End)
top_2 = Point(end_points_3.Start)
bottom_3 = Point(end_points_4.End)
top_3 = Point(end_points_4.Start)
bottom_4 = Point(end_points_5.End)
top_4 = Point(end_points_5.Start)
polyline_15 = PolyLine(Vertices=top, Closed=boolean_toggle_4)
polyline_16 = PolyLine(Vertices=bottom, Closed=Toggle(False))
polyline_17 = PolyLine(Vertices=top_2, Closed=Toggle(False))
polyline_18 = PolyLine(Vertices=bottom_2, Closed=Toggle(False))
polyline_19 = PolyLine(Vertices=top_3, Closed=Toggle(False))
polyline_20 = PolyLine(Vertices=bottom_3, Closed=Toggle(False))
polyline_21 = PolyLine(Vertices=top_4, Closed=Toggle(False))
polyline_22 = PolyLine(Vertices=bottom_4, Closed=Toggle(False))
explode_21 = Explode(Curve=polyline_15, Recursive=True)  # -> Segments, Vertices
explode_22 = Explode(Curve=polyline_16, Recursive=True)  # -> Segments, Vertices
explode_23 = Explode(Curve=polyline_17, Recursive=True)  # -> Segments, Vertices
explode_24 = Explode(Curve=polyline_18, Recursive=True)  # -> Segments, Vertices
explode_25 = Explode(Curve=polyline_19, Recursive=True)  # -> Segments, Vertices
explode_26 = Explode(Curve=polyline_20, Recursive=True)  # -> Segments, Vertices
explode_27 = Explode(Curve=polyline_21, Recursive=True)  # -> Segments, Vertices
explode_28 = Explode(Curve=polyline_22, Recursive=True)  # -> Segments, Vertices
radial_bottom = Point(explode_22.Vertices)
radial_top = Point(explode_21.Vertices)
tapered_opening_truss_top_chord = Data(explode_23.Segments)
tapered_opening_truss_bottom_chord = Data(explode_24.Segments)
tapered_primary_truss_top_chord = Data(explode_25.Segments)
centered_primary_ring_bottom_points = Data(explode_26.Vertices)
centered_secondary_ring_points = Data(explode_27.Vertices)
centered_secondary_ring_bottom_points = Data(explode_28.Vertices)
tapered_primary_truss_bottom_chord = Data(explode_26.Segments)
tapered_secondary_truss_bottom_chord = Data(explode_28.Segments)
centered_primary_ring_points = Data(explode_25.Vertices)
tapered_secondary_truss_top_chord = Data(explode_27.Segments)
split_list_6 = SplitList(List=explode_21.Segments, Index=no_radial_members_opening_primary_5)  # -> ListA, ListB
split_list_7 = SplitList(List=explode_22.Segments, Index=no_radial_members_opening_primary_6)  # -> ListA, ListB
radial_bottom_chord_after_primary = Line(split_list_6.ListB)
radial_bottom_chord_after_primary_2 = Line(split_list_7.ListB)
split_list_8 = SplitList(List=radial_bottom_chord_after_primary, Index=no_radial_members_primary_secondary_4)  # -> ListA, ListB
split_list_9 = SplitList(List=radial_bottom_chord_after_primary_2, Index=no_radial_members_primary_secondary_5)  # -> ListA, ListB
between_opening_and_primary = Data(split_list_6.ListA)
between_opening_and_primary_2 = Data(split_list_7.ListA)
between_primary_and_secondary_2 = Data(split_list_8.ListA)
between_secondary_and_edge_2 = Data(split_list_8.ListB)
between_primary_and_secondary_3 = Data(split_list_9.ListA)
between_secondary_and_edge_3 = Data(split_list_9.ListB)

radial_bottom_2 = Point(radial_bottom)
radial_top_2 = Point(radial_top)
list_item_15 = ListItem(List=radial_top_2, Index=-1, Wrap=True)
list_item_16 = ListItem(List=radial_bottom_2, Index=-1, Wrap=True)
centered_canopy_edge_bottom_points = Data(flatten(list_item_16))
centered_canopy_edge_points = Data(flatten(list_item_15))

top_5 = Point(flatten(end_points_3.Start))
top_6 = Point(end_points_2.Start)
cull_duplicates_3 = CullDuplicates(Points=top_5, Tolerance=0.1, CullMode=3)  # -> Points, Indices, Valence
list_item_17 = ListItem(List=top_6, Index=-1, Wrap=True)  # -> flatten(Item)
polyline_23 = PolyLine(Vertices=cull_duplicates_3.Points, Closed=False)  # -> flatten(Polyline)
polyline_24 = PolyLine(Vertices=list_item_17, Closed=False)

centered_secondary_ring_points_2 = Data(centered_secondary_ring_points)
centered_primary_ring_points_2 = Data(centered_primary_ring_points)
centered_canopy_edge_points_2 = Data(centered_canopy_edge_points)
centered_secondary_ring_bottom_points_2 = Data(centered_secondary_ring_bottom_points)
centered_primary_ring_bottom_points_2 = Data(centered_primary_ring_bottom_points)
centered_canopy_edge_bottom_points_2 = Data(centered_canopy_edge_bottom_points)
list_item_18 = ListItem(List=centered_primary_ring_points_2, Index=0, Wrap=True)  # -> flatten(Item)
list_item_19 = ListItem(List=centered_secondary_ring_points_2, Index=0, Wrap=True)  # -> flatten(Item)
list_item_20 = ListItem(List=centered_secondary_ring_bottom_points_2, Index=0, Wrap=True)  # -> flatten(Item)
list_item_21 = ListItem(List=centered_primary_ring_bottom_points_2, Index=0, Wrap=True)  # -> flatten(Item)
shift_list_7 = ShiftList(List=list_item_19, Shift=1, Wrap=True)
shift_list_8 = ShiftList(List=list_item_20, Shift=1, Wrap=True)
line_31 = Line(StartPoint=list_item_18, EndPoint=shift_list_7)
line_32 = Line(StartPoint=shift_list_7, EndPoint=centered_canopy_edge_points_2)
line_33 = Line(StartPoint=shift_list_8, EndPoint=centered_canopy_edge_bottom_points_2)
line_34 = Line(StartPoint=list_item_21, EndPoint=shift_list_8)
shift_list_9 = ShiftList(List=list_item_19, Shift=-1, Wrap=True)
cull_pattern_7 = CullPattern(List=line_32, CullPattern=panel_16)
shift_list_10 = ShiftList(List=list_item_20, Shift=-1, Wrap=True)
cull_pattern_8 = CullPattern(List=line_33, CullPattern=panel_17)
line_35 = Line(StartPoint=shift_list_9, EndPoint=centered_canopy_edge_points_2)
line_36 = Line(StartPoint=list_item_18, EndPoint=shift_list_9)
line_37 = Line(StartPoint=list_item_21, EndPoint=shift_list_10)
line_38 = Line(StartPoint=shift_list_10, EndPoint=centered_canopy_edge_bottom_points_2)
cull_pattern_9 = CullPattern(List=line_35, CullPattern=panel_18)
cull_pattern_10 = CullPattern(List=line_38, CullPattern=panel_19)
secondary_to_edge_hz_bracing_bottom = Line([cull_pattern_10, cull_pattern_8])
primary_to_secondary_hz_bracing_top_3 = Line([line_31, line_36])
primary_to_secondary_hz_bracing_bottom_3 = Line([line_34, line_37])
secondary_to_edge_hz_bracing_top_5 = Line([cull_pattern_9, cull_pattern_7])

primary_ring_bottom_points_5 = Data(list_item_21)
cull_pattern_11 = CullPattern(List=primary_ring_bottom_points_5, CullPattern=panel_15)
column_height_3 = Data(column_height)
line_sdl_2 = LineSDL(Start=cull_pattern_11, Direction="0,0,-1", Length=column_height_3)
columns_2 = Line(line_sdl_2)

opening_polygon_3 = Data(polyline_23)

# ----
# Can't create panel due to plane difference
edge_polygon_3 = Data(polyline_24)
panel_21 = Panel(Outlines=[opening_polygon_3, edge_polygon_3], Tolerance=1e-06, Component="{ .Panel")
surface_split_2 = SurfaceSplit(Surface=panel_21, Curves=line_9)
canopy_panel_4 = Data(surface_split_2)

between_primary_and_secondary_4 = Data(split_list_8.ListA)
between_primary_and_secondary_5 = Data(split_list_9.ListA)
end_points_6 = EndPoints(Curve=between_primary_and_secondary_5)  # -> simplify(Start), simplify(End)
end_points_7 = EndPoints(Curve=between_primary_and_secondary_4)  # -> simplify(Start), simplify(End)
list_item_22 = ListItem(List=end_points_7.Start, Index=0, Wrap=True)
list_item_23 = ListItem(List=end_points_6.Start, Index=0, Wrap=True)
all_centered_radial_verticals_2 = Data(simplify(all_centered_radial_verticals))
all_centered_radial_verticals_3 = Data(simplify(all_centered_radial_verticals))
all_centered_radial_verticals_4 = Data(simplify(all_centered_radial_verticals))

# ---- group: Taper Top & Bottom / Not needed - doubles with opening ring
between_inner_and_primary = Data(split_list_4.ListA)

# ----
cull_index_19 = CullIndex(List=between_inner_and_primary, Indices=0, Wrap=True)
end_points_8 = EndPoints(Curve=centered_primary_truss_vertical_members)  # -> Start, End
end_points_9 = EndPoints(Curve=cull_index_19)  # -> Start, End
end_points_10 = EndPoints(Curve=centered_opening_truss_vertical_members)  # -> Start, End
list_item_24 = ListItem(List=flatten(end_points_8.End), Index=0, Wrap=True)
plane_surface = PlaneSurface(Plane=list_item_24, XSize=Domain(-10, 10), YSize=Domain(-10, 10))
project_2 = Project(Geometry=end_points_9.End, Plane=plane_surface)  # -> Geometry, Transform
project_3 = Project(Geometry=end_points_10.End, Plane=plane_surface)  # -> Geometry, Transform
vector_2pt = Vector2Pt(PointA=end_points_10.End, PointB=project_3.Geometry, Unitize=False)  # -> Vector, Length
vector_2pt_2 = Vector2Pt(PointA=end_points_9.End, PointB=project_2.Geometry, Unitize=False)  # -> Vector, Length
move_5 = Move(Geometry=cull_index_19, Motion=vector_2pt_2.Vector)  # -> Geometry, Transform
move_6 = Move(Geometry=centered_opening_truss_vertical_members, Motion=vector_2pt.Vector)  # -> Geometry, Transform
flat_bottom_between_inner_and_primary = Data(move_5.Geometry)
flat_bottom_opening_truss_vertical_membe = Line(simplify(move_6.Geometry))  # "Flat Bottom Opening Truss Vertical Members"

flat_bottom_opening_truss_vertical_membe_2 = Line(simplify(move_6.Geometry))  # "Flat Bottom Opening Truss Vertical Members"
flat_bottom_between_inner_and_primary_2 = Data(move_5.Geometry)
end_points_11 = EndPoints(Curve=flat_bottom_between_inner_and_primary_2)  # -> simplify(Start), simplify(End)
end_points_12 = EndPoints(Curve=flat_bottom_opening_truss_vertical_membe_2)  # -> simplify(Start), simplify(End)
list_item_25 = ListItem(List=end_points_12.Start, Index=0, Wrap=True)
list_item_26 = ListItem(List=end_points_12.End, Index=0, Wrap=True)
list_item_27 = ListItem(List=end_points_11.End, Index=0, Wrap=True)
list_item_28 = ListItem(List=end_points_11.Start, Index=0, Wrap=True)
bottom_5 = Data(simplify([list_item_23, list_item_27, list_item_26]))
top_7 = Data(simplify([list_item_22, list_item_28, list_item_25]))
polyline_25 = PolyLine(Vertices=top_7, Closed=False)
polyline_26 = PolyLine(Vertices=bottom_5, Closed=False)
explode_29 = Explode(Curve=polyline_25, Recursive=True)  # -> Segments, Vertices
explode_30 = Explode(Curve=polyline_26, Recursive=True)  # -> Segments, Vertices

data_8 = Data(explode_30.Vertices)
data_9 = Data(explode_29.Vertices)
shift_list_11 = ShiftList(List=data_8, Shift=1, Wrap=False)
line_39 = Line(StartPoint=data_9, EndPoint=shift_list_11)
cull_index_20 = CullIndex(List=line_39, Indices=-1, Wrap=True)
flat_bottom_opening_to_primary = Data(cull_index_20)

opening_bottom = Data(explode_30.Segments)
opening_top = Data(explode_29.Segments)

primary_to_secondary_hz_bracing_bottom_4 = Line(primary_to_secondary_hz_bracing_bottom_3)
primary_to_secondary_hz_bracing_top_4 = Line(primary_to_secondary_hz_bracing_top_3)
hz_bracing_between_primary_and_secondary = Line([primary_to_secondary_hz_bracing_bottom_4, primary_to_secondary_hz_bracing_top_4])

secondary_to_edge_hz_bracing_top_6 = Line(secondary_to_edge_hz_bracing_top_5)
secondary_to_edge_hz_bracing_bottom_2 = Line(secondary_to_edge_hz_bracing_bottom)
hz_bracing_between_primary_and_secondary_2 = Line([secondary_to_edge_hz_bracing_bottom_2, secondary_to_edge_hz_bracing_top_6])

# ----
# Columns
columns_3 = Line(columns_2)

# ----
# Diagonal Members Results
radial_diagonals_opening_to_primary_3 = Line(radial_diagonals_opening_to_primary_2)
radial_diagonals_primary_to_secondary_2 = Line(radial_diagonals_primary_to_secondary)
radial_diagonals_secondary_to_edge_2 = Line(radial_diagonals_secondary_to_edge)
opening_truss_diagonals_2 = Line(opening_truss_diagonals)
primary_truss_diagonals_3 = Line(primary_truss_diagonals_2)
primary_truss_diagonals_4 = Line(primary_truss_diagonals)

radial_diagonals_opening_to_primary_4 = Line(radial_diagonals_opening_to_primary_3)
radial_diagonals_primary_to_secondary_3 = Line(radial_diagonals_primary_to_secondary_2)
radial_diagonals_secondary_to_edge_3 = Line(radial_diagonals_secondary_to_edge_2)
opening_truss_diagonals_3 = Line(opening_truss_diagonals_2)
primary_truss_diagonals_5 = Line(primary_truss_diagonals_3)
secondary_truss_diagonals = Line(primary_truss_diagonals_4)
entwine_2 = Entwine(
    Branch0X=radial_diagonals_opening_to_primary_4,
    Branch1X=radial_diagonals_primary_to_secondary_3,
    Branch2X=radial_diagonals_secondary_to_edge_3,
    Branch3X=opening_truss_diagonals_3,
    Branch4X=primary_truss_diagonals_5,
    Branch5X=secondary_truss_diagonals,
    FlattenInputs=False)  # -> simplify(Result)
curve_middle_2 = CurveMiddle(Curve=entwine_2)
pt_2 = Point(curve_middle_2)
project_4 = Project(Geometry=pt_2, Plane=planesrf)  # -> Geometry, Transform
vec2pt_2 = Vector2Pt(PointA=pt_2, PointB=project_4.Geometry, Unitize=False)  # -> Vector, Length
move_7 = Move(Geometry=entwine_2, Motion=vec2pt_2.Vector)  # -> Geometry, Transform
centered_diagonals = Geometry(move_7.Geometry)
split_tree_5 = SplitTree(Data=centered_diagonals, Masks=flatten("{0;*;*}"))  # -> Positive, Negative
split_tree_6 = SplitTree(Data=centered_diagonals, Masks=flatten("{1;*;*}"))  # -> Positive, Negative
split_tree_7 = SplitTree(Data=centered_diagonals, Masks=flatten("{3;*;*}"))  # -> Positive, Negative
split_tree_8 = SplitTree(Data=centered_diagonals, Masks=flatten("{4;*;*}"))  # -> Positive, Negative
split_tree_9 = SplitTree(Data=centered_diagonals, Masks=flatten("{5;*;*}"))  # -> Positive, Negative
split_tree_10 = SplitTree(Data=centered_diagonals, Masks=flatten("{2;*;*}"))  # -> Positive, Negative
centered_radial_diagonals_opening_to_pri = Line(simplify(split_tree_5.Positive))  # "Centered Radial Diagonals - Opening to Primary"
centered_radial_diagonals_primary_to_sec = Line(simplify(split_tree_6.Positive))  # "Centered Radial Diagonals - Primary to Secondary"
centered_secondary_truss_diagonals = Line(simplify(split_tree_9.Positive))
centered_radial_diagonals_secondary_to_e = Line(simplify(split_tree_10.Positive))  # "Centered Radial Diagonals - Secondary to Edge"
centered_opening_truss_diagonals = Line(simplify(split_tree_7.Positive))
centered_primary_truss_diagonals = Line(simplify(split_tree_8.Positive))

# ----
# Secondary Ring
secondary_truss_diagonals_2 = Line(centered_secondary_truss_diagonals)
secondary_truss_top_chord_2 = Line(tapered_secondary_truss_top_chord)
secondary_ring_bottom_4 = Data(tapered_secondary_truss_bottom_chord)
secondary_truss_vertical_members_3 = Line(centered_secondary_truss_vertical_member)
secondary_ring_truss = Line([secondary_truss_top_chord_2, secondary_ring_bottom_4, secondary_truss_vertical_members_3, secondary_truss_diagonals_2])

# ----
# Primary Ring
primary_truss_top_chord_2 = Line(tapered_primary_truss_top_chord)
primary_ring_bottom_4 = Data(tapered_primary_truss_bottom_chord)
primary_truss_vertical_members_3 = Line(centered_primary_truss_vertical_members)
primary_truss_diagonals_6 = Line(centered_primary_truss_diagonals)
primary_ring_truss = Line([primary_truss_top_chord_2, primary_ring_bottom_4, primary_truss_vertical_members_3, primary_truss_diagonals_6])

# ----
# Opening Ring
opening_truss_vertical_members_3 = Line(centered_opening_truss_vertical_members)
opening_truss_top_chord_2 = Line(tapered_opening_truss_top_chord)
canopy_opening_bottom_4 = Data(tapered_opening_truss_bottom_chord)
opening_truss_diagonals_4 = Line(centered_opening_truss_diagonals)
opening_ring_truss = Line([opening_truss_top_chord_2, canopy_opening_bottom_4, opening_truss_vertical_members_3, opening_truss_diagonals_4])

# ----
# Vertical Members Results
all_radial_verticals_3 = Data(all_radial_verticals)
radial_verticals_5 = Data(radial_verticals)
secondary_truss_vertical_members_4 = Line(secondary_truss_vertical_members)
opening_truss_vertical_members_4 = Line(opening_truss_vertical_members)
primary_truss_vertical_members_4 = Line(primary_truss_vertical_members)

# ----
# Columns
columns_4 = Line(line_sdl)

# ----
# Top Chord Results
opening_truss_top_chord_3 = Line(explode_13.Segments)
primary_truss_top_chord_3 = Line(explode_16.Segments)
secondary_truss_top_chord_3 = Line(explode_12.Segments)
primary_to_secondary_top_2 = Line(primary_to_secondary_top)
opening_to_primary_top_2 = Line(opening_to_primary_top)
radial_truss_top_chord_2 = Line([opening_to_primary_top, primary_to_secondary_top, secondary_to_edge_top])
secondary_to_edge_top_2 = Line(secondary_to_edge_top)

flat_bottom_opening_to_primary_diagonals = Data(flat_bottom_opening_to_primary)
flat_bottom_between_inner_and_primary_3 = Data(move_5.Geometry)
opening_top_2 = Data(explode_29.Segments)
opening_bottom_2 = Data(explode_30.Segments)
between_inner_and_primary_2 = Line([flat_bottom_between_inner_and_primary_3, flat_bottom_opening_to_primary_diagonals, opening_top_2, opening_bottom_2])

opening_truss_vertical_members_5 = Line(centered_opening_truss_vertical_members)
flat_bottom_opening_truss_vertical_membe_3 = Line(simplify(move_6.Geometry))  # "Flat Bottom Opening Truss Vertical Members"
end_points_13 = EndPoints(Curve=opening_truss_vertical_members_5)  # -> Start, End
end_points_14 = EndPoints(Curve=flat_bottom_opening_truss_vertical_membe_3)  # -> Start, End
vector_2pt_3 = Vector2Pt(PointA=end_points_13.End, PointB=end_points_14.End, Unitize=False)  # -> Vector, Length
move_8 = Move(Geometry=opening_ring_truss, Motion=vector_2pt_3.Vector)  # -> Geometry, Transform
opening_ring_truss_2 = Line(move_8.Geometry)

all_radial_verticals_4 = Data(all_radial_verticals_3)
# Group Members Between Ring Trusses
bottom_radial_points_no_duplicates_3 = Point(bottom_radial_points_no_duplicates)
polyline_27 = PolyLine(Vertices=bottom_radial_points_no_duplicates_3, Closed=False)
no_radial_members_opening_primary_12 = Data(number_slider_4)
no_radial_members_opening_primary_13 = Data(number_slider_4)
explode_31 = Explode(Curve=polyline_27, Recursive=True)  # -> Segments, Vertices
split_list_10 = SplitList(List=explode_31.Segments, Index=no_radial_members_opening_primary_12)  # -> ListA, ListB
split_list_11 = SplitList(List=all_radial_verticals_4, Index=no_radial_members_opening_primary_13)  # -> ListA, ListB
no_radial_members_primary_secondary_9 = Data(number_slider_5)
no_radial_members_primary_secondary_10 = Data(number_slider_5)
radial_bottom_chord_after_primary_3 = Line(split_list_10.ListB)
vertical_after_primary_2 = Line(split_list_11.ListB)
split_list_12 = SplitList(List=radial_bottom_chord_after_primary_3, Index=no_radial_members_primary_secondary_9)  # -> ListA, ListB
split_list_13 = SplitList(List=vertical_after_primary_2, Index=no_radial_members_primary_secondary_10)  # -> ListA, ListB
cull_index_21 = CullIndex(List=split_list_13.ListA, Indices=0, Wrap=True)
cull_index_22 = CullIndex(List=split_list_13.ListB, Indices=0, Wrap=True)
between_inner_and_primary_3 = Data(split_list_10.ListA)
between_primary_and_secondary_6 = Data(split_list_12.ListA)
between_secondary_and_edge_4 = Data(split_list_12.ListB)
between_primary_and_secondary_7 = Data(cull_index_21)
between_secondary_and_edge_5 = Data(cull_index_22)

# ---- group: Not needed - doubles with opening ring
between_inner_and_primary_4 = Data(split_list_11.ListA)

# ----
primary_to_secondary_hz_bracing_bottom_5 = Line(primary_to_secondary_hz_bracing_bottom_2)
primary_to_secondary_hz_bracing_top_5 = Line(primary_to_secondary_hz_bracing_top_2)
hz_bracing_between_primary_and_secondary_3 = Line([primary_to_secondary_hz_bracing_bottom_5, primary_to_secondary_hz_bracing_top_5])

secondary_to_edge_hz_bracing_top_7 = Line(secondary_to_edge_hz_bracing_top_3)
secondary_to_edge_hz_bracing_bottom_3 = Line(secondary_to_edge_hz_bracing_top_4)
hz_bracing_between_secondary_and_edge = Line([secondary_to_edge_hz_bracing_bottom_3, secondary_to_edge_hz_bracing_top_7])

# ----
# Secondary Ring
secondary_truss_diagonals_3 = Line(primary_truss_diagonals_4)
secondary_truss_top_chord_4 = Line(secondary_truss_top_chord_3)
secondary_ring_bottom_5 = Data(secondary_ring_bottom_2)
secondary_truss_vertical_members_5 = Line(secondary_truss_vertical_members_4)
secondary_ring_truss_2 = Line([secondary_truss_top_chord_4, secondary_ring_bottom_5, secondary_truss_vertical_members_5, secondary_truss_diagonals_3])

# ----
# Columns
columns_5 = Line(columns)

# ----
# Primary Ring
primary_truss_top_chord_4 = Line(primary_truss_top_chord_3)
primary_ring_bottom_5 = Data(primary_ring_bottom_2)
primary_truss_vertical_members_5 = Line(primary_truss_vertical_members_4)
primary_truss_diagonals_7 = Line(primary_truss_diagonals_3)
primary_ring_truss_2 = Line([primary_truss_top_chord_4, primary_ring_bottom_5, primary_truss_vertical_members_5, primary_truss_diagonals_7])

# ----
# Opening Ring
opening_truss_vertical_members_6 = Line(opening_truss_vertical_members_4)
opening_truss_top_chord_4 = Line(opening_truss_top_chord_3)
opening_truss_diagonals_5 = Line(opening_truss_diagonals_2)
canopy_opening_bottom_5 = Data(canopy_opening_bottom_2)
opening_ring_truss_3 = Line([opening_truss_top_chord_4, canopy_opening_bottom_5, opening_truss_vertical_members_6, opening_truss_diagonals_5])

secondary_to_edge_top_3 = Line(between_secondary_and_edge_2)
primary_to_secondary_top_3 = Line(between_primary_and_secondary_2)
opening_to_primary_top_3 = Line(between_opening_and_primary)
snaptoelements = SnapToElements(
    Element1D=centered_radial_diagonals_secondary_to_e,
    RefElements=secondary_to_edge_top_3,
    MaxDistance="0.2",
    Tolerance=1e-06,
    Component="{ .SnapToElements")
snaptoelements_2 = SnapToElements(
    Element1D=centered_radial_diagonals_opening_to_pri,
    RefElements=opening_to_primary_top_3,
    MaxDistance="0.2",
    Tolerance=1e-06,
    Component="{ .SnapToElements")
snaptoelements_3 = SnapToElements(
    Element1D=centered_radial_diagonals_primary_to_sec,
    RefElements=primary_to_secondary_top_3,
    MaxDistance="0.2",
    Tolerance=1e-06,
    Component="{ .SnapToElements")

snaptoelements_4 = SnapToElements(
    Element1D=snaptoelements_3,
    RefElements=all_centered_radial_verticals_2,
    MaxDistance="0.2",
    Tolerance=1e-06,
    Component="{ .SnapToElements")
snaptoelements_5 = SnapToElements(
    Element1D=snaptoelements_2,
    RefElements=all_centered_radial_verticals_3,
    MaxDistance="0.2",
    Tolerance=1e-06,
    Component="{ .SnapToElements")
snaptoelements_6 = SnapToElements(
    Element1D=snaptoelements,
    RefElements=all_centered_radial_verticals_4,
    MaxDistance="0.2",
    Tolerance=1e-06,
    Component="{ .SnapToElements")

# ----
# Tapered Canopy Output - Not complete
primary_to_secondary_top_4 = Line(between_primary_and_secondary_2)
radial_diagonals_primary_to_secondary_4 = Line(snaptoelements_4)
opening_to_primary_top_4 = Line(between_opening_and_primary)
secondary_to_edge_top_4 = Line(between_secondary_and_edge_2)
radial_diagonals_secondary_to_edge_4 = Line(snaptoelements_6)
edge_dummy_member_2 = Data(edge_dummy_member)

# ----
# Between Primary and Secondary
bottom_between_primary_and_secondary = Data(between_primary_and_secondary_3)
vert_between_primary_and_secondary = Data(between_primary_and_secondary)
between_primary_and_secondary_8 = Line([bottom_between_primary_and_secondary, vert_between_primary_and_secondary, primary_to_secondary_top_4, radial_diagonals_primary_to_secondary_4])

# ----
# Between Opening and Primary
bottom_between_inner_and_primary = Data(between_opening_and_primary_2)
radial_diagonals_opening_to_primary_5 = Line(snaptoelements_5)
radial_vert_opening_to_primary = Line(cull_index_19)
between_inner_and_primary_5 = Line([bottom_between_inner_and_primary, opening_to_primary_top_4, radial_diagonals_opening_to_primary_5, radial_vert_opening_to_primary])

# ----
# Between Secondary and Edge
bottom_between_secondary_and_edge = Data(between_secondary_and_edge_3)
vert_between_secondary_and_edge = Data(between_secondary_and_edge)
between_secondary_and_edge_6 = Line([bottom_between_secondary_and_edge, vert_between_secondary_and_edge, secondary_to_edge_top_4, radial_diagonals_secondary_to_edge_4])

edge_dummy_member_3 = Data(edge_dummy_member_2)
bar = Bar(
    Line=edge_dummy_member_3,
    OrientationAngle=0,
    FeaType="{ \"_t\" : \"System.Enum\", \"TypeName\" : { \"_t\" : \"System.Type\", \"Name\" : \"BH.oM.Structure.Elements.BarFEAType\", \"_bhomVersion\" : \"6.2\" }, \"Value\" : \"Flexural\", \"_bhomVersion\" : \"6.2\" }",
    Name="Dummy",
    Component="{ .Bar")

entwine_3 = Entwine(
    Branch0X=between_inner_and_primary_2,
    Branch1X=between_primary_and_secondary_8,
    Branch2X=hz_bracing_between_primary_and_secondary,
    Branch3X=between_secondary_and_edge_6,
    Branch4X=hz_bracing_between_primary_and_secondary_2,
    Branch5X=opening_ring_truss_2,
    Branch6X=primary_ring_truss,
    Branch7X=secondary_ring_truss,
    Branch8X=columns_3,
    FlattenInputs=False)
move_9 = Move(Geometry=entwine_3, Motion=Vector(0, 0, 0))  # -> Geometry, Transform
rotate = Rotate(Geometry=move_9.Geometry, Angle=0, Plane=PlaneXY(0, 0, 0))  # -> Geometry, Transform
split_tree_11 = SplitTree(Data=rotate.Geometry, Masks=flatten("{0;*;*}"))  # -> Positive, Negative
split_tree_12 = SplitTree(Data=rotate.Geometry, Masks=flatten("{8;*;*}"))  # -> Positive, Negative
split_tree_13 = SplitTree(Data=rotate.Geometry, Masks=flatten("{7;*;*}"))  # -> Positive, Negative
split_tree_14 = SplitTree(Data=rotate.Geometry, Masks=flatten("{5;*;*}"))  # -> Positive, Negative
split_tree_15 = SplitTree(Data=rotate.Geometry, Masks=flatten("{1;*;*}"))  # -> Positive, Negative
split_tree_16 = SplitTree(Data=rotate.Geometry, Masks=flatten("{3;*;*}"))  # -> Positive, Negative
split_tree_17 = SplitTree(Data=rotate.Geometry, Masks=flatten("{2;*;*}"))  # -> Positive, Negative
split_tree_18 = SplitTree(Data=rotate.Geometry, Masks=flatten("{4;*;*}"))  # -> Positive, Negative
split_tree_19 = SplitTree(Data=rotate.Geometry, Masks=flatten("{6;*;*}"))  # -> Positive, Negative
split_tree_20 = SplitTree(Data=rotate.Geometry, Masks=flatten("{9;*;*}"))  # -> Positive, Negative

# ----
# Define section properties through BHoM
# - UK not US sections as issues
# selecting section property
need_to_edit_section_to_be_composite = Panel("1000x40 Composite??")
primary_ring_truss_3 = Line(split_tree_19.Positive)
secondary_ring_truss_3 = Line(split_tree_13.Positive)
between_primary_and_secondary_9 = Line(split_tree_15.Positive)
hz_bracing_between_primary_and_secondary_4 = Line(split_tree_17.Positive)
hz_bracing_between_primary_and_secondary_5 = Line(split_tree_18.Positive)
between_secondary_and_edge_7 = Line(split_tree_16.Positive)
opening_ring_truss_4 = Line(split_tree_14.Positive)
between_inner_and_primary_6 = Line(split_tree_11.Positive)
barreleasefixfix = BarReleaseFixFix(Name="FixFix", Component="{ .BarReleaseFixFix")
canopy = Data(split_tree_20.Positive)
columns_6 = Line(split_tree_12.Positive)
barreleasefixfix_2 = BarReleaseFixFix(Name="FixFix", Component="{ .BarReleaseFixFix")
barreleasefixfix_3 = BarReleaseFixFix(Name="FixFix", Component="{ .BarReleaseFixFix")
barreleasefixfix_4 = BarReleaseFixFix(Name="FixFix", Component="{ .BarReleaseFixFix")
barreleasefixfix_5 = BarReleaseFixFix(Name="FixFix", Component="{ .BarReleaseFixFix")
barreleasefixfix_6 = BarReleaseFixFix(Name="FixFix", Component="{ .BarReleaseFixFix")
concrete = Concrete(
    {"C12/15": 0, "C16/20": 1, "C20/25": 2, "C25/30": 3, "C30/37": 4, "C35/45": 5, "C40/50": 6, "C45/55": 7, "C50/60": 8, "C55/67": 9, "C60/75": 10, "C70/85": 11, "C80/95": 12, "C90/105": 13}, selected="C40/50",
    Component="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",
    Selection=6)
hss_3 = HSS(
    {"HSS24X12X3/4": 0, "HSS24X12X5/8": 1, "HSS24X12X1/2": 2, "HSS22X22X7/8": 3, "HSS22X22X3/4": 4, "HSS20X20X7/8": 5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}, selected="HSS24X12X3/4",
    Component="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",
    Selection=0)
hss_4 = HSS(
    {"HSS24X12X3/4": 0, "HSS24X12X5/8": 1, "HSS24X12X1/2": 2, "HSS22X22X7/8": 3, "HSS22X22X3/4": 4, "HSS20X20X7/8": 5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}, selected="HSS24X12X3/4",
    Component="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",
    Selection=0)
shs_11 = SHS(
    {"SHS 40x40x2.9": 0, "SHS 40x40x3.0": 1, "SHS 40x40x3.2": 2, "SHS 40x40x3.6": 3, "SHS 40x40x4.0": 4, "SHS 40x40x5.0": 5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}, selected="SHS 250x250x12.5": 144,
    Component="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",
    Selection=144)
hss_5 = HSS(
    {"HSS24X12X3/4": 0, "HSS24X12X5/8": 1, "HSS24X12X1/2": 2, "HSS22X22X7/8": 3, "HSS22X22X3/4": 4, "HSS20X20X7/8": 5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}, selected="HSS24X12X3/4",
    Component="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",
    Selection=0)
hss_6 = HSS(
    {"HSS24X12X3/4": 0, "HSS24X12X5/8": 1, "HSS24X12X1/2": 2, "HSS22X22X7/8": 3, "HSS22X22X3/4": 4, "HSS20X20X7/8": 5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}, selected="HSS24X12X3/4",
    Component="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",
    Selection=0)
hss_7 = HSS(
    {"HSS24X12X3/4": 0, "HSS24X12X5/8": 1, "HSS24X12X1/2": 2, "HSS22X22X7/8": 3, "HSS22X22X3/4": 4, "HSS20X20X7/8": 5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}, selected="HSS24X12X3/4",
    Component="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",
    Selection=0)
diaphragmtype = DiaphragmType(
    {"RigidDiaphragm": 0, "SemiRigidDiaphragm": 1}, selected="SemiRigidDiaphragm",
    Component="BH.oM.Adapters.ETABS.DiaphragmType",
    Selection=1)
hss_8 = HSS(
    {"HSS24X12X3/4": 0, "HSS24X12X5/8": 1, "HSS24X12X1/2": 2, "HSS22X22X7/8": 3, "HSS22X22X3/4": 4, "HSS20X20X7/8": 5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}, selected="HSS24X12X3/4",
    Component="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",
    Selection=0)
hss_9 = HSS(
    {"HSS24X12X3/4": 0, "HSS24X12X5/8": 1, "HSS24X12X1/2": 2, "HSS22X22X7/8": 3, "HSS22X22X3/4": 4, "HSS20X20X7/8": 5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}, selected="HSS24X12X3/4",
    Component="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",
    Selection=0)
hss_10 = HSS(
    {"HSS24X12X3/4": 0, "HSS24X12X5/8": 1, "HSS24X12X1/2": 2, "HSS22X22X7/8": 3, "HSS22X22X3/4": 4, "HSS20X20X7/8": 5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}, selected="HSS18X18X7/8": 22,
    Component="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",
    Selection=22)
shs_12 = SHS(
    {"SHS 40x40x2.9": 0, "SHS 40x40x3.0": 1, "SHS 40x40x3.2": 2, "SHS 40x40x3.6": 3, "SHS 40x40x4.0": 4, "SHS 40x40x5.0": 5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}, selected="SHS 150x150x10.0": 93,
    Component="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",
    Selection=93)
shs_13 = SHS(
    {"SHS 40x40x2.9": 0, "SHS 40x40x3.0": 1, "SHS 40x40x3.2": 2, "SHS 40x40x3.6": 3, "SHS 40x40x4.0": 4, "SHS 40x40x5.0": 5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}, selected="SHS 220x220x10.0": 131,
    Component="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",
    Selection=131)
shs_14 = SHS(
    {"SHS 40x40x2.9": 0, "SHS 40x40x3.0": 1, "SHS 40x40x3.2": 2, "SHS 40x40x3.6": 3, "SHS 40x40x4.0": 4, "SHS 40x40x5.0": 5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}, selected="SHS 150x150x12.5": 95,
    Component="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",
    Selection=95)
barreleasefixfix_7 = BarReleaseFixFix(Name="FixFix", Component="{ .BarReleaseFixFix")
shs_15 = SHS(
    {"SHS 40x40x2.9": 0, "SHS 40x40x3.0": 1, "SHS 40x40x3.2": 2, "SHS 40x40x3.6": 3, "SHS 40x40x4.0": 4, "SHS 40x40x5.0": 5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}, selected="SHS 250x250x12.5": 144,
    Component="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",
    Selection=144)
barreleasefixfix_8 = BarReleaseFixFix(Name="FixFix", Component="{ .BarReleaseFixFix")
steeltubesection = SteelTubeSection(
    Diameter=Slider(1, range=0..1000),
    Thickness=Slider(0.04, range=0..0.1),
    Name=need_to_edit_section_to_be_composite,
    Component="{ .SteelTubeSection")
barreleasefixfix_9 = BarReleaseFixFix(Name="FixFix", Component="{ .BarReleaseFixFix")
constantthickness = ConstantThickness(
    Name="Canopy Panel",
    Thickness=Slider(0.04, range=0..0.1),
    Material=concrete,
    PanelType="{ \"_t\" : \"System.Enum\", \"TypeName\" : { \"_t\" : \"System.Type\", \"Name\" : \"BH.oM.Structure.SurfaceProperties.PanelType\", \"_bhomVersion\" : \"6.2\" }, \"Value\" : \"Slab\", \"_bhomVersion\" : \"6.2\" }",
    Component="BH.oM.Structure.SurfaceProperties.ConstantThickness")
bar_2 = Bar(
    Line=secondary_ring_truss_3,
    SectionProperty=shs,
    OrientationAngle=0,
    Release=barreleasefixfix_7,
    FeaType="{ \"_t\" : \"System.Enum\", \"TypeName\" : { \"_t\" : \"System.Type\", \"Name\" : \"BH.oM.Structure.Elements.BarFEAType\", \"_bhomVersion\" : \"6.2\" }, \"Value\" : \"Flexural\", \"_bhomVersion\" : \"6.2\" }",
    Component="{ .Bar")
bar_3 = Bar(
    Line=columns_6,
    SectionProperty=steeltubesection,
    OrientationAngle=0,
    Release=barreleasefixfix_9,
    FeaType="{ \"_t\" : \"System.Enum\", \"TypeName\" : { \"_t\" : \"System.Type\", \"Name\" : \"BH.oM.Structure.Elements.BarFEAType\", \"_bhomVersion\" : \"6.2\" }, \"Value\" : \"Flexural\", \"_bhomVersion\" : \"6.2\" }",
    Component="{ .Bar")
bar_4 = Bar(
    Line=primary_ring_truss_3,
    SectionProperty=shs_10,
    OrientationAngle=0,
    Release=barreleasefixfix_8,
    FeaType="{ \"_t\" : \"System.Enum\", \"TypeName\" : { \"_t\" : \"System.Type\", \"Name\" : \"BH.oM.Structure.Elements.BarFEAType\", \"_bhomVersion\" : \"6.2\" }, \"Value\" : \"Flexural\", \"_bhomVersion\" : \"6.2\" }",
    Component="{ .Bar")
bar_5 = Bar(
    Line=hz_bracing_between_primary_and_secondary_5,
    SectionProperty=shs_3,
    OrientationAngle=0,
    Release=barreleasefixfix_5,
    FeaType="{ \"_t\" : \"System.Enum\", \"TypeName\" : { \"_t\" : \"System.Type\", \"Name\" : \"BH.oM.Structure.Elements.BarFEAType\", \"_bhomVersion\" : \"6.2\" }, \"Value\" : \"Flexural\", \"_bhomVersion\" : \"6.2\" }",
    Component="{ .Bar")
bar_6 = Bar(
    Line=between_secondary_and_edge_7,
    SectionProperty=shs_2,
    OrientationAngle=0,
    Release=barreleasefixfix_4,
    FeaType="{ \"_t\" : \"System.Enum\", \"TypeName\" : { \"_t\" : \"System.Type\", \"Name\" : \"BH.oM.Structure.Elements.BarFEAType\", \"_bhomVersion\" : \"6.2\" }, \"Value\" : \"Flexural\", \"_bhomVersion\" : \"6.2\" }",
    Component="{ .Bar")
bar_7 = Bar(
    Line=opening_ring_truss_4,
    SectionProperty=shs_14,
    OrientationAngle=0,
    Release=barreleasefixfix,
    FeaType="{ \"_t\" : \"System.Enum\", \"TypeName\" : { \"_t\" : \"System.Type\", \"Name\" : \"BH.oM.Structure.Elements.BarFEAType\", \"_bhomVersion\" : \"6.2\" }, \"Value\" : \"Flexural\", \"_bhomVersion\" : \"6.2\" }",
    Component="{ .Bar")
bar_8 = Bar(
    Line=between_primary_and_secondary_9,
    SectionProperty=shs_5,
    OrientationAngle=0,
    Release=barreleasefixfix_2,
    FeaType="{ \"_t\" : \"System.Enum\", \"TypeName\" : { \"_t\" : \"System.Type\", \"Name\" : \"BH.oM.Structure.Elements.BarFEAType\", \"_bhomVersion\" : \"6.2\" }, \"Value\" : \"Flexural\", \"_bhomVersion\" : \"6.2\" }",
    Component="{ .Bar")
bar_9 = Bar(
    Line=hz_bracing_between_primary_and_secondary_4,
    SectionProperty=shs_6,
    OrientationAngle=0,
    Release=barreleasefixfix_3,
    FeaType="{ \"_t\" : \"System.Enum\", \"TypeName\" : { \"_t\" : \"System.Type\", \"Name\" : \"BH.oM.Structure.Elements.BarFEAType\", \"_bhomVersion\" : \"6.2\" }, \"Value\" : \"Flexural\", \"_bhomVersion\" : \"6.2\" }",
    Component="{ .Bar")
bar_10 = Bar(
    Line=between_inner_and_primary_6,
    SectionProperty=shs_8,
    OrientationAngle=0,
    Release=barreleasefixfix_6,
    FeaType="{ \"_t\" : \"System.Enum\", \"TypeName\" : { \"_t\" : \"System.Type\", \"Name\" : \"BH.oM.Structure.Elements.BarFEAType\", \"_bhomVersion\" : \"6.2\" }, \"Value\" : \"Flexural\", \"_bhomVersion\" : \"6.2\" }",
    Component="{ .Bar")
panel_22 = Panel(Surface=canopy, Property=constantthickness, Tolerance=1e-06, Component="{ .Panel")
diaphragm = Diaphragm(Rigidity=diaphragmtype, Name="D1", Component="BH.oM.Adapters.ETABS.Elements.Diaphragm")
setdiaphragm = SetDiaphragm(Panel=panel_22, Diaphragm=diaphragm, Component="{ .SetDiaphragm")

geometry = Data(rotate.Geometry)

line_40 = Line(geometry)
constantframingproperty = ConstantFramingProperty(OrientationAngle=0, Name="UB305x102x33", Component="BH.oM.Physical.FramingProperties.ConstantFramingProperty")
beam = Beam(Location=line_40, Property=constantframingproperty, Component="BH.oM.Physical.Elements.Beam")
pushtype_2 = PushType(
    {"FullPush": 0, "CreateOnly": 1, "CreateNonExisting": 2, "UpdateOnly": 3, "UpdateOrCreateOnly": 4, "DeleteThenCreate": 5, "AdapterDefault": 6}, selected="FullPush",
    Component="BH.oM.Adapter.PushType",
    Selection=0)
revitadapter = RevitAdapter(Active=Toggle(True), Component="{ ..ctor")
data_10 = Data(beam)
push = Push(Adapter=revitadapter, Objects=flatten(data_10), PushType=pushtype_2, Active=Toggle(False), Component="{ .Push")  # -> Objects, Success

# ----
# Between Primary and Secondary
bottom_between_primary_and_secondary_2 = Data(between_primary_and_secondary_6)
vert_between_primary_and_secondary_2 = Data(between_primary_and_secondary_7)

# ----
# Are the opening verticals doubling at radial points?
primary_to_secondary_top_5 = Line(primary_to_secondary_top)
radial_diagonals_primary_to_secondary_5 = Line(radial_diagonals_primary_to_secondary_2)
opening_to_primary_top_5 = Line(opening_to_primary_top)
secondary_to_edge_top_5 = Line(secondary_to_edge_top)
radial_diagonals_secondary_to_edge_5 = Line(radial_diagonals_secondary_to_edge_2)
canopy_5_translation_4 = Data(canopy_5_translation_2)
canopy_5_rotation_4 = Data(canopy_5_rotation_2)
shs_16 = SHS(
    {"SHS 40x40x2.9": 0, "SHS 40x40x3.0": 1, "SHS 40x40x3.2": 2, "SHS 40x40x3.6": 3, "SHS 40x40x4.0": 4, "SHS 40x40x5.0": 5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}, selected="SHS 200x200x10.0": 124,
    Component="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",
    Selection=124)
shs_17 = SHS(
    {"SHS 40x40x2.9": 0, "SHS 40x40x3.0": 1, "SHS 40x40x3.2": 2, "SHS 40x40x3.6": 3, "SHS 40x40x4.0": 4, "SHS 40x40x5.0": 5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}, selected="SHS 300x300x14.2": 162,
    Component="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",
    Selection=162)
pushtype_3 = PushType(
    {"FullPush": 0, "CreateOnly": 1, "CreateNonExisting": 2, "UpdateOnly": 3, "UpdateOrCreateOnly": 4, "DeleteThenCreate": 5, "AdapterDefault": 6}, selected="FullPush",
    Component="BH.oM.Adapter.PushType",
    Selection=0)

# ----
# Between Opening and Primary
bottom_between_inner_and_primary_2 = Data(between_inner_and_primary_3)
radial_diagonals_opening_to_primary_6 = Line(radial_diagonals_opening_to_primary_3)
between_inner_and_primary_7 = Line([bottom_between_inner_and_primary_2, opening_to_primary_top_5, radial_diagonals_opening_to_primary_6])

# ----
# Between Secondary and Edge
bottom_between_secondary_and_edge_2 = Data(between_secondary_and_edge_4)
vert_between_secondary_and_edge_2 = Data(between_secondary_and_edge_5)
between_secondary_and_edge_8 = Line([bottom_between_secondary_and_edge_2, vert_between_secondary_and_edge_2, secondary_to_edge_top_5, radial_diagonals_secondary_to_edge_5])

between_primary_and_secondary_10 = Line([bottom_between_primary_and_secondary_2, vert_between_primary_and_secondary_2, primary_to_secondary_top_5, radial_diagonals_primary_to_secondary_5])

merge = Merge(Data1=bar_10, Data2=bar_8, Data3=bar_9, Data4=bar_6, Data5=bar_5, Data6=bar_7, Data7=bar_4, Data8=bar_2, Data9=bar_3)  # -> flatten(Result)
bhom_object = BHoMObject(
    [merge, bar],
    ObjectType="{ \"_t\" : \"System.Type\", \"Name\" : \"System.Object, mscorlib, Version=4.0.0.0, Culture=neutral, PublicKeyToken=b77a5c561934e089\", \"_bhomVersion\" : \"6.2\" }",
    m_ForcePreview=False,
    m_MaxItemsPreview=10000)
panel_23 = Data(setdiaphragm)

# ---- group: Move Structure - Column bottom at base, for import into individual file
centered_primary_truss_vertical_members_4 = Line(simplify(flatten(centered_primary_truss_vertical_members)))
columns_7 = Line(columns_6)
end_points_15 = EndPoints(Curve=columns_7)  # -> Start, End
curve_middle_3 = CurveMiddle(Curve=centered_primary_truss_vertical_members_4)
column_base = Point(end_points_15.End)
list_item_29 = ListItem(List=column_base, Index="2", Wrap=True)
list_item_30 = ListItem(List=curve_middle_3, Index="23", Wrap=True)
point_5 = Point(list_item_29)
point_6 = Point(list_item_30)
vector = Vector(A=point_5, B=point_6, Component="{ .Vector")
panel_24 = Data(setdiaphragm)
translate = Translate(Element1D=bhom_object, Transform=vector, Component="{ .Translate")
translate_2 = Translate(Element2D=panel_24, Transform=vector, Component="{ .Translate")

# ----
vector_2 = Vector(A=point_5, B=point_6, Component="{ .Vector")
point_list_3 = PointList(Points=curve_middle_3)

# ---- group: Column Supports
column_base_2 = Point(end_points_15.End)
fixconstraint6dof = FixConstraint6DOF(Name="Fix", Component="{ .FixConstraint6DOF")

# ----
translate_3 = Translate(Pt=column_base_2, Transform=vector_2, Component="{ .Translate")

# ---- group: Column Supports (continued)
node = Node(Coordinates=translate_3, Support=fixconstraint6dof, Component="{ .Node")  # -> flatten(Node)
fixed_supports = Data(node)

# ---- group: Push to ETABS
etabsadapter = ETABSAdapter(Active=Toggle(True), Component="{ ..ctor")
push_2 = Push(
    Adapter=etabsadapter,
    Objects=flatten([translate, fixed_supports]),
    PushType=pushtype,
    Active=button,
    Component="{ .Push")  # -> Objects, Success

# ----
entwine_4 = Entwine(
    Branch0X=between_inner_and_primary_7,
    Branch1X=between_primary_and_secondary_10,
    Branch2X=hz_bracing_between_primary_and_secondary_3,
    Branch3X=between_secondary_and_edge_8,
    Branch4X=hz_bracing_between_secondary_and_edge,
    Branch5X=opening_ring_truss_3,
    Branch6X=primary_ring_truss_2,
    Branch7X=secondary_ring_truss_2,
    Branch8X=columns_5,
    Branch9X=canopy_panel_3,
    FlattenInputs=False)
move_10 = Move(Geometry=entwine_4, Motion=Vector(0, 0, 0))  # -> Geometry, Transform
rotate_2 = Rotate(Geometry=move_10.Geometry, Angle=0, Plane=PlaneXY(0, 0, 0))  # -> Geometry, Transform
split_tree_21 = SplitTree(Data=rotate_2.Geometry, Masks=flatten("{0;*;*}"))  # -> Positive, Negative
split_tree_22 = SplitTree(Data=rotate_2.Geometry, Masks=flatten("{8;*;*}"))  # -> Positive, Negative
split_tree_23 = SplitTree(Data=rotate_2.Geometry, Masks=flatten("{7;*;*}"))  # -> Positive, Negative
split_tree_24 = SplitTree(Data=rotate_2.Geometry, Masks=flatten("{5;*;*}"))  # -> Positive, Negative
split_tree_25 = SplitTree(Data=rotate_2.Geometry, Masks=flatten("{1;*;*}"))  # -> Positive, Negative
split_tree_26 = SplitTree(Data=rotate_2.Geometry, Masks=flatten("{3;*;*}"))  # -> Positive, Negative
split_tree_27 = SplitTree(Data=rotate_2.Geometry, Masks=flatten("{2;*;*}"))  # -> Positive, Negative
split_tree_28 = SplitTree(Data=rotate_2.Geometry, Masks=flatten("{4;*;*}"))  # -> Positive, Negative
split_tree_29 = SplitTree(Data=rotate_2.Geometry, Masks=flatten("{6;*;*}"))  # -> Positive, Negative
split_tree_30 = SplitTree(Data=rotate_2.Geometry, Masks=flatten("{9;*;*}"))  # -> Positive, Negative

# ----
# Define section properties through BHoM
# - UK not US sections as issues
# selecting section property
need_to_edit_section_to_be_composite_2 = Panel("1000x40 Composite??")
primary_ring_truss_4 = Line(split_tree_29.Positive)
secondary_ring_truss_4 = Line(split_tree_23.Positive)
between_primary_and_secondary_11 = Line(split_tree_25.Positive)
hz_bracing_between_primary_and_secondary_6 = Line(split_tree_27.Positive)
between_secondary_and_edge_9 = Line(split_tree_26.Positive)
hz_bracing_between_primary_and_secondary_7 = Line(split_tree_28.Positive)
opening_ring_truss_5 = Line(split_tree_24.Positive)
between_inner_and_primary_8 = Line(split_tree_21.Positive)
canopy_2 = Data(split_tree_30.Positive)
barreleasefixfix_10 = BarReleaseFixFix(Name="FixFix", Component="{ .BarReleaseFixFix")
columns_8 = Line(split_tree_22.Positive)
barreleasefixfix_11 = BarReleaseFixFix(Name="FixFix", Component="{ .BarReleaseFixFix")
barreleasefixfix_12 = BarReleaseFixFix(Name="FixFix", Component="{ .BarReleaseFixFix")
barreleasefixfix_13 = BarReleaseFixFix(Name="FixFix", Component="{ .BarReleaseFixFix")
barreleasefixfix_14 = BarReleaseFixFix(Name="FixFix", Component="{ .BarReleaseFixFix")
barreleasefixfix_15 = BarReleaseFixFix(Name="FixFix", Component="{ .BarReleaseFixFix")
concrete_2 = Concrete(
    {"C12/15": 0, "C16/20": 1, "C20/25": 2, "C25/30": 3, "C30/37": 4, "C35/45": 5, "C40/50": 6, "C45/55": 7, "C50/60": 8, "C55/67": 9, "C60/75": 10, "C70/85": 11, "C80/95": 12, "C90/105": 13}, selected="C40/50",
    Component="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",
    Selection=6)
hss_11 = HSS(
    {"HSS24X12X3/4": 0, "HSS24X12X5/8": 1, "HSS24X12X1/2": 2, "HSS22X22X7/8": 3, "HSS22X22X3/4": 4, "HSS20X20X7/8": 5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}, selected="HSS24X12X3/4",
    Component="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",
    Selection=0)
hss_12 = HSS(
    {"HSS24X12X3/4": 0, "HSS24X12X5/8": 1, "HSS24X12X1/2": 2, "HSS22X22X7/8": 3, "HSS22X22X3/4": 4, "HSS20X20X7/8": 5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}, selected="HSS24X12X3/4",
    Component="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",
    Selection=0)
shs_18 = SHS(
    {"SHS 40x40x2.9": 0, "SHS 40x40x3.0": 1, "SHS 40x40x3.2": 2, "SHS 40x40x3.6": 3, "SHS 40x40x4.0": 4, "SHS 40x40x5.0": 5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}, selected="SHS 300x300x14.2": 162,
    Component="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",
    Selection=162)
hss_13 = HSS(
    {"HSS24X12X3/4": 0, "HSS24X12X5/8": 1, "HSS24X12X1/2": 2, "HSS22X22X7/8": 3, "HSS22X22X3/4": 4, "HSS20X20X7/8": 5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}, selected="HSS24X12X3/4",
    Component="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",
    Selection=0)
hss_14 = HSS(
    {"HSS24X12X3/4": 0, "HSS24X12X5/8": 1, "HSS24X12X1/2": 2, "HSS22X22X7/8": 3, "HSS22X22X3/4": 4, "HSS20X20X7/8": 5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}, selected="HSS24X12X3/4",
    Component="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",
    Selection=0)
hss_15 = HSS(
    {"HSS24X12X3/4": 0, "HSS24X12X5/8": 1, "HSS24X12X1/2": 2, "HSS22X22X7/8": 3, "HSS22X22X3/4": 4, "HSS20X20X7/8": 5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}, selected="HSS24X12X3/4",
    Component="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",
    Selection=0)
diaphragmtype_2 = DiaphragmType(
    {"RigidDiaphragm": 0, "SemiRigidDiaphragm": 1}, selected="SemiRigidDiaphragm",
    Component="BH.oM.Adapters.ETABS.DiaphragmType",
    Selection=1)
hss_16 = HSS(
    {"HSS24X12X3/4": 0, "HSS24X12X5/8": 1, "HSS24X12X1/2": 2, "HSS22X22X7/8": 3, "HSS22X22X3/4": 4, "HSS20X20X7/8": 5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}, selected="HSS24X12X3/4",
    Component="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",
    Selection=0)
hss_17 = HSS(
    {"HSS24X12X3/4": 0, "HSS24X12X5/8": 1, "HSS24X12X1/2": 2, "HSS22X22X7/8": 3, "HSS22X22X3/4": 4, "HSS20X20X7/8": 5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}, selected="HSS24X12X3/4",
    Component="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",
    Selection=0)
hss_18 = HSS(
    {"HSS24X12X3/4": 0, "HSS24X12X5/8": 1, "HSS24X12X1/2": 2, "HSS22X22X7/8": 3, "HSS22X22X3/4": 4, "HSS20X20X7/8": 5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}, selected="HSS18X18X7/8": 22,
    Component="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",
    Selection=22)
shs_19 = SHS(
    {"SHS 40x40x2.9": 0, "SHS 40x40x3.0": 1, "SHS 40x40x3.2": 2, "SHS 40x40x3.6": 3, "SHS 40x40x4.0": 4, "SHS 40x40x5.0": 5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}, selected="SHS 250x250x16.0": 146,
    Component="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",
    Selection=146)
shs_20 = SHS(
    {"SHS 40x40x2.9": 0, "SHS 40x40x3.0": 1, "SHS 40x40x3.2": 2, "SHS 40x40x3.6": 3, "SHS 40x40x4.0": 4, "SHS 40x40x5.0": 5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}, selected="SHS 250x250x14.2": 145,
    Component="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",
    Selection=145)
shs_21 = SHS(
    {"SHS 40x40x2.9": 0, "SHS 40x40x3.0": 1, "SHS 40x40x3.2": 2, "SHS 40x40x3.6": 3, "SHS 40x40x4.0": 4, "SHS 40x40x5.0": 5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}, selected="SHS 150x150x12.5": 95,
    Component="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",
    Selection=95)
barreleasefixfix_16 = BarReleaseFixFix(Name="FixFix", Component="{ .BarReleaseFixFix")
shs_22 = SHS(
    {"SHS 40x40x2.9": 0, "SHS 40x40x3.0": 1, "SHS 40x40x3.2": 2, "SHS 40x40x3.6": 3, "SHS 40x40x4.0": 4, "SHS 40x40x5.0": 5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}, selected="SHS 300x300x14.2": 162,
    Component="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",
    Selection=162)
barreleasefixfix_17 = BarReleaseFixFix(Name="FixFix", Component="{ .BarReleaseFixFix")
steeltubesection_2 = SteelTubeSection(
    Diameter=Slider(1, range=0..1000),
    Thickness=Slider(0.04, range=0..0.1),
    Name=need_to_edit_section_to_be_composite_2,
    Component="{ .SteelTubeSection")
barreleasefixfix_18 = BarReleaseFixFix(Name="FixFix", Component="{ .BarReleaseFixFix")
constantthickness_2 = ConstantThickness(
    Name="Canopy Panel",
    Thickness=Slider(0.04, range=0..0.1),
    Material=concrete_2,
    PanelType="{ \"_t\" : \"System.Enum\", \"TypeName\" : { \"_t\" : \"System.Type\", \"Name\" : \"BH.oM.Structure.SurfaceProperties.PanelType\", \"_bhomVersion\" : \"6.2\" }, \"Value\" : \"Slab\", \"_bhomVersion\" : \"6.2\" }",
    Component="BH.oM.Structure.SurfaceProperties.ConstantThickness")
bar_11 = Bar(
    Line=secondary_ring_truss_4,
    SectionProperty=shs_18,
    OrientationAngle=0,
    Release=barreleasefixfix_16,
    FeaType="{ \"_t\" : \"System.Enum\", \"TypeName\" : { \"_t\" : \"System.Type\", \"Name\" : \"BH.oM.Structure.Elements.BarFEAType\", \"_bhomVersion\" : \"6.2\" }, \"Value\" : \"Flexural\", \"_bhomVersion\" : \"6.2\" }",
    Component="{ .Bar")
bar_12 = Bar(
    Line=columns_8,
    SectionProperty=steeltubesection_2,
    OrientationAngle=0,
    Release=barreleasefixfix_18,
    FeaType="{ \"_t\" : \"System.Enum\", \"TypeName\" : { \"_t\" : \"System.Type\", \"Name\" : \"BH.oM.Structure.Elements.BarFEAType\", \"_bhomVersion\" : \"6.2\" }, \"Value\" : \"Flexural\", \"_bhomVersion\" : \"6.2\" }",
    Component="{ .Bar")
bar_13 = Bar(
    Line=primary_ring_truss_4,
    SectionProperty=fabricatedsteelboxsection_2,
    OrientationAngle=0,
    Release=barreleasefixfix_17,
    FeaType="{ \"_t\" : \"System.Enum\", \"TypeName\" : { \"_t\" : \"System.Type\", \"Name\" : \"BH.oM.Structure.Elements.BarFEAType\", \"_bhomVersion\" : \"6.2\" }, \"Value\" : \"Flexural\", \"_bhomVersion\" : \"6.2\" }",
    Name="Change Section",
    Component="{ .Bar")
bar_14 = Bar(
    Line=hz_bracing_between_primary_and_secondary_7,
    SectionProperty=shs_16,
    OrientationAngle=0,
    Release=barreleasefixfix_14,
    FeaType="{ \"_t\" : \"System.Enum\", \"TypeName\" : { \"_t\" : \"System.Type\", \"Name\" : \"BH.oM.Structure.Elements.BarFEAType\", \"_bhomVersion\" : \"6.2\" }, \"Value\" : \"Flexural\", \"_bhomVersion\" : \"6.2\" }",
    Component="{ .Bar")
bar_15 = Bar(
    Line=between_secondary_and_edge_9,
    SectionProperty=shs_19,
    OrientationAngle=0,
    Release=barreleasefixfix_13,
    FeaType="{ \"_t\" : \"System.Enum\", \"TypeName\" : { \"_t\" : \"System.Type\", \"Name\" : \"BH.oM.Structure.Elements.BarFEAType\", \"_bhomVersion\" : \"6.2\" }, \"Value\" : \"Flexural\", \"_bhomVersion\" : \"6.2\" }",
    Component="{ .Bar")
bar_16 = Bar(
    Line=opening_ring_truss_5,
    SectionProperty=shs_21,
    OrientationAngle=0,
    Release=barreleasefixfix_10,
    FeaType="{ \"_t\" : \"System.Enum\", \"TypeName\" : { \"_t\" : \"System.Type\", \"Name\" : \"BH.oM.Structure.Elements.BarFEAType\", \"_bhomVersion\" : \"6.2\" }, \"Value\" : \"Flexural\", \"_bhomVersion\" : \"6.2\" }",
    Component="{ .Bar")
bar_17 = Bar(
    Line=between_primary_and_secondary_11,
    SectionProperty=shs_17,
    OrientationAngle=0,
    Release=barreleasefixfix_11,
    FeaType="{ \"_t\" : \"System.Enum\", \"TypeName\" : { \"_t\" : \"System.Type\", \"Name\" : \"BH.oM.Structure.Elements.BarFEAType\", \"_bhomVersion\" : \"6.2\" }, \"Value\" : \"Flexural\", \"_bhomVersion\" : \"6.2\" }",
    Component="{ .Bar")
bar_18 = Bar(
    Line=hz_bracing_between_primary_and_secondary_6,
    SectionProperty=shs_20,
    OrientationAngle=0,
    Release=barreleasefixfix_12,
    FeaType="{ \"_t\" : \"System.Enum\", \"TypeName\" : { \"_t\" : \"System.Type\", \"Name\" : \"BH.oM.Structure.Elements.BarFEAType\", \"_bhomVersion\" : \"6.2\" }, \"Value\" : \"Flexural\", \"_bhomVersion\" : \"6.2\" }",
    Component="{ .Bar")
bar_19 = Bar(
    Line=between_inner_and_primary_8,
    SectionProperty=shs_22,
    OrientationAngle=0,
    Release=barreleasefixfix_15,
    FeaType="{ \"_t\" : \"System.Enum\", \"TypeName\" : { \"_t\" : \"System.Type\", \"Name\" : \"BH.oM.Structure.Elements.BarFEAType\", \"_bhomVersion\" : \"6.2\" }, \"Value\" : \"Flexural\", \"_bhomVersion\" : \"6.2\" }",
    Component="{ .Bar")
panel_25 = Panel(Surface=canopy_2, Property=constantthickness_2, Tolerance=1e-06, Component="{ .Panel")
diaphragm_2 = Diaphragm(Rigidity=diaphragmtype_2, Name="D1", Component="BH.oM.Adapters.ETABS.Elements.Diaphragm")
setdiaphragm_2 = SetDiaphragm(Panel=panel_25, Diaphragm=diaphragm_2, Component="{ .SetDiaphragm")

merge_2 = Merge(
    Data1=bar_19,
    Data2=bar_17,
    Data3=bar_18,
    Data4=bar_15,
    Data5=bar_14,
    Data6=bar_16,
    Data7=bar_13,
    Data8=bar_11,
    Data9=bar_12)  # -> flatten(Result)
bhom_object_2 = BHoMObject(
    merge_2,
    ObjectType="{ \"_t\" : \"System.Type\", \"Name\" : \"System.Object, mscorlib, Version=4.0.0.0, Culture=neutral, PublicKeyToken=b77a5c561934e089\", \"_bhomVersion\" : \"6.2\" }",
    m_ForcePreview=False,
    m_MaxItemsPreview=10000)
panel_26 = Data(setdiaphragm_2)

# ---- group: Move Structure - Column bottom at base, for import into individual file
columns_9 = Line(columns_5)
end_points_16 = EndPoints(Curve=columns_9)  # -> Start, End
primary_truss_top_points_5 = Data(flatten(primary_truss_top_points_2))
column_base_3 = Point(end_points_16.End)
list_item_31 = ListItem(List=column_base_3, Index="2", Wrap=True)
list_item_32 = ListItem(List=primary_truss_top_points_5, Index="40", Wrap=True)
point_7 = Point(list_item_31)
point_8 = Point(list_item_32)
vector_3 = Vector(A=point_7, B=point_8, Component="{ .Vector")
panel_27 = Data(setdiaphragm_2)
translate_4 = Translate(Element1D=bhom_object_2, Transform=vector_3, Component="{ .Translate")
translate_5 = Translate(Element2D=panel_27, Transform=vector_3, Component="{ .Translate")

# ---- group: Column Supports
column_base_4 = Point(end_points_16.End)
fixconstraint6dof_2 = FixConstraint6DOF(Name="Fix", Component="{ .FixConstraint6DOF")

# ----
vector_4 = Vector(A=point_7, B=point_8, Component="{ .Vector")
translate_6 = Translate(Pt=column_base_4, Transform=vector_4, Component="{ .Translate")

# ---- group: Column Supports (continued)
node_2 = Node(Coordinates=translate_6, Support=fixconstraint6dof_2, Component="{ .Node")  # -> flatten(Node)
fixed_supports_2 = Data(node_2)

# ---- group: Robot Push
robotadapter = RobotAdapter(Active=Toggle(False), Component="{ ..ctor")
push_3 = Push(
    Adapter=robotadapter,
    Objects=flatten([translate_4, translate_5, fixed_supports_2]),
    PushType=pushtype_3,
    Active=boolean_toggle_2,
    Component="{ .Push")  # -> Objects, Success

# ---- group: Push to ETABS
# Incorrect taper. See white section below.
boolean_toggle_5 = BooleanToggle(True)
etabsadapter_2 = ETABSAdapter(Active=boolean_toggle_5, Component="{ ..ctor")
pushtype_4 = PushType(
    {"FullPush": 0, "CreateOnly": 1, "CreateNonExisting": 2, "UpdateOnly": 3, "UpdateOrCreateOnly": 4, "DeleteThenCreate": 5, "AdapterDefault": 6}, selected="FullPush",
    Component="BH.oM.Adapter.PushType",
    Selection=0)
push_4 = Push(
    Adapter=etabsadapter_2,
    Objects=flatten([translate_4, fixed_supports_2]),
    PushType=pushtype_4,
    Active=boolean_toggle_3,
    Component="{ .Push")  # -> Objects, Success
