# Grasshopper definition Canopy Columns.gh (Grasshopper 1.0.7)
# plug-ins: BH.UI.Grasshopper

getinfo = GetInfo(Component="{ .GetInfo")
# <Script name>
project_number = Panel("")
setprojectid = SetProjectID(ProjectID=project_number, Component="{ .SetProjectID")
bhom_version_used_to_create = Panel("6.0")
bhom_version_currently_installed = Panel(getinfo)
discipline = Discipline(
    {"Undefined": 0, "Environmental": 1, "Structural": 2, "Architecture": 3, "Physical": 4, "Facade": 5}, selected="Physical",
    Component="BH.oM.Adapters.Revit.Enums.Discipline",
    Selection=4)
revitpullconfig = RevitPullConfig(
    Discipline=discipline,
    IncludeClosedWorksets=False,
    IncludeNestedElements=True,
    PullMaterialTakeOff=False,
    Component="{ .RevitPullConfig")
geo = Geometry([Line((23.03919053, 19.30064697, 29.9), (23.03919053, 19.30064697, 36)), Line((60.63420948, 30.64762002, -0.9), (60.63420948, 30.64762002, 18.4)), Line((59.31774003, 12.45253915, -0.9), (59.31774003, 12.45253915, 14.9)), Line((55.64372594, 39.29160037, -0.9), (55.64372594, 39.29160037, 18.4)), Line((65.57434339, 39.27513344, -0.9), (65.57434339, 39.27513344, 18.4)), Line((69.86488052, 19.26666668, -0.9), (69.86488052, 19.26666668, 14.9))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])
revitadapter = RevitAdapter(Active=Toggle(True), Component="{ ..ctor")
filterbyselection = FilterBySelection(Component="{ .FilterBySelection")
pull = Pull(
    Adapter=revitadapter,
    Request=filterbyselection,
    PullType="{ \"_t\" : \"System.Enum\", \"TypeName\" : { \"_t\" : \"System.Type\", \"Name\" : \"BH.oM.Adapter.PullType\", \"_bhomVersion\" : \"6.0\" }, \"Value\" : \"AdapterDefault\", \"_bhomVersion\" : \"6.0\" }",
    ActionConfig=revitpullconfig,
    Active=Toggle(False),
    Component="{ .Pull")
