# Grasshopper definition Canopy Grasshopper V8 - Type 1 (Revit).gh (Grasshopper 1.0.7)
# plug-ins: BH.UI.Grasshopper

getinfo = GetInfo(Component="{ .GetInfo")  # -> Description, Version, Installer, Libraries, Types, Methods, Adapters, Website, Github, Wiki
bhom_version_used_to_create = Panel("5.3")
# <Script name>
project_number = Panel("")
setprojectid = SetProjectID(ProjectID=project_number, Component="{ .SetProjectID")
# Create input at start detailing the canopy
# number - this inputs the respective radii and
# translation values
# Canopy Group 1: Inital Pre-DD:
# Primary 8000
# Opening 4000
# Edge 16000
# Column 6000
# Max Depth 1500
# Min Depth 500
# Arrival Building Canopy 4&5: Inital Pre-DD:
# Primary 5775
# Opening 4150
# Edge 16000
# Column 5000
# Max Depth 1500
# Min Depth 500
# Arrival Building Canopy 7&8: Inital Pre-DD:
# Primary 7000
# Opening 5000
# Edge 21500
# Column 6000
# Max Depth 2500
# Min Depth 1000
# Canopy Group 2: Inital Pre-DD:
# Primary 8000
# Opening 4000
# Edge 16000
# Column 9000
# Max Depth 1500
# Min Depth 500
# Canopy Group 4: Inital Pre-DD:
# Primary 11000
# Opening 6000
# Edge 21500
# Column 11500
# Max Depth 2500
# Min Depth 1000
bhom_version_currently_installed = Panel(getinfo.Version)

panel = Panel("Input Revit Column extraction here")
# Radial Bay defining ring position
# Extract Radius from Revit column position - or set radius
panel_2 = Panel("0,0")
canopy_center_point = Data(panel_2)
column_top = Data(panel)
line = Line(StartPoint=canopy_center_point, EndPoint=column_top)
length = Length(Curve=line)

# ----
# Inputs
# Split Ring Truss
number_slider = Slider(2, range=0..4)
# Truss Depth
number_slider_2 = Slider(1500, range=0..10000)
# Radius
number_slider_3 = Slider(7200, range=0..11000)
# No. Radial Members
number_slider_4 = Slider(2, range=0..10)
number_slider_5 = Slider(4, range=0..10)
# No. Sides
number_slider_6 = Slider(12, range=0..100)

division = Division(A=number_slider_2, B="1000")
division_2 = Division(A=Slider(600, range=0..1000), B="1000")
division_3 = Division(A=Slider(6000, range=0..12000), B="1000")
division_4 = Division(A=number_slider_3, B="1000")
division_5 = Division(A=Slider(4420, range=0..10000), B="1000")
division_6 = Division(A=Slider(19250, range=0..100000), B="1000")
negative = Negative(Value=division)
negative_2 = Negative(Value=division_2)
unit_z = UnitZ(Factor=negative)
unit_z_2 = UnitZ(Factor=negative_2)

# ---- group: Use when extracting columns from Revit
column_top_2 = Data(panel)

# ----
panel_3 = Panel("""True
False
False
False""")

# ---- group: Use when extracting columns from Revit
column_top_3 = Data(panel)

# ----
panel_4 = Panel("""True
False
False
False""")

# ---- group: not working with BHoM elements
# Canopy #4 Translation
# Canopy #5 Translation
panel_5 = Panel("{34.034, 34.867, 28.150}")
radians = Radians(Degrees="30.11004210")
radians_2 = Radians(Degrees="72.74429881")
canopy_4_translation = Data("{60.604, 36.393, 20.9}")
canopy_5_translation = Data(panel_5)
canopy_4_rotation = Data(radians)
canopy_5_rotation = Data(radians_2)

# ----
canopy_5_translation_2 = Data(canopy_5_translation)
canopy_5_rotation_2 = Data(canopy_5_rotation)

# ---- group: Sections
canopy_beam_sections_typical = Panel("""SHS300x300x14.2
SHS250x250x14.2
SHS250x250x16
SHS400x400x16
SHS200x200x10
SHS150x150x12.5""")
item = ListItem(List=canopy_beam_sections_typical, Index=0, Wrap=True)  # -> Item, Item1, Item2, Item3, Item4, Item5
panel_6 = Panel(item.Item1)
panel_7 = Panel(item.Item2)
panel_8 = Panel(item.Item)
panel_9 = Panel(item.Item3)
panel_10 = Panel(item.Item4)
panel_11 = Panel(item.Item5)

# ---- group: not working with BHoM elements
# Canopy #4 Translation
# Canopy #5 Translation
panel_12 = Panel("{34.034, 34.867, 28.150}")
radians_3 = Radians(Degrees="30.11004210")
radians_4 = Radians(Degrees="72.74429881")
canopy_4_translation_2 = Data("{60.604, 36.393, 20.9}")
canopy_5_translation_3 = Data(panel_12)
canopy_4_rotation_2 = Data(radians_3)
canopy_5_rotation_3 = Data(radians_4)

# ---- group: Fabricated sections not pushing
number_slider_7 = Slider(0.02, range=0..0.1)
number_slider_8 = Slider(0.4, range=0..1)
fabricatedsteelboxsection = FabricatedSteelBoxSection(
    Height=number_slider_8,
    Width=number_slider_8,
    WebThickness=number_slider_7,
    FlangeThickness=number_slider_7,
    WeldSize=0,
    Name="SHS 400x400x16",
    Component="{ .FabricatedSteelBoxSection")

# ----
# Initial Information
edge_radius = Data(division_6)
opening_radius = Data(division_5)
primary_ring_radius = Data(division_4)
max_truss_depth = Data(unit_z)
min_truss_depth = Data(unit_z_2)
no_of_polygon_sides = Data(number_slider_6)
no_primary_ring_bays = Data(Slider(2, range=0..4))
no_opening_ring_bays = Data(number_slider)
no_secondary_ring_bays = Data(Slider(4, range=0..4))
# Look into having this position optimised
no_radial_members_opening_primary = Data(number_slider_4)
no_radial_members_secondary_edge = Data(Slider(2, range=0..10))
no_radial_members_primary_secondary = Data(number_slider_5)

# ----
# Define Ring Radius and Radial Bay Spacing
no_radial_members_primary_secondary_2 = Data(no_radial_members_primary_secondary)
edge_radius_2 = Data(edge_radius)
primary_ring_radius_2 = Data(primary_ring_radius)
opening_radius_2 = Data(opening_radius)
multiplication = Multiplication(A=no_radial_members_primary_secondary_2, B="2")
primary_ring_radius_3 = Data(primary_ring_radius)
subtraction = Subtraction(A=primary_ring_radius_2, B=opening_radius_2)
no_radial_members_opening_primary_2 = Data(no_radial_members_opening_primary)
addition = Addition(A=primary_ring_radius_3, B=multiplication)
secondary_ring_radius = Data(addition)
subtraction_2 = Subtraction(A=edge_radius_2, B=secondary_ring_radius)
division_7 = Division(A=subtraction, B=no_radial_members_opening_primary_2)
panel_13 = Panel(addition)
radial_truss_spacing = Panel(division_7)
secondary_ring_radius_2 = Data(addition)
determined_main_radial_bay_spacing = Data(division_7)
determined_main_radial_bay_spacing_2 = Data(determined_main_radial_bay_spacing)
determined_main_radial_bay_spacing_3 = Data(determined_main_radial_bay_spacing)
integer_division = IntegerDivision(A=subtraction_2, B=determined_main_radial_bay_spacing_3)
division_8 = Division(A=subtraction_2, B=determined_main_radial_bay_spacing_3)
note_of_actual_division = Panel(division_8)
determined_main_radial_bay_spacing_4 = Data(determined_main_radial_bay_spacing)
multiplication_2 = Multiplication(A=determined_main_radial_bay_spacing_4, B=integer_division)
panel_14 = Panel(multiplication_2)
subtraction_3 = Subtraction(A=subtraction_2, B=multiplication_2)
determined_main_radial_bay_spacing_5 = Data(determined_main_radial_bay_spacing)
ghpython_script = GhPythonScript(x=subtraction_3, y=determined_main_radial_bay_spacing_5)  # -> out, a
# ---------- ghpython_script: Python ----------
if x > 0:
    a = x
else:
    a = y

import rhinoscriptsyntax as rs
# ---------- end ghpython_script ----------
panel_15 = Panel(ghpython_script.a)
end_radial_bay_spacing = Data(ghpython_script.a)

# ---- group: Background
no_of_polygon_sides_2 = Data(no_of_polygon_sides)
no_of_polygon_sides_3 = Data(no_of_polygon_sides)
secondary_ring_radius_3 = Data(secondary_ring_radius_2)
edge_radius_3 = Data(edge_radius)
no_of_polygon_sides_4 = Data(no_of_polygon_sides)
opening_radius_3 = Data(opening_radius)
primary_ring_radius_4 = Data(primary_ring_radius)
no_of_polygon_sides_5 = Data(no_of_polygon_sides)
polygon = Polygon(Plane=PlaneXY(0, 0, 0), Radius=edge_radius_3, Segments=no_of_polygon_sides_2, FilletRadius=0)  # -> Polygon, Length
polygon_2 = Polygon(Plane=PlaneXY(0, 0, 0), Radius=opening_radius_3, Segments=no_of_polygon_sides_3, FilletRadius=0)  # -> Polygon, Length
polygon_3 = Polygon(Plane=PlaneXY(0, 0, 0), Radius=secondary_ring_radius_3, Segments=no_of_polygon_sides_4, FilletRadius=0)  # -> Polygon, Length
polygon_4 = Polygon(Plane=PlaneXY(0, 0, 0), Radius=primary_ring_radius_4, Segments=no_of_polygon_sides_5, FilletRadius=0)  # -> Polygon, Length
edge_polygon = Data(polygon.Polygon)
primary_polygon = Data(polygon_4.Polygon)
secondary_polygon = Data(polygon_3.Polygon)
opening_polygon = Data(polygon_2.Polygon)
explode = Explode(Curve=polygon_2.Polygon, Recursive=True)  # -> Segments, Vertices
explode_2 = Explode(Curve=polygon_4.Polygon, Recursive=True)  # -> Segments, Vertices
explode_3 = Explode(Curve=polygon_3.Polygon, Recursive=True)  # -> Segments, Vertices
explode_4 = Explode(Curve=polygon.Polygon, Recursive=True)  # -> Segments, Vertices
cull_index = CullIndex(List=explode_4.Vertices, Indices=-1, Wrap=True)
cull_index_2 = CullIndex(List=explode.Vertices, Indices=-1, Wrap=True)
cull_index_3 = CullIndex(List=explode_2.Vertices, Indices=-1, Wrap=True)
cull_index_4 = CullIndex(List=explode_3.Vertices, Indices=-1, Wrap=True)
canopy_edge_points = Data(cull_index)
primary_ring_top = Data(explode_2.Segments)
primary_ring_points = Data(cull_index_3)
secondary_ring_top = Data(explode_3.Segments)
canopy_opening_top = Data(explode.Segments)
secondary_ring_points = Data(cull_index_4)
canopy_opening_points = Data(cull_index_2)

# ----
opening_polygon_2 = Data(polygon_2.Polygon)
edge_polygon_2 = Data(polygon.Polygon)
canopy_opening_points_2 = Data(canopy_opening_points)
canopy_edge_points_2 = Data(canopy_edge_points)
panel_16 = Panel(
    Outlines=[edge_polygon_2, opening_polygon_2],
    Tolerance=1e-06,
    Component="{ \"SelectedItem\" : null, \"InputParams\" : [], \"OutputParams\" : [], \"BHoM_Guid\" : \"2afee7f6-46f4-45fb-8964-ab6e882246b8\", \"_bhomVersion\" : \"6.0\" }")
line_2 = Line(StartPoint=canopy_opening_points_2, EndPoint=canopy_edge_points_2)
surface_split = SurfaceSplit(Surface=panel_16, Curves=line_2)
canopy_panel = Data(surface_split)

no_radial_members_secondary_edge_2 = Data(no_radial_members_secondary_edge)

# ----
# Panel
canopy_panel_2 = Data(canopy_panel)

# ---- group: Points on Radial Trusses
canopy_edge_points_3 = Data(explode_4.Vertices)
primary_ring_points_2 = Data(explode_2.Vertices)
secondary_ring_points_2 = Data(explode_3.Vertices)
canopy_opening_points_3 = Data(explode.Vertices)

# ----
# Panel
canopy_panel_3 = Data(canopy_panel)

# ----
# Columns - look into extracting location from etabs
panel_17 = Panel("""True
False
False
False""")

# ----
# Radial Diagonals
# Ring Truss Diagonals
# Opening Truss
# Opening Truss
# Need to make more responsive to parametric changes
# Primary Truss
# Primary Truss
# Secondary Truss
# Secondary Truss
number_slider_9 = Slider(1, range=0..1)
no_radial_members_opening_primary_3 = Data(number_slider_4)
number_slider_10 = Slider(2, range=0..3)
addition_2 = Addition(A=no_radial_members_opening_primary_3, B=number_slider_9)
number_slider_11 = Slider(3, range=0..5)
number_slider_12 = Slider(3, range=0..5)
number_slider_13 = Slider(2, range=0..3)
panel_18 = Panel("""False
True""")
series = Series(Start=number_slider_10, Step=number_slider_10, Count=2)
series_2 = Series(Start=number_slider_13, Step=number_slider_13, Count=2)
no_radial_members_primary_secondary_3 = Data(number_slider_5)

# ---- group: Background
canopy_edge_points_4 = Data(canopy_edge_points)
canopy_opening_points_4 = Data(canopy_opening_points)
min_truss_depth_2 = Data(min_truss_depth)
max_truss_depth_2 = Data(max_truss_depth)
move = Move(Geometry=canopy_edge_points_4, Motion=min_truss_depth_2)  # -> Geometry, Transform
move_2 = Move(Geometry=canopy_opening_points_4, Motion=max_truss_depth_2)  # -> Geometry, Transform
edge_bottom_points = Data(move.Geometry)
opening_ring_bottom_points = Data(move_2.Geometry)
line_3 = Line(StartPoint=opening_ring_bottom_points, EndPoint=edge_bottom_points)
unit_z_3 = UnitZ(Factor="-1")

# ----
# Define Horizontal Bracing
canopy_edge_points_5 = Data(canopy_edge_points_3)
primary_ring_points_3 = Data(primary_ring_points_2)
secondary_ring_points_3 = Data(secondary_ring_points_2)
shift_list = ShiftList(List=secondary_ring_points_3, Shift=1, Wrap=True)
line_4 = Line(StartPoint=shift_list, EndPoint=canopy_edge_points_5)
line_5 = Line(StartPoint=primary_ring_points_3, EndPoint=shift_list)
panel_19 = Panel("""True
False""")
panel_20 = Panel("""True
False""")
shift_list_2 = ShiftList(List=secondary_ring_points_3, Shift=-1, Wrap=True)
cull_index_5 = CullIndex(List=line_5, Indices=-1, Wrap=True)
cull_pattern = CullPattern(List=line_4, CullPattern=panel_19)
line_6 = Line(StartPoint=shift_list_2, EndPoint=canopy_edge_points_5)
line_7 = Line(StartPoint=primary_ring_points_3, EndPoint=shift_list_2)
panel_21 = Panel("""False
True""")
cull_index_6 = CullIndex(List=line_7, Indices=0, Wrap=True)
panel_22 = Panel("""False
True""")
cull_pattern_2 = CullPattern(List=line_6, CullPattern=panel_21)
primary_to_secondary_hz_bracing_top = Line([cull_index_5, cull_index_6])

point_list = PointList(Points=shift_list, Size=Slider(1, range=0..1))
cull_index_7 = CullIndex(List=cull_pattern, Indices=-1, Wrap=True)

# ----
# Columns - look into extracting location from etabs
panel_23 = Panel("""True
False
False
False
False
False
False
False""")

canopy_opening_points_5 = Data(canopy_opening_points)
canopy_edge_points_6 = Data(canopy_edge_points)
line_8 = Line(StartPoint=canopy_opening_points_5, EndPoint=canopy_edge_points_6)

# ----
# Top & Bottom Chords
boolean_toggle = BooleanToggle(False)
no_radial_members_opening_primary_4 = Data(number_slider_4)
no_radial_members_opening_primary_5 = Data(number_slider_4)
no_radial_members_primary_secondary_4 = Data(number_slider_5)
no_radial_members_primary_secondary_5 = Data(number_slider_5)

# ----
# Bottom Chord
# Radial Bottom Chord
# Ring Bottom Chords
# Currently has duplicated points at ring beams - might be useful further on so keep for now.
radial_bottom_chord = Line(line_3)
no_radial_members_primary_secondary_6 = Data(number_slider_5)
no_radial_members_opening_primary_6 = Data(number_slider_4)
opening_ring_bottom_points_2 = Data(move_2.Geometry)
canopy_edge_bottom_points = Data(move.Geometry)
no_radial_members_opening_primary_7 = Data(number_slider_4)
addition_3 = Addition(A=no_radial_members_opening_primary_6, B=no_radial_members_primary_secondary_6)
polyline = PolyLine(Vertices=canopy_edge_bottom_points, Closed=Toggle(True))
polyline_2 = PolyLine(Vertices=opening_ring_bottom_points_2, Closed=Toggle(True))
no_of_polygon_sides_6 = Data(no_of_polygon_sides)
no_of_polygon_sides_7 = Data(no_of_polygon_sides)
explode_5 = Explode(Curve=polyline, Recursive=True)  # -> Segments, Vertices
explode_6 = Explode(Curve=polyline_2, Recursive=True)  # -> Segments, Vertices
canopy_edge_bottom = Data(explode_5.Segments)
canopy_opening_bottom = Data(explode_6.Segments)

# ----
# Define Horizontal Bracing
panel_24 = Panel("""True
False""")
panel_25 = Panel("""True
False""")
panel_26 = Panel("""False
True""")
panel_27 = Panel("""False
True""")

# ----
# Diagonals
planesrf = PlaneSurface(Plane=PlaneXY(0, 0, 0), XSize=Domain(-10, 10), YSize=Domain(-10, 10))

# ---- group: Taper Top & Bottom
# Verticals
planesrf_2 = PlaneSurface(Plane=PlaneXY(0, 0, 0), XSize=Domain(-10, 10), YSize=Domain(-10, 10))
no_radial_members_opening_primary_8 = Data(number_slider_4)
subtraction_4 = Subtraction(A=no_radial_members_opening_primary_8, B="1")
no_radial_members_primary_secondary_7 = Data(number_slider_5)
subtraction_5 = Subtraction(A=no_radial_members_primary_secondary_7, B="1")

# ----
# Top Chord
# Ring Top Chords
# Radial Top Chord
# Currently has duplicated points at ring beams
# - might be useful further on so keep for now.
# Duplicated removed at next stage.
primary_ring_points_4 = Data(primary_ring_points)
canopy_edge_points_7 = Data(canopy_edge_points)
secondary_ring_points_4 = Data(secondary_ring_points)
canopy_opening_points_6 = Data(canopy_opening_points)
line_9 = Line(StartPoint=canopy_opening_points_6, EndPoint=primary_ring_points_4)
line_10 = Line(StartPoint=primary_ring_points_4, EndPoint=secondary_ring_points_4)
line_11 = Line(StartPoint=secondary_ring_points_4, EndPoint=canopy_edge_points_7)
determined_main_radial_bay_spacing_6 = Data(determined_main_radial_bay_spacing)
determined_main_radial_bay_spacing_7 = Data(determined_main_radial_bay_spacing)
divide_distance = DivideDistance(Curve=line_9, Distance=determined_main_radial_bay_spacing_6)  # -> Points, Tangents, Parameters
divide_distance_2 = DivideDistance(Curve=line_10, Distance="2")  # -> Points, Tangents, Parameters
polyline_3 = PolyLine(Vertices=divide_distance.Points, Closed=False)
polyline_4 = PolyLine(Vertices=divide_distance_2.Points, Closed=False)
explode_7 = Explode(Curve=polyline_3, Recursive=True)  # -> Segments, Vertices
explode_8 = Explode(Curve=polyline_4, Recursive=True)  # -> Segments, Vertices
opening_to_primary_top = Line(explode_7.Segments)
primary_to_secondary_top = Line(explode_8.Segments)

divide_curve = DivideCurve(Curve=line_11, Count=no_radial_members_secondary_edge_2, Kinks=False)  # -> Points, Tangents, Parameters

polyline_5 = PolyLine(Vertices=divide_curve.Points, Closed=False)
explode_9 = Explode(Curve=polyline_5, Recursive=True)  # -> Segments, Vertices
secondary_to_edge_top = Line(explode_9.Segments)
radial_truss_top_chord = Line([opening_to_primary_top, primary_to_secondary_top, secondary_to_edge_top])

# ---- group: Background (continued)
top_radial_points = Data([explode_7.Vertices, explode_8.Vertices, explode_9.Vertices])
project_point = ProjectPoint(Point=top_radial_points, Direction=unit_z_3, Geometry=radial_bottom_chord)  # -> Point, Index
bottom_radial_points = Point(project_point.Point)

# ----
opening_to_primary_top_points = Data(explode_7.Vertices)
primary_to_secondary_top_points = Data(explode_8.Vertices)
secondary_to_edge_top_points = Data(explode_9.Vertices)

# ----
# Radial Verticals
# Radial
# Ring Verticals
# Opening Truss
# Primary Truss
# Secondary Truss
top_radial_points_2 = Data(top_radial_points)
bottom_radial_points_2 = Point(bottom_radial_points)
cull_duplicates = CullDuplicates(Points=top_radial_points_2, Tolerance=0.1, CullMode=3)  # -> Points, Indices, Valence
cull_duplicates_2 = CullDuplicates(Points=bottom_radial_points_2, Tolerance=0.1, CullMode=3)  # -> Points, Indices, Valence
top_radial_points_no_duplicates = Point(cull_duplicates.Points)
bottom_radial_points_no_duplicates = Point(cull_duplicates_2.Points)
line_12 = Line(StartPoint=cull_duplicates.Points, EndPoint=cull_duplicates_2.Points)
all_radial_verticals = Data(line_12)
no_radial_members_primary_secondary_8 = Data(number_slider_5)
no_radial_members_opening_primary_9 = Data(number_slider_4)
no_radial_members_opening_primary_10 = Data(number_slider_4)
addition_4 = Addition(A=no_radial_members_opening_primary_9, B=no_radial_members_primary_secondary_8)
data = Data(["0", no_radial_members_opening_primary_10, addition_4])
cull_index_8 = CullIndex(List=all_radial_verticals, Indices=data, Wrap=True)
radial_verticals = Data(cull_index_8)

all_radial_verticals_2 = Data(line_12)
panel_28 = Panel(addition_4)

# ---- group: Taper Top & Bottom (continued)
# Correct Taper
radial_verticals_2 = Data(cull_index_8)

# ----
bottom_radial_points_3 = Point(cull_duplicates_2.Points)
opening_to_primary_top_points_2 = Data(explode_7.Vertices)
split_list = SplitList(List=bottom_radial_points_3, Index=addition_2)  # -> ListA, ListB
primary_to_secondary_top_points_2 = Data(explode_8.Vertices)
secondary_to_edge_top_points_2 = Data(explode_9.Vertices)
shift_list_3 = ShiftList(List=opening_to_primary_top_points_2, Shift=1, Wrap=Toggle(False))
radial_bottom_points_after_primary = Data(split_list.ListB)
cull_index_9 = CullIndex(List=secondary_to_edge_top_points_2, Indices=-1, Wrap=True)
split_list_2 = SplitList(List=radial_bottom_points_after_primary, Index=no_radial_members_primary_secondary_3)  # -> ListA, ListB
radial_bottom_points_secondary_to_edge = Data(split_list_2.ListB)
radial_bottom_points_secondary_to_edge_2 = Data(radial_bottom_points_secondary_to_edge)
line_13 = Line(StartPoint=cull_index_9, EndPoint=radial_bottom_points_secondary_to_edge_2)
radial_bottom_points_primary_to_secondar = Data(split_list_2.ListA)  # "Radial Bottom Points - Primary to Secondary"
radial_bottom_points_primary_to_secondar_2 = Data(radial_bottom_points_primary_to_secondar)  # "Radial Bottom Points - Primary to Secondary"
radial_diagonals_secondary_to_edge = Line(line_13)

cull_index_10 = CullIndex(List=primary_to_secondary_top_points_2, Indices=-1, Wrap=True)
cull_index_11 = CullIndex(List=split_list.ListA, Indices=-1, Wrap=True)

line_14 = Line(StartPoint=shift_list_3, EndPoint=cull_index_11)
line_15 = Line(StartPoint=cull_index_10, EndPoint=radial_bottom_points_primary_to_secondar_2)
radial_diagonals_opening_to_primary = Line(line_14)
radial_diagonals_primary_to_secondary = Line(line_15)

secondary_to_edge_hz_bracing_top = Line([cull_pattern_2, cull_index_7])

radial_verticals_3 = Data(all_radial_verticals)
radial_verticals_4 = Data(all_radial_verticals)
length_2 = Length(Curve=radial_verticals_3)
length_3 = Length(Curve=radial_verticals_4)
list_item = ListItem(List=length_2, Index=addition_3, Wrap=True)  # -> flatten(Item)
list_item_2 = ListItem(List=length_3, Index=no_radial_members_opening_primary_7, Wrap=True)  # -> flatten(Item)

list_item_3 = ListItem(List=list_item, Index=0, Wrap=True)
list_item_4 = ListItem(List=list_item_2, Index=0, Wrap=True)

negative_3 = Negative(Value=list_item_3)
negative_4 = Negative(Value=list_item_4)
unit_z_4 = UnitZ(Factor=negative_3)
unit_z_5 = UnitZ(Factor=negative_4)
polygon_5 = Polygon(Plane=unit_z_4, Radius=secondary_ring_radius_2, Segments=no_of_polygon_sides_6, FilletRadius=0)  # -> Polygon, Length
polygon_6 = Polygon(Plane=unit_z_5, Radius=primary_ring_radius, Segments=no_of_polygon_sides_7, FilletRadius=0)  # -> Polygon, Length
explode_10 = Explode(Curve=polygon_6.Polygon, Recursive=True)  # -> Segments, Vertices
explode_11 = Explode(Curve=polygon_5.Polygon, Recursive=True)  # -> Segments, Vertices
primary_ring_bottom = Data(explode_10.Segments)
secondary_ring_bottom = Data(explode_11.Segments)
secondary_ring_bottom_points = Data(explode_11.Vertices)
primary_ring_bottom_points = Data(explode_10.Vertices)

# ---- group: Points on Radial Trusses
primary_ring_bottom_points_2 = Data(explode_10.Vertices)
opening_ring_bottom_points_3 = Data(move_2.Geometry)
canopy_edge_bottom_points_2 = Data(move.Geometry)
secondary_ring_bottom_points_2 = Data(explode_11.Vertices)

# ----
primary_ring_bottom_points_3 = Data(primary_ring_bottom_points_2)
canopy_edge_bottom_points_3 = Data(canopy_edge_bottom_points_2)
secondary_ring_bottom_points_3 = Data(secondary_ring_bottom_points_2)
shift_list_4 = ShiftList(List=secondary_ring_bottom_points_3, Shift=1, Wrap=True)
line_16 = Line(StartPoint=shift_list_4, EndPoint=canopy_edge_bottom_points_3)
line_17 = Line(StartPoint=primary_ring_bottom_points_3, EndPoint=shift_list_4)
cull_index_12 = CullIndex(List=line_17, Indices=-1, Wrap=True)
shift_list_5 = ShiftList(List=secondary_ring_bottom_points_3, Shift=-1, Wrap=True)
cull_pattern_3 = CullPattern(List=line_16, CullPattern=panel_20)
line_18 = Line(StartPoint=primary_ring_bottom_points_3, EndPoint=shift_list_5)
line_19 = Line(StartPoint=shift_list_5, EndPoint=canopy_edge_bottom_points_3)
cull_index_13 = CullIndex(List=cull_pattern_3, Indices=-1, Wrap=True)
cull_index_14 = CullIndex(List=line_18, Indices=0, Wrap=True)
cull_pattern_4 = CullPattern(List=line_19, CullPattern=panel_22)
secondary_to_edge_hz_bracing_top_2 = Line([cull_pattern_4, cull_index_13])
primary_to_secondary_hz_bracing_bottom = Line([cull_index_12, cull_index_14])

# ----
# HZ Bracing Results
secondary_to_edge_hz_bracing_top_3 = Line(secondary_to_edge_hz_bracing_top)
secondary_to_edge_hz_bracing_top_4 = Line(secondary_to_edge_hz_bracing_top_2)
primary_to_secondary_hz_bracing_top_2 = Line(primary_to_secondary_hz_bracing_top)
primary_to_secondary_hz_bracing_bottom_2 = Line(primary_to_secondary_hz_bracing_bottom)

# ----
# Bottom Chord Results
radial_bottom_chord_2 = Line(line_3)
primary_ring_bottom_2 = Data(explode_10.Segments)
secondary_ring_bottom_2 = Data(explode_11.Segments)
canopy_opening_bottom_2 = Data(explode_6.Segments)

# ----
# Split Ring Trusses
no_opening_ring_bays_2 = Data(no_opening_ring_bays)
canopy_opening_top_2 = Data(explode.Segments)
canopy_opening_bottom_3 = Data(canopy_opening_bottom)
no_primary_ring_bays_2 = Data(no_primary_ring_bays)
no_secondary_ring_bays_2 = Data(no_secondary_ring_bays)
primary_ring_bottom_3 = Data(primary_ring_bottom_2)
primary_ring_top_2 = Data(explode_2.Segments)
secondary_ring_top_2 = Data(explode_3.Segments)
secondary_ring_bottom_3 = Data(secondary_ring_bottom_2)
divide_curve_2 = DivideCurve(Curve=secondary_ring_top_2, Count=no_secondary_ring_bays_2, Kinks=False)  # -> Points, Tangents, Parameters
divide_curve_3 = DivideCurve(Curve=canopy_opening_top_2, Count=no_opening_ring_bays_2, Kinks=False)  # -> Points, Tangents, Parameters
divide_curve_4 = DivideCurve(Curve=secondary_ring_bottom_3, Count=no_secondary_ring_bays_2, Kinks=False)  # -> Points, Tangents, Parameters
divide_curve_5 = DivideCurve(Curve=canopy_opening_bottom_3, Count=no_opening_ring_bays_2, Kinks=False)  # -> Points, Tangents, Parameters
divide_curve_6 = DivideCurve(Curve=primary_ring_top_2, Count=no_primary_ring_bays_2, Kinks=False)  # -> Points, Tangents, Parameters
divide_curve_7 = DivideCurve(Curve=primary_ring_bottom_3, Count=no_primary_ring_bays_2, Kinks=False)  # -> Points, Tangents, Parameters
polyline_6 = PolyLine(Vertices=divide_curve_2.Points, Closed=False)
polyline_7 = PolyLine(Vertices=divide_curve_3.Points, Closed=False)
polyline_8 = PolyLine(Vertices=divide_curve_4.Points, Closed=False)
polyline_9 = PolyLine(Vertices=divide_curve_5.Points, Closed=False)
polyline_10 = PolyLine(Vertices=divide_curve_6.Points, Closed=False)
polyline_11 = PolyLine(Vertices=divide_curve_7.Points, Closed=False)
explode_12 = Explode(Curve=polyline_6, Recursive=True)  # -> Segments, Vertices
explode_13 = Explode(Curve=polyline_7, Recursive=True)  # -> Segments, Vertices
explode_14 = Explode(Curve=polyline_8, Recursive=True)  # -> Segments, Vertices
explode_15 = Explode(Curve=polyline_9, Recursive=True)  # -> Segments, Vertices
explode_16 = Explode(Curve=polyline_10, Recursive=True)  # -> Segments, Vertices
explode_17 = Explode(Curve=polyline_11, Recursive=True)  # -> Segments, Vertices
opening_truss_top_chord = Line(explode_13.Segments)
opening_truss_top_points = Data(explode_13.Vertices)
opening_truss_bottom_chord = Line(explode_15.Segments)
primary_truss_top_chord = Line(explode_16.Segments)
opening_truss_bottom_points = Data(explode_15.Vertices)
primary_truss_top_points = Data(explode_16.Vertices)
secondary_truss_top_chord = Line(explode_12.Segments)
secondary_truss_top_points = Data(explode_12.Vertices)
primary_truss_bottom_chord = Line(explode_17.Segments)
primary_truss_bottom_points = Data(explode_17.Vertices)
secondary_truss_bottom_chord = Line(explode_14.Segments)
secondary_truss_bottom_points = Data(explode_14.Vertices)

point_list_2 = PointList(Points=[explode_15.Vertices, explode_13.Vertices], Size=Slider(0, range=0..1))

# ----
# Geometry Results
# Top Chord Points Results
top_radial_points_3 = Data(cull_duplicates.Points)
primary_truss_top_points_2 = Data(explode_16.Vertices)
opening_truss_top_points_2 = Data(explode_13.Vertices)
secondary_truss_top_points_2 = Data(explode_12.Vertices)
opening_to_primary_top_points_3 = Data(explode_7.Vertices)
secondary_to_edge_top_points_3 = Data(explode_9.Vertices)
primary_to_secondary_top_points_3 = Data(explode_8.Vertices)
top_radial_points_no_duplicates_2 = Point(top_radial_points_no_duplicates)

# ----
# Bottom Chord Points Results
bottom_radial_points_4 = Point(cull_duplicates_2.Points)
primary_truss_bottom_points_2 = Data(explode_17.Vertices)
opening_truss_bottom_points_2 = Data(explode_15.Vertices)
secondary_truss_bottom_points_2 = Data(explode_14.Vertices)
bottom_radial_points_no_duplicates_2 = Point(bottom_radial_points_no_duplicates)

opening_truss_top_points_3 = Data(opening_truss_top_points_2)
opening_truss_bottom_points_3 = Data(opening_truss_bottom_points_2)
primary_truss_bottom_points_3 = Data(primary_truss_bottom_points_2)
primary_truss_top_points_3 = Data(primary_truss_top_points_2)
secondary_truss_top_points_3 = Data(secondary_truss_top_points_2)
secondary_truss_bottom_points_3 = Data(secondary_truss_bottom_points_2)
cull_duplicates_3 = CullDuplicates(Points=flatten(opening_truss_bottom_points_3), Tolerance=0.1, CullMode=3)  # -> graft(Points), Indices, Valence
cull_duplicates_4 = CullDuplicates(Points=flatten(opening_truss_top_points_3), Tolerance=0.1, CullMode=3)  # -> graft(Points), Indices, Valence
cull_duplicates_5 = CullDuplicates(Points=flatten(secondary_truss_bottom_points_3), Tolerance=0.1, CullMode=3)  # -> graft(Points), Indices, Valence
cull_duplicates_6 = CullDuplicates(Points=flatten(secondary_truss_top_points_3), Tolerance=0.1, CullMode=3)  # -> graft(Points), Indices, Valence
cull_duplicates_7 = CullDuplicates(Points=flatten(primary_truss_bottom_points_3), Tolerance=0.1, CullMode=3)  # -> graft(Points), Indices, Valence
cull_duplicates_8 = CullDuplicates(Points=flatten(primary_truss_top_points_3), Tolerance=0.1, CullMode=3)  # -> graft(Points), Indices, Valence
line_20 = Line(StartPoint=cull_duplicates_4.Points, EndPoint=cull_duplicates_3.Points)
line_21 = Line(StartPoint=cull_duplicates_6.Points, EndPoint=cull_duplicates_5.Points)
line_22 = Line(StartPoint=cull_duplicates_8.Points, EndPoint=cull_duplicates_7.Points)
opening_truss_vertical_members = Line(line_20)
primary_truss_vertical_members = Line(line_22)
secondary_truss_vertical_members = Line(line_21)

primary_truss_top_points_4 = Data(primary_truss_top_points_2)
primary_truss_bottom_points_4 = Data(primary_truss_bottom_points_2)
secondary_truss_top_points_4 = Data(secondary_truss_top_points_2)
secondary_truss_bottom_points_4 = Data(secondary_truss_bottom_points_2)
opening_truss_top_points_4 = Data(opening_truss_top_points_2)
opening_truss_bottom_points_4 = Data(opening_truss_bottom_points_2)
list_length = ListLength(List=secondary_truss_bottom_points_4)
list_length_2 = ListLength(List=primary_truss_bottom_points_4)
cull_pattern_5 = CullPattern(List=opening_truss_top_points_4, CullPattern=panel_18)
cull_index_15 = CullIndex(List=opening_truss_bottom_points_4, Indices=1, Wrap=True)
division_9 = Division(A=list_length, B=number_slider_11)
division_10 = Division(A=list_length_2, B=number_slider_12)
line_23 = Line(StartPoint=cull_pattern_5, EndPoint=cull_index_15)
series_3 = Series(Start=number_slider_11, Step=number_slider_11, Count=division_9)
series_4 = Series(Start=number_slider_12, Step=number_slider_12, Count=division_10)
list_item_5 = ListItem(List=secondary_truss_bottom_points_4, Index=series_3, Wrap=Toggle(True))
list_item_6 = ListItem(List=primary_truss_bottom_points_4, Index=series_4, Wrap=Toggle(True))
list_item_7 = ListItem(List=secondary_truss_top_points_4, Index=series, Wrap=Toggle(True))
data_2 = Data(list_item_5)
data_3 = Data(list_item_6)
list_item_8 = ListItem(List=primary_truss_top_points_4, Index=series_2, Wrap=Toggle(True))
data_4 = Data(list_item_7)
data_5 = Data(list_item_8)
list_item_9 = ListItem(List=data_5, Index=1, Wrap=True)
list_item_10 = ListItem(List=data_3, Index=1, Wrap=True)
sort_points = SortPoints(Points=list_item_10)  # -> Points, Indices
list_item_11 = ListItem(List=data_4, Index=1, Wrap=True)
list_item_12 = ListItem(List=data_2, Index=1, Wrap=True)
sort_points_2 = SortPoints(Points=list_item_9)  # -> Points, Indices
line_24 = Line(StartPoint=list_item_9, EndPoint=list_item_10)
explode_tree = ExplodeTree(Data=list_item_10)  # -> _00000, _00100, _00200, _00300, _00400, _00500, _00600, _00700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
# Need to adjust this when bays in
# Primary ring turss >2
explode_tree_2 = ExplodeTree(Data=list_item_9)  # -> _0000, _0010, _0020, _0030, _0040, _0050, _0060, _0070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
explode_tree_3 = ExplodeTree(Data=list_item_12)  # -> _00000, _00100, _00200, _00300, _00400, _00500, _00600, _00700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
explode_tree_4 = ExplodeTree(Data=list_item_11)  # -> _0000, _0010, _0020, _0030, _0040, _0050, _0060, _0070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
point = Point([explode_tree_2._0010, explode_tree_2._0020, explode_tree_2._0030, explode_tree_2._0040, explode_tree_2._0050, explode_tree_2._0060, explode_tree_2._0070, explode_tree_2._0080, explode_tree_2._0090, explode_tree_2._00100, explode_tree_2._0000])
point_2 = Point([explode_tree._00100, explode_tree._00200, explode_tree._00300, explode_tree._00400, explode_tree._00500, explode_tree._00600, explode_tree._00700, explode_tree._00800, explode_tree._00900, explode_tree._001000, explode_tree._001100])
point_3 = Point([explode_tree_4._0010, explode_tree_4._0020, explode_tree_4._0030, explode_tree_4._0040, explode_tree_4._0050, explode_tree_4._0060, explode_tree_4._0070, explode_tree_4._0080, explode_tree_4._0090, explode_tree_4._00100, explode_tree_4._0000])
point_4 = Point([explode_tree_3._00100, explode_tree_3._00200, explode_tree_3._00300, explode_tree_3._00400, explode_tree_3._00500, explode_tree_3._00600, explode_tree_3._00700, explode_tree_3._00800, explode_tree_3._00900, explode_tree_3._001000, explode_tree_3._001100])
line_25 = Line(StartPoint=explode_tree_2._00110, EndPoint=explode_tree._00000)
line_26 = Line(StartPoint=point, EndPoint=point_2)
line_27 = Line(StartPoint=explode_tree_4._00110, EndPoint=explode_tree_3._00000)
line_28 = Line(StartPoint=point_3, EndPoint=point_4)
insert_items = InsertItems(List=data_2, Item=data_4, Indices=1, Wrap=Toggle(True))
insert_items_2 = InsertItems(List=data_3, Item=data_5, Indices=1, Wrap=Toggle(False))
data_6 = Data(insert_items)
data_7 = Data(insert_items_2)
sort_points_3 = SortPoints(Points=data_6)  # -> Points, Indices
sort_points_4 = SortPoints(Points=data_7)  # -> Points, Indices
polyline_12 = PolyLine(Vertices=sort_points_3.Points, Closed=False)
polyline_13 = PolyLine(Vertices=sort_points_4.Points, Closed=False)
explode_18 = Explode(Curve=polyline_12, Recursive=True)  # -> Segments, Vertices
explode_19 = Explode(Curve=polyline_13, Recursive=True)  # -> Segments, Vertices
opening_truss_diagonals = Line(line_23)
primary_truss_diagonals = Line([line_28, line_27, explode_18.Segments])
primary_truss_diagonals_2 = Line([line_24, line_25, line_26])

# ---- group: Taper Top & Bottom (continued)
secondary_truss_vertical_members_2 = Line(line_21)
opening_truss_vertical_members_2 = Line(line_20)
primary_truss_vertical_members_2 = Line(line_22)
entwine = Entwine(
    Branch0X=radial_verticals_2,
    Branch1X=opening_truss_vertical_members_2,
    Branch2X=primary_truss_vertical_members_2,
    Branch3X=secondary_truss_vertical_members_2,
    Branch4X=all_radial_verticals_2,
    FlattenInputs=False)  # -> simplify(Result)
curve_middle = CurveMiddle(Curve=entwine)
pt = Point(curve_middle)
project = Project(Geometry=pt, Plane=planesrf_2)  # -> Geometry, Transform
vec2pt = Vector2Pt(PointA=pt, PointB=project.Geometry, Unitize=False)  # -> Vector, Length
move_3 = Move(Geometry=entwine, Motion=vec2pt.Vector)  # -> Geometry, Transform
centered_verticals = Geometry(move_3.Geometry)
split_tree = SplitTree(Data=centered_verticals, Masks=flatten("{4;*;*}"))  # -> Positive, Negative
split_tree_2 = SplitTree(Data=centered_verticals, Masks=flatten("{0;*;*}"))  # -> Positive, Negative
split_tree_3 = SplitTree(Data=centered_verticals, Masks=flatten("{1;*;*}"))  # -> Positive, Negative
split_tree_4 = SplitTree(Data=centered_verticals, Masks=flatten("{3;*;*}"))  # -> Positive, Negative
split_tree_5 = SplitTree(Data=centered_verticals, Masks=flatten("{2;*;*}"))  # -> Positive, Negative
centered_radial_verticals = Data(simplify(split_tree_2.Positive))
centered_opening_truss_vertical_members = Line(simplify(split_tree_3.Positive))
centered_primary_truss_vertical_members = Line(simplify(split_tree_5.Positive))
centered_secondary_truss_vertical_member = Line(simplify(split_tree_4.Positive))  # "Centered Secondary Truss Vertical Members"
split_list_3 = SplitList(List=centered_radial_verticals, Index=subtraction_4)  # -> ListA, ListB
vertical_after_primary = Line(split_list_3.ListB)
split_list_4 = SplitList(List=vertical_after_primary, Index=subtraction_5)  # -> ListA, ListB
between_secondary_and_edge = Data(split_list_4.ListB)
between_primary_and_secondary = Data(split_list_4.ListA)

# ----
# Column Height
centered_primary_truss_vertical_members_2 = Line(simplify(split_tree_5.Positive))
list_item_13 = ListItem(List=flatten(centered_primary_truss_vertical_members_2), Index=0, Wrap=True)
length_4 = Length(Curve=list_item_13)
division_11 = Division(A=length_4, B="2")
subtraction_6 = Subtraction(A=division_3, B=division_11)

column_height = Data(subtraction_6)

primary_ring_bottom_points_4 = Data(explode_10.Vertices)
cull_pattern_6 = CullPattern(List=primary_ring_bottom_points_4, CullPattern=panel_17)
column_height_2 = Data(column_height)
line_sdl = LineSDL(Start=cull_pattern_6, Direction="0,0,-1", Length=column_height_2)
columns = Line(line_sdl)

list_item_14 = ListItem(List=between_secondary_and_edge, Index=1, Wrap=True)
edge_verticals = Data(list_item_14)
end_points = EndPoints(Curve=edge_verticals)  # -> flatten(Start), End
polyline_14 = PolyLine(Vertices=end_points.Start, Closed=True)
explode_20 = Explode(Curve=polyline_14, Recursive=True)  # -> Segments, Vertices
edge_dummy_member = Data(explode_20.Segments)

all_centered_radial_verticals = Data(simplify(split_tree.Positive))

centered_radial_verticals_2 = Data(simplify(all_centered_radial_verticals))
centered_opening_truss_vertical_members_2 = Line(simplify(split_tree_3.Positive))
centered_primary_truss_vertical_members_3 = Line(simplify(split_tree_5.Positive))
centered_secondary_truss_vertical_member_2 = Line(simplify(split_tree_4.Positive))  # "Centered Secondary Truss Vertical Members"
end_points_2 = EndPoints(Curve=centered_radial_verticals_2)  # -> Start, End
end_points_3 = EndPoints(Curve=centered_opening_truss_vertical_members_2)  # -> Start, End
end_points_4 = EndPoints(Curve=centered_primary_truss_vertical_members_3)  # -> Start, End
end_points_5 = EndPoints(Curve=centered_secondary_truss_vertical_member_2)  # -> Start, End
bottom = Point(flatten(end_points_3.End))
top = Point(flatten(end_points_3.Start))
bottom_2 = Point(flatten(end_points_4.End))
top_2 = Point(flatten(end_points_4.Start))
bottom_3 = Point(end_points_2.End)
top_3 = Point(end_points_2.Start)
bottom_4 = Point(flatten(end_points_5.End))
top_4 = Point(flatten(end_points_5.Start))
polyline_15 = PolyLine(Vertices=top_3, Closed=boolean_toggle)
polyline_16 = PolyLine(Vertices=bottom_3, Closed=Toggle(False))
polyline_17 = PolyLine(Vertices=top, Closed=Toggle(True))
polyline_18 = PolyLine(Vertices=bottom, Closed=Toggle(True))
polyline_19 = PolyLine(Vertices=top_2, Closed=Toggle(True))
polyline_20 = PolyLine(Vertices=bottom_2, Closed=Toggle(True))
polyline_21 = PolyLine(Vertices=top_4, Closed=Toggle(True))
polyline_22 = PolyLine(Vertices=bottom_4, Closed=Toggle(True))
explode_21 = Explode(Curve=polyline_15, Recursive=True)  # -> Segments, Vertices
explode_22 = Explode(Curve=polyline_16, Recursive=True)  # -> Segments, Vertices
explode_23 = Explode(Curve=polyline_17, Recursive=True)  # -> Segments, Vertices
explode_24 = Explode(Curve=polyline_18, Recursive=True)  # -> Segments, Vertices
explode_25 = Explode(Curve=polyline_19, Recursive=True)  # -> Segments, Vertices
explode_26 = Explode(Curve=polyline_20, Recursive=True)  # -> Segments, Vertices
explode_27 = Explode(Curve=polyline_21, Recursive=True)  # -> Segments, Vertices
explode_28 = Explode(Curve=polyline_22, Recursive=True)  # -> Segments, Vertices
radial_top = Point(explode_21.Vertices)
radial_bottom = Point(explode_22.Vertices)
tapered_opening_truss_top_chord = Data(explode_23.Segments)
centered_primary_ring_points = Data(explode_25.Vertices)
centered_secondary_ring_points = Data(explode_27.Vertices)
tapered_opening_truss_bottom_chord = Data(explode_24.Segments)
tapered_primary_truss_top_chord = Data(explode_25.Segments)
tapered_primary_truss_bottom_chord = Data(explode_26.Segments)
centered_primary_ring_bottom_points = Data(explode_26.Vertices)
tapered_secondary_truss_top_chord = Data(explode_27.Segments)
centered_secondary_ring_bottom_points = Data(explode_28.Vertices)
tapered_secondary_truss_bottom_chord = Data(explode_28.Segments)
cull_duplicates_9 = CullDuplicates(Points=centered_primary_ring_points, Tolerance=0.1, CullMode=3)  # -> Points, Indices, Valence
cull_duplicates_10 = CullDuplicates(Points=centered_primary_ring_bottom_points, Tolerance=0.1, CullMode=3)  # -> Points, Indices, Valence
cull_duplicates_11 = CullDuplicates(Points=centered_secondary_ring_points, Tolerance=0.1, CullMode=3)  # -> Points, Indices, Valence
cull_duplicates_12 = CullDuplicates(Points=centered_secondary_ring_bottom_points, Tolerance=0.1, CullMode=3)  # -> Points, Indices, Valence
split_list_5 = SplitList(List=explode_21.Segments, Index=no_radial_members_opening_primary_4)  # -> ListA, ListB
split_list_6 = SplitList(List=explode_22.Segments, Index=no_radial_members_opening_primary_5)  # -> ListA, ListB
shift_list_6 = ShiftList(List=cull_duplicates_9.Points, Shift=-2, Wrap=True)
shift_list_7 = ShiftList(List=cull_duplicates_10.Points, Shift=-2, Wrap=True)
shift_list_8 = ShiftList(List=cull_duplicates_11.Points, Shift=-2, Wrap=True)
shift_list_9 = ShiftList(List=cull_duplicates_12.Points, Shift=-2, Wrap=True)
radial_bottom_chord_after_primary = Line(split_list_5.ListB)
radial_bottom_chord_after_primary_2 = Line(split_list_6.ListB)
split_list_7 = SplitList(List=radial_bottom_chord_after_primary, Index=no_radial_members_primary_secondary_4)  # -> ListA, ListB
split_list_8 = SplitList(List=radial_bottom_chord_after_primary_2, Index=no_radial_members_primary_secondary_5)  # -> ListA, ListB
between_opening_and_primary = Data(split_list_5.ListA)
between_opening_and_primary_2 = Data(split_list_6.ListA)
between_secondary_and_edge_2 = Data(split_list_7.ListB)
between_secondary_and_edge_3 = Data(split_list_8.ListB)
between_primary_and_secondary_2 = Data(split_list_7.ListA)
between_primary_and_secondary_3 = Data(split_list_8.ListA)

radial_top_2 = Point(radial_top)
radial_bottom_2 = Point(radial_bottom)
list_item_15 = ListItem(List=radial_top_2, Index=-1, Wrap=True)
list_item_16 = ListItem(List=radial_bottom_2, Index=-1, Wrap=True)
centered_canopy_edge_points = Data(flatten(list_item_15))
centered_canopy_edge_bottom_points = Data(flatten(list_item_16))

top_5 = Point(flatten(end_points_3.Start))
top_6 = Point(end_points_2.Start)
cull_duplicates_13 = CullDuplicates(Points=top_5, Tolerance=0.1, CullMode=3)  # -> Points, Indices, Valence
list_item_17 = ListItem(List=top_6, Index=-1, Wrap=True)  # -> flatten(Item)
polyline_23 = PolyLine(Vertices=cull_duplicates_13.Points, Closed=False)  # -> flatten(Polyline)
polyline_24 = PolyLine(Vertices=list_item_17, Closed=False)
opening_polygon_3 = Data(polyline_23)

# ----
# Can't create panel due to plane difference
edge_polygon_3 = Data(polyline_24)
panel_29 = Panel(
    Outlines=[opening_polygon_3, edge_polygon_3],
    Tolerance=1e-06,
    Component="{ \"SelectedItem\" : null, \"InputParams\" : [], \"OutputParams\" : [], \"BHoM_Guid\" : \"3f61bbee-52f2-437a-99aa-cdf819bde0c0\", \"_bhomVersion\" : \"6.0\" }")
surface_split_2 = SurfaceSplit(Surface=panel_29, Curves=line_8)
canopy_panel_4 = Data(surface_split_2)

panel_30 = Panel(centered_opening_truss_vertical_members)
secondary_to_edge_top_2 = Line(between_secondary_and_edge_2)
primary_to_secondary_top_2 = Line(between_primary_and_secondary_2)
opening_to_primary_top_2 = Line(between_opening_and_primary)
all_centered_radial_verticals_2 = Data(simplify(centered_radial_verticals))
all_centered_radial_verticals_3 = Data(simplify(centered_radial_verticals))
all_centered_radial_verticals_4 = Data(simplify(centered_radial_verticals))

# ---- group: Taper Top & Bottom / Not needed - doubles with opening ring
between_inner_and_primary = Data(split_list_3.ListA)

# ----
# Vertical Members Results
radial_verticals_5 = Data(radial_verticals)
all_radial_verticals_3 = Data(all_radial_verticals)
primary_truss_vertical_members_3 = Line(primary_truss_vertical_members)
opening_truss_vertical_members_3 = Line(opening_truss_vertical_members)
secondary_truss_vertical_members_3 = Line(secondary_truss_vertical_members)

# ----
# Columns
columns_2 = Line(line_sdl)

# ----
# Diagonal Members Results
primary_truss_diagonals_3 = Line(primary_truss_diagonals_2)
primary_truss_diagonals_4 = Line(primary_truss_diagonals)
opening_truss_diagonals_2 = Line(opening_truss_diagonals)
radial_diagonals_opening_to_primary_2 = Line(radial_diagonals_opening_to_primary)
radial_diagonals_secondary_to_edge_2 = Line(radial_diagonals_secondary_to_edge)
radial_diagonals_primary_to_secondary_2 = Line(radial_diagonals_primary_to_secondary)

primary_truss_diagonals_5 = Line(primary_truss_diagonals_3)
opening_truss_diagonals_3 = Line(opening_truss_diagonals_2)
secondary_truss_diagonals = Line(primary_truss_diagonals_4)
radial_diagonals_opening_to_primary_3 = Line(radial_diagonals_opening_to_primary_2)
radial_diagonals_secondary_to_edge_3 = Line(radial_diagonals_secondary_to_edge_2)
radial_diagonals_primary_to_secondary_3 = Line(radial_diagonals_primary_to_secondary_2)
entwine_2 = Entwine(
    Branch0X=radial_diagonals_opening_to_primary_3,
    Branch1X=radial_diagonals_primary_to_secondary_3,
    Branch2X=radial_diagonals_secondary_to_edge_3,
    Branch3X=opening_truss_diagonals_3,
    Branch4X=primary_truss_diagonals_5,
    Branch5X=secondary_truss_diagonals,
    FlattenInputs=False)  # -> simplify(Result)
curve_middle_2 = CurveMiddle(Curve=entwine_2)
pt_2 = Point(curve_middle_2)
project_2 = Project(Geometry=pt_2, Plane=planesrf)  # -> Geometry, Transform
vec2pt_2 = Vector2Pt(PointA=pt_2, PointB=project_2.Geometry, Unitize=False)  # -> Vector, Length
move_4 = Move(Geometry=entwine_2, Motion=vec2pt_2.Vector)  # -> Geometry, Transform
centered_diagonals = Geometry(move_4.Geometry)
split_tree_6 = SplitTree(Data=centered_diagonals, Masks=flatten("{0;*;*}"))  # -> Positive, Negative
split_tree_7 = SplitTree(Data=centered_diagonals, Masks=flatten("{1;*;*}"))  # -> Positive, Negative
split_tree_8 = SplitTree(Data=centered_diagonals, Masks=flatten("{3;*;*}"))  # -> Positive, Negative
split_tree_9 = SplitTree(Data=centered_diagonals, Masks=flatten("{4;*;*}"))  # -> Positive, Negative
split_tree_10 = SplitTree(Data=centered_diagonals, Masks=flatten("{5;*;*}"))  # -> Positive, Negative
split_tree_11 = SplitTree(Data=centered_diagonals, Masks=flatten("{2;*;*}"))  # -> Positive, Negative
centered_secondary_truss_diagonals = Line(simplify(split_tree_10.Positive))
centered_primary_truss_diagonals = Line(simplify(split_tree_9.Positive))
centered_opening_truss_diagonals = Line(simplify(split_tree_8.Positive))
centered_radial_diagonals_opening_to_pri = Line(simplify(split_tree_6.Positive))  # "Centered Radial Diagonals - Opening to Primary"
centered_radial_diagonals_secondary_to_e = Line(simplify(split_tree_11.Positive))  # "Centered Radial Diagonals - Secondary to Edge"
centered_radial_diagonals_primary_to_sec = Line(simplify(split_tree_7.Positive))  # "Centered Radial Diagonals - Primary to Secondary"

snaptoelements = SnapToElements(
    Element1D=centered_radial_diagonals_secondary_to_e,
    RefElements=secondary_to_edge_top_2,
    MaxDistance="0.2",
    Tolerance=1e-06,
    Component="{ .SnapToElements")
snaptoelements_2 = SnapToElements(
    Element1D=centered_radial_diagonals_opening_to_pri,
    RefElements=opening_to_primary_top_2,
    MaxDistance="0.2",
    Tolerance=1e-06,
    Component="{ .SnapToElements")
snaptoelements_3 = SnapToElements(
    Element1D=centered_radial_diagonals_primary_to_sec,
    RefElements=primary_to_secondary_top_2,
    MaxDistance="0.2",
    Tolerance=1e-06,
    Component="{ .SnapToElements")
snaptoelements_4 = SnapToElements(
    Element1D=snaptoelements_3,
    RefElements=all_centered_radial_verticals_2,
    MaxDistance="0.2",
    Tolerance=1e-06,
    Component="{ .SnapToElements")
snaptoelements_5 = SnapToElements(
    Element1D=snaptoelements_2,
    RefElements=all_centered_radial_verticals_3,
    MaxDistance="0.2",
    Tolerance=1e-06,
    Component="{ .SnapToElements")
snaptoelements_6 = SnapToElements(
    Element1D=snaptoelements,
    RefElements=all_centered_radial_verticals_4,
    MaxDistance="0.2",
    Tolerance=1e-06,
    Component="{ .SnapToElements")

# ----
# Tapered Canopy Output - Not complete
secondary_to_edge_top_3 = Line(between_secondary_and_edge_2)
opening_to_primary_top_3 = Line(between_opening_and_primary)
edge_dummy_member_2 = Data(edge_dummy_member)
primary_to_secondary_top_3 = Line(between_primary_and_secondary_2)
radial_diagonals_secondary_to_edge_4 = Line(snaptoelements_6)
radial_diagonals_primary_to_secondary_4 = Line(snaptoelements_4)

# ----
# Primary Ring
primary_ring_bottom_4 = Data(tapered_primary_truss_bottom_chord)
primary_truss_top_chord_2 = Line(tapered_primary_truss_top_chord)
primary_truss_diagonals_6 = Line(centered_primary_truss_diagonals)
primary_truss_vertical_members_4 = Line(centered_primary_truss_vertical_members)
primary_ring_truss = Line([primary_truss_top_chord_2, primary_ring_bottom_4, primary_truss_vertical_members_4, primary_truss_diagonals_6])

# ----
# Secondary Ring
secondary_ring_bottom_4 = Data(tapered_secondary_truss_bottom_chord)
secondary_truss_diagonals_2 = Line(centered_secondary_truss_diagonals)
secondary_truss_top_chord_2 = Line(tapered_secondary_truss_top_chord)
secondary_truss_vertical_members_4 = Line(centered_secondary_truss_vertical_member)
secondary_ring_truss = Line([secondary_truss_top_chord_2, secondary_ring_bottom_4, secondary_truss_vertical_members_4, secondary_truss_diagonals_2])

# ----
# Opening Ring
canopy_opening_bottom_4 = Data(tapered_opening_truss_bottom_chord)
opening_truss_diagonals_4 = Line(centered_opening_truss_diagonals)
opening_truss_top_chord_2 = Line(tapered_opening_truss_top_chord)
opening_truss_vertical_members_4 = Line(centered_opening_truss_vertical_members)
opening_ring_truss = Line([opening_truss_top_chord_2, canopy_opening_bottom_4, opening_truss_vertical_members_4, opening_truss_diagonals_4])

# ----
# Between Opening and Primary
bottom_between_inner_and_primary = Data(between_opening_and_primary_2)
radial_vert_opening_to_primary = Line(between_inner_and_primary)
radial_diagonals_opening_to_primary_4 = Line(snaptoelements_5)
between_inner_and_primary_2 = Line([bottom_between_inner_and_primary, opening_to_primary_top_3, radial_diagonals_opening_to_primary_4, radial_vert_opening_to_primary])

# ----
# Between Secondary and Edge
vert_between_secondary_and_edge = Data(between_secondary_and_edge)
bottom_between_secondary_and_edge = Data(between_secondary_and_edge_3)
between_secondary_and_edge_4 = Line([bottom_between_secondary_and_edge, vert_between_secondary_and_edge, secondary_to_edge_top_3, radial_diagonals_secondary_to_edge_4])

# ----
# Between Primary and Secondary
vert_between_primary_and_secondary = Data(between_primary_and_secondary)
bottom_between_primary_and_secondary = Data(between_primary_and_secondary_3)
between_primary_and_secondary_4 = Line([bottom_between_primary_and_secondary, vert_between_primary_and_secondary, primary_to_secondary_top_3, radial_diagonals_primary_to_secondary_4])

# ----
# Top Chord Results
primary_truss_top_chord_3 = Line(explode_16.Segments)
radial_truss_top_chord_2 = Line([opening_to_primary_top, primary_to_secondary_top, secondary_to_edge_top])
secondary_to_edge_top_4 = Line(secondary_to_edge_top)
opening_truss_top_chord_3 = Line(explode_13.Segments)
opening_to_primary_top_4 = Line(opening_to_primary_top)
primary_to_secondary_top_4 = Line(primary_to_secondary_top)
secondary_truss_top_chord_3 = Line(explode_12.Segments)

all_radial_verticals_4 = Data(all_radial_verticals_3)
# Group Members Between Ring Trusses
bottom_radial_points_no_duplicates_3 = Point(bottom_radial_points_no_duplicates)
polyline_25 = PolyLine(Vertices=bottom_radial_points_no_duplicates_3, Closed=False)
explode_29 = Explode(Curve=polyline_25, Recursive=True)  # -> Segments, Vertices
no_radial_members_opening_primary_11 = Data(number_slider_4)
no_radial_members_opening_primary_12 = Data(number_slider_4)
split_list_9 = SplitList(List=explode_29.Segments, Index=no_radial_members_opening_primary_11)  # -> ListA, ListB
split_list_10 = SplitList(List=all_radial_verticals_4, Index=no_radial_members_opening_primary_12)  # -> ListA, ListB
no_radial_members_primary_secondary_9 = Data(number_slider_5)
no_radial_members_primary_secondary_10 = Data(number_slider_5)
radial_bottom_chord_after_primary_3 = Line(split_list_9.ListB)
vertical_after_primary_2 = Line(split_list_10.ListB)
split_list_11 = SplitList(List=radial_bottom_chord_after_primary_3, Index=no_radial_members_primary_secondary_9)  # -> ListA, ListB
split_list_12 = SplitList(List=vertical_after_primary_2, Index=no_radial_members_primary_secondary_10)  # -> ListA, ListB
cull_index_16 = CullIndex(List=split_list_12.ListA, Indices=0, Wrap=True)
cull_index_17 = CullIndex(List=split_list_12.ListB, Indices=0, Wrap=True)
between_inner_and_primary_3 = Data(split_list_9.ListA)
between_secondary_and_edge_5 = Data(split_list_11.ListB)
between_primary_and_secondary_5 = Data(split_list_11.ListA)
between_primary_and_secondary_6 = Data(cull_index_16)
between_secondary_and_edge_6 = Data(cull_index_17)

# ---- group: Not needed - doubles with opening ring
between_inner_and_primary_4 = Data(split_list_10.ListA)

# ----
# Columns
columns_3 = Line(columns)

# ----
# Primary Ring
primary_ring_bottom_5 = Data(primary_ring_bottom_2)
primary_truss_top_chord_4 = Line(primary_truss_top_chord_3)
primary_truss_diagonals_7 = Line(primary_truss_diagonals_3)
primary_truss_vertical_members_5 = Line(primary_truss_vertical_members_3)
primary_ring_truss_2 = Line([primary_truss_top_chord_4, primary_ring_bottom_5, primary_truss_vertical_members_5, primary_truss_diagonals_7])

# ----
# Secondary Ring
secondary_ring_bottom_5 = Data(secondary_ring_bottom_2)
secondary_truss_diagonals_3 = Line(primary_truss_diagonals_4)
secondary_truss_top_chord_4 = Line(secondary_truss_top_chord_3)
secondary_truss_vertical_members_5 = Line(secondary_truss_vertical_members_3)
secondary_ring_truss_2 = Line([secondary_truss_top_chord_4, secondary_ring_bottom_5, secondary_truss_vertical_members_5, secondary_truss_diagonals_3])

secondary_to_edge_hz_bracing_top_5 = Line(secondary_to_edge_hz_bracing_top_3)
secondary_to_edge_hz_bracing_bottom = Line(secondary_to_edge_hz_bracing_top_4)
hz_bracing_between_secondary_and_edge = Line([secondary_to_edge_hz_bracing_bottom, secondary_to_edge_hz_bracing_top_5])

# ----
# Opening Ring
opening_truss_diagonals_5 = Line(opening_truss_diagonals_2)
canopy_opening_bottom_5 = Data(canopy_opening_bottom_2)
opening_truss_top_chord_4 = Line(opening_truss_top_chord_3)
opening_truss_vertical_members_5 = Line(opening_truss_vertical_members_3)
opening_ring_truss_2 = Line([opening_truss_top_chord_4, canopy_opening_bottom_5, opening_truss_vertical_members_5, opening_truss_diagonals_5])

primary_to_secondary_hz_bracing_top_3 = Line(primary_to_secondary_hz_bracing_top_2)
primary_to_secondary_hz_bracing_bottom_3 = Line(primary_to_secondary_hz_bracing_bottom_2)
hz_bracing_between_primary_and_secondary = Line([primary_to_secondary_hz_bracing_bottom_3, primary_to_secondary_hz_bracing_top_3])

centered_primary_ring_points_2 = Data(shift_list_6)
centered_canopy_edge_points_2 = Data(centered_canopy_edge_points)
centered_secondary_ring_points_2 = Data(shift_list_8)
centered_primary_ring_bottom_points_2 = Data(shift_list_7)
centered_canopy_edge_bottom_points_2 = Data(centered_canopy_edge_bottom_points)
centered_secondary_ring_bottom_points_2 = Data(shift_list_9)

primary_ring_bottom_points_5 = Data(centered_primary_ring_bottom_points_2)
cull_pattern_7 = CullPattern(List=primary_ring_bottom_points_5, CullPattern=panel_23)
column_height_3 = Data(column_height)
line_sdl_2 = LineSDL(Start=cull_pattern_7, Direction="0,0,-1", Length=flatten(column_height_3))
columns_4 = Line(line_sdl_2)

cull_pattern_8 = CullPattern(List=centered_secondary_ring_points_2, CullPattern=panel_3)
cull_nth = CullNth(List=centered_primary_ring_points_2, CullFrequency="2")
cull_pattern_9 = CullPattern(List=centered_secondary_ring_bottom_points_2, CullPattern=panel_4)
cull_nth_2 = CullNth(List=centered_primary_ring_bottom_points_2, CullFrequency="2")
panel_31 = Panel(cull_pattern_9)

shift_list_10 = ShiftList(List=cull_pattern_8, Shift=1, Wrap=True)
shift_list_11 = ShiftList(List=cull_pattern_9, Shift=1, Wrap=True)
line_29 = Line(StartPoint=cull_nth, EndPoint=shift_list_10)
line_30 = Line(StartPoint=shift_list_10, EndPoint=centered_canopy_edge_points_2)
line_31 = Line(StartPoint=shift_list_11, EndPoint=centered_canopy_edge_bottom_points_2)
line_32 = Line(StartPoint=cull_nth_2, EndPoint=shift_list_11)
shift_list_12 = ShiftList(List=cull_pattern_8, Shift=-1, Wrap=True)
cull_pattern_10 = CullPattern(List=line_30, CullPattern=panel_24)
shift_list_13 = ShiftList(List=cull_pattern_9, Shift=-1, Wrap=True)
cull_pattern_11 = CullPattern(List=line_31, CullPattern=panel_25)
line_33 = Line(StartPoint=shift_list_12, EndPoint=centered_canopy_edge_points_2)
line_34 = Line(StartPoint=cull_nth, EndPoint=shift_list_12)
line_35 = Line(StartPoint=cull_nth_2, EndPoint=shift_list_13)
line_36 = Line(StartPoint=shift_list_13, EndPoint=centered_canopy_edge_bottom_points_2)
cull_pattern_12 = CullPattern(List=line_33, CullPattern=panel_26)
cull_pattern_13 = CullPattern(List=line_36, CullPattern=panel_27)
primary_to_secondary_hz_bracing_top_4 = Line([line_29, line_34])
secondary_to_edge_hz_bracing_bottom_2 = Line([cull_pattern_13, cull_pattern_11])
secondary_to_edge_hz_bracing_top_6 = Line([cull_pattern_12, cull_pattern_10])
primary_to_secondary_hz_bracing_bottom_4 = Line([line_32, line_35])

# ----
# Columns
columns_5 = Line(columns_4)

secondary_to_edge_hz_bracing_top_7 = Line(secondary_to_edge_hz_bracing_top_6)
secondary_to_edge_hz_bracing_bottom_3 = Line(secondary_to_edge_hz_bracing_bottom_2)
hz_bracing_between_primary_and_secondary_2 = Line([secondary_to_edge_hz_bracing_bottom_3, secondary_to_edge_hz_bracing_top_7])

primary_to_secondary_hz_bracing_top_5 = Line(primary_to_secondary_hz_bracing_top_4)
primary_to_secondary_hz_bracing_bottom_5 = Line(primary_to_secondary_hz_bracing_bottom_4)
hz_bracing_between_primary_and_secondary_3 = Line([primary_to_secondary_hz_bracing_bottom_5, primary_to_secondary_hz_bracing_top_5])

entwine_3 = Entwine(
    Branch0X=between_inner_and_primary_2,
    Branch1X=between_primary_and_secondary_4,
    Branch2X=hz_bracing_between_primary_and_secondary_3,
    Branch3X=between_secondary_and_edge_4,
    Branch4X=hz_bracing_between_primary_and_secondary_2,
    Branch5X=opening_ring_truss,
    Branch6X=primary_ring_truss,
    Branch7X=secondary_ring_truss,
    Branch8X=columns_5,
    FlattenInputs=False)
move_5 = Move(Geometry=entwine_3, Motion=Vector(0, 0, 0))  # -> Geometry, Transform
rotate = Rotate(Geometry=move_5.Geometry, Angle=0, Plane=PlaneXY(0, 0, 0))  # -> Geometry, Transform
split_tree_12 = SplitTree(Data=rotate.Geometry, Masks=flatten("{0;*;*}"))  # -> Positive, Negative
split_tree_13 = SplitTree(Data=rotate.Geometry, Masks=flatten("{8;*;*}"))  # -> Positive, Negative
split_tree_14 = SplitTree(Data=rotate.Geometry, Masks=flatten("{7;*;*}"))  # -> Positive, Negative
split_tree_15 = SplitTree(Data=rotate.Geometry, Masks=flatten("{5;*;*}"))  # -> Positive, Negative
split_tree_16 = SplitTree(Data=rotate.Geometry, Masks=flatten("{1;*;*}"))  # -> Positive, Negative
split_tree_17 = SplitTree(Data=rotate.Geometry, Masks=flatten("{3;*;*}"))  # -> Positive, Negative
split_tree_18 = SplitTree(Data=rotate.Geometry, Masks=flatten("{2;*;*}"))  # -> Positive, Negative
split_tree_19 = SplitTree(Data=rotate.Geometry, Masks=flatten("{4;*;*}"))  # -> Positive, Negative
split_tree_20 = SplitTree(Data=rotate.Geometry, Masks=flatten("{6;*;*}"))  # -> Positive, Negative

# ----
# Define section properties through BHoM
# - UK not US sections as issues
# selecting section property
primary_ring_truss_3 = Line(split_tree_20.Positive)
secondary_ring_truss_3 = Line(split_tree_14.Positive)
columns_6 = Line(split_tree_13.Positive)
opening_ring_truss_3 = Line(split_tree_15.Positive)
between_inner_and_primary_5 = Line(split_tree_12.Positive)
between_secondary_and_edge_7 = Line(split_tree_17.Positive)
between_primary_and_secondary_7 = Line(split_tree_16.Positive)
hz_bracing_between_primary_and_secondary_4 = Line(split_tree_18.Positive)
hz_bracing_between_primary_and_secondary_5 = Line(split_tree_19.Positive)

# ---- group: SHS150x150x12.5
data_8 = Data(opening_ring_truss_3)

# ---- group: SHS300x300x14.2
data_9 = Data(columns_6)

# ---- group: SHS400x400x16
data_10 = Data(primary_ring_truss_3)

# ---- group: SHS300x300x14.2
data_11 = Data(secondary_ring_truss_3)

# ---- group: SHS250x250x14.2
data_12 = Data(hz_bracing_between_primary_and_secondary_4)

# ---- group: SHS300x300x14.2
data_13 = Data(between_inner_and_primary_5)

data_14 = Data(between_primary_and_secondary_7)

# ---- group: SHS200x200x10
data_15 = Data(hz_bracing_between_primary_and_secondary_5)

# ---- group: SHS250x250x16
data_16 = Data(between_secondary_and_edge_7)

# ----
# Are the opening verticals doubling at radial points?
secondary_to_edge_top_5 = Line(secondary_to_edge_top)
opening_to_primary_top_5 = Line(opening_to_primary_top)
primary_to_secondary_top_5 = Line(primary_to_secondary_top)
radial_diagonals_secondary_to_edge_5 = Line(radial_diagonals_secondary_to_edge_2)
radial_diagonals_primary_to_secondary_5 = Line(radial_diagonals_primary_to_secondary_2)
canopy_5_translation_4 = Data(canopy_5_translation_3)
canopy_5_rotation_4 = Data(canopy_5_rotation_3)
shs = SHS(Component="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")
shs_2 = SHS(Component="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")

# ----
# Between Opening and Primary
bottom_between_inner_and_primary_2 = Data(between_inner_and_primary_3)
radial_diagonals_opening_to_primary_5 = Line(radial_diagonals_opening_to_primary_2)
between_inner_and_primary_6 = Line([bottom_between_inner_and_primary_2, opening_to_primary_top_5, radial_diagonals_opening_to_primary_5])

# ----
# Between Secondary and Edge
vert_between_secondary_and_edge_2 = Data(between_secondary_and_edge_6)
bottom_between_secondary_and_edge_2 = Data(between_secondary_and_edge_5)
between_secondary_and_edge_8 = Line([bottom_between_secondary_and_edge_2, vert_between_secondary_and_edge_2, secondary_to_edge_top_5, radial_diagonals_secondary_to_edge_5])

# ----
# Between Primary and Secondary
vert_between_primary_and_secondary_2 = Data(between_primary_and_secondary_6)
bottom_between_primary_and_secondary_2 = Data(between_primary_and_secondary_5)
between_primary_and_secondary_8 = Line([bottom_between_primary_and_secondary_2, vert_between_primary_and_secondary_2, primary_to_secondary_top_5, radial_diagonals_primary_to_secondary_5])

entwine_4 = Entwine(
    Branch0X=between_inner_and_primary_6,
    Branch1X=between_primary_and_secondary_8,
    Branch2X=hz_bracing_between_primary_and_secondary,
    Branch3X=between_secondary_and_edge_8,
    Branch4X=hz_bracing_between_secondary_and_edge,
    Branch5X=opening_ring_truss_2,
    Branch6X=primary_ring_truss_2,
    Branch7X=secondary_ring_truss_2,
    Branch8X=columns_3,
    Branch9X=canopy_panel_3,
    FlattenInputs=False)
move_6 = Move(Geometry=entwine_4, Motion=Vector(0, 0, 0))  # -> Geometry, Transform
rotate_2 = Rotate(Geometry=move_6.Geometry, Angle=0, Plane=PlaneXY(0, 0, 0))  # -> Geometry, Transform
split_tree_21 = SplitTree(Data=rotate_2.Geometry, Masks=flatten("{0;*;*}"))  # -> Positive, Negative
split_tree_22 = SplitTree(Data=rotate_2.Geometry, Masks=flatten("{8;*;*}"))  # -> Positive, Negative
split_tree_23 = SplitTree(Data=rotate_2.Geometry, Masks=flatten("{7;*;*}"))  # -> Positive, Negative
split_tree_24 = SplitTree(Data=rotate_2.Geometry, Masks=flatten("{5;*;*}"))  # -> Positive, Negative
split_tree_25 = SplitTree(Data=rotate_2.Geometry, Masks=flatten("{1;*;*}"))  # -> Positive, Negative
split_tree_26 = SplitTree(Data=rotate_2.Geometry, Masks=flatten("{3;*;*}"))  # -> Positive, Negative
split_tree_27 = SplitTree(Data=rotate_2.Geometry, Masks=flatten("{2;*;*}"))  # -> Positive, Negative
split_tree_28 = SplitTree(Data=rotate_2.Geometry, Masks=flatten("{4;*;*}"))  # -> Positive, Negative
split_tree_29 = SplitTree(Data=rotate_2.Geometry, Masks=flatten("{6;*;*}"))  # -> Positive, Negative
split_tree_30 = SplitTree(Data=rotate_2.Geometry, Masks=flatten("{9;*;*}"))  # -> Positive, Negative

# ----
# Define section properties through BHoM
# - UK not US sections as issues
# selecting section property
need_to_edit_section_to_be_composite = Panel("1000x40 Composite??")
primary_ring_truss_4 = Line(split_tree_29.Positive)
canopy = Data(split_tree_30.Positive)
barreleasefixfix = BarReleaseFixFix(Name="FixFix", Component="{ .BarReleaseFixFix")
secondary_ring_truss_4 = Line(split_tree_23.Positive)
opening_ring_truss_4 = Line(split_tree_24.Positive)
columns_7 = Line(split_tree_22.Positive)
barreleasefixfix_2 = BarReleaseFixFix(Name="FixFix", Component="{ .BarReleaseFixFix")
barreleasefixfix_3 = BarReleaseFixFix(Name="FixFix", Component="{ .BarReleaseFixFix")
barreleasefixfix_4 = BarReleaseFixFix(Name="FixFix", Component="{ .BarReleaseFixFix")
barreleasefixfix_5 = BarReleaseFixFix(Name="FixFix", Component="{ .BarReleaseFixFix")
barreleasefixfix_6 = BarReleaseFixFix(Name="FixFix", Component="{ .BarReleaseFixFix")
between_inner_and_primary_7 = Line(split_tree_21.Positive)
between_secondary_and_edge_9 = Line(split_tree_26.Positive)
between_primary_and_secondary_9 = Line(split_tree_25.Positive)
hz_bracing_between_primary_and_secondary_6 = Line(split_tree_27.Positive)
concrete = Concrete(Component="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")
hz_bracing_between_primary_and_secondary_7 = Line(split_tree_28.Positive)
hss = HSS(Component="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")
hss_2 = HSS(Component="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")
shs_3 = SHS(Component="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")
hss_3 = HSS(Component="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")
hss_4 = HSS(Component="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")
hss_5 = HSS(Component="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")
hss_6 = HSS(Component="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")
hss_7 = HSS(Component="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")
hss_8 = HSS(Component="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")
shs_4 = SHS(Component="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")
barreleasefixfix_7 = BarReleaseFixFix(Name="FixFix", Component="{ .BarReleaseFixFix")
diaphragmtype = DiaphragmType(
    {"RigidDiaphragm": 0, "SemiRigidDiaphragm": 1}, selected="SemiRigidDiaphragm",
    Component="BH.oM.Adapters.ETABS.DiaphragmType",
    Selection=1)
shs_5 = SHS(Component="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")
shs_6 = SHS(Component="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")
shs_7 = SHS(Component="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")
barreleasefixfix_8 = BarReleaseFixFix(Name="FixFix", Component="{ .BarReleaseFixFix")
steeltubesection = SteelTubeSection(
    Diameter=Slider(1, range=0..1000),
    Thickness=Slider(0.04, range=0..0.1),
    Name=need_to_edit_section_to_be_composite,
    Component="{ .SteelTubeSection")
barreleasefixfix_9 = BarReleaseFixFix(Name="FixFix", Component="{ .BarReleaseFixFix")
constantthickness = ConstantThickness(
    Name="Canopy Panel",
    Thickness=Slider(0.04, range=0..0.1),
    Material=concrete,
    PanelType="{ \"_t\" : \"System.Enum\", \"TypeName\" : { \"_t\" : \"System.Type\", \"Name\" : \"BH.oM.Structure.SurfaceProperties.PanelType\", \"_bhomVersion\" : \"6.0\" }, \"Value\" : \"Slab\", \"_bhomVersion\" : \"6.0\" }",
    Component="BH.oM.Structure.SurfaceProperties.ConstantThickness")
bar = Bar(
    Line=secondary_ring_truss_4,
    SectionProperty=shs_3,
    OrientationAngle=0,
    Release=barreleasefixfix_7,
    FeaType="{ \"_t\" : \"System.Enum\", \"TypeName\" : { \"_t\" : \"System.Type\", \"Name\" : \"BH.oM.Structure.Elements.BarFEAType\", \"_bhomVersion\" : \"6.0\" }, \"Value\" : \"Flexural\", \"_bhomVersion\" : \"6.0\" }",
    Component="{ .Bar")
bar_2 = Bar(
    Line=columns_7,
    SectionProperty=steeltubesection,
    OrientationAngle=0,
    Release=barreleasefixfix_9,
    FeaType="{ \"_t\" : \"System.Enum\", \"TypeName\" : { \"_t\" : \"System.Type\", \"Name\" : \"BH.oM.Structure.Elements.BarFEAType\", \"_bhomVersion\" : \"6.0\" }, \"Value\" : \"Flexural\", \"_bhomVersion\" : \"6.0\" }",
    Component="{ .Bar")
bar_3 = Bar(
    Line=primary_ring_truss_4,
    SectionProperty=fabricatedsteelboxsection,
    OrientationAngle=0,
    Release=barreleasefixfix_8,
    FeaType="{ \"_t\" : \"System.Enum\", \"TypeName\" : { \"_t\" : \"System.Type\", \"Name\" : \"BH.oM.Structure.Elements.BarFEAType\", \"_bhomVersion\" : \"6.0\" }, \"Value\" : \"Flexural\", \"_bhomVersion\" : \"6.0\" }",
    Name="Change Section",
    Component="{ .Bar")
bar_4 = Bar(
    Line=hz_bracing_between_primary_and_secondary_7,
    SectionProperty=shs,
    OrientationAngle=0,
    Release=barreleasefixfix_5,
    FeaType="{ \"_t\" : \"System.Enum\", \"TypeName\" : { \"_t\" : \"System.Type\", \"Name\" : \"BH.oM.Structure.Elements.BarFEAType\", \"_bhomVersion\" : \"6.0\" }, \"Value\" : \"Flexural\", \"_bhomVersion\" : \"6.0\" }",
    Component="{ .Bar")
bar_5 = Bar(
    Line=between_secondary_and_edge_9,
    SectionProperty=shs_4,
    OrientationAngle=0,
    Release=barreleasefixfix_4,
    FeaType="{ \"_t\" : \"System.Enum\", \"TypeName\" : { \"_t\" : \"System.Type\", \"Name\" : \"BH.oM.Structure.Elements.BarFEAType\", \"_bhomVersion\" : \"6.0\" }, \"Value\" : \"Flexural\", \"_bhomVersion\" : \"6.0\" }",
    Component="{ .Bar")
bar_6 = Bar(
    Line=opening_ring_truss_4,
    SectionProperty=shs_6,
    OrientationAngle=0,
    Release=barreleasefixfix,
    FeaType="{ \"_t\" : \"System.Enum\", \"TypeName\" : { \"_t\" : \"System.Type\", \"Name\" : \"BH.oM.Structure.Elements.BarFEAType\", \"_bhomVersion\" : \"6.0\" }, \"Value\" : \"Flexural\", \"_bhomVersion\" : \"6.0\" }",
    Component="{ .Bar")
bar_7 = Bar(
    Line=between_primary_and_secondary_9,
    SectionProperty=shs_2,
    OrientationAngle=0,
    Release=barreleasefixfix_2,
    FeaType="{ \"_t\" : \"System.Enum\", \"TypeName\" : { \"_t\" : \"System.Type\", \"Name\" : \"BH.oM.Structure.Elements.BarFEAType\", \"_bhomVersion\" : \"6.0\" }, \"Value\" : \"Flexural\", \"_bhomVersion\" : \"6.0\" }",
    Component="{ .Bar")
bar_8 = Bar(
    Line=hz_bracing_between_primary_and_secondary_6,
    SectionProperty=shs_5,
    OrientationAngle=0,
    Release=barreleasefixfix_3,
    FeaType="{ \"_t\" : \"System.Enum\", \"TypeName\" : { \"_t\" : \"System.Type\", \"Name\" : \"BH.oM.Structure.Elements.BarFEAType\", \"_bhomVersion\" : \"6.0\" }, \"Value\" : \"Flexural\", \"_bhomVersion\" : \"6.0\" }",
    Component="{ .Bar")
bar_9 = Bar(
    Line=between_inner_and_primary_7,
    SectionProperty=shs_7,
    OrientationAngle=0,
    Release=barreleasefixfix_6,
    FeaType="{ \"_t\" : \"System.Enum\", \"TypeName\" : { \"_t\" : \"System.Type\", \"Name\" : \"BH.oM.Structure.Elements.BarFEAType\", \"_bhomVersion\" : \"6.0\" }, \"Value\" : \"Flexural\", \"_bhomVersion\" : \"6.0\" }",
    Component="{ .Bar")
panel_32 = Panel(
    Surface=canopy,
    Property=constantthickness,
    Tolerance=1e-06,
    Component="{ \"SelectedItem\" : null, \"InputParams\" : [], \"OutputParams\" : [], \"BHoM_Guid\" : \"f2f23406-04e4-4877-8b50-bd949ca4a859\", \"_bhomVersion\" : \"6.0\" }")
diaphragm = Diaphragm(Rigidity=diaphragmtype, Name="D1", Component="BH.oM.Adapters.ETABS.Elements.Diaphragm")
setdiaphragm = SetDiaphragm(Panel=panel_32, Diaphragm=diaphragm, Component="{ .SetDiaphragm")

constantframingproperty = ConstantFramingProperty(OrientationAngle=0, Name=panel_8, Component="BH.oM.Physical.FramingProperties.ConstantFramingProperty")
constantframingproperty_2 = ConstantFramingProperty(OrientationAngle=0, Name=panel_8, Component="BH.oM.Physical.FramingProperties.ConstantFramingProperty")
constantframingproperty_3 = ConstantFramingProperty(OrientationAngle=0, Name=panel_8, Component="BH.oM.Physical.FramingProperties.ConstantFramingProperty")
constantframingproperty_4 = ConstantFramingProperty(OrientationAngle=0, Name=panel_8, Component="BH.oM.Physical.FramingProperties.ConstantFramingProperty")
constantframingproperty_5 = ConstantFramingProperty(OrientationAngle=0, Name=panel_6, Component="BH.oM.Physical.FramingProperties.ConstantFramingProperty")
constantframingproperty_6 = ConstantFramingProperty(OrientationAngle=0, Name=panel_7, Component="BH.oM.Physical.FramingProperties.ConstantFramingProperty")
constantframingproperty_7 = ConstantFramingProperty(OrientationAngle=0, Name=panel_10, Component="BH.oM.Physical.FramingProperties.ConstantFramingProperty")
constantframingproperty_8 = ConstantFramingProperty(OrientationAngle=0, Name=panel_11, Component="BH.oM.Physical.FramingProperties.ConstantFramingProperty")
constantframingproperty_9 = ConstantFramingProperty(OrientationAngle=0, Name=panel_9, Component="BH.oM.Physical.FramingProperties.ConstantFramingProperty")
beam = Beam(Location=data_9, Property=constantframingproperty, Component="BH.oM.Physical.Elements.Beam")  # -> flatten(B)
beam_2 = Beam(Location=data_13, Property=constantframingproperty_2, Component="BH.oM.Physical.Elements.Beam")  # -> flatten(B)
beam_3 = Beam(Location=data_14, Property=constantframingproperty_3, Component="BH.oM.Physical.Elements.Beam")  # -> flatten(B)
beam_4 = Beam(Location=data_11, Property=constantframingproperty_4, Component="BH.oM.Physical.Elements.Beam")  # -> flatten(B)
beam_5 = Beam(Location=data_12, Property=constantframingproperty_5, Component="BH.oM.Physical.Elements.Beam")  # -> flatten(B)
beam_6 = Beam(Location=data_16, Property=constantframingproperty_6, Component="BH.oM.Physical.Elements.Beam")  # -> flatten(B)
beam_7 = Beam(Location=data_15, Property=constantframingproperty_7, Component="BH.oM.Physical.Elements.Beam")  # -> flatten(B)
beam_8 = Beam(Location=data_8, Property=constantframingproperty_8, Component="BH.oM.Physical.Elements.Beam")  # -> flatten(B)
beam_9 = Beam(Location=data_10, Property=constantframingproperty_9, Component="BH.oM.Physical.Elements.Beam")  # -> flatten(B)
entwine_5 = Entwine(
    Branch0X=beam_2,
    Branch1X=beam_3,
    Branch2X=beam_5,
    Branch3X=beam_6,
    Branch4X=beam_7,
    Branch5X=beam_8,
    Branch6X=beam_9,
    Branch7X=beam_4,
    Branch8X=beam,
    FlattenInputs=False)  # -> flatten(Result)
pushtype = PushType(
    {"FullPush": 0, "CreateOnly": 1, "CreateNonExisting": 2, "UpdateOnly": 3, "UpdateOrCreateOnly": 4, "DeleteThenCreate": 5, "AdapterDefault": 6}, selected="CreateOnly",
    Component="BH.oM.Adapter.PushType",
    Selection=1)
revitadapter = RevitAdapter(Active=Toggle(True), Component="{ ..ctor")

# ---- group: Move Structure - Column bottom at base, for import into individual file
centered_primary_truss_vertical_members_4 = Line(simplify(flatten(centered_primary_truss_vertical_members)))
columns_8 = Line(data_9)
end_points_6 = EndPoints(Curve=columns_8)  # -> Start, End
curve_middle_3 = CurveMiddle(Curve=centered_primary_truss_vertical_members_4)
column_base = Point(end_points_6.End)
list_item_18 = ListItem(List=column_base, Index="2", Wrap=True)
list_item_19 = ListItem(List=curve_middle_3, Index="15", Wrap=True)
point_5 = Point(list_item_18)
point_6 = Point(list_item_19)
vector = Vector(A=point_5, B=point_6, Component="{ .Vector")
panel_33 = Data()
translate = Translate(Element1D=entwine_5, Transform=vector, Component="{ .Translate")
translate_2 = Translate(Element2D=panel_33, Transform=vector, Component="{ .Translate")

# ---- group: Column Supports
column_base_2 = Point(end_points_6.End)
fixconstraint6dof = FixConstraint6DOF(Name="Fix", Component="{ .FixConstraint6DOF")

# ----
vector_2 = Vector(A=point_5, B=point_6, Component="{ .Vector")
point_list_3 = PointList(Points=curve_middle_3)
translate_3 = Translate(Pt=column_base_2, Transform=vector_2, Component="{ .Translate")
push = Push(Adapter=revitadapter, Objects=translate, PushType=pushtype, Active=Toggle(False), Component="{ .Push")  # -> Objects, Success

# ---- group: Column Supports (continued)
node = Node(Coordinates=translate_3, Support=fixconstraint6dof, Component="{ .Node")  # -> flatten(Node)
fixed_supports = Data(node)

# ----
merge = Merge(Data1=bar_9, Data2=bar_7, Data3=bar_8, Data4=bar_5, Data5=bar_4, Data6=bar_6, Data7=bar_3, Data8=bar, Data9=bar_2)  # -> flatten(Result)
panel_34 = Data(setdiaphragm)
bhom_object = BHoMObject(
    merge,
    ObjectType="{ \"_t\" : \"System.Type\", \"Name\" : \"System.Object, mscorlib, Version=4.0.0.0, Culture=neutral, PublicKeyToken=b77a5c561934e089\", \"_bhomVersion\" : \"6.0\" }",
    m_ForcePreview=False,
    m_MaxItemsPreview=10000)

# ---- group: Move Structure - Column bottom at base, for import into individual file
columns_9 = Line(columns_3)
end_points_7 = EndPoints(Curve=columns_9)  # -> Start, End
primary_truss_top_points_5 = Data(flatten(primary_truss_top_points_2))
column_base_3 = Point(end_points_7.End)
list_item_20 = ListItem(List=column_base_3, Index="2", Wrap=True)
list_item_21 = ListItem(List=primary_truss_top_points_5, Index="40", Wrap=True)
point_7 = Point(list_item_20)
point_8 = Point(list_item_21)
vector_3 = Vector(A=point_7, B=point_8, Component="{ .Vector")
panel_35 = Data(setdiaphragm)
# Incorrect taper. See white section below.
translate_4 = Translate(Element1D=bhom_object, Transform=vector_3, Component="{ .Translate")
translate_5 = Translate(Element2D=panel_35, Transform=vector_3, Component="{ .Translate")

# ----
vector_4 = Vector(A=point_7, B=point_8, Component="{ .Vector")

# ---- group: Column Supports
column_base_4 = Point(end_points_7.End)
fixconstraint6dof_2 = FixConstraint6DOF(Name="Fix", Component="{ .FixConstraint6DOF")

# ----
translate_6 = Translate(Pt=column_base_4, Transform=vector_4, Component="{ .Translate")

# ---- group: Column Supports (continued)
node_2 = Node(Coordinates=translate_6, Support=fixconstraint6dof_2, Component="{ .Node")  # -> flatten(Node)
fixed_supports_2 = Data(node_2)
