# Grasshopper definition Canopy Type 1 - JA2.1.gh (Grasshopper 1.0.7)
# plug-ins: BH.UI.Grasshopper, LunchBox

# ----
# Truss 1 Cross Bracing
panel = Panel("""0
1""")
panel_2 = Panel("""6
5
4
3
2""")
item = ListItem(Index=panel, Wrap=True)
item_2 = ListItem(Index=panel_2, Wrap=True)
end = EndPoints(Curve=item)  # -> Start, End
end_2 = EndPoints(Curve=item_2)  # -> Start, End
shift = ShiftList(List=end.Start, Shift=1, Wrap="false")
shift_2 = ShiftList(List=end_2.Start, Shift=1, Wrap="false")
short = ShortestList(ListA=shift_2, ListB=end_2.End, TrimMode=2)  # -> ListA, ListB
ln = Line(StartPoint=end.End, EndPoint=shift)
ln_2 = Line(StartPoint=short.ListA, EndPoint=short.ListB)

data = Data()
data_2 = Data()
shift_3 = ShiftList(List=data, Shift=1, Wrap=True)
shift_4 = ShiftList(List=data_2, Shift=1, Wrap=True)

midpt = CurveMiddle()
points = PointList(Size=Slider(500, range=5..10000))

getinfo = GetInfo(Component="{ .GetInfo")
ln_3 = Line(StartPoint=data_2, EndPoint=shift_3)
ln_4 = Line(StartPoint=shift_4, EndPoint=data)
# <Script name>
project_number = Panel("")
setprojectid = SetProjectID(ProjectID=project_number, Component="{ .SetProjectID")
bhom_version_used_to_create = Panel("6.0")
bhom_version_currently_installed = Panel(getinfo)
entwine = Entwine(Branch00=ln_3, Branch01=ln_4, FlattenInputs=True)
cull = CullPattern(List=entwine, CullPattern=[True, False])
data_3 = Data(cull)

# ---- group: Inputs
no_of_canopy_sides = Slider(12, range=12..13)
external_depth = Slider(500, range=0..1000)
external_radius = Slider(16000, range=0..50000)
truss_4_radius = Slider(4000, range=0..50000)
truss_3_radius = Slider(8000, range=0..50000)
truss_2_radius = Slider(12000, range=0..50000)
truss_depth_4 = Slider(1500, range=0..10000)
truss_divisions = Panel("""2
4
4""")
pt = Point(Point(0, 0, 0))
number_of_canopy_sides = Number(no_of_canopy_sides)
external_radius_mm = Number(external_radius)
external_depth_mm = Number(external_depth)
truss_4_radius_mm = Number(truss_4_radius)
truss_3_radius_mm = Number(truss_3_radius)
truss_2_radius_mm = Number(truss_2_radius)
truss_depth_1_mm = Number(truss_depth_4)
truss_divisions_2 = Number(truss_divisions)
centre_point = Point(pt)

# ----
# Inputs
no_of_canopy_sides_2 = Slider(12, range=12..13)
external_radius_2 = Slider(16000, range=0..50000)
truss_4_radius_2 = Slider(4000, range=0..50000)
truss_3_radius_2 = Slider(8000, range=0..50000)
truss_2_radius_2 = Slider(12000, range=0..50000)
truss_depth_1 = Slider(1500, range=0..10000)
truss_depth_2 = Slider(500, range=0..1000)

# ---- group: Create Circles
external_radius_mm_2 = Number(external_radius_mm)
truss_4_radius_mm_2 = Number(truss_4_radius_mm)
truss_3_radius_mm_2 = Number(truss_3_radius_mm)
truss_2_radius_mm_2 = Number(truss_2_radius_mm)
centre_point_2 = Point(centre_point)
cir = Circle(Plane=centre_point_2, Radius=truss_4_radius_mm_2)
cir_2 = Circle(Plane=centre_point_2, Radius=truss_3_radius_mm_2)
cir_3 = Circle(Plane=centre_point_2, Radius=truss_2_radius_mm_2)
cir_4 = Circle(Plane=centre_point_2, Radius=external_radius_mm_2)
circle_external = Geometry(cir_4)
circle_truss_4 = Geometry(cir)
circle_truss_3 = Geometry(cir_2)
circle_truss_2 = Geometry(cir_3)

# ---- group: Move Circles
external_depth_mm_2 = Number(external_depth_mm)
truss_depth_1_mm_2 = Number(truss_depth_1_mm)
circle_external_2 = Geometry(circle_external)
circle_truss_4_2 = Geometry(circle_truss_4)
Z = UnitZ(Factor=truss_depth_1_mm_2)  # -> expr("-x", UnitVector)
Z_2 = UnitZ(Factor=external_depth_mm_2)  # -> expr("-x", UnitVector)
move = Move(Geometry=circle_truss_4_2, Motion=Z)  # -> Geometry, Transform
move_2 = Move(Geometry=circle_external_2, Motion=Z_2)  # -> Geometry, Transform
circle_external_lower = Geometry(move_2.Geometry)
circle_truss_4_lower = Geometry(move.Geometry)

# ---- group: Radial Chords - Upper
number_of_canopy_sides_2 = Number(number_of_canopy_sides)
circle_external_3 = Geometry(circle_external)
circle_truss_4_3 = Geometry(circle_truss_4)
divide = DivideCurve(Curve=circle_truss_4_3, Count=number_of_canopy_sides_2, Kinks=False)  # -> Points, Tangents, Parameters
divide_2 = DivideCurve(Curve=circle_external_3, Count=number_of_canopy_sides_2, Kinks=False)  # -> Points, Tangents, Parameters
ln_5 = Line(StartPoint=divide.Points, EndPoint=divide_2.Points)
radial_chords_upper = Geometry(ln_5)

# ---- group: Radial Chords - Lower
number_of_canopy_sides_3 = Number(number_of_canopy_sides)
circle_truss_4_lower_2 = Geometry(circle_truss_4_lower)
circle_external_lower_2 = Geometry(circle_external_lower)
divide_3 = DivideCurve(Curve=circle_truss_4_lower_2, Count=number_of_canopy_sides_3, Kinks=False)  # -> Points, Tangents, Parameters
divide_4 = DivideCurve(Curve=circle_external_lower_2, Count=number_of_canopy_sides_3, Kinks=False)  # -> Points, Tangents, Parameters
ln_6 = Line(StartPoint=divide_3.Points, EndPoint=divide_4.Points)
radial_chords_lower = Geometry(ln_6)

# ---- group: Split Chords at Inner Trusses
radial_chords_lower_2 = Geometry(graft(radial_chords_lower))
radial_chords_upper_2 = Geometry(graft(radial_chords_upper))
truss_depth_1_mm_3 = Number(truss_depth_1_mm)
circle_truss_3_2 = Geometry(circle_truss_3)
circle_truss_2_2 = Geometry(circle_truss_2)
Z_3 = UnitZ(Factor=truss_depth_1_mm_3)  # -> expr("-x", UnitVector)
extr = Extrude(Base=circle_truss_3_2, Direction=Z_3)
extr_2 = Extrude(Base=circle_truss_2_2, Direction=Z_3)
bcx = BrepCurve(Brep=[extr, extr_2], Curve=radial_chords_upper_2)  # -> Curves, Points
bcx_2 = BrepCurve(Brep=[extr, extr_2], Curve=radial_chords_lower_2)  # -> Curves, Points
end_3 = EndPoints(Curve=radial_chords_upper_2)  # -> Start, End
# Trim Tree = Collapses last branch of path
end_4 = EndPoints(Curve=radial_chords_lower_2)  # -> Start, End
trim = TrimTree(Tree=bcx.Points, Depth=1)
trim_2 = TrimTree(Tree=bcx_2.Points, Depth=1)
merge = Merge(Data1=end_3.Start, Data2=trim, Data3=end_3.End)
merge_2 = Merge(Data1=end_4.Start, Data2=trim_2, Data3=end_4.End)
pline = PolyLine(Vertices=merge, Closed=False)  # -> simplify(Polyline)
pline_2 = PolyLine(Vertices=merge_2, Closed=False)  # -> simplify(Polyline)
radial_chords_lower_3 = Geometry(pline_2)
radial_chords_upper_3 = Geometry(pline)

# ----
# Truss 1 Top Chord
polygon = Polygon(Plane=PlaneXY(0, 0, 0), Radius=truss_4_radius_2, Segments=no_of_canopy_sides_2, FilletRadius=0)  # -> Polygon, Length
polygon_2 = Polygon(Plane=PlaneXY(0, 0, 0), Radius=truss_3_radius_2, Segments=no_of_canopy_sides_2, FilletRadius=0)  # -> Polygon, Length
polygon_3 = Polygon(Plane=PlaneXY(0, 0, 0), Radius=truss_2_radius_2, Segments=no_of_canopy_sides_2, FilletRadius=0)  # -> Polygon, Length
polygon_4 = Polygon(Plane=PlaneXY(0, 0, 0), Radius=external_radius_2, Segments=no_of_canopy_sides_2, FilletRadius=0)  # -> Polygon, Length
divide_5 = DivideCurve(Curve=polygon.Polygon, Count=no_of_canopy_sides_2, Kinks=False)  # -> Points, Tangents, Parameters
divide_6 = DivideCurve(Curve=polygon_4.Polygon, Count=no_of_canopy_sides_2, Kinks=False)  # -> Points, Tangents, Parameters
divide_7 = DivideCurve(Curve=polygon_2.Polygon, Count=no_of_canopy_sides_2, Kinks=False)  # -> Points, Tangents, Parameters
divide_8 = DivideCurve(Curve=polygon_3.Polygon, Count=no_of_canopy_sides_2, Kinks=False)  # -> Points, Tangents, Parameters
ln_7 = Line(StartPoint=divide_8.Points, EndPoint=divide_6.Points)
ln_8 = Line(StartPoint=divide_5.Points, EndPoint=divide_7.Points)
ln_9 = Line(StartPoint=divide_7.Points, EndPoint=divide_8.Points)
midpt_2 = CurveMiddle(Curve=ln_7)
midpt_3 = CurveMiddle(Curve=ln_9)
midpt_4 = CurveMiddle(Curve=ln_8)

# ---- group: Center Point
pcen = PolygonCenter(Polyline=polygon.Polygon)  # -> CenterV, CenterE, CenterA

# ----
cp = ControlPoints(Curve=polygon.Polygon)  # -> Points, Weights, Knots

radial_chords_lower_4 = Geometry(radial_chords_lower_3)
# Flip Matrix = Swaps the ros and columns of data tree
# Tree must only have one layer (otherwise use path mapper)
radial_chords_upper_4 = Geometry(radial_chords_upper_3)
cp_2 = ControlPoints(Curve=radial_chords_upper_4)  # -> simplify(Points), Weights, Knots
cp_3 = ControlPoints(Curve=radial_chords_lower_4)  # -> simplify(Points), Weights, Knots
flip = FlipMatrix(Data=cp_2.Points)
flip_2 = FlipMatrix(Data=cp_3.Points)
pline_3 = PolyLine(Vertices=flip, Closed=True)
pline_4 = PolyLine(Vertices=flip_2, Closed=True)
circumferential_chords_upper = Geometry(pline_3)
circumferential_chords_upper_2 = Geometry(pline_4)

column_base_level_mm = Slider(-5000, range=-10000..0)
column_length_mm = Slider(5500, range=0..10000)
number_of_cols = Slider(3, range=0..10)
column_base_level_mm_2 = Number(column_base_level_mm)
column_length_mm_2 = Number(column_length_mm)
number_of_cols_2 = Number(number_of_cols)

# ---- group: Circ Trusses - More Control over Direction of Diagonals
circumferential_chords_upper_3 = Geometry(simplify(circumferential_chords_upper_2))
circumferential_chords_upper_4 = Geometry(simplify(circumferential_chords_upper))
truss_divisions_circumferential = Number(truss_divisions_2)
item_3 = ListItem(List=truss_divisions_circumferential, Index=0, Wrap=True)  # -> Item, Item1, Item2
bang = ExplodeTree(Data=circumferential_chords_upper_4)  # -> Branch0, Branch1, Branch2, Branch3
bang_2 = ExplodeTree(Data=circumferential_chords_upper_3)  # -> Branch0, Branch1, Branch2, Branch3
explode = Explode(Curve=bang.Branch0, Recursive=True)  # -> Segments, Vertices
explode_2 = Explode(Curve=bang.Branch1, Recursive=True)  # -> Segments, Vertices
explode_3 = Explode(Curve=bang.Branch2, Recursive=True)  # -> Segments, Vertices
explode_4 = Explode(Curve=bang_2.Branch0, Recursive=True)  # -> Segments, Vertices
explode_5 = Explode(Curve=bang_2.Branch1, Recursive=True)  # -> Segments, Vertices
explode_6 = Explode(Curve=bang_2.Branch2, Recursive=True)  # -> Segments, Vertices
number_slider = Slider(0, range=0..3)
truss = _2DTruss(CurveA=simplify(explode_4.Segments), CurveB=simplify(explode.Segments), Divisions=item_3.Item, TrussToggle=number_slider)  # -> simplify(PrimaryLines), simplify(BraceLines), simplify(VerticalLines), StructureNodes
truss_2 = _2DTruss(
    CurveA=simplify(explode_2.Segments),
    CurveB=simplify(explode_5.Segments),
    Divisions=item_3.Item1,
    TrussToggle=number_slider)  # -> simplify(PrimaryLines), simplify(BraceLines), simplify(VerticalLines), StructureNodes
truss_3 = _2DTruss(
    CurveA=simplify(explode_3.Segments),
    CurveB=simplify(explode_6.Segments),
    Divisions=item_3.Item2,
    TrussToggle=number_slider)  # -> simplify(PrimaryLines), simplify(BraceLines), simplify(VerticalLines), StructureNodes
join = JoinCurves(Curves=truss.PrimaryLines, Preserve=False)
join_2 = JoinCurves(Curves=truss_2.PrimaryLines, Preserve=False)
join_3 = JoinCurves(Curves=truss_3.PrimaryLines, Preserve=False)
midpt_5 = CurveMiddle(Curve=join)
midpt_6 = CurveMiddle(Curve=join_2)
midpt_7 = CurveMiddle(Curve=join_3)
pdecon = Deconstruct(Point=midpt_5)  # -> XComponent, YComponent, ZComponent
pdecon_2 = Deconstruct(Point=midpt_6)  # -> XComponent, YComponent, ZComponent
pdecon_3 = Deconstruct(Point=midpt_7)  # -> XComponent, YComponent, ZComponent
sort = SortList(Keys=pdecon.ZComponent, ValuesA=join)  # -> Keys, ValuesA
sort_2 = SortList(Keys=pdecon_2.ZComponent, ValuesA=join_2)  # -> Keys, ValuesA
sort_3 = SortList(Keys=pdecon_3.ZComponent, ValuesA=join_3)  # -> Keys, ValuesA
item_4 = ListItem(List=sort.ValuesA, Index=0, Wrap=True)  # -> Item, Item1
item_5 = ListItem(List=sort_2.ValuesA, Index=0, Wrap=True)  # -> Item, Item1
item_6 = ListItem(List=sort_3.ValuesA, Index=0, Wrap=True)  # -> Item, Item1
cull_i = CullIndex(List=truss.VerticalLines, Indices=[0, -1], Wrap=True)
cull_i_2 = CullIndex(List=truss_2.VerticalLines, Indices=[0, -1], Wrap=True)
cull_i_3 = CullIndex(List=truss_3.VerticalLines, Indices=[0, -1], Wrap=True)
entwine_2 = Entwine(Branch00=item_4.Item1, Branch01=item_5.Item1, Branch02=item_6.Item1, FlattenInputs=True)
entwine_3 = Entwine(Branch00=item_4.Item, Branch01=item_5.Item, Branch02=item_6.Item, FlattenInputs=True)
entwine_4 = Entwine(Branch00=truss.BraceLines, Branch01=truss_2.BraceLines, Branch02=truss_3.BraceLines, FlattenInputs=True)
entwine_5 = Entwine(Branch00=cull_i, Branch01=cull_i_2, Branch02=cull_i_3, FlattenInputs=True)
truss_bottom_chords = Geometry(entwine_3)
truss_top_chords = Geometry(entwine_2)
truss_diagonals = Geometry(entwine_4)
truss_verticals = Geometry(entwine_5)

# ---- group: Circ Trusses
circumferential_chords_upper_5 = Geometry(flatten(circumferential_chords_upper))  # disabled
circumferential_chords_upper_6 = Geometry(flatten(circumferential_chords_upper_2))  # disabled
truss_divisions_circumferential_2 = Number(truss_divisions_2)  # disabled
cull_i_4 = CullIndex(List=circumferential_chords_upper_5, Indices=-1, Wrap=True)  # disabled
cull_i_5 = CullIndex(List=circumferential_chords_upper_6, Indices=-1, Wrap=True)  # disabled
number_slider_2 = Slider(0, range=0..3)  # disabled
explode_7 = Explode(Curve=cull_i_4, Recursive=True)  # -> Segments, Vertices; disabled
explode_8 = Explode(Curve=cull_i_5, Recursive=True)  # -> Segments, Vertices; disabled
truss_4 = _2DTruss(
    CurveA=simplify(explode_7.Segments),
    CurveB=simplify(explode_8.Segments),
    Divisions=graft(truss_divisions_circumferential_2),
    TrussToggle=number_slider_2)  # -> simplify(PrimaryLines), simplify(BraceLines), simplify(VerticalLines), StructureNodes; disabled
join_4 = JoinCurves(Curves=truss_4.PrimaryLines, Preserve=False)  # disabled
item_7 = ListItem(List=join_4, Index=0, Wrap=True)  # -> Item, Item1; disabled
cull_i_6 = CullIndex(List=truss_4.VerticalLines, Indices=[0, -1], Wrap=True)  # disabled
truss_bottomchords = Geometry(item_7.Item1)  # disabled
truss_top_chords_2 = Geometry(item_7.Item)  # disabled
truss_verticals_2 = Geometry(truss_4.BraceLines)  # disabled
truss_verticals_3 = Geometry(cull_i_6)  # disabled

# ---- group: Plan Bracing
radial_chords_upper_5 = Geometry(radial_chords_upper_3)
radial_chords_lower_5 = Geometry(radial_chords_lower_3)
explode_9 = Explode(Curve=radial_chords_upper_5, Recursive=True)  # -> simplify(Segments), Vertices
explode_10 = Explode(Curve=radial_chords_lower_5, Recursive=True)  # -> simplify(Segments), Vertices
flip_3 = FlipMatrix(Data=explode_9.Segments)
flip_4 = FlipMatrix(Data=explode_10.Segments)
shift_5 = ShiftList(List=flip_3, Shift=1, Wrap=True)
shift_6 = ShiftList(List=flip_4, Shift=1, Wrap=True)
end_5 = EndPoints(Curve=flip_3)  # -> Start, End
end_6 = EndPoints(Curve=shift_5)  # -> Start, End
end_7 = EndPoints(Curve=flip_4)  # -> Start, End
end_8 = EndPoints(Curve=shift_6)  # -> Start, End
ln_10 = Line(StartPoint=end_5.End, EndPoint=end_6.Start)
ln_11 = Line(StartPoint=end_5.Start, EndPoint=end_6.End)
ln_12 = Line(StartPoint=end_7.End, EndPoint=end_8.Start)
ln_13 = Line(StartPoint=end_7.Start, EndPoint=end_8.End)
plan_bracing_bottom = Geometry([ln_12, ln_13])
plan_bracing_top = Geometry([ln_10, ln_11])

# ---- group: Column - By Base Height
radial_chords_lower_6 = Geometry(flatten(radial_chords_lower_3))
column_base_level_mm_3 = Number(column_base_level_mm_2)
number_of_cols_3 = Number(number_of_cols_2)
lng = ListLength(List=radial_chords_lower_6)
shift_cols_around = Slider(0, range=0..10)
division = Division(A=lng, B=number_of_cols_3)
series = Series(Start=0, Step=1, Count=number_of_cols_3)
multiplication = Multiplication(A=division, B=series)
addition = Addition(A=multiplication, B=shift_cols_around)
item_8 = ListItem(List=radial_chords_lower_6, Index=addition, Wrap=True)
cp_4 = ControlPoints(Curve=item_8)  # -> Points, Weights, Knots
item_9 = ListItem(List=cp_4.Points, Index=0, Wrap=True)  # -> Item, Item1
pdecon_4 = Deconstruct(Point=item_9.Item1)  # -> XComponent, YComponent, ZComponent
pt_2 = ConstructPoint(XCoordinate=pdecon_4.XComponent, YCoordinate=pdecon_4.YComponent, ZCoordinate=column_base_level_mm_3)
ln_14 = Line(StartPoint=item_9.Item1, EndPoint=pt_2)
column = Geometry(ln_14)

# ---- group: Column - By Length
radial_chords_lower_7 = Geometry(flatten(radial_chords_lower_3))
column_length_mm_3 = Number(column_length_mm_2)
number_of_cols_4 = Number(number_of_cols_2)
lng_2 = ListLength(List=radial_chords_lower_7)
shift_cols_around_2 = Slider(0, range=0..10)
division_2 = Division(A=lng_2, B=number_of_cols_4)
series_2 = Series(Start=0, Step=1, Count=number_of_cols_4)
multiplication_2 = Multiplication(A=division_2, B=series_2)
addition_2 = Addition(A=multiplication_2, B=shift_cols_around_2)
item_10 = ListItem(List=radial_chords_lower_7, Index=addition_2, Wrap=True)
cp_5 = ControlPoints(Curve=item_10)  # -> Points, Weights, Knots
item_11 = ListItem(List=cp_5.Points, Index=0, Wrap=True)  # -> Item, Item1
Z_4 = UnitZ(Factor=1)  # -> expr("-x", UnitVector)
line = LineSDL(Start=item_11.Item1, Direction=Z_4, Length=column_length_mm_3)
column_2 = Geometry(line)

# ----
# Horizontal Cross Bracing (Top)
entwine_6 = Entwine(Branch00=ln_7, Branch01=ln_9, FlattenInputs=True)
end_9 = EndPoints(Curve=entwine_6)  # -> Start, End
data_4 = Data(end_9.End)
data_5 = Data(end_9.Start)
shift_7 = ShiftList(List=data_4, Shift=1, Wrap=True)
shift_8 = ShiftList(List=data_5, Shift=1, Wrap=True)
ln_15 = Line(StartPoint=data_5, EndPoint=shift_7)
ln_16 = Line(StartPoint=shift_8, EndPoint=data_4)
entwine_7 = Entwine(Branch00=ln_15, Branch01=ln_16, FlattenInputs=True)
cull_2 = CullPattern(List=entwine_7, CullPattern=[True, False])
data_6 = Data(cull_2)

geo = Geometry(Line((0, 0, 0), (0, 0, 1)))

# ---- group: Plan Bracing
plan_bracing_bottom_2 = Geometry(plan_bracing_bottom)
plan_bracing_top_2 = Geometry(plan_bracing_top)

# ---- group: Circumfrencial Trusses
truss_bottom_chords_2 = Geometry(truss_bottom_chords)
truss_top_chords_3 = Geometry(truss_top_chords)
truss_diagonals_2 = Geometry(truss_diagonals)
truss_verticals_4 = Geometry(truss_verticals)

# ----
# Truss 1 Bot Chord
panel_3 = Panel("0")
neg = Negative(Value=truss_depth_2)
neg_2 = Negative(Value=truss_depth_1)
Z_5 = UnitZ(Factor=neg)
Z_6 = UnitZ(Factor=neg_2)
polygon_5 = Polygon(Plane=Z_5, Radius=external_radius_2, Segments=no_of_canopy_sides_2, FilletRadius=0)  # -> Polygon, Length
polygon_6 = Polygon(Plane=Z_6, Radius=truss_4_radius_2, Segments=no_of_canopy_sides_2, FilletRadius=0)  # -> Polygon, Length
divide_9 = DivideCurve(Curve=polygon_5.Polygon, Count=no_of_canopy_sides_2, Kinks=False)  # -> Points, Tangents, Parameters
divide_10 = DivideCurve(Curve=polygon_6.Polygon, Count=no_of_canopy_sides_2, Kinks=False)  # -> Points, Tangents, Parameters
ln_17 = Line(StartPoint=divide_10.Points, EndPoint=divide_9.Points)

project = ProjectPoint(Point=divide_8.Points, Direction=Vector(0, 0, -1), Geometry=ln_17)  # -> Point, Index
project_2 = ProjectPoint(Point=divide_6.Points, Direction=Vector(0, 0, -1), Geometry=ln_17)  # -> Point, Index
project_3 = ProjectPoint(Point=divide_7.Points, Direction=Vector(0, 0, -1), Geometry=ln_17)  # -> Point, Index
project_4 = ProjectPoint(Point=divide_5.Points, Direction=Vector(0, 0, -1), Geometry=ln_17)  # -> Point, Index
project_5 = ProjectPoint(Point=midpt_3, Direction=Vector(0, 0, -1), Geometry=ln_17)  # -> Point, Index
project_6 = ProjectPoint(Point=midpt_4, Direction=Vector(0, 0, -1), Geometry=ln_17)  # -> Point, Index
project_7 = ProjectPoint(Point=midpt_2, Direction=Vector(0, 0, -1), Geometry=ln_17)  # -> Point, Index

# ----
# Truss 4 Generation
no_of_bays = Slider(2, range=0..10)
shatter = Shatter(Curve=polygon_6.Polygon, Parameters=divide_10.Parameters, UseTasks=True)
shatter_2 = Shatter(Curve=polygon.Polygon, Parameters=divide_5.Parameters, UseTasks=True)
divide_11 = DivideCurve(Curve=shatter, Count=no_of_bays, Kinks=False)  # -> Points, Tangents, Parameters
divide_12 = DivideCurve(Curve=shatter_2, Count=no_of_bays, Kinks=False)  # -> Points, Tangents, Parameters
ln_18 = Line(StartPoint=divide_11.Points, EndPoint=divide_12.Points)
cull_3 = CullPattern(List=ln_18, CullPattern=[False, True])

# ----
# Horizontal Cross Bracing (Bot)
ln_19 = Line(StartPoint=project_3.Point, EndPoint=project.Point)
ln_20 = Line(StartPoint=project.Point, EndPoint=project_2.Point)
entwine_8 = Entwine(Branch00=ln_19, Branch01=ln_20, FlattenInputs=True)
end_10 = EndPoints(Curve=entwine_8)  # -> Start, End
data_7 = Data(end_10.End)
data_8 = Data(end_10.Start)
shift_9 = ShiftList(List=data_7, Shift=1, Wrap=True)
shift_10 = ShiftList(List=data_8, Shift=1, Wrap=True)
ln_21 = Line(StartPoint=data_8, EndPoint=shift_9)
ln_22 = Line(StartPoint=shift_10, EndPoint=data_7)
entwine_9 = Entwine(Branch00=ln_21, Branch01=ln_22, FlattenInputs=True)
cull_4 = CullPattern(List=entwine_9, CullPattern=[True, False])
data_9 = Data(cull_4)

# ----
# Truss 1 Cross Bracing
end_11 = EndPoints(Curve=ln_8)  # -> Start, End
end_12 = EndPoints(Curve=ln_20)  # -> Start, End
end_13 = EndPoints(Curve=ln_7)  # -> Start, End
ln_23 = Line(StartPoint=end_11.Start, EndPoint=project_4.Point)
ln_24 = Line(StartPoint=midpt_4, EndPoint=project_6.Point)
ln_25 = Line(StartPoint=end_11.End, EndPoint=project_3.Point)
ln_26 = Line(StartPoint=midpt_3, EndPoint=project_5.Point)
ln_27 = Line(StartPoint=end_13.Start, EndPoint=project.Point)
ln_28 = Line(StartPoint=midpt_2, EndPoint=project_7.Point)
ln_29 = Line(StartPoint=end_13.End, EndPoint=project_2.Point)
end_14 = EndPoints(Curve=ln_25)  # -> Start, End
end_15 = EndPoints(Curve=ln_24)  # -> Start, End
end_16 = EndPoints(Curve=ln_23)  # -> Start, End
end_17 = EndPoints(Curve=ln_26)  # -> Start, End
end_18 = EndPoints(Curve=ln_27)  # -> Start, End
end_19 = EndPoints(Curve=ln_28)  # -> Start, End
end_20 = EndPoints(Curve=ln_29)  # -> Start, End
ln_30 = Line(StartPoint=end_16.End, EndPoint=end_14.End)
ln_31 = Line(StartPoint=end_15.Start, EndPoint=end_16.End)
ln_32 = Line(StartPoint=end_14.Start, EndPoint=end_15.End)
ln_33 = Line(StartPoint=end_18.End, EndPoint=end_17.Start)
ln_34 = Line(StartPoint=end_17.End, EndPoint=end_14.Start)
ln_35 = Line(StartPoint=end_19.End, EndPoint=end_18.Start)
ln_36 = Line(StartPoint=end_20.End, EndPoint=end_19.Start)

len = Length(Curve=flatten(ln_27))
len_2 = Length(Curve=flatten(ln_25))
item_12 = ListItem(List=len, Index="0", Wrap=True)
item_13 = ListItem(List=len_2, Index=panel_3, Wrap=True)
neg_3 = Negative(Value=item_13)
neg_4 = Negative(Value=item_12)
Z_7 = UnitZ(Factor=neg_3)
Z_8 = UnitZ(Factor=neg_4)
polygon_7 = Polygon(Plane=Z_7, Radius=truss_3_radius_2, Segments=no_of_canopy_sides_2, FilletRadius=0)  # -> Polygon, Length
polygon_8 = Polygon(Plane=Z_8, Radius=truss_2_radius_2, Segments=no_of_canopy_sides_2, FilletRadius=0)  # -> Polygon, Length

# ----
# Truss 2 Generation
no_of_bays_2 = Slider(4, range=0..10)
divide_13 = DivideCurve(Curve=polygon_3.Polygon, Count=no_of_canopy_sides_2, Kinks=False)  # -> Points, Tangents, Parameters
divide_14 = DivideCurve(Curve=polygon_8.Polygon, Count=no_of_canopy_sides_2, Kinks=False)  # -> Points, Tangents, Parameters
shatter_3 = Shatter(Curve=polygon_3.Polygon, Parameters=divide_13.Parameters, UseTasks=True)
shatter_4 = Shatter(Curve=polygon_8.Polygon, Parameters=divide_14.Parameters, UseTasks=True)
divide_15 = DivideCurve(Curve=shatter_3, Count=no_of_bays_2, Kinks=False)  # -> Points, Tangents, Parameters
divide_16 = DivideCurve(Curve=shatter_4, Count=no_of_bays_2, Kinks=False)  # -> Points, Tangents, Parameters
ln_37 = Line(StartPoint=divide_15.Points, EndPoint=divide_16.Points)
cull_5 = CullPattern(List=ln_37, CullPattern=[False, True, True, True])

# ----
# Truss 3 Generation
no_of_bays_3 = Slider(4, range=0..10)
divide_17 = DivideCurve(Curve=polygon_7.Polygon, Count=no_of_canopy_sides_2, Kinks=False)  # -> Points, Tangents, Parameters
shatter_5 = Shatter(Curve=polygon_2.Polygon, Parameters=divide_7.Parameters, UseTasks=True)
shatter_6 = Shatter(Curve=polygon_7.Polygon, Parameters=divide_17.Parameters, UseTasks=True)
divide_18 = DivideCurve(Curve=shatter_5, Count=no_of_bays_3, Kinks=False)  # -> Points, Tangents, Parameters
divide_19 = DivideCurve(Curve=shatter_6, Count=no_of_bays_3, Kinks=False)  # -> Points, Tangents, Parameters
ln_38 = Line(StartPoint=divide_18.Points, EndPoint=divide_19.Points)
cull_6 = CullPattern(List=ln_38, CullPattern=[False, True, True, True])

# ----
# Truss 3 Cross Bracing
panel_4 = Panel("""3
2""")
panel_5 = Panel("""1
0""")
panel_6 = Panel("""1
2""")
panel_7 = Panel("""3
4""")
item_14 = ListItem(List=ln_38, Index=panel_5, Wrap=True)
item_15 = ListItem(List=ln_38, Index=panel_6, Wrap=True)
item_16 = ListItem(List=ln_38, Index=panel_4, Wrap=True)
item_17 = ListItem(List=ln_38, Index=panel_7, Wrap=True)
end_21 = EndPoints(Curve=item_14)  # -> Start, End
end_22 = EndPoints(Curve=item_15)  # -> Start, End
end_23 = EndPoints(Curve=item_16)  # -> Start, End
end_24 = EndPoints(Curve=item_17)  # -> Start, End
shift_11 = ShiftList(List=end_21.Start, Shift=1, Wrap="false")
shift_12 = ShiftList(List=end_22.Start, Shift=1, Wrap="false")
shift_13 = ShiftList(List=end_23.Start, Shift=1, Wrap="false")
shift_14 = ShiftList(List=end_24.Start, Shift=1, Wrap="false")
short_2 = ShortestList(ListA=shift_11, ListB=end_21.End, TrimMode=2)  # -> ListA, ListB
short_3 = ShortestList(ListA=shift_12, ListB=end_22.End, TrimMode=2)  # -> ListA, ListB
short_4 = ShortestList(ListA=shift_13, ListB=end_23.End, TrimMode=2)  # -> ListA, ListB
short_5 = ShortestList(ListA=shift_14, ListB=end_24.End, TrimMode=2)  # -> ListA, ListB
ln_39 = Line(StartPoint=short_2.ListA, EndPoint=short_2.ListB)
ln_40 = Line(StartPoint=short_3.ListA, EndPoint=short_3.ListB)
ln_41 = Line(StartPoint=short_4.ListA, EndPoint=short_4.ListB)
ln_42 = Line(StartPoint=short_5.ListA, EndPoint=short_5.ListB)

# ----
# Truss 2 Cross Bracing
panel_8 = Panel("""1
0""")
panel_9 = Panel("""3
2""")
panel_10 = Panel("""1
2""")
panel_11 = Panel("""3
4""")
item_18 = ListItem(List=ln_37, Index=panel_8, Wrap=True)
item_19 = ListItem(List=ln_37, Index=panel_10, Wrap=True)
item_20 = ListItem(List=ln_37, Index=panel_9, Wrap=True)
item_21 = ListItem(List=ln_37, Index=panel_11, Wrap=True)
end_25 = EndPoints(Curve=item_18)  # -> Start, End
end_26 = EndPoints(Curve=item_19)  # -> Start, End
end_27 = EndPoints(Curve=item_20)  # -> Start, End
end_28 = EndPoints(Curve=item_21)  # -> Start, End
shift_15 = ShiftList(List=end_25.Start, Shift=1, Wrap="false")
shift_16 = ShiftList(List=end_26.Start, Shift=1, Wrap="false")
shift_17 = ShiftList(List=end_27.Start, Shift=1, Wrap="false")
shift_18 = ShiftList(List=end_28.Start, Shift=1, Wrap="false")
short_6 = ShortestList(ListA=shift_15, ListB=end_25.End, TrimMode=2)  # -> ListA, ListB
short_7 = ShortestList(ListA=shift_16, ListB=end_26.End, TrimMode=2)  # -> ListA, ListB
short_8 = ShortestList(ListA=shift_17, ListB=end_27.End, TrimMode=2)  # -> ListA, ListB
short_9 = ShortestList(ListA=shift_18, ListB=end_28.End, TrimMode=2)  # -> ListA, ListB
ln_43 = Line(StartPoint=short_6.ListA, EndPoint=short_6.ListB)
ln_44 = Line(StartPoint=short_7.ListA, EndPoint=short_7.ListB)
ln_45 = Line(StartPoint=short_8.ListA, EndPoint=short_8.ListB)
ln_46 = Line(StartPoint=short_9.ListA, EndPoint=short_9.ListB)

# ----
# Truss 4 Cross Bracing
panel_12 = Panel("""1
0""")
panel_13 = Panel("""1
2""")
item_22 = ListItem(List=ln_18, Index=panel_12, Wrap=True)
item_23 = ListItem(List=ln_18, Index=panel_13, Wrap=True)
end_29 = EndPoints(Curve=item_22)  # -> Start, End
end_30 = EndPoints(Curve=item_23)  # -> Start, End
shift_19 = ShiftList(List=end_29.Start, Shift=1, Wrap="false")
shift_20 = ShiftList(List=end_30.Start, Shift=1, Wrap="false")
short_10 = ShortestList(ListA=shift_19, ListB=end_29.End, TrimMode=2)  # -> ListA, ListB
short_11 = ShortestList(ListA=shift_20, ListB=end_30.End, TrimMode=2)  # -> ListA, ListB
ln_47 = Line(StartPoint=short_10.ListA, EndPoint=short_10.ListB)
ln_48 = Line(StartPoint=short_11.ListA, EndPoint=short_11.ListB)

# ----
# Columns
no_off_columns = Slider(3, range=0..10)
Z_9 = UnitZ(Factor=1)
divide_20 = DivideCurve(Curve=polygon_7.Polygon, Count=no_off_columns, Kinks=False)  # -> Points, Tangents, Parameters
neg_5 = Negative(Value=Z_9)
line_2 = LineSDL(Start=divide_20.Points, Direction=neg_5, Length=Slider(8000, range=0..100000))

# ---- group: Circ Trusses - No Lunch Box
circumferential_chords_upper_7 = Geometry(simplify(circumferential_chords_upper_2))
circumferential_chords_upper_8 = Geometry(simplify(circumferential_chords_upper))
truss_divisions_circumferential_3 = Number(truss_divisions_2)
bang_3 = ExplodeTree(Data=circumferential_chords_upper_7)  # -> Branch0, Branch1, Branch2, Branch3
item_24 = ListItem(List=truss_divisions_circumferential_3, Index=0, Wrap=True)  # -> Item, Item1, Item2
bang_4 = ExplodeTree(Data=circumferential_chords_upper_8)  # -> Branch0, Branch1, Branch2, Branch3

explode_11 = Explode(Curve=bang_3.Branch0, Recursive=True)  # -> Segments, Vertices
explode_12 = Explode(Curve=bang_4.Branch0, Recursive=True)  # -> Segments, Vertices
divide_21 = DivideCurve(Curve=explode_12.Segments, Count=item_24.Item, Kinks=False)  # -> Points, Tangents, Parameters
divide_22 = DivideCurve(Curve=explode_11.Segments, Count=item_24.Item, Kinks=False)  # -> Points, Tangents, Parameters
shift_21 = ShiftList(List=divide_22.Points, Shift=1, Wrap=True)
ln_49 = Line(StartPoint=divide_21.Points, EndPoint=divide_22.Points)
shift_22 = ShiftList(List=divide_21.Points, Shift=1, Wrap=True)
pline_5 = PolyLine(Vertices=divide_22.Points, Closed=False)
pline_6 = PolyLine(Vertices=divide_21.Points, Closed=False)
panel_14 = Panel("""0
1""")
cull_i_7 = CullIndex(List=ln_49, Indices=[0, -1], Wrap=True)
ln_50 = Line(StartPoint=shift_22, EndPoint=divide_22.Points)
ln_51 = Line(StartPoint=divide_21.Points, EndPoint=shift_21)
repeat = RepeatData(Data=panel_14, Length=item_24.Item)
cull_i_8 = CullIndex(List=ln_50, Indices=-1, Wrap=True)
cull_i_9 = CullIndex(List=ln_51, Indices=-1, Wrap=True)
p_n_c = PickNChoose(Pattern=repeat, Stream0=cull_i_8, Stream1=cull_i_9)

explode_13 = Explode(Curve=bang_3.Branch1, Recursive=True)  # -> Segments, Vertices
explode_14 = Explode(Curve=bang_4.Branch1, Recursive=True)  # -> Segments, Vertices
divide_23 = DivideCurve(Curve=explode_14.Segments, Count=item_24.Item1, Kinks=False)  # -> Points, Tangents, Parameters
divide_24 = DivideCurve(Curve=explode_13.Segments, Count=item_24.Item1, Kinks=False)  # -> Points, Tangents, Parameters
shift_23 = ShiftList(List=divide_24.Points, Shift=1, Wrap=True)
ln_52 = Line(StartPoint=divide_23.Points, EndPoint=divide_24.Points)
shift_24 = ShiftList(List=divide_23.Points, Shift=1, Wrap=True)
pline_7 = PolyLine(Vertices=divide_24.Points, Closed=False)
pline_8 = PolyLine(Vertices=divide_23.Points, Closed=False)
panel_15 = Panel("""0
1""")
cull_i_10 = CullIndex(List=ln_52, Indices=[0, -1], Wrap=True)
ln_53 = Line(StartPoint=shift_24, EndPoint=divide_24.Points)
ln_54 = Line(StartPoint=divide_23.Points, EndPoint=shift_23)
repeat_2 = RepeatData(Data=reverse(panel_15), Length=item_24.Item1)
cull_i_11 = CullIndex(List=ln_53, Indices=-1, Wrap=True)
cull_i_12 = CullIndex(List=ln_54, Indices=-1, Wrap=True)
p_n_c_2 = PickNChoose(Pattern=repeat_2, Stream0=cull_i_11, Stream1=cull_i_12)

explode_15 = Explode(Curve=bang_3.Branch2, Recursive=True)  # -> Segments, Vertices
explode_16 = Explode(Curve=bang_4.Branch2, Recursive=True)  # -> Segments, Vertices
divide_25 = DivideCurve(Curve=explode_16.Segments, Count=item_24.Item1, Kinks=False)  # -> Points, Tangents, Parameters
divide_26 = DivideCurve(Curve=explode_15.Segments, Count=item_24.Item1, Kinks=False)  # -> Points, Tangents, Parameters
shift_25 = ShiftList(List=divide_26.Points, Shift=1, Wrap=True)
ln_55 = Line(StartPoint=divide_25.Points, EndPoint=divide_26.Points)
shift_26 = ShiftList(List=divide_25.Points, Shift=1, Wrap=True)
pline_9 = PolyLine(Vertices=divide_26.Points, Closed=False)
pline_10 = PolyLine(Vertices=divide_25.Points, Closed=False)
panel_16 = Panel("""0
1""")
cull_i_13 = CullIndex(List=ln_55, Indices=[0, -1], Wrap=True)
ln_56 = Line(StartPoint=shift_26, EndPoint=divide_26.Points)
ln_57 = Line(StartPoint=divide_25.Points, EndPoint=shift_25)
repeat_3 = RepeatData(Data=reverse(panel_16), Length=item_24.Item1)
cull_i_14 = CullIndex(List=ln_56, Indices=-1, Wrap=True)
cull_i_15 = CullIndex(List=ln_57, Indices=-1, Wrap=True)
p_n_c_3 = PickNChoose(Pattern=repeat_3, Stream0=cull_i_14, Stream1=cull_i_15)

entwine_10 = Entwine(Branch00=pline_6, Branch01=pline_8, Branch02=pline_10, FlattenInputs=True)
entwine_11 = Entwine(Branch00=pline_5, Branch01=pline_7, Branch02=pline_9, FlattenInputs=True)
entwine_12 = Entwine(Branch00=p_n_c, Branch01=p_n_c_2, Branch02=p_n_c_3, FlattenInputs=True)
entwine_13 = Entwine(Branch00=cull_i_7, Branch01=cull_i_10, Branch02=cull_i_13, FlattenInputs=True)
truss_bottom_chords_3 = Geometry(entwine_11)
truss_top_chords_4 = Geometry(entwine_10)
truss_diagonals_3 = Geometry(entwine_12)
truss_verticals_5 = Geometry(entwine_13)

# ---- group: Radial Trusses
radial_chords_lower_8 = Geometry(radial_chords_lower_3)
radial_chords_upper_6 = Geometry(radial_chords_upper_3)
explode_17 = Explode(Curve=radial_chords_upper_6, Recursive=True)  # -> Segments, Vertices
explode_18 = Explode(Curve=radial_chords_lower_8, Recursive=True)  # -> Segments, Vertices
truss_5 = _2DTruss(
    CurveA=explode_17.Segments,
    CurveB=explode_18.Segments,
    Divisions=Slider(2, range=0..10),
    TrussToggle=Slider(2, range=0..3))  # -> PrimaryLines, BraceLines, VerticalLines, StructureNodes
join_5 = JoinCurves(Curves=truss_5.PrimaryLines, Preserve=False)
item_25 = ListItem(List=join_5, Index=0, Wrap=True)  # -> Item, Item1
radial_truss_bottomchords = Geometry(simplify(item_25.Item1))
radial_truss_top_chords = Geometry(simplify(item_25.Item))
radial_truss_diagonals = Geometry(simplify(truss_5.BraceLines))

# ---- group: Radial Trusses / Cull duplicates
trim_3 = TrimTree(Tree=simplify(truss_5.VerticalLines), Depth=1)
midpt_8 = CurveMiddle(Curve=trim_3)
cullpt = CullDuplicates(Points=midpt_8, Tolerance=0.1, CullMode=1)  # -> Points, Indices, Valence
item_26 = ListItem(List=trim_3, Index=cullpt.Indices, Wrap=True)

# ---- group: Radial Trusses (continued)
radial_truss_verticals = Geometry(simplify(item_26))

# ---- group: Radial Trusses - No Lunchbox
radial_chords_lower_9 = Geometry(radial_chords_lower_3)
radial_chords_upper_7 = Geometry(radial_chords_upper_3)
number_slider_3 = Slider(2, range=0..10)
explode_19 = Explode(Curve=radial_chords_lower_9, Recursive=True)  # -> Segments, Vertices
explode_20 = Explode(Curve=radial_chords_upper_7, Recursive=True)  # -> Segments, Vertices
divide_27 = DivideCurve(Curve=explode_20.Segments, Count=number_slider_3, Kinks=False)  # -> Points, Tangents, Parameters
divide_28 = DivideCurve(Curve=explode_19.Segments, Count=number_slider_3, Kinks=False)  # -> Points, Tangents, Parameters
shift_27 = ShiftList(List=divide_27.Points, Shift=1, Wrap=True)
pline_11 = PolyLine(Vertices=divide_27.Points, Closed=False)
pline_12 = PolyLine(Vertices=divide_28.Points, Closed=False)
ln_58 = Line(StartPoint=divide_27.Points, EndPoint=divide_28.Points)
ln_59 = Line(StartPoint=divide_28.Points, EndPoint=shift_27)
cull_i_16 = CullIndex(List=ln_59, Indices=-1, Wrap=True)
radial_truss_bottomchords_2 = Geometry(pline_12)
radial_truss_top_chords_2 = Geometry(pline_11)
radial_truss_diagonals_2 = Geometry(cull_i_16)

# ---- group: Radial Trusses - No Lunchbox / Cull duplicates
trim_4 = TrimTree(Tree=simplify(ln_58), Depth=1)
midpt_9 = CurveMiddle(Curve=trim_4)
cullpt_2 = CullDuplicates(Points=midpt_9, Tolerance=0.1, CullMode=1)  # -> Points, Indices, Valence
item_27 = ListItem(List=trim_4, Index=cullpt_2.Indices, Wrap=True)

# ---- group: Radial Trusses - No Lunchbox (continued)
radial_truss_verticals_2 = Geometry(item_27)

# ---- group: Radial Trusses - More Control
radial_chords_lower_10 = Geometry(radial_chords_lower_3)
radial_chords_upper_8 = Geometry(radial_chords_upper_3)
number_slider_4 = Slider(2, range=0..3)
number_slider_5 = Slider(2, range=0..10)
explode_21 = Explode(Curve=radial_chords_upper_8, Recursive=True)  # -> Segments, Vertices
explode_22 = Explode(Curve=radial_chords_lower_10, Recursive=True)  # -> Segments, Vertices
item_28 = ListItem(List=explode_21.Segments, Index=0, Wrap=True)  # -> Item, Item1, Item2
item_29 = ListItem(List=explode_22.Segments, Index=0, Wrap=True)  # -> Item, Item1, Item2
truss_6 = _2DTruss(CurveA=item_28.Item, CurveB=item_29.Item, Divisions=number_slider_5, TrussToggle=number_slider_4)  # -> PrimaryLines, BraceLines, VerticalLines, StructureNodes
truss_7 = _2DTruss(CurveA=item_29.Item1, CurveB=item_28.Item1, Divisions=number_slider_5, TrussToggle=number_slider_4)  # -> PrimaryLines, BraceLines, VerticalLines, StructureNodes
truss_8 = _2DTruss(CurveA=item_29.Item2, CurveB=item_28.Item2, Divisions=number_slider_5, TrussToggle=number_slider_4)  # -> PrimaryLines, BraceLines, VerticalLines, StructureNodes
join_6 = JoinCurves(Curves=truss_6.PrimaryLines, Preserve=False)
join_7 = JoinCurves(Curves=truss_7.PrimaryLines, Preserve=False)
join_8 = JoinCurves(Curves=truss_8.PrimaryLines, Preserve=False)
midpt_10 = CurveMiddle(Curve=join_6)
midpt_11 = CurveMiddle(Curve=join_7)
midpt_12 = CurveMiddle(Curve=join_8)
pdecon_5 = Deconstruct(Point=midpt_10)  # -> XComponent, YComponent, ZComponent
pdecon_6 = Deconstruct(Point=midpt_11)  # -> XComponent, YComponent, ZComponent
pdecon_7 = Deconstruct(Point=midpt_12)  # -> XComponent, YComponent, ZComponent
sort_4 = SortList(Keys=pdecon_5.ZComponent, ValuesA=join_6)  # -> Keys, reverse(ValuesA)
sort_5 = SortList(Keys=pdecon_6.ZComponent, ValuesA=join_7)  # -> Keys, reverse(ValuesA)
sort_6 = SortList(Keys=pdecon_7.ZComponent, ValuesA=join_8)  # -> Keys, reverse(ValuesA)
item_30 = ListItem(List=sort_4.ValuesA, Index=0, Wrap=True)  # -> Item, Item1
item_31 = ListItem(List=sort_5.ValuesA, Index=0, Wrap=True)  # -> Item, Item1
item_32 = ListItem(List=sort_6.ValuesA, Index=0, Wrap=True)  # -> Item, Item1
entwine_14 = Entwine(Branch00=item_30.Item, Branch01=item_31.Item, Branch02=item_32.Item, FlattenInputs=True)
entwine_15 = Entwine(Branch00=item_30.Item1, Branch01=item_31.Item1, Branch02=item_32.Item1, FlattenInputs=True)
radial_truss_bottomchords_3 = Geometry(simplify(entwine_15))
radial_truss_top_chords_3 = Geometry(simplify(entwine_14))
radial_truss_diagonals_3 = Geometry(simplify([truss_6.BraceLines, truss_7.BraceLines, truss_8.BraceLines]))

# ---- group: Radial Trusses - More Control / Cull duplicates
geo_2 = Geometry(simplify([truss_6.VerticalLines, truss_7.VerticalLines, truss_8.VerticalLines]))
midpt_13 = CurveMiddle(Curve=geo_2)
cullpt_3 = CullDuplicates(Points=midpt_13, Tolerance=0.1, CullMode=1)  # -> Points, Indices, Valence
item_33 = ListItem(List=geo_2, Index=cullpt_3.Indices, Wrap=True)

# ----
flip_5 = FlipCurve(Curve=item_33, Guide=geo)  # -> Curve, Flag

# ---- group: Radial Trusses - More Control (continued)
radial_truss_verticals_3 = Geometry(simplify(flip_5.Curve))

# ---- group: Radial Trusses
radial_truss_bottomchords_4 = Geometry(radial_truss_bottomchords_3)
radial_truss_top_chords_4 = Geometry(radial_truss_top_chords_3)
radial_truss_diagonals_4 = Geometry(radial_truss_diagonals_3)
radial_truss_verticals_4 = Geometry(radial_truss_verticals_3)
