# Grasshopper definition Canopy Type 1 Final (Transformations).gh (Grasshopper 1.0.7)
# plug-ins: LunchBox, BH.UI.Grasshopper

# Inputs
# Truss 1 Cross Bracing
geo = Geometry([Line((23.03919053, 19.30064697, 29.9), (23.03919053, 19.30064697, 36)), Line((60.63420948, 30.64762002, -0.9), (60.63420948, 30.64762002, 18.4)), Line((59.31774003, 12.45253915, -0.9), (59.31774003, 12.45253915, 14.9)), Line((55.64372594, 39.29160037, -0.9), (55.64372594, 39.29160037, 18.4)), Line((65.57434339, 39.27513344, -0.9), (65.57434339, 39.27513344, 18.4)), Line((69.86488052, 19.26666668, -0.9), (69.86488052, 19.26666668, 14.9))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])
column_length_mm = Slider(5500, range=0..10000)
column_base_level_mm = Slider(-5000, range=-10000..0)
number_of_cols = Slider(3, range=0..10)
division = Division(A=Slider(20900, range=0..100000), B="1000")
division_2 = Division(A=column_base_level_mm, B="1000")
number_of_cols_2 = Number(number_of_cols)
column_base_level_mm_2 = Number(division_2)
column_length_mm_2 = Number(division)
geo_2 = Geometry(Line((0, 0, 0), (0, 0, 1)))

midpt = CurveMiddle()
points = PointList(Points=midpt, Size=Slider(1, range=0..100))

revitadapter = RevitAdapter(Active=Toggle(True), Component="{ ..ctor")
filterbyselection = FilterBySelection(Component="{ .FilterBySelection")
pull = Pull(
    Adapter=revitadapter,
    Request=filterbyselection,
    PullType="{ \"_t\" : \"System.Enum\", \"TypeName\" : { \"_t\" : \"System.Type\", \"Name\" : \"BH.oM.Adapter.PullType\", \"_bhomVersion\" : \"6.0\" }, \"Value\" : \"AdapterDefault\", \"_bhomVersion\" : \"6.0\" }",
    Active=Toggle(False),
    Component="{ .Pull")

# ---- group: Canopy 2
geo_3 = Geometry(Tree({0}: [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, Line((50.19712613, 64.26695758, 11.642), (49.52385374, 61.859323, 9.142)), Line((50.87039852, 66.67459217, 11.642), (50.19712613, 64.26695758, 9.376375)), Line((51.5436709, 69.08222675, 9.845125), (50.87039852, 66.67459217, 11.642)), Line((52.21694329, 71.48986134, 10.0795), (51.5436709, 69.08222675, 11.642)), Line((53.02487016, 74.37902284, 10.36075), (52.21694329, 71.48986134, 11.642)), Line((53.83279703, 77.26818434, 10.642), (53.02487016, 74.37902284, 11.642)), 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], {0;0}: [Line((47.97103133, 61.87621219, 9.142), (47.97103133, 61.87621219, 11.642)), Line((45.06498063, 61.13131662, 9.142), (45.06498063, 61.13131662, 11.642)), Line((42.92071467, 59.0331928, 9.142), (42.92071467, 59.0331928, 11.642)), Line((42.11278781, 56.14403133, 9.142), (42.11278781, 56.14403133, 11.642)), Line((42.85768338, 53.23798063, 9.142), (42.85768338, 53.23798063, 11.642)), Line((44.9558072, 51.09371467, 9.142), (44.9558072, 51.09371467, 11.642))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], {0;0;0}: [Line((42.44543269, 77.39203842, 10.642), (36.71800623, 67.51708497, 10.0795)), Line((26.72081566, 62.00579703, 10.642), (32.40906297, 52.10822377, 10.0795)), Line((32.18338317, 40.69475857, 10.642), (43.59905671, 40.67213866, 10.0795)), Line((53.37056731, 34.76996158, 10.642), (59.09799377, 44.64491503, 10.0795)), Line((69.09518434, 50.15620297, 10.642), (63.40693703, 60.05377623, 10.0795)), Line((63.63261683, 71.46724143, 10.642), (52.21694329, 71.48986134, 10.0795))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], {0;0;1}: [Line((37.25248079, 53.34971634, 9.61075), (37.25248079, 53.34971634, -2.03125))], {0;0;2}: [Line((55.60112072, 48.21869158, 9.61075), (55.60112072, 48.21869158, -2.03125))], {0;1}: [Line((49.44697797, 66.69007393, 11.642), (49.44697797, 66.69007393, 9.61075)), Line((48.02355743, 66.70555569, 11.642), (48.02355743, 66.70555569, 9.61075)), Line((46.60013689, 66.72103745, 11.642), (46.60013689, 66.72103745, 9.61075)), Line((43.93625708, 66.03821651, 11.642), (43.93625708, 66.03821651, 9.61075)), Line((42.69579781, 65.33991381, 11.642), (42.69579781, 65.33991381, 9.61075)), Line((41.45533855, 64.64161111, 11.642), (41.45533855, 64.64161111, 9.61075))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]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))

# ---- group: Canopy 3
geo_4 = Geometry(Tree({0}: [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, Line((88.34889898, 71.46976146, 6.5), (86.87993265, 70.11250764, 4)), Line((89.8178653, 72.82701528, 6.5), (88.34889898, 71.46976146, 4.25)), Line((91.28683163, 74.1842691, 4.75), (89.8178653, 72.82701528, 6.5)), Line((92.75579796, 75.54152292, 5), (91.28683163, 74.1842691, 6.5)), Line((94.22476428, 76.89877674, 5.25), (92.75579796, 75.54152292, 6.5)), Line((95.69373061, 78.25603056, 5.5), (94.22476428, 76.89877674, 6.5)), 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], {0;0}: [Line((86.00450158, 70.66515327, 4), (86.00450158, 70.66515327, 6.5)), Line((84.09460212, 71.25868851, 4), (84.09460212, 71.25868851, 6.5)), Line((82.14381305, 70.81775539, 4), (82.14381305, 70.81775539, 6.5)), Line((80.67484673, 69.46050158, 4), (80.67484673, 69.46050158, 6.5)), Line((80.08131149, 67.55060212, 4), (80.08131149, 67.55060212, 6.5)), Line((80.52224461, 65.59981305, 4), (80.52224461, 65.59981305, 6.5))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], {0;0;0}: [Line((88.69028205, 82.67719558, 5.5), (81.29640119, 79.10273438, 5)), Line((73.08396944, 79.14973061, 5.5), (72.48260332, 70.95921154, 5)), Line((68.33568749, 63.87053493, 5.5), (75.12820204, 59.25447708, 5)), Line((79.19371795, 52.11880442, 5.5), (86.58759881, 55.69326562, 5)), Line((94.80003056, 55.64626939, 5.5), (95.40139668, 63.83678846, 5)), Line((99.54831251, 70.92546507, 5.5), (92.75579796, 75.54152292, 5))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], {0;0;1}: [Line((76.30240221, 69.77214103, 4.5), (76.30240221, 69.77214103, -1.5))], {0;0;2}: [Line((85.70573254, 59.59484375, 4.5), (85.70573254, 59.59484375, -1.5))], {0;1}: [Line((88.94243424, 73.37966091, 6.5), (88.94243424, 73.37966091, 4.5)), Line((88.06700317, 73.93230654, 6.5), (88.06700317, 73.93230654, 4.5)), Line((87.1915721, 74.48495216, 6.5), (87.1915721, 74.48495216, 4.5)), Line((85.28167263, 75.07848741, 6.5), (85.28167263, 75.07848741, 4.5)), Line((84.24720424, 75.11937702, 6.5), (84.24720424, 75.11937702, 4.5)), Line((83.21273585, 75.16026664, 6.5), (83.21273585, 75.16026664, 4.5))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]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))

# ---- group: Canopy 4
geo_5 = Geometry(Tree({0}: [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, Line((64.81902195, 38.83734986, 20.9), (64.06425403, 38.39964945, 18.4)), Line((65.57378986, 39.27505027, 20.9), (64.81902195, 38.83734986, 18.5090625)), Line((68.27927598, 40.84399931, 19.0090625), (65.57378986, 39.27505027, 20.9)), Line((70.9847621, 42.41294835, 19.4), (68.27927598, 40.84399931, 20.9)), Line((72.71488912, 43.41627308, 19.65), (70.9847621, 42.41294835, 20.9)), Line((74.44501614, 44.4195978, 19.9), (72.71488912, 43.41627308, 20.9)), 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], {0;0}: [Line((63.33079861, 39.13029293, 18.4), (63.33079861, 39.13029293, 20.9)), Line((61.59683039, 40.12696451, 18.4), (61.59683039, 40.12696451, 20.9)), Line((59.59683407, 40.12312333, 18.4), (59.59683407, 40.12312333, 20.9)), Line((57.86670707, 39.11979861, 18.4), (57.86670707, 39.11979861, 20.9)), Line((56.87003549, 37.38583039, 18.4), (56.87003549, 37.38583039, 20.9)), Line((56.87387667, 35.38583407, 18.4), (56.87387667, 35.38583407, 20.9))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], {0;0;0}: [Line((68.57737277, 50.26474563, 19.9), (60.58095279, 48.39297787, 19.4)), Line((52.5774022, 50.23401614, 19.9), (50.20019078, 42.37302957, 19.4)), Line((44.60402951, 36.36227039, 19.9), (50.2232379, 30.37305165, 19.4)), Line((52.63062723, 22.52125437, 19.9), (60.62704721, 24.39302213, 19.4)), Line((68.6305978, 22.55198386, 19.9), (71.00780922, 30.41297043, 19.4)), Line((76.60397049, 36.42372961, 19.9), (70.9847621, 42.41294835, 19.4))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], {0;0;1}: [Line((55.62317634, 39.25593916, 18.618125), (55.62317634, 39.25593916, -2.281875))], {0;0;2}: [Line((60.61503385, 30.6480106, 18.618125), (60.61503385, 30.6480106, -2.281875))], {0;1}: [Line((65.04707718, 39.79974362, 20.9), (65.04707718, 39.79974362, 18.618125)), Line((64.52036451, 40.32443697, 20.9), (64.52036451, 40.32443697, 18.618125)), Line((63.99365183, 40.84913032, 20.9), (63.99365183, 40.84913032, 18.618125)), Line((62.74844591, 41.5648651, 20.9), (62.74844591, 41.5648651, 18.618125)), Line((62.02995265, 41.75590653, 20.9), (62.02995265, 41.75590653, 18.618125)), Line((61.3114594, 41.94694797, 20.9), (61.3114594, 41.94694797, 18.618125))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]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))

# ---- group: Canopy 7
geo_6 = Geometry(Tree({0}: [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, Line((68.23971493, 19.18723606, 40.2), (66.61517635, 19.10738216, 37.7)), Line((69.86425351, 19.26708995, 40.2), (68.23971493, 19.18723606, 37.9033125)), Line((72.23489128, 19.38361822, 38.4033125), (69.86425351, 19.26708995, 40.2)), Line((74.60552904, 19.50014648, 38.7), (72.23489128, 19.38361822, 40.2)), Line((76.60311722, 19.59833756, 38.95), (74.60552904, 19.50014648, 40.2)), Line((78.60070539, 19.69652864, 39.2), (76.60311722, 19.59833756, 40.2)), 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], {0;0}: [Line((66.29845474, 20.09302113, 37.7), (66.29845474, 20.09302113, 40.2)), Line((65.21462468, 21.7738877, 37.7), (65.21462468, 21.7738877, 40.2)), Line((63.43556703, 22.68764582, 37.7), (63.43556703, 22.68764582, 40.2)), Line((61.43797887, 22.58945474, 37.7), (61.43797887, 22.58945474, 40.2)), Line((59.7571123, 21.50562468, 37.7), (59.7571123, 21.50562468, 40.2)), Line((58.84335418, 19.72656703, 37.7), (58.84335418, 19.72656703, 40.2))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], {0;0;0}: [Line((76.06693257, 27.58164038, 39.2), (68.10254865, 29.5853459, 38.7)), Line((61.83447136, 34.89170539, 39.2), (56.11701972, 28.99619942, 38.7)), Line((48.38753881, 26.22106487, 39.2), (50.63447096, 18.32185352, 38.7)), Line((49.17306743, 10.24035962, 39.2), (57.13745135, 8.236654104, 38.7)), Line((63.40552864, 2.93029461, 39.2), (69.12298028, 8.825800575, 38.7)), Line((76.85246119, 11.60093513, 39.2), (74.60552904, 19.50014648, 38.7))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], {0;0;1}: [Line((58.68949033, 25.00666262, 38.106625), (58.68949033, 25.00666262, -2.093375))], {0;0;2}: [Line((59.30625622, 12.45924743, 38.106625), (59.30625622, 12.45924743, -2.093375))], {0;1}: [Line((69.57710579, 20.16069488, 40.2), (69.57710579, 20.16069488, 38.106625)), Line((69.28995807, 21.05429981, 40.2), (69.28995807, 21.05429981, 38.106625)), Line((69.00281034, 21.94790474, 40.2), (69.00281034, 21.94790474, 38.106625)), Line((68.02018291, 23.47182039, 40.2), (68.02018291, 23.47182039, 38.106625)), Line((67.3247032, 24.10213112, 40.2), (67.3247032, 24.10213112, 38.106625)), Line((66.62922349, 24.73244184, 40.2), (66.62922349, 24.73244184, 38.106625))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]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))

# ---- group: Canopy 8
geo_7 = Geometry(Tree({0}: [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, Line((22.56104031, 17.73341008, 38.2), (22.0826115, 16.16579186, 35.7)), Line((23.03946912, 19.3010283, 38.2), (22.56104031, 17.73341008, 35.904875)), Line((23.72865181, 21.55920194, 36.404875), (23.03946912, 19.3010283, 38.2)), Line((24.4178345, 23.81737559, 36.7), (23.72865181, 21.55920194, 38.2)), Line((25.00164025, 25.73027152, 36.95), (24.4178345, 23.81737559, 38.2)), Line((25.585446, 27.64316746, 37.2), (25.00164025, 25.73027152, 38.2)), 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], {0;0}: [Line((21.04794841, 16.20141528, 35.7), (21.04794841, 16.20141528, 38.2)), Line((19.09942905, 15.75055792, 35.7), (19.09942905, 15.75055792, 38.2)), Line((17.63739046, 14.38584432, 35.7), (17.63739046, 14.38584432, 38.2)), Line((17.05358472, 12.47294841, 35.7), (17.05358472, 12.47294841, 38.2)), Line((17.50444208, 10.52442905, 35.7), (17.50444208, 10.52442905, 38.2)), Line((18.86915568, 9.062390464, 35.7), (18.86915568, 9.062390464, 38.2))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], {0;0;0}: [Line((17.30814124, 27.92815479, 37.2), (12.72671838, 21.11223142, 36.7)), Line((5.611832545, 17.010446, 37.2), (9.223883904, 9.634855932, 36.7)), Line((9.218691444, 1.422291167, 37.2), (17.4121655, 0.8626244087, 36.7)), Line((24.52185876, -3.248154795, 37.2), (29.10328162, 3.567768583, 36.7)), Line((36.21816746, 7.669554, 37.2), (32.6061161, 15.04514407, 36.7)), Line((32.61130856, 23.25770883, 37.2), (24.4178345, 23.81737559, 36.7))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], {0;0;1}: [Line((13.82433809, 10.69933012, 36.10975), (13.82433809, 10.69933012, 30.10975))], {0;0;2}: [Line((25.88119281, 7.019641645, 36.10975), (25.88119281, 7.019641645, 30.10975))], {0;1}: [Line((22.09818437, 19.3334367, 38.2), (22.09818437, 19.3334367, 36.10975)), Line((21.15689962, 19.3658451, 38.2), (21.15689962, 19.3658451, 36.10975)), Line((20.21561487, 19.39825351, 38.2), (20.21561487, 19.39825351, 36.10975)), Line((18.44294939, 18.98808602, 38.2), (18.44294939, 18.98808602, 36.10975)), Line((17.61156866, 18.54551013, 38.2), (17.61156866, 18.54551013, 36.10975)), Line((16.78018793, 18.10293424, 38.2), (16.78018793, 18.10293424, 36.10975))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]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))

# ---- group: Canopy 5
geo_8 = Geometry(Tree({0}: [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, Line((35.48010344, 39.52257836, 28.15), (35.22054641, 38.68696173, 25.65)), Line((35.73966046, 40.35819499, 28.15), (35.48010344, 39.52257836, 25.759375)), Line((36.66664985, 43.34254009, 26.259375), (35.73966046, 40.35819499, 28.15)), Line((37.59363923, 46.32688519, 26.65), (36.66664985, 43.34254009, 28.15)), Line((38.18691243, 48.23686605, 26.9), (37.59363923, 46.32688519, 28.15)), Line((38.78018564, 50.14684692, 27.15), (38.18691243, 48.23686605, 28.15)), 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], {0;0}: [Line((34.18607245, 38.72770942, 25.65), (34.18607245, 38.72770942, 28.15)), Line((32.23534389, 38.28650865, 25.65), (32.23534389, 38.28650865, 28.15)), Line((30.76656378, 36.9290533, 25.65), (30.76656378, 36.9290533, 28.15)), Line((30.17329058, 35.01907245, 25.65), (30.17329058, 35.01907245, 28.15)), Line((30.61449135, 33.06834389, 25.65), (30.61449135, 33.06834389, 28.15)), Line((31.9719467, 31.59956378, 25.65), (31.9719467, 31.59956378, 28.15))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], {0;0;0}: [Line((30.50439396, 50.47282844, 27.15), (25.88926787, 43.67968055, 26.65)), Line((18.75415308, 39.61318564, 27.15), (22.32962867, 32.21979547, 26.65)), Line((22.28375926, 24.00735716, 27.15), (30.47436077, 23.40711481, 26.65)), Line((37.56360604, 19.26117156, 27.15), (42.17873213, 26.05431945, 26.65)), Line((49.31384692, 30.12081436, 27.15), (45.73837133, 37.51420453, 26.65)), Line((45.78424074, 45.72664284, 27.15), (37.59363923, 46.32688519, 26.65))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], {0;0;1}: [Line((28.42565541, 33.59854783, 25.86875), (28.42565541, 33.59854783, -3.13125))], {0;0;2}: [Line((37.93668415, 30.64425723, 25.86875), (37.93668415, 30.64425723, -3.13125))], {0;1}: [Line((34.9961323, 40.38748239, 28.15), (34.9961323, 40.38748239, 25.86875)), Line((34.25260415, 40.41676979, 28.15), (34.25260415, 40.41676979, 25.86875)), Line((33.50907599, 40.44605719, 28.15), (33.50907599, 40.44605719, 25.86875)), Line((32.10698984, 40.12894414, 28.15), (32.10698984, 40.12894414, 25.86875)), Line((31.44843184, 39.78254368, 28.15), (31.44843184, 39.78254368, 25.86875)), Line((30.78987385, 39.43614322, 28.15), (30.78987385, 39.43614322, 25.86875))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]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))

# ----
# Push to Revit
panel = Panel("UB305x102x33")
line = Line()
constantframingproperty = ConstantFramingProperty(OrientationAngle=0, Name=panel, Component="BH.oM.Physical.FramingProperties.ConstantFramingProperty")
beam = Beam(Location=line, Property=constantframingproperty, Component="BH.oM.Physical.Elements.Beam")
pushtype = PushType(
    {"FullPush": 0, "CreateOnly": 1, "CreateNonExisting": 2, "UpdateOnly": 3, "UpdateOrCreateOnly": 4, "DeleteThenCreate": 5, "AdapterDefault": 6}, selected="CreateOnly",
    Component="BH.oM.Adapter.PushType",
    Selection=1)
revitadapter_2 = RevitAdapter(Active=Toggle(True), Component="{ ..ctor")
data = Data(beam)
push = Push(Adapter=revitadapter_2, Objects=flatten(data), PushType=pushtype, Active=Toggle(False), Component="{ .Push")  # -> Objects, Success

geo_9 = Geometry([Line((23.03919053, 19.30064697, 29.9), (23.03919053, 19.30064697, 36)), Line((60.63420948, 30.64762002, -0.9), (60.63420948, 30.64762002, 18.4)), Line((58.68226471, 25.00193373, -0.9), (58.68226471, 25.00193373, 7.4)), Line((59.31774003, 12.45253915, -0.9), (59.31774003, 12.45253915, 14.9)), Line((55.64372594, 39.29160037, -0.9), (55.64372594, 39.29160037, 18.4)), Line((65.57434339, 39.27513344, -0.9), (65.57434339, 39.27513344, 18.4))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])

# ----
# Truss #3 Translation
panel_2 = Panel("{83.942,67.398,6.5}")
move = Move(Motion=panel_2)  # -> Geometry, Transform
rad = Radians(Degrees="42.73643791")
rotate = Rotate(Geometry=move.Geometry, Angle=rad, Plane=panel_2)  # -> Geometry, Transform

# ----
# Truss #4 Translation
panel_3 = Panel("{60.604,36.393,20.9}")
move_2 = Move(Motion=panel_3)  # -> Geometry, Transform
rad_2 = Radians(Degrees="30.11004210")
rotate_2 = Rotate(Geometry=move_2.Geometry, Angle=rad_2, Plane=panel_3)  # -> Geometry, Transform

# ----
# DONE
# Truss #2 Translation
panel_4 = Panel("{47.908,56.081,11.642}")
move_3 = Move(Motion=panel_4)  # -> Geometry, Transform
rad_3 = Radians(Degrees="74.37685015")
rotate_3 = Rotate(Geometry=move_3.Geometry, Angle=rad_3, Plane=panel_4)  # -> Geometry, Transform

# ----
# Truss #5 Translation
panel_5 = Panel("{34.034,34.867,28.150}")
move_4 = Move(Motion=panel_5)  # -> Geometry, Transform
rad_4 = Radians(Degrees="72.74429881")
rotate_4 = Rotate(Geometry=move_4.Geometry, Angle=rad_4, Plane=panel_5)  # -> Geometry, Transform

# ----
# Truss #7 Translation
panel_6 = Panel("{62.620,18.911,40.2}")
move_5 = Move(Motion=panel_6)  # -> Geometry, Transform
rad_5 = Radians(Degrees="2.81409851")
rotate_5 = Rotate(Geometry=move_5.Geometry, Angle=rad_5, Plane=panel_6)  # -> Geometry, Transform

# ----
# Truss #8 Translation
panel_7 = Panel("{20.915,12.340,38.2}")
move_6 = Move(Motion=panel_7)  # -> Geometry, Transform
rad_6 = Radians(Degrees="73.02808723")
rotate_6 = Rotate(Geometry=move_6.Geometry, Angle=rad_6, Plane=panel_7)  # -> Geometry, Transform

# ---- group: Inputs
no_of_canopy_sides = Slider(12, range=12..13)
external_depth = Slider(1000, range=0..1000)
external_radius = Slider(16000, range=0..50000)
truss_4_radius = Slider(4000, range=0..50000)
truss_3_radius = Slider(5745, range=0..50000)
truss_2_radius = Slider(12000, range=0..50000)
truss_depth_4 = Slider(2500, range=0..10000)
truss_divisions = Panel("""2
4
4""")
pt = Point(Point(0, 0, 0))
truss_divisions_2 = Number(truss_divisions)
centre_point = Point(pt)
number_of_canopy_sides = Number(no_of_canopy_sides)

# ----
division_3 = Division(A=external_depth, B="1000")
division_4 = Division(A=truss_depth_4, B="1000")
division_5 = Division(A=truss_4_radius, B="1000")
division_6 = Division(A=truss_3_radius, B="1000")
division_7 = Division(A=truss_2_radius, B="1000")
division_8 = Division(A=external_radius, B="1000")

# ---- group: Inputs (continued)
truss_4_radius_mm = Number(division_5)
truss_3_radius_mm = Number(division_6)
truss_2_radius_mm = Number(division_7)
external_radius_mm = Number(division_8)
truss_depth_1_mm = Number(division_4)
external_depth_mm = Number(division_3)

# ---- group: Create Circles
truss_4_radius_mm_2 = Number(truss_4_radius_mm)
truss_3_radius_mm_2 = Number(truss_3_radius_mm)
truss_2_radius_mm_2 = Number(truss_2_radius_mm)
external_radius_mm_2 = Number(external_radius_mm)
centre_point_2 = Point(centre_point)
cir = Circle(Plane=centre_point_2, Radius=truss_4_radius_mm_2)
cir_2 = Circle(Plane=centre_point_2, Radius=truss_3_radius_mm_2)
cir_3 = Circle(Plane=centre_point_2, Radius=truss_2_radius_mm_2)
cir_4 = Circle(Plane=centre_point_2, Radius=external_radius_mm_2)
circle_truss_4 = Geometry(cir)
circle_truss_3 = Geometry(cir_2)
circle_truss_2 = Geometry(cir_3)
circle_external = Geometry(cir_4)

# ---- group: Move Circles
circle_truss_4_2 = Geometry(circle_truss_4)
truss_depth_1_mm_2 = Number(truss_depth_1_mm)
circle_external_2 = Geometry(circle_external)
external_depth_mm_2 = Number(external_depth_mm)
Z = UnitZ(Factor=truss_depth_1_mm_2)  # -> expr("-x", UnitVector)
Z_2 = UnitZ(Factor=external_depth_mm_2)  # -> expr("-x", UnitVector)
move_7 = Move(Geometry=circle_truss_4_2, Motion=Z)  # -> Geometry, Transform
move_8 = Move(Geometry=circle_external_2, Motion=Z_2)  # -> Geometry, Transform
circle_truss_4_lower = Geometry(move_7.Geometry)
circle_external_lower = Geometry(move_8.Geometry)

# ---- group: Radial Chords - Upper
number_of_canopy_sides_2 = Number(number_of_canopy_sides)
circle_truss_4_3 = Geometry(circle_truss_4)
circle_external_3 = Geometry(circle_external)
divide = DivideCurve(Curve=circle_truss_4_3, Count=number_of_canopy_sides_2, Kinks=False)  # -> Points, Tangents, Parameters
divide_2 = DivideCurve(Curve=circle_external_3, Count=number_of_canopy_sides_2, Kinks=False)  # -> Points, Tangents, Parameters
ln = Line(StartPoint=divide.Points, EndPoint=divide_2.Points)
radial_chords_upper = Geometry(ln)

# ---- group: Radial Chords - Lower
number_of_canopy_sides_3 = Number(number_of_canopy_sides)
circle_truss_4_lower_2 = Geometry(circle_truss_4_lower)
circle_external_lower_2 = Geometry(circle_external_lower)
divide_3 = DivideCurve(Curve=circle_truss_4_lower_2, Count=number_of_canopy_sides_3, Kinks=False)  # -> Points, Tangents, Parameters
divide_4 = DivideCurve(Curve=circle_external_lower_2, Count=number_of_canopy_sides_3, Kinks=False)  # -> Points, Tangents, Parameters
ln_2 = Line(StartPoint=divide_3.Points, EndPoint=divide_4.Points)
radial_chords_lower = Geometry(ln_2)

# ---- group: Split Chords at Inner Trusses
radial_chords_lower_2 = Geometry(graft(radial_chords_lower))
radial_chords_upper_2 = Geometry(graft(radial_chords_upper))
circle_truss_3_2 = Geometry(circle_truss_3)
circle_truss_2_2 = Geometry(circle_truss_2)
truss_depth_1_mm_3 = Number(truss_depth_1_mm)
Z_3 = UnitZ(Factor=truss_depth_1_mm_3)  # -> expr("-x", UnitVector)
extr = Extrude(Base=circle_truss_3_2, Direction=Z_3)
extr_2 = Extrude(Base=circle_truss_2_2, Direction=Z_3)
bcx = BrepCurve(Brep=[extr, extr_2], Curve=radial_chords_upper_2)  # -> Curves, Points
bcx_2 = BrepCurve(Brep=[extr, extr_2], Curve=radial_chords_lower_2)  # -> Curves, Points
end = EndPoints(Curve=radial_chords_upper_2)  # -> Start, End
# Trim Tree = Collapses last branch of path
end_2 = EndPoints(Curve=radial_chords_lower_2)  # -> Start, End
trim = TrimTree(Tree=bcx.Points, Depth=1)
trim_2 = TrimTree(Tree=bcx_2.Points, Depth=1)
merge = Merge(Data1=end.Start, Data2=trim, Data3=end.End)
merge_2 = Merge(Data1=end_2.Start, Data2=trim_2, Data3=end_2.End)
pline = PolyLine(Vertices=merge, Closed=False)  # -> simplify(Polyline)
pline_2 = PolyLine(Vertices=merge_2, Closed=False)  # -> simplify(Polyline)
radial_chords_lower_3 = Geometry(pline_2)
radial_chords_upper_3 = Geometry(pline)

# ----
# Flip Matrix = Swaps the ros and columns of data tree
# Tree must only have one layer (otherwise use path mapper)
radial_chords_upper_4 = Geometry(radial_chords_upper_3)
radial_chords_lower_4 = Geometry(radial_chords_lower_3)
cp = ControlPoints(Curve=radial_chords_upper_4)  # -> simplify(Points), Weights, Knots
cp_2 = ControlPoints(Curve=radial_chords_lower_4)  # -> simplify(Points), Weights, Knots
flip = FlipMatrix(Data=cp.Points)
flip_2 = FlipMatrix(Data=cp_2.Points)
pline_3 = PolyLine(Vertices=flip, Closed=True)
pline_4 = PolyLine(Vertices=flip_2, Closed=True)
circumferential_chords_upper = Geometry(pline_3)
circumferential_chords_upper_2 = Geometry(pline_4)

# ---- group: Column - By Base Height
radial_chords_lower_5 = Geometry(flatten(radial_chords_lower_3))
column_base_level_mm_3 = Number(column_base_level_mm_2)
number_of_cols_3 = Number(number_of_cols_2)
lng = ListLength(List=radial_chords_lower_5)
shift_cols_around = Slider(0, range=0..10)
division_9 = Division(A=lng, B=number_of_cols_3)
series = Series(Start=0, Step=1, Count=number_of_cols_3)
multiplication = Multiplication(A=division_9, B=series)
addition = Addition(A=multiplication, B=shift_cols_around)
item = ListItem(List=radial_chords_lower_5, Index=addition, Wrap=True)
cp_3 = ControlPoints(Curve=item)  # -> Points, Weights, Knots
item_2 = ListItem(List=cp_3.Points, Index=0, Wrap=True)  # -> Item, Item1
pdecon = Deconstruct(Point=item_2.Item1)  # -> XComponent, YComponent, ZComponent
pt_2 = ConstructPoint(XCoordinate=pdecon.XComponent, YCoordinate=pdecon.YComponent, ZCoordinate=column_base_level_mm_3)
ln_3 = Line(StartPoint=item_2.Item1, EndPoint=pt_2)
column = Geometry(ln_3)

# ---- group: Column - By Length
radial_chords_lower_6 = Geometry(flatten(radial_chords_lower_3))
number_of_cols_4 = Number(number_of_cols_2)
column_length_mm_3 = Number(column_length_mm_2)
lng_2 = ListLength(List=radial_chords_lower_6)
shift_cols_around_2 = Slider(0, range=0..10)
division_10 = Division(A=lng_2, B=number_of_cols_4)
series_2 = Series(Start=0, Step=1, Count=number_of_cols_4)
multiplication_2 = Multiplication(A=division_10, B=series_2)
addition_2 = Addition(A=multiplication_2, B=shift_cols_around_2)
item_3 = ListItem(List=radial_chords_lower_6, Index=addition_2, Wrap=True)
cp_4 = ControlPoints(Curve=item_3)  # -> Points, Weights, Knots
item_4 = ListItem(List=cp_4.Points, Index=0, Wrap=True)  # -> Item, Item1
Z_4 = UnitZ(Factor=1)  # -> expr("-x", UnitVector)
line_2 = LineSDL(Start=item_4.Item1, Direction=Z_4, Length=column_length_mm_3)
column_2 = Geometry(line_2)

# ---- group: Circ Trusses - More Control over Direction of Diagonals
circumferential_chords_upper_3 = Geometry(simplify(circumferential_chords_upper))
circumferential_chords_upper_4 = Geometry(simplify(circumferential_chords_upper_2))
truss_divisions_circumferential = Number(truss_divisions_2)
item_5 = ListItem(List=truss_divisions_circumferential, Index=0, Wrap=True)  # -> Item, Item1, Item2
bang = ExplodeTree(Data=circumferential_chords_upper_3)  # -> Branch0, Branch1, Branch2, Branch3
bang_2 = ExplodeTree(Data=circumferential_chords_upper_4)  # -> Branch0, Branch1, Branch2, Branch3
explode = Explode(Curve=bang.Branch0, Recursive=True)  # -> Segments, Vertices
explode_2 = Explode(Curve=bang.Branch1, Recursive=True)  # -> Segments, Vertices
explode_3 = Explode(Curve=bang.Branch2, Recursive=True)  # -> Segments, Vertices
explode_4 = Explode(Curve=bang_2.Branch0, Recursive=True)  # -> Segments, Vertices
explode_5 = Explode(Curve=bang_2.Branch1, Recursive=True)  # -> Segments, Vertices
explode_6 = Explode(Curve=bang_2.Branch2, Recursive=True)  # -> Segments, Vertices
number_slider = Slider(0, range=0..3)
truss = _2DTruss(CurveA=simplify(explode_4.Segments), CurveB=simplify(explode.Segments), Divisions=item_5.Item, TrussToggle=number_slider)  # -> simplify(PrimaryLines), simplify(BraceLines), simplify(VerticalLines), StructureNodes
truss_2 = _2DTruss(
    CurveA=simplify(explode_2.Segments),
    CurveB=simplify(explode_5.Segments),
    Divisions=item_5.Item1,
    TrussToggle=number_slider)  # -> simplify(PrimaryLines), simplify(BraceLines), simplify(VerticalLines), StructureNodes
truss_3 = _2DTruss(
    CurveA=simplify(explode_3.Segments),
    CurveB=simplify(explode_6.Segments),
    Divisions=item_5.Item2,
    TrussToggle=number_slider)  # -> simplify(PrimaryLines), simplify(BraceLines), simplify(VerticalLines), StructureNodes
join = JoinCurves(Curves=truss.PrimaryLines, Preserve=False)
join_2 = JoinCurves(Curves=truss_2.PrimaryLines, Preserve=False)
join_3 = JoinCurves(Curves=truss_3.PrimaryLines, Preserve=False)
midpt_2 = CurveMiddle(Curve=join)
midpt_3 = CurveMiddle(Curve=join_2)
midpt_4 = CurveMiddle(Curve=join_3)
pdecon_2 = Deconstruct(Point=midpt_2)  # -> XComponent, YComponent, ZComponent
pdecon_3 = Deconstruct(Point=midpt_3)  # -> XComponent, YComponent, ZComponent
pdecon_4 = Deconstruct(Point=midpt_4)  # -> XComponent, YComponent, ZComponent
sort = SortList(Keys=pdecon_2.ZComponent, ValuesA=join)  # -> Keys, ValuesA
sort_2 = SortList(Keys=pdecon_3.ZComponent, ValuesA=join_2)  # -> Keys, ValuesA
sort_3 = SortList(Keys=pdecon_4.ZComponent, ValuesA=join_3)  # -> Keys, ValuesA
item_6 = ListItem(List=sort.ValuesA, Index=0, Wrap=True)  # -> Item, Item1
item_7 = ListItem(List=sort_2.ValuesA, Index=0, Wrap=True)  # -> Item, Item1
item_8 = ListItem(List=sort_3.ValuesA, Index=0, Wrap=True)  # -> Item, Item1
cull_i = CullIndex(List=truss.VerticalLines, Indices=[0, -1], Wrap=True)
cull_i_2 = CullIndex(List=truss_2.VerticalLines, Indices=[0, -1], Wrap=True)
cull_i_3 = CullIndex(List=truss_3.VerticalLines, Indices=[0, -1], Wrap=True)
entwine = Entwine(Branch00=item_6.Item1, Branch01=item_7.Item1, Branch02=item_8.Item1, FlattenInputs=True)
entwine_2 = Entwine(Branch00=item_6.Item, Branch01=item_7.Item, Branch02=item_8.Item, FlattenInputs=True)
entwine_3 = Entwine(Branch00=truss.BraceLines, Branch01=truss_2.BraceLines, Branch02=truss_3.BraceLines, FlattenInputs=True)
entwine_4 = Entwine(Branch00=cull_i, Branch01=cull_i_2, Branch02=cull_i_3, FlattenInputs=True)
truss_verticals = Geometry(entwine_4)
truss_top_chords = Geometry(entwine)
truss_bottom_chords = Geometry(entwine_2)
truss_diagonals = Geometry(entwine_3)

# ---- group: Plan Bracing
radial_chords_upper_5 = Geometry(radial_chords_upper_3)
radial_chords_lower_7 = Geometry(radial_chords_lower_3)
explode_7 = Explode(Curve=radial_chords_upper_5, Recursive=True)  # -> simplify(Segments), Vertices
explode_8 = Explode(Curve=radial_chords_lower_7, Recursive=True)  # -> simplify(Segments), Vertices
flip_3 = FlipMatrix(Data=explode_7.Segments)
flip_4 = FlipMatrix(Data=explode_8.Segments)
shift = ShiftList(List=flip_3, Shift=1, Wrap=True)
shift_2 = ShiftList(List=flip_4, Shift=1, Wrap=True)
end_3 = EndPoints(Curve=flip_3)  # -> Start, End
end_4 = EndPoints(Curve=shift)  # -> Start, End
end_5 = EndPoints(Curve=flip_4)  # -> Start, End
end_6 = EndPoints(Curve=shift_2)  # -> Start, End
ln_4 = Line(StartPoint=end_3.End, EndPoint=end_4.Start)
ln_5 = Line(StartPoint=end_3.Start, EndPoint=end_4.End)
ln_6 = Line(StartPoint=end_5.End, EndPoint=end_6.Start)
ln_7 = Line(StartPoint=end_5.Start, EndPoint=end_6.End)
flip_5 = FlipMatrix(Data=[ln_6, ln_7])
flip_6 = FlipMatrix(Data=[ln_4, ln_5])
cull_i_4 = CullIndex(List=flip_5, Indices="0", Wrap=True)
cull_i_5 = CullIndex(List=flip_6, Indices="0", Wrap=True)
item_9 = ListItem(List=cull_i_4, Index="3", Wrap=True)
item_10 = ListItem(List=cull_i_5, Index="2", Wrap=True)
item_11 = ListItem(List=cull_i_5, Index="3", Wrap=True)
item_12 = ListItem(List=cull_i_4, Index="2", Wrap=True)
flip_7 = FlipMatrix(Data=item_11)
flip_8 = FlipMatrix(Data=item_9)
cull = CullPattern(List=flip_8, CullPattern=[False, True])
cull_2 = CullPattern(List=flip_7, CullPattern=[False, True])
plan_bracing_top = Geometry([cull_2, item_10])
plan_bracing_bottom = Geometry([cull, item_12])

# ---- group: Columns
plan_bracing_top_2 = Geometry(column_2)

# ---- group: Plan Bracing
plan_bracing_top_3 = Geometry(plan_bracing_top)
plan_bracing_bottom_2 = Geometry(plan_bracing_bottom)

# ---- group: Circumfrencial Trusses
truss_top_chords_2 = Geometry(truss_top_chords)
truss_bottom_chords_2 = Geometry(truss_bottom_chords)
truss_diagonals_2 = Geometry(truss_diagonals)
truss_verticals_2 = Geometry(truss_verticals)

# ---- group: Radial Trusses - More Control
radial_chords_lower_8 = Geometry(radial_chords_lower_3)
number_slider_2 = Slider(2, range=0..3)
radial_chords_upper_6 = Geometry(radial_chords_upper_3)
explode_9 = Explode(Curve=radial_chords_upper_6, Recursive=True)  # -> Segments, Vertices
explode_10 = Explode(Curve=radial_chords_lower_8, Recursive=True)  # -> Segments, Vertices
item_13 = ListItem(List=explode_9.Segments, Index=0, Wrap=True)  # -> Item, Item1, Item2
item_14 = ListItem(List=explode_10.Segments, Index=0, Wrap=True)  # -> Item, Item1, Item2
truss_4 = _2DTruss(CurveA=item_14.Item2, CurveB=item_13.Item2, Divisions=Slider(2, range=0..10), TrussToggle=number_slider_2)  # -> PrimaryLines, BraceLines, VerticalLines, StructureNodes
truss_5 = _2DTruss(CurveA=item_14.Item1, CurveB=item_13.Item1, Divisions=Slider(2, range=0..10), TrussToggle=number_slider_2)  # -> PrimaryLines, BraceLines, VerticalLines, StructureNodes
truss_6 = _2DTruss(CurveA=item_13.Item, CurveB=item_14.Item, Divisions=Slider(2, range=0..10), TrussToggle=number_slider_2)  # -> PrimaryLines, BraceLines, VerticalLines, StructureNodes
join_4 = JoinCurves(Curves=truss_6.PrimaryLines, Preserve=False)
join_5 = JoinCurves(Curves=truss_5.PrimaryLines, Preserve=False)
join_6 = JoinCurves(Curves=truss_4.PrimaryLines, Preserve=False)
midpt_5 = CurveMiddle(Curve=join_4)
midpt_6 = CurveMiddle(Curve=join_5)
midpt_7 = CurveMiddle(Curve=join_6)
pdecon_5 = Deconstruct(Point=midpt_5)  # -> XComponent, YComponent, ZComponent
pdecon_6 = Deconstruct(Point=midpt_6)  # -> XComponent, YComponent, ZComponent
pdecon_7 = Deconstruct(Point=midpt_7)  # -> XComponent, YComponent, ZComponent
sort_4 = SortList(Keys=pdecon_5.ZComponent, ValuesA=join_4)  # -> Keys, reverse(ValuesA)
sort_5 = SortList(Keys=pdecon_6.ZComponent, ValuesA=join_5)  # -> Keys, reverse(ValuesA)
sort_6 = SortList(Keys=pdecon_7.ZComponent, ValuesA=join_6)  # -> Keys, reverse(ValuesA)
item_15 = ListItem(List=sort_4.ValuesA, Index=0, Wrap=True)  # -> Item, Item1
item_16 = ListItem(List=sort_5.ValuesA, Index=0, Wrap=True)  # -> Item, Item1
item_17 = ListItem(List=sort_6.ValuesA, Index=0, Wrap=True)  # -> Item, Item1
entwine_5 = Entwine(Branch00=item_15.Item, Branch01=item_16.Item, Branch02=item_17.Item, FlattenInputs=True)
entwine_6 = Entwine(Branch00=item_15.Item1, Branch01=item_16.Item1, Branch02=item_17.Item1, FlattenInputs=True)
radial_truss_top_chords = Geometry(simplify(entwine_5))
radial_truss_bottomchords = Geometry(simplify(entwine_6))
radial_truss_diagonals = Geometry(simplify([truss_6.BraceLines, truss_5.BraceLines, truss_4.BraceLines]))

# ---- group: Radial Trusses - More Control / Cull duplicates
geo_10 = Geometry(simplify([truss_6.VerticalLines, truss_5.VerticalLines, truss_4.VerticalLines]))
midpt_8 = CurveMiddle(Curve=geo_10)
cullpt = CullDuplicates(Points=midpt_8, Tolerance=0.1, CullMode=1)  # -> Points, Indices, Valence
item_18 = ListItem(List=geo_10, Index=cullpt.Indices, Wrap=True)

# ----
flip_9 = FlipCurve(Curve=item_18, Guide=geo_2)  # -> Curve, Flag

# ---- group: Radial Trusses - More Control (continued)
radial_truss_verticals = Geometry(simplify(flip_9.Curve))

# ---- group: Radial Trusses
radial_truss_top_chords_2 = Geometry(radial_truss_top_chords)
radial_truss_bottomchords_2 = Geometry(radial_truss_bottomchords)
radial_truss_diagonals_2 = Geometry(radial_truss_diagonals)
radial_truss_verticals_2 = Geometry(radial_truss_verticals)

# ----
geo_11 = Geometry([truss_verticals_2, truss_diagonals_2, truss_bottom_chords_2, truss_top_chords_2, radial_truss_verticals_2, radial_truss_diagonals_2, radial_truss_bottomchords_2, radial_truss_top_chords_2, plan_bracing_bottom_2, plan_bracing_top_3, plan_bracing_top_2])
