# Grasshopper definition Canopy Type 1.2.gh (Grasshopper 1.0.7)
# plug-ins: LunchBox, BH.UI.Grasshopper

column_length_mm = Slider(5500, range=0..10000)
column_base_level_mm = Slider(-5000, range=-10000..0)
number_of_cols = Slider(3, range=0..10)
division = Division(A=column_length_mm, B="1000")
division_2 = Division(A=column_base_level_mm, B="1000")
number_of_cols_2 = Number(number_of_cols)
column_base_level_mm_2 = Number(division_2)
column_length_mm_2 = Number(division)
geo = Geometry(Line((0, 0, 0), (0, 0, 1)))

midpt = CurveMiddle()
points = PointList(Points=midpt, Size=Slider(1, range=0..100))

# ----
# Push to Revit
panel = Panel("UB305x102x33")
line = Line()
constantframingproperty = ConstantFramingProperty(OrientationAngle=0, Name=panel, Component="BH.oM.Physical.FramingProperties.ConstantFramingProperty")
beam = Beam(Location=line, Property=constantframingproperty, Component="BH.oM.Physical.Elements.Beam")
pushtype = PushType(
    {"FullPush": 0, "CreateOnly": 1, "CreateNonExisting": 2, "UpdateOnly": 3, "UpdateOrCreateOnly": 4, "DeleteThenCreate": 5, "AdapterDefault": 6}, selected="UpdateOnly",
    Component="BH.oM.Adapter.PushType",
    Selection=3)
revitadapter = RevitAdapter(Active=Toggle(True), Component="{ ..ctor")
data = Data(beam)
push = Push(Adapter=revitadapter, Objects=flatten(data), PushType=pushtype, Active=Toggle(False), Component="{ .Push")  # -> Objects, Success

# ---- group: Inputs
no_of_canopy_sides = Slider(12, range=12..13)
external_depth = Slider(500, range=0..1000)
external_radius = Slider(16000, range=0..50000)
# Truss 1 Cross Bracing
truss_4_radius = Slider(4000, range=0..50000)
truss_3_radius = Slider(8000, range=0..50000)
truss_2_radius = Slider(12000, range=0..50000)
truss_depth_4 = Slider(1500, range=0..10000)
truss_divisions = Panel("""2
4
4""")
# Inputs
pt = Point(Point(0, 0, 0))
truss_divisions_2 = Number(truss_divisions)
centre_point = Point(pt)
number_of_canopy_sides = Number(no_of_canopy_sides)

# ----
division_3 = Division(A=external_depth, B="1000")
division_4 = Division(A=truss_depth_4, B="1000")
division_5 = Division(A=truss_4_radius, B="1000")
division_6 = Division(A=truss_3_radius, B="1000")
division_7 = Division(A=truss_2_radius, B="1000")
division_8 = Division(A=external_radius, B="1000")

# ---- group: Inputs (continued)
truss_4_radius_mm = Number(division_5)
truss_3_radius_mm = Number(division_6)
truss_2_radius_mm = Number(division_7)
external_radius_mm = Number(division_8)
truss_depth_1_mm = Number(division_4)
external_depth_mm = Number(division_3)

# ---- group: Create Circles
truss_4_radius_mm_2 = Number(truss_4_radius_mm)
truss_3_radius_mm_2 = Number(truss_3_radius_mm)
truss_2_radius_mm_2 = Number(truss_2_radius_mm)
external_radius_mm_2 = Number(external_radius_mm)
centre_point_2 = Point(centre_point)
cir = Circle(Plane=centre_point_2, Radius=truss_4_radius_mm_2)
cir_2 = Circle(Plane=centre_point_2, Radius=truss_3_radius_mm_2)
cir_3 = Circle(Plane=centre_point_2, Radius=truss_2_radius_mm_2)
cir_4 = Circle(Plane=centre_point_2, Radius=external_radius_mm_2)
circle_truss_4 = Geometry(cir)
circle_truss_3 = Geometry(cir_2)
circle_truss_2 = Geometry(cir_3)
circle_external = Geometry(cir_4)

# ---- group: Move Circles
circle_truss_4_2 = Geometry(circle_truss_4)
truss_depth_1_mm_2 = Number(truss_depth_1_mm)
circle_external_2 = Geometry(circle_external)
external_depth_mm_2 = Number(external_depth_mm)
Z = UnitZ(Factor=truss_depth_1_mm_2)  # -> expr("-x", UnitVector)
Z_2 = UnitZ(Factor=external_depth_mm_2)  # -> expr("-x", UnitVector)
move = Move(Geometry=circle_truss_4_2, Motion=Z)  # -> Geometry, Transform
move_2 = Move(Geometry=circle_external_2, Motion=Z_2)  # -> Geometry, Transform
circle_truss_4_lower = Geometry(move.Geometry)
circle_external_lower = Geometry(move_2.Geometry)

# ---- group: Radial Chords - Upper
number_of_canopy_sides_2 = Number(number_of_canopy_sides)
circle_truss_4_3 = Geometry(circle_truss_4)
circle_external_3 = Geometry(circle_external)
divide = DivideCurve(Curve=circle_truss_4_3, Count=number_of_canopy_sides_2, Kinks=False)  # -> Points, Tangents, Parameters
divide_2 = DivideCurve(Curve=circle_external_3, Count=number_of_canopy_sides_2, Kinks=False)  # -> Points, Tangents, Parameters
ln = Line(StartPoint=divide.Points, EndPoint=divide_2.Points)
radial_chords_upper = Geometry(ln)

# ---- group: Radial Chords - Lower
number_of_canopy_sides_3 = Number(number_of_canopy_sides)
circle_truss_4_lower_2 = Geometry(circle_truss_4_lower)
circle_external_lower_2 = Geometry(circle_external_lower)
divide_3 = DivideCurve(Curve=circle_truss_4_lower_2, Count=number_of_canopy_sides_3, Kinks=False)  # -> Points, Tangents, Parameters
divide_4 = DivideCurve(Curve=circle_external_lower_2, Count=number_of_canopy_sides_3, Kinks=False)  # -> Points, Tangents, Parameters
ln_2 = Line(StartPoint=divide_3.Points, EndPoint=divide_4.Points)
radial_chords_lower = Geometry(ln_2)

# ---- group: Split Chords at Inner Trusses
radial_chords_lower_2 = Geometry(graft(radial_chords_lower))
radial_chords_upper_2 = Geometry(graft(radial_chords_upper))
circle_truss_3_2 = Geometry(circle_truss_3)
circle_truss_2_2 = Geometry(circle_truss_2)
truss_depth_1_mm_3 = Number(truss_depth_1_mm)
Z_3 = UnitZ(Factor=truss_depth_1_mm_3)  # -> expr("-x", UnitVector)
extr = Extrude(Base=circle_truss_3_2, Direction=Z_3)
extr_2 = Extrude(Base=circle_truss_2_2, Direction=Z_3)
bcx = BrepCurve(Brep=[extr, extr_2], Curve=radial_chords_upper_2)  # -> Curves, Points
bcx_2 = BrepCurve(Brep=[extr, extr_2], Curve=radial_chords_lower_2)  # -> Curves, Points
end = EndPoints(Curve=radial_chords_upper_2)  # -> Start, End
# Trim Tree = Collapses last branch of path
end_2 = EndPoints(Curve=radial_chords_lower_2)  # -> Start, End
trim = TrimTree(Tree=bcx.Points, Depth=1)
trim_2 = TrimTree(Tree=bcx_2.Points, Depth=1)
merge = Merge(Data1=end.Start, Data2=trim, Data3=end.End)
merge_2 = Merge(Data1=end_2.Start, Data2=trim_2, Data3=end_2.End)
pline = PolyLine(Vertices=merge, Closed=False)  # -> simplify(Polyline)
pline_2 = PolyLine(Vertices=merge_2, Closed=False)  # -> simplify(Polyline)
radial_chords_lower_3 = Geometry(pline_2)
radial_chords_upper_3 = Geometry(pline)

# ----
radial_chords_lower_4 = Geometry(radial_chords_lower_3)
# Flip Matrix = Swaps the ros and columns of data tree
# Tree must only have one layer (otherwise use path mapper)
radial_chords_upper_4 = Geometry(radial_chords_upper_3)
cp = ControlPoints(Curve=radial_chords_upper_4)  # -> simplify(Points), Weights, Knots
cp_2 = ControlPoints(Curve=radial_chords_lower_4)  # -> simplify(Points), Weights, Knots
flip = FlipMatrix(Data=cp.Points)
flip_2 = FlipMatrix(Data=cp_2.Points)
pline_3 = PolyLine(Vertices=flip, Closed=True)
pline_4 = PolyLine(Vertices=flip_2, Closed=True)
circumferential_chords_upper = Geometry(pline_3)
circumferential_chords_upper_2 = Geometry(pline_4)

# ---- group: Circ Trusses - More Control over Direction of Diagonals
circumferential_chords_upper_3 = Geometry(simplify(circumferential_chords_upper))
circumferential_chords_upper_4 = Geometry(simplify(circumferential_chords_upper_2))
truss_divisions_circumferential = Number(truss_divisions_2)
item = ListItem(List=truss_divisions_circumferential, Index=0, Wrap=True)  # -> Item, Item1, Item2
bang = ExplodeTree(Data=circumferential_chords_upper_3)  # -> Branch0, Branch1, Branch2, Branch3
bang_2 = ExplodeTree(Data=circumferential_chords_upper_4)  # -> Branch0, Branch1, Branch2, Branch3
explode = Explode(Curve=bang.Branch0, Recursive=True)  # -> Segments, Vertices
explode_2 = Explode(Curve=bang.Branch1, Recursive=True)  # -> Segments, Vertices
explode_3 = Explode(Curve=bang.Branch2, Recursive=True)  # -> Segments, Vertices
explode_4 = Explode(Curve=bang_2.Branch0, Recursive=True)  # -> Segments, Vertices
explode_5 = Explode(Curve=bang_2.Branch1, Recursive=True)  # -> Segments, Vertices
explode_6 = Explode(Curve=bang_2.Branch2, Recursive=True)  # -> Segments, Vertices
number_slider = Slider(0, range=0..3)
truss = _2DTruss(CurveA=simplify(explode_4.Segments), CurveB=simplify(explode.Segments), Divisions=item.Item, TrussToggle=number_slider)  # -> simplify(PrimaryLines), simplify(BraceLines), simplify(VerticalLines), StructureNodes
truss_2 = _2DTruss(
    CurveA=simplify(explode_2.Segments),
    CurveB=simplify(explode_5.Segments),
    Divisions=item.Item1,
    TrussToggle=number_slider)  # -> simplify(PrimaryLines), simplify(BraceLines), simplify(VerticalLines), StructureNodes
truss_3 = _2DTruss(
    CurveA=simplify(explode_3.Segments),
    CurveB=simplify(explode_6.Segments),
    Divisions=item.Item2,
    TrussToggle=number_slider)  # -> simplify(PrimaryLines), simplify(BraceLines), simplify(VerticalLines), StructureNodes
join = JoinCurves(Curves=truss.PrimaryLines, Preserve=False)
join_2 = JoinCurves(Curves=truss_2.PrimaryLines, Preserve=False)
join_3 = JoinCurves(Curves=truss_3.PrimaryLines, Preserve=False)
midpt_2 = CurveMiddle(Curve=join)
midpt_3 = CurveMiddle(Curve=join_2)
midpt_4 = CurveMiddle(Curve=join_3)
pdecon = Deconstruct(Point=midpt_2)  # -> XComponent, YComponent, ZComponent
pdecon_2 = Deconstruct(Point=midpt_3)  # -> XComponent, YComponent, ZComponent
pdecon_3 = Deconstruct(Point=midpt_4)  # -> XComponent, YComponent, ZComponent
sort = SortList(Keys=pdecon.ZComponent, ValuesA=join)  # -> Keys, ValuesA
sort_2 = SortList(Keys=pdecon_2.ZComponent, ValuesA=join_2)  # -> Keys, ValuesA
sort_3 = SortList(Keys=pdecon_3.ZComponent, ValuesA=join_3)  # -> Keys, ValuesA
item_2 = ListItem(List=sort.ValuesA, Index=0, Wrap=True)  # -> Item, Item1
item_3 = ListItem(List=sort_2.ValuesA, Index=0, Wrap=True)  # -> Item, Item1
item_4 = ListItem(List=sort_3.ValuesA, Index=0, Wrap=True)  # -> Item, Item1
cull_i = CullIndex(List=truss.VerticalLines, Indices=[0, -1], Wrap=True)
cull_i_2 = CullIndex(List=truss_2.VerticalLines, Indices=[0, -1], Wrap=True)
cull_i_3 = CullIndex(List=truss_3.VerticalLines, Indices=[0, -1], Wrap=True)
entwine = Entwine(Branch00=item_2.Item1, Branch01=item_3.Item1, Branch02=item_4.Item1, FlattenInputs=True)
entwine_2 = Entwine(Branch00=item_2.Item, Branch01=item_3.Item, Branch02=item_4.Item, FlattenInputs=True)
entwine_3 = Entwine(Branch00=truss.BraceLines, Branch01=truss_2.BraceLines, Branch02=truss_3.BraceLines, FlattenInputs=True)
entwine_4 = Entwine(Branch00=cull_i, Branch01=cull_i_2, Branch02=cull_i_3, FlattenInputs=True)
truss_top_chords = Geometry(entwine)
truss_bottom_chords = Geometry(entwine_2)
truss_diagonals = Geometry(entwine_3)
truss_verticals = Geometry(entwine_4)

# ---- group: Circ Trusses
circumferential_chords_upper_5 = Geometry(flatten(circumferential_chords_upper_2))  # disabled
circumferential_chords_upper_6 = Geometry(flatten(circumferential_chords_upper))  # disabled
truss_divisions_circumferential_2 = Number(truss_divisions_2)  # disabled
cull_i_4 = CullIndex(List=circumferential_chords_upper_6, Indices=-1, Wrap=True)  # disabled
cull_i_5 = CullIndex(List=circumferential_chords_upper_5, Indices=-1, Wrap=True)  # disabled
number_slider_2 = Slider(0, range=0..3)  # disabled
explode_7 = Explode(Curve=cull_i_4, Recursive=True)  # -> Segments, Vertices; disabled
explode_8 = Explode(Curve=cull_i_5, Recursive=True)  # -> Segments, Vertices; disabled
truss_4 = _2DTruss(
    CurveA=simplify(explode_7.Segments),
    CurveB=simplify(explode_8.Segments),
    Divisions=graft(truss_divisions_circumferential_2),
    TrussToggle=number_slider_2)  # -> simplify(PrimaryLines), simplify(BraceLines), simplify(VerticalLines), StructureNodes; disabled
join_4 = JoinCurves(Curves=truss_4.PrimaryLines, Preserve=False)  # disabled
item_5 = ListItem(List=join_4, Index=0, Wrap=True)  # -> Item, Item1; disabled
cull_i_6 = CullIndex(List=truss_4.VerticalLines, Indices=[0, -1], Wrap=True)  # disabled
truss_bottomchords = Geometry(item_5.Item1)  # disabled
truss_verticals_2 = Geometry(truss_4.BraceLines)  # disabled
truss_top_chords_2 = Geometry(item_5.Item)  # disabled
truss_verticals_3 = Geometry(cull_i_6)  # disabled

# ---- group: Column - By Base Height
radial_chords_lower_5 = Geometry(flatten(radial_chords_lower_3))
column_base_level_mm_3 = Number(column_base_level_mm_2)
number_of_cols_3 = Number(number_of_cols_2)
lng = ListLength(List=radial_chords_lower_5)
shift_cols_around = Slider(0, range=0..10)
division_9 = Division(A=lng, B=number_of_cols_3)
series = Series(Start=0, Step=1, Count=number_of_cols_3)
multiplication = Multiplication(A=division_9, B=series)
addition = Addition(A=multiplication, B=shift_cols_around)
item_6 = ListItem(List=radial_chords_lower_5, Index=addition, Wrap=True)
cp_3 = ControlPoints(Curve=item_6)  # -> Points, Weights, Knots
item_7 = ListItem(List=cp_3.Points, Index=0, Wrap=True)  # -> Item, Item1
pdecon_4 = Deconstruct(Point=item_7.Item1)  # -> XComponent, YComponent, ZComponent
pt_2 = ConstructPoint(XCoordinate=pdecon_4.XComponent, YCoordinate=pdecon_4.YComponent, ZCoordinate=column_base_level_mm_3)
ln_3 = Line(StartPoint=item_7.Item1, EndPoint=pt_2)
column = Geometry(ln_3)

# ---- group: Column - By Length
radial_chords_lower_6 = Geometry(flatten(radial_chords_lower_3))
number_of_cols_4 = Number(number_of_cols_2)
column_length_mm_3 = Number(column_length_mm_2)
lng_2 = ListLength(List=radial_chords_lower_6)
shift_cols_around_2 = Slider(0, range=0..10)
division_10 = Division(A=lng_2, B=number_of_cols_4)
series_2 = Series(Start=0, Step=1, Count=number_of_cols_4)
multiplication_2 = Multiplication(A=division_10, B=series_2)
addition_2 = Addition(A=multiplication_2, B=shift_cols_around_2)
item_8 = ListItem(List=radial_chords_lower_6, Index=addition_2, Wrap=True)
cp_4 = ControlPoints(Curve=item_8)  # -> Points, Weights, Knots
item_9 = ListItem(List=cp_4.Points, Index=0, Wrap=True)  # -> Item, Item1
Z_4 = UnitZ(Factor=1)  # -> expr("-x", UnitVector)
line_2 = LineSDL(Start=item_9.Item1, Direction=Z_4, Length=column_length_mm_3)
column_2 = Geometry(line_2)

# ---- group: Columns
plan_bracing_top = Geometry(column_2)

# ---- group: Circumfrencial Trusses
truss_top_chords_3 = Geometry(truss_top_chords)
truss_bottom_chords_2 = Geometry(truss_bottom_chords)
truss_diagonals_2 = Geometry(truss_diagonals)
truss_verticals_4 = Geometry(truss_verticals)

# ---- group: Radial Trusses
radial_chords_lower_7 = Geometry(radial_chords_lower_3)
radial_chords_upper_5 = Geometry(radial_chords_upper_3)
explode_9 = Explode(Curve=radial_chords_upper_5, Recursive=True)  # -> Segments, Vertices
explode_10 = Explode(Curve=radial_chords_lower_7, Recursive=True)  # -> Segments, Vertices
truss_5 = _2DTruss(
    CurveA=explode_9.Segments,
    CurveB=explode_10.Segments,
    Divisions=Slider(2, range=0..10),
    TrussToggle=Slider(2, range=0..3))  # -> PrimaryLines, BraceLines, VerticalLines, StructureNodes
join_5 = JoinCurves(Curves=truss_5.PrimaryLines, Preserve=False)
item_10 = ListItem(List=join_5, Index=0, Wrap=True)  # -> Item, Item1
radial_truss_top_chords = Geometry(simplify(item_10.Item))
radial_truss_bottomchords = Geometry(simplify(item_10.Item1))
radial_truss_diagonals = Geometry(simplify(truss_5.BraceLines))

# ---- group: Radial Trusses / Cull duplicates
trim_3 = TrimTree(Tree=simplify(truss_5.VerticalLines), Depth=1)
midpt_5 = CurveMiddle(Curve=trim_3)
cullpt = CullDuplicates(Points=midpt_5, Tolerance=0.1, CullMode=1)  # -> Points, Indices, Valence
item_11 = ListItem(List=trim_3, Index=cullpt.Indices, Wrap=True)

# ---- group: Radial Trusses (continued)
radial_truss_verticals = Geometry(simplify(item_11))

# ---- group: Plan Bracing
radial_chords_upper_6 = Geometry(radial_chords_upper_3)
radial_chords_lower_8 = Geometry(radial_chords_lower_3)
explode_11 = Explode(Curve=radial_chords_upper_6, Recursive=True)  # -> simplify(Segments), Vertices
explode_12 = Explode(Curve=radial_chords_lower_8, Recursive=True)  # -> simplify(Segments), Vertices
flip_3 = FlipMatrix(Data=explode_11.Segments)
flip_4 = FlipMatrix(Data=explode_12.Segments)
shift = ShiftList(List=flip_3, Shift=1, Wrap=True)
shift_2 = ShiftList(List=flip_4, Shift=1, Wrap=True)
end_3 = EndPoints(Curve=flip_3)  # -> Start, End
end_4 = EndPoints(Curve=shift)  # -> Start, End
end_5 = EndPoints(Curve=flip_4)  # -> Start, End
end_6 = EndPoints(Curve=shift_2)  # -> Start, End
ln_4 = Line(StartPoint=end_3.End, EndPoint=end_4.Start)
ln_5 = Line(StartPoint=end_3.Start, EndPoint=end_4.End)
ln_6 = Line(StartPoint=end_5.End, EndPoint=end_6.Start)
ln_7 = Line(StartPoint=end_5.Start, EndPoint=end_6.End)

# ----
flip_5 = FlipMatrix(Data=[ln_6, ln_7])
flip_6 = FlipMatrix(Data=[ln_4, ln_5])

# ---- group: Plan Bracing (continued)
cull_i_7 = CullIndex(List=flip_5, Indices="0", Wrap=True)
cull_i_8 = CullIndex(List=flip_6, Indices="0", Wrap=True)
item_12 = ListItem(List=cull_i_7, Index="3", Wrap=True)
item_13 = ListItem(List=cull_i_8, Index="2", Wrap=True)
item_14 = ListItem(List=cull_i_8, Index="3", Wrap=True)
item_15 = ListItem(List=cull_i_7, Index="2", Wrap=True)
flip_7 = FlipMatrix(Data=item_14)
flip_8 = FlipMatrix(Data=item_12)
cull = CullPattern(List=flip_8, CullPattern=[False, True])
cull_2 = CullPattern(List=flip_7, CullPattern=[False, True])
plan_bracing_top_2 = Geometry([cull_2, item_13])
plan_bracing_bottom = Geometry([cull, item_15])

plan_bracing_top_3 = Geometry(plan_bracing_top_2)
plan_bracing_bottom_2 = Geometry(plan_bracing_bottom)

# ---- group: Circ Trusses - No Lunch Box
circumferential_chords_upper_7 = Geometry(simplify(circumferential_chords_upper_2))
circumferential_chords_upper_8 = Geometry(simplify(circumferential_chords_upper))
truss_divisions_circumferential_3 = Number(truss_divisions_2)
bang_3 = ExplodeTree(Data=circumferential_chords_upper_7)  # -> Branch0, Branch1, Branch2, Branch3
item_16 = ListItem(List=truss_divisions_circumferential_3, Index=0, Wrap=True)  # -> Item, Item1, Item2
bang_4 = ExplodeTree(Data=circumferential_chords_upper_8)  # -> Branch0, Branch1, Branch2, Branch3

explode_13 = Explode(Curve=bang_3.Branch0, Recursive=True)  # -> Segments, Vertices
explode_14 = Explode(Curve=bang_4.Branch0, Recursive=True)  # -> Segments, Vertices
divide_5 = DivideCurve(Curve=explode_14.Segments, Count=item_16.Item, Kinks=False)  # -> Points, Tangents, Parameters
divide_6 = DivideCurve(Curve=explode_13.Segments, Count=item_16.Item, Kinks=False)  # -> Points, Tangents, Parameters
shift_3 = ShiftList(List=divide_6.Points, Shift=1, Wrap=True)
ln_8 = Line(StartPoint=divide_5.Points, EndPoint=divide_6.Points)
shift_4 = ShiftList(List=divide_5.Points, Shift=1, Wrap=True)
pline_5 = PolyLine(Vertices=divide_6.Points, Closed=False)
pline_6 = PolyLine(Vertices=divide_5.Points, Closed=False)
panel_2 = Panel("""0
1""")
cull_i_9 = CullIndex(List=ln_8, Indices=[0, -1], Wrap=True)
ln_9 = Line(StartPoint=shift_4, EndPoint=divide_6.Points)
ln_10 = Line(StartPoint=divide_5.Points, EndPoint=shift_3)
repeat = RepeatData(Data=panel_2, Length=item_16.Item)
cull_i_10 = CullIndex(List=ln_9, Indices=-1, Wrap=True)
cull_i_11 = CullIndex(List=ln_10, Indices=-1, Wrap=True)
p_n_c = PickNChoose(Pattern=repeat, Stream0=cull_i_10, Stream1=cull_i_11)

explode_15 = Explode(Curve=bang_3.Branch1, Recursive=True)  # -> Segments, Vertices
explode_16 = Explode(Curve=bang_4.Branch1, Recursive=True)  # -> Segments, Vertices
divide_7 = DivideCurve(Curve=explode_16.Segments, Count=item_16.Item1, Kinks=False)  # -> Points, Tangents, Parameters
divide_8 = DivideCurve(Curve=explode_15.Segments, Count=item_16.Item1, Kinks=False)  # -> Points, Tangents, Parameters
shift_5 = ShiftList(List=divide_8.Points, Shift=1, Wrap=True)
ln_11 = Line(StartPoint=divide_7.Points, EndPoint=divide_8.Points)
shift_6 = ShiftList(List=divide_7.Points, Shift=1, Wrap=True)
pline_7 = PolyLine(Vertices=divide_8.Points, Closed=False)
pline_8 = PolyLine(Vertices=divide_7.Points, Closed=False)
panel_3 = Panel("""0
1""")
cull_i_12 = CullIndex(List=ln_11, Indices=[0, -1], Wrap=True)
ln_12 = Line(StartPoint=shift_6, EndPoint=divide_8.Points)
ln_13 = Line(StartPoint=divide_7.Points, EndPoint=shift_5)
repeat_2 = RepeatData(Data=reverse(panel_3), Length=item_16.Item1)
cull_i_13 = CullIndex(List=ln_12, Indices=-1, Wrap=True)
cull_i_14 = CullIndex(List=ln_13, Indices=-1, Wrap=True)
p_n_c_2 = PickNChoose(Pattern=repeat_2, Stream0=cull_i_13, Stream1=cull_i_14)

explode_17 = Explode(Curve=bang_3.Branch2, Recursive=True)  # -> Segments, Vertices
explode_18 = Explode(Curve=bang_4.Branch2, Recursive=True)  # -> Segments, Vertices
divide_9 = DivideCurve(Curve=explode_18.Segments, Count=item_16.Item1, Kinks=False)  # -> Points, Tangents, Parameters
divide_10 = DivideCurve(Curve=explode_17.Segments, Count=item_16.Item1, Kinks=False)  # -> Points, Tangents, Parameters
shift_7 = ShiftList(List=divide_10.Points, Shift=1, Wrap=True)
ln_14 = Line(StartPoint=divide_9.Points, EndPoint=divide_10.Points)
shift_8 = ShiftList(List=divide_9.Points, Shift=1, Wrap=True)
pline_9 = PolyLine(Vertices=divide_10.Points, Closed=False)
pline_10 = PolyLine(Vertices=divide_9.Points, Closed=False)
panel_4 = Panel("""0
1""")
cull_i_15 = CullIndex(List=ln_14, Indices=[0, -1], Wrap=True)
ln_15 = Line(StartPoint=shift_8, EndPoint=divide_10.Points)
ln_16 = Line(StartPoint=divide_9.Points, EndPoint=shift_7)
repeat_3 = RepeatData(Data=reverse(panel_4), Length=item_16.Item1)
cull_i_16 = CullIndex(List=ln_15, Indices=-1, Wrap=True)
cull_i_17 = CullIndex(List=ln_16, Indices=-1, Wrap=True)
p_n_c_3 = PickNChoose(Pattern=repeat_3, Stream0=cull_i_16, Stream1=cull_i_17)

entwine_5 = Entwine(Branch00=pline_6, Branch01=pline_8, Branch02=pline_10, FlattenInputs=True)
entwine_6 = Entwine(Branch00=pline_5, Branch01=pline_7, Branch02=pline_9, FlattenInputs=True)
entwine_7 = Entwine(Branch00=p_n_c, Branch01=p_n_c_2, Branch02=p_n_c_3, FlattenInputs=True)
entwine_8 = Entwine(Branch00=cull_i_9, Branch01=cull_i_12, Branch02=cull_i_15, FlattenInputs=True)
truss_bottom_chords_3 = Geometry(entwine_6)
truss_diagonals_3 = Geometry(entwine_7)
truss_verticals_5 = Geometry(entwine_8)
truss_top_chords_4 = Geometry(entwine_5)

# ---- group: Radial Trusses - No Lunchbox
radial_chords_lower_9 = Geometry(radial_chords_lower_3)
radial_chords_upper_7 = Geometry(radial_chords_upper_3)
number_slider_3 = Slider(2, range=0..10)
explode_19 = Explode(Curve=radial_chords_lower_9, Recursive=True)  # -> Segments, Vertices
explode_20 = Explode(Curve=radial_chords_upper_7, Recursive=True)  # -> Segments, Vertices
divide_11 = DivideCurve(Curve=explode_20.Segments, Count=number_slider_3, Kinks=False)  # -> Points, Tangents, Parameters
divide_12 = DivideCurve(Curve=explode_19.Segments, Count=number_slider_3, Kinks=False)  # -> Points, Tangents, Parameters
shift_9 = ShiftList(List=divide_11.Points, Shift=1, Wrap=True)
pline_11 = PolyLine(Vertices=divide_11.Points, Closed=False)
pline_12 = PolyLine(Vertices=divide_12.Points, Closed=False)
ln_17 = Line(StartPoint=divide_11.Points, EndPoint=divide_12.Points)
ln_18 = Line(StartPoint=divide_12.Points, EndPoint=shift_9)
cull_i_18 = CullIndex(List=ln_18, Indices=-1, Wrap=True)
radial_truss_top_chords_2 = Geometry(pline_11)
radial_truss_bottomchords_2 = Geometry(pline_12)
radial_truss_diagonals_2 = Geometry(cull_i_18)

# ---- group: Radial Trusses - No Lunchbox / Cull duplicates
trim_4 = TrimTree(Tree=simplify(ln_17), Depth=1)
midpt_6 = CurveMiddle(Curve=trim_4)
cullpt_2 = CullDuplicates(Points=midpt_6, Tolerance=0.1, CullMode=1)  # -> Points, Indices, Valence
item_17 = ListItem(List=trim_4, Index=cullpt_2.Indices, Wrap=True)

# ---- group: Radial Trusses - No Lunchbox (continued)
radial_truss_verticals_2 = Geometry(item_17)

# ---- group: Radial Trusses - More Control
radial_chords_lower_10 = Geometry(radial_chords_lower_3)
radial_chords_upper_8 = Geometry(radial_chords_upper_3)
number_slider_4 = Slider(2, range=0..3)
number_slider_5 = Slider(2, range=0..10)
explode_21 = Explode(Curve=radial_chords_upper_8, Recursive=True)  # -> Segments, Vertices
explode_22 = Explode(Curve=radial_chords_lower_10, Recursive=True)  # -> Segments, Vertices
item_18 = ListItem(List=explode_21.Segments, Index=0, Wrap=True)  # -> Item, Item1, Item2
item_19 = ListItem(List=explode_22.Segments, Index=0, Wrap=True)  # -> Item, Item1, Item2
truss_6 = _2DTruss(CurveA=item_19.Item1, CurveB=item_18.Item1, Divisions=number_slider_5, TrussToggle=number_slider_4)  # -> PrimaryLines, BraceLines, VerticalLines, StructureNodes
truss_7 = _2DTruss(CurveA=item_19.Item2, CurveB=item_18.Item2, Divisions=number_slider_5, TrussToggle=number_slider_4)  # -> PrimaryLines, BraceLines, VerticalLines, StructureNodes
truss_8 = _2DTruss(CurveA=item_18.Item, CurveB=item_19.Item, Divisions=number_slider_5, TrussToggle=number_slider_4)  # -> PrimaryLines, BraceLines, VerticalLines, StructureNodes
join_6 = JoinCurves(Curves=truss_8.PrimaryLines, Preserve=False)
join_7 = JoinCurves(Curves=truss_6.PrimaryLines, Preserve=False)
join_8 = JoinCurves(Curves=truss_7.PrimaryLines, Preserve=False)
midpt_7 = CurveMiddle(Curve=join_6)
midpt_8 = CurveMiddle(Curve=join_7)
midpt_9 = CurveMiddle(Curve=join_8)
pdecon_5 = Deconstruct(Point=midpt_7)  # -> XComponent, YComponent, ZComponent
pdecon_6 = Deconstruct(Point=midpt_8)  # -> XComponent, YComponent, ZComponent
pdecon_7 = Deconstruct(Point=midpt_9)  # -> XComponent, YComponent, ZComponent
sort_4 = SortList(Keys=pdecon_5.ZComponent, ValuesA=join_6)  # -> Keys, reverse(ValuesA)
sort_5 = SortList(Keys=pdecon_6.ZComponent, ValuesA=join_7)  # -> Keys, reverse(ValuesA)
sort_6 = SortList(Keys=pdecon_7.ZComponent, ValuesA=join_8)  # -> Keys, reverse(ValuesA)
item_20 = ListItem(List=sort_4.ValuesA, Index=0, Wrap=True)  # -> Item, Item1
item_21 = ListItem(List=sort_5.ValuesA, Index=0, Wrap=True)  # -> Item, Item1
item_22 = ListItem(List=sort_6.ValuesA, Index=0, Wrap=True)  # -> Item, Item1
entwine_9 = Entwine(Branch00=item_20.Item, Branch01=item_21.Item, Branch02=item_22.Item, FlattenInputs=True)
entwine_10 = Entwine(Branch00=item_20.Item1, Branch01=item_21.Item1, Branch02=item_22.Item1, FlattenInputs=True)
radial_truss_top_chords_3 = Geometry(simplify(entwine_9))
radial_truss_bottomchords_3 = Geometry(simplify(entwine_10))
radial_truss_diagonals_3 = Geometry(simplify([truss_8.BraceLines, truss_6.BraceLines, truss_7.BraceLines]))

# ---- group: Radial Trusses - More Control / Cull duplicates
geo_2 = Geometry(simplify([truss_8.VerticalLines, truss_6.VerticalLines, truss_7.VerticalLines]))
midpt_10 = CurveMiddle(Curve=geo_2)
cullpt_3 = CullDuplicates(Points=midpt_10, Tolerance=0.1, CullMode=1)  # -> Points, Indices, Valence
item_23 = ListItem(List=geo_2, Index=cullpt_3.Indices, Wrap=True)

# ----
flip_9 = FlipCurve(Curve=item_23, Guide=geo)  # -> Curve, Flag

# ---- group: Radial Trusses - More Control (continued)
radial_truss_verticals_3 = Geometry(simplify(flip_9.Curve))

# ---- group: Radial Trusses
radial_truss_top_chords_4 = Geometry(radial_truss_top_chords_3)
radial_truss_bottomchords_4 = Geometry(radial_truss_bottomchords_3)
radial_truss_diagonals_4 = Geometry(radial_truss_diagonals_3)
radial_truss_verticals_4 = Geometry(radial_truss_verticals_3)
