# Grasshopper definition Canopy Type 1.gh (Grasshopper 1.0.7)
# plug-ins: BH.UI.Grasshopper

# ----
# Truss 1 Cross Bracing
panel = Panel("""0
1""")
panel_2 = Panel("""6
5
4
3
2""")
item = ListItem(Index=panel, Wrap=True)
item_2 = ListItem(Index=panel_2, Wrap=True)
end = EndPoints(Curve=item)  # -> Start, End
end_2 = EndPoints(Curve=item_2)  # -> Start, End
shift = ShiftList(List=end.Start, Shift=1, Wrap="false")
shift_2 = ShiftList(List=end_2.Start, Shift=1, Wrap="false")
short = ShortestList(ListA=shift_2, ListB=end_2.End, TrimMode=2)  # -> ListA, ListB
ln = Line(StartPoint=end.End, EndPoint=shift)
ln_2 = Line(StartPoint=short.ListA, EndPoint=short.ListB)

data = Data()
data_2 = Data()
shift_3 = ShiftList(List=data, Shift=1, Wrap=True)
shift_4 = ShiftList(List=data_2, Shift=1, Wrap=True)

midpt = CurveMiddle()
points = PointList(Size=Slider(500, range=5..10000))

getinfo = GetInfo(Component="{ .GetInfo")
ln_3 = Line(StartPoint=data_2, EndPoint=shift_3)
ln_4 = Line(StartPoint=shift_4, EndPoint=data)
# <Script name>
project_number = Panel("")
setprojectid = SetProjectID(ProjectID=project_number, Component="{ .SetProjectID")
bhom_version_used_to_create = Panel("6.0")
bhom_version_currently_installed = Panel(getinfo)
entwine = Entwine(Branch00=ln_3, Branch01=ln_4, FlattenInputs=True)
cull = CullPattern(List=entwine, CullPattern=[True, False])
data_3 = Data(cull)

# ----
# Inputs
no_of_canopy_sides = Slider(12, range=12..13)
external_radius = Slider(16000, range=0..50000)
truss_4_radius = Slider(4000, range=0..50000)
truss_3_radius = Slider(8000, range=0..50000)
truss_2_radius = Slider(12000, range=0..50000)
truss_depth_1 = Slider(1500, range=0..10000)
truss_depth_2 = Slider(500, range=0..1000)

# ----
# Truss 1 Top Chord
polygon = Polygon(Plane=PlaneXY(0, 0, 0), Radius=truss_4_radius, Segments=no_of_canopy_sides, FilletRadius=0)  # -> Polygon, Length
polygon_2 = Polygon(Plane=PlaneXY(0, 0, 0), Radius=truss_3_radius, Segments=no_of_canopy_sides, FilletRadius=0)  # -> Polygon, Length
polygon_3 = Polygon(Plane=PlaneXY(0, 0, 0), Radius=truss_2_radius, Segments=no_of_canopy_sides, FilletRadius=0)  # -> Polygon, Length
polygon_4 = Polygon(Plane=PlaneXY(0, 0, 0), Radius=external_radius, Segments=no_of_canopy_sides, FilletRadius=0)  # -> Polygon, Length
divide = DivideCurve(Curve=polygon.Polygon, Count=no_of_canopy_sides, Kinks=False)  # -> Points, Tangents, Parameters
divide_2 = DivideCurve(Curve=polygon_4.Polygon, Count=no_of_canopy_sides, Kinks=False)  # -> Points, Tangents, Parameters
divide_3 = DivideCurve(Curve=polygon_2.Polygon, Count=no_of_canopy_sides, Kinks=False)  # -> Points, Tangents, Parameters
divide_4 = DivideCurve(Curve=polygon_3.Polygon, Count=no_of_canopy_sides, Kinks=False)  # -> Points, Tangents, Parameters
ln_5 = Line(StartPoint=divide_4.Points, EndPoint=divide_2.Points)
ln_6 = Line(StartPoint=divide.Points, EndPoint=divide_3.Points)
ln_7 = Line(StartPoint=divide_3.Points, EndPoint=divide_4.Points)
midpt_2 = CurveMiddle(Curve=ln_5)
midpt_3 = CurveMiddle(Curve=ln_7)
midpt_4 = CurveMiddle(Curve=ln_6)

# ---- group: Center Point
pcen = PolygonCenter(Polyline=polygon.Polygon)  # -> CenterV, CenterE, CenterA

# ----
# Horizontal Cross Bracing (Top)
entwine_2 = Entwine(Branch00=ln_5, Branch01=ln_7, FlattenInputs=True)
end_3 = EndPoints(Curve=entwine_2)  # -> Start, End
data_4 = Data(end_3.End)
data_5 = Data(end_3.Start)
shift_5 = ShiftList(List=data_4, Shift=1, Wrap=True)
shift_6 = ShiftList(List=data_5, Shift=1, Wrap=True)
ln_8 = Line(StartPoint=data_5, EndPoint=shift_5)
ln_9 = Line(StartPoint=shift_6, EndPoint=data_4)
entwine_3 = Entwine(Branch00=ln_8, Branch01=ln_9, FlattenInputs=True)
cull_2 = CullPattern(List=entwine_3, CullPattern=[True, False])
data_6 = Data(cull_2)

# ----
# Truss 1 Bot Chord
panel_3 = Panel("0")
neg = Negative(Value=truss_depth_2)
neg_2 = Negative(Value=truss_depth_1)
Z = UnitZ(Factor=neg)
Z_2 = UnitZ(Factor=neg_2)
polygon_5 = Polygon(Plane=Z, Radius=external_radius, Segments=no_of_canopy_sides, FilletRadius=0)  # -> Polygon, Length
polygon_6 = Polygon(Plane=Z_2, Radius=truss_4_radius, Segments=no_of_canopy_sides, FilletRadius=0)  # -> Polygon, Length
divide_5 = DivideCurve(Curve=polygon_5.Polygon, Count=no_of_canopy_sides, Kinks=False)  # -> Points, Tangents, Parameters
divide_6 = DivideCurve(Curve=polygon_6.Polygon, Count=no_of_canopy_sides, Kinks=False)  # -> Points, Tangents, Parameters
ln_10 = Line(StartPoint=divide_6.Points, EndPoint=divide_5.Points)

project = ProjectPoint(Point=divide_4.Points, Direction=Vector(0, 0, -1), Geometry=ln_10)  # -> Point, Index
project_2 = ProjectPoint(Point=divide_2.Points, Direction=Vector(0, 0, -1), Geometry=ln_10)  # -> Point, Index
project_3 = ProjectPoint(Point=divide_3.Points, Direction=Vector(0, 0, -1), Geometry=ln_10)  # -> Point, Index
project_4 = ProjectPoint(Point=divide.Points, Direction=Vector(0, 0, -1), Geometry=ln_10)  # -> Point, Index
project_5 = ProjectPoint(Point=midpt_3, Direction=Vector(0, 0, -1), Geometry=ln_10)  # -> Point, Index
project_6 = ProjectPoint(Point=midpt_4, Direction=Vector(0, 0, -1), Geometry=ln_10)  # -> Point, Index
project_7 = ProjectPoint(Point=midpt_2, Direction=Vector(0, 0, -1), Geometry=ln_10)  # -> Point, Index

# ----
# Truss 4 Generation
no_of_bays = Slider(2, range=0..10)
shatter = Shatter(Curve=polygon_6.Polygon, Parameters=divide_6.Parameters, UseTasks=True)
shatter_2 = Shatter(Curve=polygon.Polygon, Parameters=divide.Parameters, UseTasks=True)
divide_7 = DivideCurve(Curve=shatter, Count=no_of_bays, Kinks=False)  # -> Points, Tangents, Parameters
divide_8 = DivideCurve(Curve=shatter_2, Count=no_of_bays, Kinks=False)  # -> Points, Tangents, Parameters
ln_11 = Line(StartPoint=divide_7.Points, EndPoint=divide_8.Points)
cull_3 = CullPattern(List=ln_11, CullPattern=[False, True])

# ----
# Horizontal Cross Bracing (Bot)
ln_12 = Line(StartPoint=project_3.Point, EndPoint=project.Point)
ln_13 = Line(StartPoint=project.Point, EndPoint=project_2.Point)
entwine_4 = Entwine(Branch00=ln_12, Branch01=ln_13, FlattenInputs=True)
end_4 = EndPoints(Curve=entwine_4)  # -> Start, End
data_7 = Data(end_4.End)
data_8 = Data(end_4.Start)
shift_7 = ShiftList(List=data_7, Shift=1, Wrap=True)
shift_8 = ShiftList(List=data_8, Shift=1, Wrap=True)
ln_14 = Line(StartPoint=data_8, EndPoint=shift_7)
ln_15 = Line(StartPoint=shift_8, EndPoint=data_7)
entwine_5 = Entwine(Branch00=ln_14, Branch01=ln_15, FlattenInputs=True)
cull_4 = CullPattern(List=entwine_5, CullPattern=[True, False])
data_9 = Data(cull_4)

# ----
# Truss 1 Cross Bracing
end_5 = EndPoints(Curve=ln_6)  # -> Start, End
end_6 = EndPoints(Curve=ln_13)  # -> Start, End
end_7 = EndPoints(Curve=ln_5)  # -> Start, End
ln_16 = Line(StartPoint=end_5.Start, EndPoint=project_4.Point)
ln_17 = Line(StartPoint=midpt_4, EndPoint=project_6.Point)
ln_18 = Line(StartPoint=end_5.End, EndPoint=project_3.Point)
ln_19 = Line(StartPoint=midpt_3, EndPoint=project_5.Point)
ln_20 = Line(StartPoint=end_7.Start, EndPoint=project.Point)
ln_21 = Line(StartPoint=midpt_2, EndPoint=project_7.Point)
ln_22 = Line(StartPoint=end_7.End, EndPoint=project_2.Point)
end_8 = EndPoints(Curve=ln_18)  # -> Start, End
end_9 = EndPoints(Curve=ln_17)  # -> Start, End
end_10 = EndPoints(Curve=ln_16)  # -> Start, End
end_11 = EndPoints(Curve=ln_19)  # -> Start, End
end_12 = EndPoints(Curve=ln_20)  # -> Start, End
end_13 = EndPoints(Curve=ln_21)  # -> Start, End
end_14 = EndPoints(Curve=ln_22)  # -> Start, End
ln_23 = Line(StartPoint=end_10.End, EndPoint=end_8.End)
ln_24 = Line(StartPoint=end_9.Start, EndPoint=end_10.End)
ln_25 = Line(StartPoint=end_8.Start, EndPoint=end_9.End)
ln_26 = Line(StartPoint=end_12.End, EndPoint=end_11.Start)
ln_27 = Line(StartPoint=end_11.End, EndPoint=end_8.Start)
ln_28 = Line(StartPoint=end_13.End, EndPoint=end_12.Start)
ln_29 = Line(StartPoint=end_14.End, EndPoint=end_13.Start)

len = Length(Curve=flatten(ln_20))
len_2 = Length(Curve=flatten(ln_18))
item_3 = ListItem(List=len, Index="0", Wrap=True)
item_4 = ListItem(List=len_2, Index=panel_3, Wrap=True)
neg_3 = Negative(Value=item_4)
neg_4 = Negative(Value=item_3)
Z_3 = UnitZ(Factor=neg_3)
Z_4 = UnitZ(Factor=neg_4)
polygon_7 = Polygon(Plane=Z_3, Radius=truss_3_radius, Segments=no_of_canopy_sides, FilletRadius=0)  # -> Polygon, Length
polygon_8 = Polygon(Plane=Z_4, Radius=truss_2_radius, Segments=no_of_canopy_sides, FilletRadius=0)  # -> Polygon, Length

# ----
# Truss 2 Generation
no_of_bays_2 = Slider(4, range=0..10)
divide_9 = DivideCurve(Curve=polygon_3.Polygon, Count=no_of_canopy_sides, Kinks=False)  # -> Points, Tangents, Parameters
divide_10 = DivideCurve(Curve=polygon_8.Polygon, Count=no_of_canopy_sides, Kinks=False)  # -> Points, Tangents, Parameters
shatter_3 = Shatter(Curve=polygon_3.Polygon, Parameters=divide_9.Parameters, UseTasks=True)
shatter_4 = Shatter(Curve=polygon_8.Polygon, Parameters=divide_10.Parameters, UseTasks=True)
divide_11 = DivideCurve(Curve=shatter_3, Count=no_of_bays_2, Kinks=False)  # -> Points, Tangents, Parameters
divide_12 = DivideCurve(Curve=shatter_4, Count=no_of_bays_2, Kinks=False)  # -> Points, Tangents, Parameters
ln_30 = Line(StartPoint=divide_11.Points, EndPoint=divide_12.Points)
cull_5 = CullPattern(List=ln_30, CullPattern=[False, True, True, True])

# ----
# Truss 3 Generation
no_of_bays_3 = Slider(4, range=0..10)
divide_13 = DivideCurve(Curve=polygon_7.Polygon, Count=no_of_canopy_sides, Kinks=False)  # -> Points, Tangents, Parameters
shatter_5 = Shatter(Curve=polygon_2.Polygon, Parameters=divide_3.Parameters, UseTasks=True)
shatter_6 = Shatter(Curve=polygon_7.Polygon, Parameters=divide_13.Parameters, UseTasks=True)
divide_14 = DivideCurve(Curve=shatter_5, Count=no_of_bays_3, Kinks=False)  # -> Points, Tangents, Parameters
divide_15 = DivideCurve(Curve=shatter_6, Count=no_of_bays_3, Kinks=False)  # -> Points, Tangents, Parameters
ln_31 = Line(StartPoint=divide_14.Points, EndPoint=divide_15.Points)
cull_6 = CullPattern(List=ln_31, CullPattern=[False, True, True, True])

# ----
# Truss 3 Cross Bracing
panel_4 = Panel("""3
2""")
panel_5 = Panel("""1
0""")
panel_6 = Panel("""1
2""")
panel_7 = Panel("""3
4""")
item_5 = ListItem(List=ln_31, Index=panel_5, Wrap=True)
item_6 = ListItem(List=ln_31, Index=panel_6, Wrap=True)
item_7 = ListItem(List=ln_31, Index=panel_4, Wrap=True)
item_8 = ListItem(List=ln_31, Index=panel_7, Wrap=True)
end_15 = EndPoints(Curve=item_5)  # -> Start, End
end_16 = EndPoints(Curve=item_6)  # -> Start, End
end_17 = EndPoints(Curve=item_7)  # -> Start, End
end_18 = EndPoints(Curve=item_8)  # -> Start, End
shift_9 = ShiftList(List=end_15.Start, Shift=1, Wrap="false")
shift_10 = ShiftList(List=end_16.Start, Shift=1, Wrap="false")
shift_11 = ShiftList(List=end_17.Start, Shift=1, Wrap="false")
shift_12 = ShiftList(List=end_18.Start, Shift=1, Wrap="false")
short_2 = ShortestList(ListA=shift_9, ListB=end_15.End, TrimMode=2)  # -> ListA, ListB
short_3 = ShortestList(ListA=shift_10, ListB=end_16.End, TrimMode=2)  # -> ListA, ListB
short_4 = ShortestList(ListA=shift_11, ListB=end_17.End, TrimMode=2)  # -> ListA, ListB
short_5 = ShortestList(ListA=shift_12, ListB=end_18.End, TrimMode=2)  # -> ListA, ListB
ln_32 = Line(StartPoint=short_2.ListA, EndPoint=short_2.ListB)
ln_33 = Line(StartPoint=short_3.ListA, EndPoint=short_3.ListB)
ln_34 = Line(StartPoint=short_4.ListA, EndPoint=short_4.ListB)
ln_35 = Line(StartPoint=short_5.ListA, EndPoint=short_5.ListB)

# ----
# Truss 2 Cross Bracing
panel_8 = Panel("""1
0""")
panel_9 = Panel("""3
2""")
panel_10 = Panel("""1
2""")
panel_11 = Panel("""3
4""")
item_9 = ListItem(List=ln_30, Index=panel_8, Wrap=True)
item_10 = ListItem(List=ln_30, Index=panel_10, Wrap=True)
item_11 = ListItem(List=ln_30, Index=panel_9, Wrap=True)
item_12 = ListItem(List=ln_30, Index=panel_11, Wrap=True)
end_19 = EndPoints(Curve=item_9)  # -> Start, End
end_20 = EndPoints(Curve=item_10)  # -> Start, End
end_21 = EndPoints(Curve=item_11)  # -> Start, End
end_22 = EndPoints(Curve=item_12)  # -> Start, End
shift_13 = ShiftList(List=end_19.Start, Shift=1, Wrap="false")
shift_14 = ShiftList(List=end_20.Start, Shift=1, Wrap="false")
shift_15 = ShiftList(List=end_21.Start, Shift=1, Wrap="false")
shift_16 = ShiftList(List=end_22.Start, Shift=1, Wrap="false")
short_6 = ShortestList(ListA=shift_13, ListB=end_19.End, TrimMode=2)  # -> ListA, ListB
short_7 = ShortestList(ListA=shift_14, ListB=end_20.End, TrimMode=2)  # -> ListA, ListB
short_8 = ShortestList(ListA=shift_15, ListB=end_21.End, TrimMode=2)  # -> ListA, ListB
short_9 = ShortestList(ListA=shift_16, ListB=end_22.End, TrimMode=2)  # -> ListA, ListB
ln_36 = Line(StartPoint=short_6.ListA, EndPoint=short_6.ListB)
ln_37 = Line(StartPoint=short_7.ListA, EndPoint=short_7.ListB)
ln_38 = Line(StartPoint=short_8.ListA, EndPoint=short_8.ListB)
ln_39 = Line(StartPoint=short_9.ListA, EndPoint=short_9.ListB)

# ----
# Truss 4 Cross Bracing
panel_12 = Panel("""1
0""")
panel_13 = Panel("""1
2""")
item_13 = ListItem(List=ln_11, Index=panel_12, Wrap=True)
item_14 = ListItem(List=ln_11, Index=panel_13, Wrap=True)
end_23 = EndPoints(Curve=item_13)  # -> Start, End
end_24 = EndPoints(Curve=item_14)  # -> Start, End
shift_17 = ShiftList(List=end_23.Start, Shift=1, Wrap="false")
shift_18 = ShiftList(List=end_24.Start, Shift=1, Wrap="false")
short_10 = ShortestList(ListA=shift_17, ListB=end_23.End, TrimMode=2)  # -> ListA, ListB
short_11 = ShortestList(ListA=shift_18, ListB=end_24.End, TrimMode=2)  # -> ListA, ListB
ln_40 = Line(StartPoint=short_10.ListA, EndPoint=short_10.ListB)
ln_41 = Line(StartPoint=short_11.ListA, EndPoint=short_11.ListB)

# ----
# Columns
no_off_columns = Slider(3, range=0..10)
Z_5 = UnitZ(Factor=1)
divide_16 = DivideCurve(Curve=polygon_7.Polygon, Count=no_off_columns, Kinks=False)  # -> Points, Tangents, Parameters
neg_5 = Negative(Value=Z_5)
line = LineSDL(Start=divide_16.Points, Direction=neg_5, Length=Slider(8000, range=0..100000))
