# Grasshopper definition Column Family Along Curve v1.gh (Grasshopper 1.0.7)
# plug-ins: Rhino.Inside for Autodesk Revit

# ---- group: Move the objects to the origin to create the Family definition
brep = Brep([<brep referenced from the Rhino model> x3])
pt = Point([<point referenced from the Rhino model> x9])
item = ListItem(List=pt, Index=0, Wrap=True)
vec2pt = Vector2Pt(PointA=item, PointB=Point(0, 0, 0), Unitize=False)  # -> Vector, Length
move = Move(Geometry=brep, Motion=vec2pt.Vector)  # -> Geometry, Transform

# ----
model = ModelCategoriesPicker({"Abutments": -2006130, "Air Systems": -2001008, "Air Terminals": -2008013, "Analysis Display Style": -2000304, "Analysis Results": -2000303, "Areas": -2003200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}, selected="Columns": -2000100)
path = FilePath("C:\ProgramData\Autodesk\RVT 2019\Family Templates\English_I\Column.rft")
new_component_family = NewComponentFamily(Template=path, Overwrite=Toggle(True), Name="ColumnRight", Category=model, Geometry=move.Geometry)

# ---- group: Create a plane frame that represents rotation on insertion
crv = Curve(<curve referenced from the Rhino model>)
crv_cp = CurveClosestPoint(Point=pt, Curve=crv)  # -> Point, Parameter, Distance
eval = EvaluateCurve(Curve=crv, Parameter=crv_cp.Parameter)  # -> Point, Tangent, Angle
pl = ConstructPlane(Origin=eval.Point, XAxis=eval.Tangent, YAxis=Vector(0, 1, 0))

# ----
level = DocumentLevelsPicker(<document.levelspicker referenced from the Revit model>)
family_gettypes = FamilyGetTypes(Family=new_component_family)
bylocation = AddFamilyInstanceByLocation(Location=pl, Type=family_gettypes, Level=level, TrackingMode=2)
