# Grasshopper definition Sample_Revit_to_RhinoV1.gh (Grasshopper 1.0.7)
# plug-ins: Rhino.Inside for Autodesk Revit

model = DocumentCategoriesPicker({"Abutments": -2006130, "Air Systems": -2001008, "Air Terminals": -2008013, "Analysis Display Style": -2000304, "Analysis Results": -2000303, "Areas": -2003200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}, selected="Roofs": -2000035)
model_2 = DocumentCategoriesPicker({"Abutments": -2006130, "Air Systems": -2001008, "Air Terminals": -2008013, "Analysis Display Style": -2000304, "Analysis Results": -2000303, "Areas": -2003200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}, selected="Walls": -2000011)
model_3 = DocumentCategoriesPicker({"Abutments": -2006130, "Air Systems": -2001008, "Air Terminals": -2008013, "Analysis Display Style": -2000304, "Analysis Results": -2000303, "Areas": -2003200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}, selected="Doors": -2000023)
model_4 = DocumentCategoriesPicker({"Abutments": -2006130, "Air Systems": -2001008, "Air Terminals": -2008013, "Analysis Display Style": -2000304, "Analysis Results": -2000303, "Areas": -2003200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}, selected="Floors": -2000032)
model_5 = DocumentCategoriesPicker({"Abutments": -2006130, "Air Systems": -2001008, "Air Terminals": -2008013, "Analysis Display Style": -2000304, "Analysis Results": -2000303, "Areas": -2003200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}, selected="Windows": -2000014)
model_6 = DocumentCategoriesPicker({"Abutments": -2006130, "Air Systems": -2001008, "Air Terminals": -2008013, "Analysis Display Style": -2000304, "Analysis Results": -2000303, "Areas": -2003200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}, selected="Curtain Wall Mullions": -2000171)

# ---- group: Upgraded : Document Categories
categories = DocumentCategories(Type=1)
A = AllowsSubcategories()  # disabled
A_2 = AllowsParameters()  # disabled
M = HasMaterialQuantities()  # disabled

# ----
value_set_picker = ValueSetPicker(categories)
category_filter = ElementCategoryFilter(Categories=model, Inverted=False)
identity = CategoryIdentity(Category=model)  # -> Type, Parent, Name, AllowsSubcategories, AllowsParameters, HasMaterialQuantities, Cuttable
category_filter_2 = ElementCategoryFilter(Categories=model_2, Inverted=False)
identity_2 = CategoryIdentity(Category=model_2)  # -> Type, Parent, Name, AllowsSubcategories, AllowsParameters, HasMaterialQuantities, Cuttable
category_filter_3 = ElementCategoryFilter(Categories=model_3, Inverted=False)
identity_3 = CategoryIdentity(Category=model_3)  # -> Type, Parent, Name, AllowsSubcategories, AllowsParameters, HasMaterialQuantities, Cuttable
category_filter_4 = ElementCategoryFilter(Categories=model_4, Inverted=False)
identity_4 = CategoryIdentity(Category=model_4)  # -> Type, Parent, Name, AllowsSubcategories, AllowsParameters, HasMaterialQuantities, Cuttable
category_filter_5 = ElementCategoryFilter(Categories=model_5, Inverted=False)
identity_5 = CategoryIdentity(Category=model_5)  # -> Type, Parent, Name, AllowsSubcategories, AllowsParameters, HasMaterialQuantities, Cuttable
category_filter_6 = ElementCategoryFilter(Categories=model_6, Inverted=False)
identity_6 = CategoryIdentity(Category=model_6)  # -> Type, Parent, Name, AllowsSubcategories, AllowsParameters, HasMaterialQuantities, Cuttable
category_filter_7 = ElementCategoryFilter(Categories=value_set_picker, Inverted=False)
identity_7 = CategoryIdentity(Category=value_set_picker)  # -> Type, Parent, Name, AllowsSubcategories, AllowsParameters, HasMaterialQuantities, Cuttable
elements = DocumentElements(Filter=category_filter)
elements_2 = DocumentElements(Filter=category_filter_2)
elements_3 = DocumentElements(Filter=category_filter_3)
elements_4 = DocumentElements(Filter=category_filter_4)
elements_5 = DocumentElements(Filter=category_filter_5)
elements_6 = DocumentElements(Filter=category_filter_6)
elements_7 = DocumentElements(Filter=category_filter_7)
element_geometry = ElementGeometry(Elements=elements_5)
element_geometry_2 = ElementGeometry(Elements=elements_2)
element_geometry_3 = ElementGeometry(Elements=elements_7)
element_geometry_4 = ElementGeometry(Elements=elements_4)
element_geometry_5 = ElementGeometry(Elements=elements_3)
element_geometry_6 = ElementGeometry(Elements=elements_6)
element_geometry_7 = ElementGeometry(Elements=elements)
python = GhPythonScript(G=flatten(element_geometry_7), L=identity.Name, B=Button())  # -> out, a; inputs B: Boolean
# ---------- python: Python ----------
"""Provides a scripting component.
    Inputs:
        G: Geometry to bake
        L: Layer name for bake
        B: Bake Activate
    Output:
        a: The a output variable"""

__author__ = "ScottD"
__version__ = "2019.08.10"

import rhinoscriptsyntax as rs
import scriptcontext
import Rhino


scriptcontext.doc = ghdoc


if B:
    
    #debug message to Python output
    print(type(G))
    
    #we obtain the reference in the Rhino doc
    doc_object = rs.coercerhinoobject(G, True, True)
    print(type(doc_object))
    
    attributes = doc_object.Attributes
    print('the type of attributes is: ' + str(type(attributes)))
    geometry = doc_object.Geometry
    print('the type of geometry is: ' + str(type(doc_object)))
    
    #we change the scriptcontext
    scriptcontext.doc = Rhino.RhinoDoc.ActiveDoc
    
    #we add both the geometry and the attributes to the Rhino doc
    rhino_brep = scriptcontext.doc.Objects.Add(geometry, attributes)
    print('the Rhino doc ID is: ' + str(rhino_brep))
    
    #we can for example change color in Rhino...
    # rs.ObjectColor(rhino_line, color)
    if not rs.IsLayer(L): 
        rs.AddLayer(L)
    rs.ObjectLayer(rhino_brep, L)
    
    #we put back the original Grasshopper document as default
    scriptcontext.doc = ghdoc
    a = rhino_brep
# ---------- end python ----------
python_2 = GhPythonScript(G=flatten(element_geometry_2), L=identity_2.Name, B=Button())  # -> out, a; inputs B: Boolean; same code as python
python_3 = GhPythonScript(G=flatten(element_geometry_5), L=identity_3.Name, B=Button())  # -> out, a; inputs B: Boolean; same code as python
python_4 = GhPythonScript(G=flatten(element_geometry_4), L=identity_4.Name, B=Button())  # -> out, a; inputs B: Boolean; same code as python
python_5 = GhPythonScript(G=flatten(element_geometry), L=identity_5.Name, B=Button())  # -> out, a; inputs B: Boolean; same code as python
python_6 = GhPythonScript(G=flatten(element_geometry_6), L=identity_6.Name, B=Button())  # -> out, a; inputs B: Boolean; same code as python
python_7 = GhPythonScript(G=flatten(element_geometry_3), L=identity_7.Name, B=Button())  # -> out, a; inputs B: Boolean; same code as python
