# Grasshopper definition Testing Truss.gh (Grasshopper 1.0.7)
# plug-ins: BH.UI.Grasshopper, LunchBox

# ----
# Push to Revit
panel = Panel("UB305x102x33")
line = Line()
constantframingproperty = ConstantFramingProperty(OrientationAngle=0, Name=panel, Component="BH.oM.Physical.FramingProperties.ConstantFramingProperty")
beam = Beam(Location=line, Property=constantframingproperty, Component="BH.oM.Physical.Elements.Beam")
pushtype = PushType(
    {"FullPush": 0, "CreateOnly": 1, "CreateNonExisting": 2, "UpdateOnly": 3, "UpdateOrCreateOnly": 4, "DeleteThenCreate": 5, "AdapterDefault": 6}, selected="UpdateOnly",
    Component="BH.oM.Adapter.PushType",
    Selection=3)
revitadapter = RevitAdapter(Active=Toggle(True), Component="{ ..ctor")
data = Data(beam)
push = Push(Adapter=revitadapter, Objects=flatten(data), PushType=pushtype, Active=Toggle(False), Component="{ .Push")  # -> Objects, Success

# ---- group: Inputs
no_of_canopy_sides = Slider(12, range=12..13)
external_depth = Slider(500, range=0..1000)
external_radius = Slider(16000, range=0..50000)
# Truss 1 Cross Bracing
truss_4_radius = Slider(4000, range=0..50000)
truss_3_radius = Slider(8000, range=0..50000)
truss_2_radius = Slider(12000, range=0..50000)
truss_depth_4 = Slider(1500, range=0..10000)
truss_divisions = Panel("""2
4
4""")
# Inputs
pt = Point(Point(0, 0, 0))
truss_divisions_2 = Number(truss_divisions)
number_of_canopy_sides = Number(no_of_canopy_sides)
centre_point = Point(pt)

# ----
division = Division(A=external_depth, B="2")
division_2 = Division(A=truss_depth_4, B="2")
division_3 = Division(A=division, B="1000")
division_4 = Division(A=division_2, B="1000")
division_5 = Division(A=truss_4_radius, B="1000")
division_6 = Division(A=truss_3_radius, B="1000")
division_7 = Division(A=truss_2_radius, B="1000")
division_8 = Division(A=external_radius, B="1000")

# ---- group: Inputs (continued)
truss_4_radius_mm = Number(division_5)
truss_3_radius_mm = Number(division_6)
truss_2_radius_mm = Number(division_7)
external_radius_mm = Number(division_8)
truss_depth_1_mm = Number(division_4)
external_depth_mm = Number(division_3)

# ---- group: Create Circles
truss_4_radius_mm_2 = Number(truss_4_radius_mm)
truss_3_radius_mm_2 = Number(truss_3_radius_mm)
truss_2_radius_mm_2 = Number(truss_2_radius_mm)
external_radius_mm_2 = Number(external_radius_mm)
centre_point_2 = Point(centre_point)
cir = Circle(Plane=centre_point_2, Radius=truss_4_radius_mm_2)
cir_2 = Circle(Plane=centre_point_2, Radius=truss_3_radius_mm_2)
cir_3 = Circle(Plane=centre_point_2, Radius=truss_2_radius_mm_2)
cir_4 = Circle(Plane=centre_point_2, Radius=external_radius_mm_2)
circle_truss_4 = Geometry(cir)
circle_truss_3 = Geometry(cir_2)
circle_truss_2 = Geometry(cir_3)
circle_external = Geometry(cir_4)

# ---- group: Move Circles Down
circle_truss_4_2 = Geometry(circle_truss_4)
truss_depth_1_mm_2 = Number(truss_depth_1_mm)
circle_external_2 = Geometry(circle_external)
external_depth_mm_2 = Number(external_depth_mm)
Z = UnitZ(Factor=truss_depth_1_mm_2)  # -> expr("-x", UnitVector)
Z_2 = UnitZ(Factor=external_depth_mm_2)  # -> expr("-x", UnitVector)
move = Move(Geometry=circle_truss_4_2, Motion=Z)  # -> Geometry, Transform
move_2 = Move(Geometry=circle_external_2, Motion=Z_2)  # -> Geometry, Transform
circle_truss_4_lower = Geometry(move.Geometry)
circle_external_lower = Geometry(move_2.Geometry)

# ---- group: Move Circles Up
circle_truss_4_3 = Geometry(circle_truss_4)
truss_depth_1_mm_3 = Number(truss_depth_1_mm)
circle_external_3 = Geometry(circle_external)
external_depth_mm_3 = Number(external_depth_mm)
Z_3 = UnitZ(Factor=truss_depth_1_mm_3)
Z_4 = UnitZ(Factor=external_depth_mm_3)
move_3 = Move(Geometry=circle_truss_4_3, Motion=Z_3)  # -> Geometry, Transform
move_4 = Move(Geometry=circle_external_3, Motion=Z_4)  # -> Geometry, Transform
circle_truss_4_lower_2 = Geometry(move_3.Geometry)
circle_external_lower_2 = Geometry(move_4.Geometry)

# ---- group: Radial Chords - Upper
number_of_canopy_sides_2 = Number(number_of_canopy_sides)
circle_truss_4_4 = Geometry(circle_truss_4_lower_2)
circle_external_4 = Geometry(circle_external_lower_2)
divide = DivideCurve(Curve=circle_truss_4_4, Count=number_of_canopy_sides_2, Kinks=False)  # -> Points, Tangents, Parameters
divide_2 = DivideCurve(Curve=circle_external_4, Count=number_of_canopy_sides_2, Kinks=False)  # -> Points, Tangents, Parameters
ln = Line(StartPoint=divide.Points, EndPoint=divide_2.Points)
radial_chords_upper = Geometry(ln)

# ---- group: Radial Chords - Lower
number_of_canopy_sides_3 = Number(number_of_canopy_sides)
circle_truss_4_lower_3 = Geometry(circle_truss_4_lower)
circle_external_lower_3 = Geometry(circle_external_lower)
divide_3 = DivideCurve(Curve=circle_truss_4_lower_3, Count=number_of_canopy_sides_3, Kinks=False)  # -> Points, Tangents, Parameters
divide_4 = DivideCurve(Curve=circle_external_lower_3, Count=number_of_canopy_sides_3, Kinks=False)  # -> Points, Tangents, Parameters
ln_2 = Line(StartPoint=divide_3.Points, EndPoint=divide_4.Points)
radial_chords_lower = Geometry(ln_2)

# ----
midpt = CurveMiddle(Curve=radial_chords_upper)
points = PointList(Points=midpt, Size=Slider(1, range=0..100))

item = ListItem(List=radial_chords_lower, Index="0", Wrap=True)
item_2 = ListItem(List=radial_chords_upper, Index="0", Wrap=True)
divide_5 = DivideCurve(Curve=item, Count=Slider(3, range=0..10), Kinks=False)  # -> Points, Tangents, Parameters
divide_6 = DivideCurve(Curve=item_2, Count=Slider(3, range=0..10), Kinks=False)  # -> Points, Tangents, Parameters
shatter = Shatter(Curve=item, Parameters=divide_5.Parameters)
shatter_2 = Shatter(Curve=item_2, Parameters=divide_6.Parameters)
item_3 = ListItem(List=shatter, Index=0, Wrap=True)  # -> Item, Item1, Item2
item_4 = ListItem(List=shatter_2, Index=0, Wrap=True)  # -> Item, Item1, Item2
truss = _2DTruss(CurveA=item_4.Item, CurveB=item_3.Item, Divisions=Slider(2, range=0..10), TrussToggle=Slider(2, range=0..10))  # -> PrimaryLines, BraceLines, VerticalLines, StructureNodes
truss_2 = _2DTruss(CurveA=item_4.Item2, CurveB=item_3.Item2, Divisions=Slider(2, range=0..10), TrussToggle=Slider(1, range=0..10))  # -> PrimaryLines, BraceLines, VerticalLines, StructureNodes
truss_3 = _2DTruss(CurveA=item_4.Item1, CurveB=item_3.Item1, Divisions=Slider(2, range=0..10), TrussToggle=Slider(1, range=0..10))  # -> PrimaryLines, BraceLines, VerticalLines, StructureNodes
