# Grasshopper definition Adaptive Paneling V1.gh (Grasshopper 1.0.7)
# plug-ins: PTComponentLibrary, Kangaroo2 Components, Rhino.Inside for Autodesk Revit

# ---- group: Input surface
srf = Surface(<surface referenced from the Rhino model>)

# ----
surface_display = SurfaceDisplay(S=srf)
preview = CustomPreview(Geometry=srf, Material=ColourSwatch(SwatchColor=RGBA(181, 209, 255, 96)))

# ---- group: Untrimmed input surface
untrim = Untrim(Surface=srf)

# ---- group: Create Horizontal lines / Floor height
H = Slider(80.9, range=5..120)

# ---- group: Create Horizontal lines / Number of floors
panel = Panel("13")

# ---- group: Create Horizontal lines
series = Series(Start=0, Step=H, Count=panel)
line = Line(Line((185.9887586, 613.4858305, 0), (185.9887586, -1242.942051, 0)))
Z = UnitZ(Factor=series)
move = Move(Geometry=line, Motion=Z)  # -> Geometry, Transform
X = UnitX(Factor=1)

# ---- group: Create Horizontal lines / Horezontal curves
project = Project(Curve=move.Geometry, Brep=untrim, Direction=X)

# ----
preview_2 = CustomPreview(Geometry=project, Material=ColourSwatch(SwatchColor=RGB(173, 42, 42)))

# ---- group: Create Vertical Grid Lines / Number of curves
number_slider = Slider(40, range=0..100)

# ---- group: Create Vertical Grid Lines
range = Range(Domain="0 to 2*Pi", Steps=number_slider)
bbox = BoundingBox(Content=untrim, Plane=PlaneXY(0, 0, 0))  # -> Box, Box_2
X_2 = UnitX(Factor=1)
rotate = Rotate(Geometry=X_2, Angle=range, Plane=PlaneXY(0, 0, 0))  # -> Geometry, Transform
boxprop = BoxProperties(Box=bbox.Box)  # -> Center, Diagonal, Area, Volume, Degeneracy
vlen = VectorLength(Vector=boxprop.Diagonal)
line_2 = LineSDL(Start=boxprop.Center, Direction=rotate.Geometry, Length=vlen)
Z_2 = UnitZ(Factor=vlen)
extr = Extrude(Base=line_2, Direction=Z_2)
move_2 = Move(Geometry=extr, Motion=expr("-x/2", Z_2))  # -> Geometry, Transform

# ---- group: Create Vertical Grid Lines / Vertical curves
bbx = BrepBrep(BrepA=untrim, BrepB=move_2.Geometry)  # -> Curves, Points

# ----
preview_3 = CustomPreview(Geometry=bbx.Curves, Material=ColourSwatch(SwatchColor=RGB(26, 60, 130)))

# ---- group: Grid from horizontal and vertical curves intersections
ptuvcrvs = IntersectCurves(CU=flatten(project), CV=flatten(bbx.Curves))

# ----
symsim = SymbolSimple(Style=5, Size=3, Rotation=0, Colour=ColourSwatch(SwatchColor=RGB(135, 203, 201)))
symbol = SymbolDisplay(Location=ptuvcrvs, Display=symsim)

# ---- group: Trim the grid
list = ValueList({"Inside": 0, "Outside": 1, "Edge": 2}, selected="Outside")
pttrim = TrimGrid(Grid=ptuvcrvs, BRep=srf, Mode=list)

# ----
symsim_2 = SymbolSimple(Style=5, Size=3, Rotation=0, Colour=ColourSwatch(SwatchColor=RGB(135, 203, 201)))
symbol_2 = SymbolDisplay(Location=pttrim, Display=symsim_2)

# ---- group: All cells geometry
ptcell = Cellulate(Grid=pttrim)  # -> Wires, Cells, Meshes

# ----
symsim_3 = SymbolSimple(Style=5, Size=3, Rotation=0, Colour=ColourSwatch(SwatchColor=RGB(135, 203, 201)))
preview_4 = CustomPreview(Geometry=ptcell.Wires, Material=ColourSwatch(SwatchColor=RGB(26, 60, 130)))
preview_5 = CustomPreview(Geometry=ptcell.Meshes, Material=ColourSwatch(SwatchColor=RGBA(181, 209, 255, 96)))
symbol_3 = SymbolDisplay(Location=pttrim, Display=symsim_3)

# ---- group: Trimmed panels as NURBS (use untrimmed grid)
list_2 = ValueList({"Staright": 0, "Pull": 1, "Iso": 2, "Shortest Path": 2}, selected="Iso")
ptfaces = GenerateFaces(Grid=pttrim, PanelShape=list_2, Surface=srf)

# ---- group: Test if cell points are within active region (outside points have dis > tol when pulled)
srf_cp = SurfaceClosestPoint(Point=ptcell.Cells, Surface=srf)  # -> Point, UVPoint, Distance
ma = MassAddition(Input=srf_cp.Distance)  # -> flatten(Result), PartialResults
larger = LargerThan(FirstNumber=ma.Result, SecondNumber="0.001")  # -> LargerThan, OrEqualTo
not = GateNot(A=larger.LargerThan)

# ----
preview_6 = CustomPreview(Geometry=ptfaces, Material=ColourSwatch(SwatchColor=RGB(181, 209, 255)))

# ---- group: borders
join = JoinCurves(Curves=ptcell.Wires, Preserve=False)  # -> flatten(Curves)

# ---- group: Meshes
mesh = Mesh(flatten(ptcell.Meshes))

# ---- group: Cells corner points
pt = Point(ptcell.Cells)

# ---- group: The solid fill panels
srf_2 = Surface(flatten(ptfaces))
cull = CullPattern(List=srf_2, CullPattern=larger.LargerThan)
bybrep = AddDirectShapeByBrep(Brep=cull, TrackingMode=2)  # disabled

# ----
viewer = ParamViewer(pt)

# ---- group: Edge geometry / Edge borders
cull_2 = CullPattern(List=join, CullPattern=larger.LargerThan)

# ---- group: Edge geometry / Edge meshes
cull_3 = CullPattern(List=mesh, CullPattern=larger.LargerThan)

# ---- group: Edge geometry / Edge cell points
cull_4 = CullPattern(List=viewer, CullPattern=larger.LargerThan)
branch = TreeBranch(Tree=pt, Path=cull_4, MaintainPaths=True)

# ---- group: Inside geometry / Inside borders
cull_5 = CullPattern(List=join, CullPattern=not)

# ---- group: Inside geometry / Inside meshes
cull_6 = CullPattern(List=mesh, CullPattern=not)

# ---- group: Inside geometry / Inside cell points
cull_7 = CullPattern(List=viewer, CullPattern=not)
branch_2 = TreeBranch(Tree=pt, Path=cull_7, MaintainPaths=True)

# ---- group: Edge geometry
swatch = ColourSwatch(SwatchColor=RGB(135, 203, 201))

# ----
symsim_4 = SymbolSimple(Style=5, Size=3, Rotation=0, Colour=swatch)
symsim_5 = SymbolSimple(Style=5, Size=3, Rotation=0, Colour=ColourSwatch(SwatchColor=RGB(135, 203, 201)))
preview_7 = CustomPreview(Geometry=cull_2, Material=ColourSwatch(SwatchColor=RGB(26, 60, 130)))
preview_8 = CustomPreview(Geometry=cull_3, Material=ColourSwatch(SwatchColor=RGBA(181, 209, 255, 195)))
symbol_4 = SymbolDisplay(Location=branch, Display=symsim_4)
preview_9 = CustomPreview(Geometry=cull_6, Material=ColourSwatch(SwatchColor=RGBA(181, 209, 255, 195)))
preview_10 = CustomPreview(Geometry=cull_5, Material=ColourSwatch(SwatchColor=RGB(26, 60, 130)))
symbol_5 = SymbolDisplay(Location=branch_2, Display=symsim_5)
model = ModelCategoriesPicker({"Abutments": -2006130, "Air Systems": -2001008, "Air Terminals": -2008013, "Analysis Display Style": -2000304, "Analysis Results": -2000303, "Areas": -2003200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}, selected="Generic Models": -2000151)
cpoly = ControlPolygon(Curve=cull_5)  # -> Polygon, Points
duppt = RemoveDuplicatePts(Points=cpoly.Points, Tolerance=0.01)
panel_2 = Panel(duppt)
elementtype_byname = ElementTypeByName(
    model,
    {"Frame-Panel : Frame-Panel": "091913f7-764d-42ce-9176-a15e5e7cfbd9-2a540609-0fa7-4a85-b9dc-f97551aaf940-00056637", "Model Text : 24\" Arial": "091913f7-764d-42ce-9176-a15e5e7cfbd9-b0b76196-1902-482f-b464-0488e33408cc-00006da0"}, selected="Frame-Panel : Frame-Panel")
active_document = ActiveDocument()
add_component_adaptive = AddComponentAdaptive(Points=duppt, Type=elementtype_byname, TrackingMode=2)
query_parameters = QueryParameters(Document=active_document, Name="Frame-thickness")
number_slider_2 = Slider(6, range=1..6)

# ==== cluster SurfaceDisplay
S = ClusterInput()

# ---- group: Visualizing surface parameterization
range = Range(Domain=Domain(0, 1), Steps="16")
pt = ConstructPoint(XCoordinate=range, YCoordinate=range, ZCoordinate=0)
iso = IsoCurve(Surface=reparameterize(S), UVPoint=pt)  # -> UIsocurve, VIsocurve
crv = Curve(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)
preview = CustomPreview(Geometry=iso.UIsocurve, Material=ColourSwatch(SwatchColor=RGB(173, 42, 42)))
preview_2 = CustomPreview(Geometry=iso.VIsocurve, Material=ColourSwatch(SwatchColor=RGB(38, 135, 61)))
preview_3 = CustomPreview(Geometry=crv, Material=ColourSwatch(SwatchColor=RGB(0, 0, 0)))
