# Grasshopper definition create_revit_walls_v1.gh (Grasshopper 1.0.7)
# plug-ins: Rhino.Inside for Autodesk Revit

# ---- group: Right-click to select a Rhino curve
crv = Curve(<curve referenced from the Rhino model>)

# ---- group: Right-click to select a Revit wall
geometric_element = GeometricElement(<wall referenced from the Revit model>)

# ----
height_of_walls = Slider(78.894, range=0..101)
level = DocumentLevelsPicker(<document.levelspicker referenced from the Revit model>)
explode = Explode(Curve=crv, Recursive=True)  # -> Segments, Vertices
element_type = ElementType(Element=geometric_element)  # -> Element, Type
wall = AddWall(Curve=explode.Segments, Type=element_type.Type, Level=level, Height=height_of_walls, TrackingMode=2)
