# Grasshopper definition structural_revit_to_rhino_v1.gh (Grasshopper 1.0.7)
# plug-ins: Rhino.Inside for Autodesk Revit, karambaGH

model = ModelCategoriesPicker({"Abutments": -2006130, "Air Systems": -2001008, "Air Terminals": -2008013, "Analysis Display Style": -2000304, "Analysis Results": -2000303, "Areas": -2003200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}, selected="Structural Framing": -2001320)
analytical = AnalyticalCategoriesPicker({"Analytical Beams": -2009630, "Analytical Braces": -2009633, "Analytical Columns": -2009636, "Analytical Floors": -2009639, "Analytical Foundation Slabs": -2009643, "Analytical Isolated Foundations": -2009641, "Analytical Links": -2009657, "Analytical Nodes": -2009645, "Analytical Pipe Connections": -2000983, "Analytical Spaces": -2008185, "Analytical Surfaces": -2008186, "Analytical Wall Foundations": -2009642, "Analytical Walls": -2009640, "Boundary Conditions": -2005301, "Structural Internal Loads": -2005204, "Structural Load Cases": -2005210, "Structural Loads": -2005200, "System-Zones": -2001001}, selected="Analytical Columns")
model_2 = ModelCategoriesPicker({"Abutments": -2006130, "Air Systems": -2001008, "Air Terminals": -2008013, "Analysis Display Style": -2000304, "Analysis Results": -2000303, "Areas": -2003200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}, selected="Structural Framing": -2001320)
analytical_2 = AnalyticalCategoriesPicker({"Analytical Beams": -2009630, "Analytical Braces": -2009633, "Analytical Columns": -2009636, "Analytical Floors": -2009639, "Analytical Foundation Slabs": -2009643, "Analytical Isolated Foundations": -2009641, "Analytical Links": -2009657, "Analytical Nodes": -2009645, "Analytical Pipe Connections": -2000983, "Analytical Spaces": -2008185, "Analytical Surfaces": -2008186, "Analytical Wall Foundations": -2009642, "Analytical Walls": -2009640, "Boundary Conditions": -2005301, "Structural Internal Loads": -2005204, "Structural Load Cases": -2005210, "Structural Loads": -2005200, "System-Zones": -2001001}, selected="Analytical Beams")
analytical_3 = AnalyticalCategoriesPicker({"Analytical Beams": -2009630, "Analytical Braces": -2009633, "Analytical Columns": -2009636, "Analytical Floors": -2009639, "Analytical Foundation Slabs": -2009643, "Analytical Isolated Foundations": -2009641, "Analytical Links": -2009657, "Analytical Nodes": -2009645, "Analytical Pipe Connections": -2000983, "Analytical Spaces": -2008185, "Analytical Surfaces": -2008186, "Analytical Wall Foundations": -2009642, "Analytical Walls": -2009640, "Boundary Conditions": -2005301, "Structural Internal Loads": -2005204, "Structural Load Cases": -2005210, "Structural Loads": -2005200, "System-Zones": -2001001}, selected="Analytical Walls")
analytical_4 = AnalyticalCategoriesPicker({"Analytical Beams": -2009630, "Analytical Braces": -2009633, "Analytical Columns": -2009636, "Analytical Floors": -2009639, "Analytical Foundation Slabs": -2009643, "Analytical Isolated Foundations": -2009641, "Analytical Links": -2009657, "Analytical Nodes": -2009645, "Analytical Pipe Connections": -2000983, "Analytical Spaces": -2008185, "Analytical Surfaces": -2008186, "Analytical Wall Foundations": -2009642, "Analytical Walls": -2009640, "Boundary Conditions": -2005301, "Structural Internal Loads": -2005204, "Structural Load Cases": -2005210, "Structural Loads": -2005200, "System-Zones": -2001001}, selected="Analytical Floors")
elementtype_byname = ElementTypeByName(
    model_2,
    {"CHS-Circular Hollow Sections (AS 1163_C250L0) : 88.9x5.0CHS": "890f9267-8c55-4fd2-bfe7-ed6d35141e7e-ac41f7a3-cb0b-4a04-8450-3865860e70e7-000fe98e", "Light Gauge-Joists : SC15012": "890f9267-8c55-4fd2-bfe7-ed6d35141e7e-ac41f7a3-cb0b-4a04-8450-3865860e70e7-000fe203", "M_TJL Wood Open Web Joist : 356mm": "890f9267-8c55-4fd2-bfe7-ed6d35141e7e-cb4373ed-72c2-4885-8dda-08d3bf962cc6-000f0584", "PFC-Parallel Flange Channels (AS 3679_1) : 200PFC": "890f9267-8c55-4fd2-bfe7-ed6d35141e7e-511d935d-408a-4da2-a617-e9f5cbee853b-00125dbb", "Rectangular(Timber)-Beam : Timber_50 x150 _ContentGenerator": "890f9267-8c55-4fd2-bfe7-ed6d35141e7e-8b0290ad-df16-4dec-aae3-c13f9d487e42-0011b5f2", "Rectangular(Timber)-Beam : Timber_50 x200": "890f9267-8c55-4fd2-bfe7-ed6d35141e7e-c06e6027-af9f-448f-9f75-4a25e1e75cae-00125912", "Round Bar : 30mm": "890f9267-8c55-4fd2-bfe7-ed6d35141e7e-79a8a0c0-fdbb-4ecc-9ef7-be6296419a09-000fb974", "UB-Universal Beams (AS 3679_1) : 200UB25.4": "890f9267-8c55-4fd2-bfe7-ed6d35141e7e-ac41f7a3-cb0b-4a04-8450-3865860e70e7-000fe771"}, selected="CHS-Circular Hollow Sections (AS 1163_C250L0) : 88.9x5.0CHS")
elementtype_byname_2 = ElementTypeByName(
    model,
    {"CHS-Circular Hollow Sections (AS 1163_C250L0) : 88.9x5.0CHS": "890f9267-8c55-4fd2-bfe7-ed6d35141e7e-ac41f7a3-cb0b-4a04-8450-3865860e70e7-000fe98e", "Light Gauge-Joists : SC15012": "890f9267-8c55-4fd2-bfe7-ed6d35141e7e-ac41f7a3-cb0b-4a04-8450-3865860e70e7-000fe203", "M_TJL Wood Open Web Joist : 356mm": "890f9267-8c55-4fd2-bfe7-ed6d35141e7e-cb4373ed-72c2-4885-8dda-08d3bf962cc6-000f0584", "PFC-Parallel Flange Channels (AS 3679_1) : 200PFC": "890f9267-8c55-4fd2-bfe7-ed6d35141e7e-511d935d-408a-4da2-a617-e9f5cbee853b-00125dbb", "Rectangular(Timber)-Beam : Timber_50 x150 _ContentGenerator": "890f9267-8c55-4fd2-bfe7-ed6d35141e7e-8b0290ad-df16-4dec-aae3-c13f9d487e42-0011b5f2", "Rectangular(Timber)-Beam : Timber_50 x200": "890f9267-8c55-4fd2-bfe7-ed6d35141e7e-c06e6027-af9f-448f-9f75-4a25e1e75cae-00125912", "Round Bar : 30mm": "890f9267-8c55-4fd2-bfe7-ed6d35141e7e-79a8a0c0-fdbb-4ecc-9ef7-be6296419a09-000fb974", "UB-Universal Beams (AS 3679_1) : 200UB25.4": "890f9267-8c55-4fd2-bfe7-ed6d35141e7e-ac41f7a3-cb0b-4a04-8450-3865860e70e7-000fe771"}, selected="CHS-Circular Hollow Sections (AS 1163_C250L0) : 88.9x5.0CHS")
category_filter = ElementCategoryFilter(Categories=analytical, Inverted=False)
identity = CategoryIdentity(Category=analytical)  # -> Type, Parent, Name, AllowsSubcategories, AllowsParameters, HasMaterialQuantities, Cuttable
identity_2 = CategoryIdentity(Category=analytical_2)  # -> Type, Parent, Name, AllowsSubcategories, AllowsParameters, HasMaterialQuantities, Cuttable
category_filter_2 = ElementCategoryFilter(Categories=analytical_2, Inverted=False)
identity_3 = CategoryIdentity(Category=analytical_3)  # -> Type, Parent, Name, AllowsSubcategories, AllowsParameters, HasMaterialQuantities, Cuttable
category_filter_3 = ElementCategoryFilter(Categories=analytical_3, Inverted=False)
category_filter_4 = ElementCategoryFilter(Categories=analytical_4, Inverted=False)
identity_4 = CategoryIdentity(Category=analytical_4)  # -> Type, Parent, Name, AllowsSubcategories, AllowsParameters, HasMaterialQuantities, Cuttable
elements = DocumentElements(Filter=category_filter)
elements_2 = DocumentElements(Filter=category_filter_3)
elements_3 = DocumentElements(Filter=category_filter_4)
elements_4 = DocumentElements(Filter=category_filter_2)
element_geometry = ElementGeometry(Elements=elements)
element_geometry_2 = ElementGeometry(Elements=elements_3)
element_geometry_3 = ElementGeometry(Elements=elements_2)
element_geometry_4 = ElementGeometry(Elements=elements_4)
number_slider = Slider(1, range=0..1)
python = GhPythonScript(G=flatten(element_geometry), L=identity.Name, B=Button())  # -> out, a; inputs B: Boolean
# ---------- python: Python ----------
"""Provides a scripting component.
    Inputs:
        G: Geometry to bake
        L: Layer name for bake
        B: Bake Activate
    Output:
        a: The a output variable"""

__author__ = "ScottD"
__version__ = "2019.08.10"

import rhinoscriptsyntax as rs
import scriptcontext
import Rhino


scriptcontext.doc = ghdoc


if B:
    
    #debug message to Python output
    print(type(G))
    
    #we obtain the reference in the Rhino doc
    doc_object = rs.coercerhinoobject(G, True, True)
    print(type(doc_object))
    
    attributes = doc_object.Attributes
    print('the type of attributes is: ' + str(type(attributes)))
    geometry = doc_object.Geometry
    print('the type of geometry is: ' + str(type(doc_object)))
    
    #we change the scriptcontext
    scriptcontext.doc = Rhino.RhinoDoc.ActiveDoc
    
    #we add both the geometry and the attributes to the Rhino doc
    rhino_brep = scriptcontext.doc.Objects.Add(geometry, attributes)
    print('the Rhino doc ID is: ' + str(rhino_brep))
    
    #we can for example change color in Rhino...
    # rs.ObjectColor(rhino_line, color)
    if not rs.IsLayer(L): 
        rs.AddLayer(L)
    rs.ObjectLayer(rhino_brep, L)
    
    #we put back the original Grasshopper document as default
    scriptcontext.doc = ghdoc
    a = rhino_brep
# ---------- end python ----------
python_2 = GhPythonScript(G=flatten(element_geometry_2), L=identity_4.Name, B=Button())  # -> out, a; inputs B: Boolean; same code as python
join = JoinCurves(Curves=element_geometry_4, Preserve=False)
python_3 = GhPythonScript(G=flatten(element_geometry_3), L=identity_3.Name, B=Button())  # -> out, a; inputs B: Boolean; same code as python

# ---- group: Original Points
end = EndPoints(Curve=element_geometry_4)  # -> Start, End

# ----
number_slider_2 = Slider(1, range=0..1)
join_2 = JoinCurves(Curves=element_geometry, Preserve=False)
simplify = SimplifyCurve(Curve=join_2, Tolerance=number_slider_2, AngleTolerance=number_slider_2)  # -> Curve, Simplified
linetobeam = LineToBeamKaramba3D(Line=simplify.Curve, New=True, Remove=True, LimitDistance_m=0.005)  # -> Element, Points, Info
end_2 = EndPoints(Curve=simplify.Curve)  # -> Start, End
pt = Point(end_2.Start)
supp = SupportKaramba3D(PosInd=pt, menu=[buttons(on, on, on, on, on, on)])
loads_karamba3d = LoadsKaramba3D(Vector=Vector(0, 0, -1), LCase=0, mode="Gravity")
assemble = AssembleModelKaramba3D(Elem=linetobeam.Element, Support=supp, Load=loads_karamba3d, LimitDistance_m=0.005)  # -> Model, Info, Mass_kg, CenterOfGravity

simplify_2 = SimplifyCurve(Curve=join, Tolerance=number_slider, AngleTolerance=number_slider)  # -> Curve, Simplified

# ---- group: Create Model Based on Type
decompose = ElementDecompose(Element=elements_4)
enable_button = Button()
txt = Text(decompose)
python_4 = GhPythonScript(G=flatten(simplify_2.Curve), L=identity_2.Name, T=txt, B=enable_button)  # -> out, a; inputs B: Boolean
# ---------- python_4: Python ----------
"""Provides a scripting component.
    Inputs:
        G: Geometry to bake
        L: Layer name for bake
        B: Bake Activate
    Output:
        a: The a output variable"""

__author__ = "ScottD"
__version__ = "2019.08.10"

import rhinoscriptsyntax as rs
import scriptcontext
import Rhino


scriptcontext.doc = ghdoc


if B:
    
    #debug message to Python output
    #print(type(G))
    
    #we obtain the reference in the Rhino doc
    doc_object = rs.coercerhinoobject(G, True, True)
    #print(type(doc_object))
    
    attributes = doc_object.Attributes
    #print('the type of attributes is: ' + str(type(attributes)))
    geometry = doc_object.Geometry
    #print('the type of geometry is: ' + str(type(doc_object)))
    
    #we change the scriptcontext
    scriptcontext.doc = Rhino.RhinoDoc.ActiveDoc
    
    #we add both the geometry and the attributes to the Rhino doc
    rhino_brep = scriptcontext.doc.Objects.Add(geometry, attributes)
    #print('the Rhino doc ID is: ' + str(rhino_brep))
    
    #we can for example change color in Rhino...
    # rs.ObjectColor(rhino_line, color)
    if not rs.IsLayer(L):
        rs.AddLayer(L)

    LT = str(L) + "::" + str(T)
    
    print(str(T))

    if not rs.IsLayer(LT):
        rs.AddLayer(T,parent=L)

    rs.ObjectLayer(rhino_brep, str(T))
    
    #we put back the original Grasshopper document as default
    scriptcontext.doc = ghdoc
    a = rhino_brep
# ---------- end python_4 ----------

# ----
type_filter = ElementTypeFilter(Types=elementtype_byname_2, Inverted=False)
type_filter_2 = ElementTypeFilter(Types=elementtype_byname, Inverted=False)

# ---- group: Needs to be enabled then re-calculate
elements_5 = DocumentElements(Filter=type_filter_2)
elements_6 = DocumentElements(Filter=type_filter)

# ---- group: Cleaned points
end_3 = EndPoints(Curve=simplify_2.Curve)  # -> Start, End

# ----
panel = Panel(decompose)
panel_2 = Panel(txt)
int = Integer(1)
int_2 = Integer(1)
element_parameter = ElementParameter(Element=elements_6, Parameter="Enable Analytical Model", Value=int_2)  # -> Element, Value
element_parameter_2 = ElementParameter(Element=elements_5, Parameter="Enable Analytical Model", Value=int)  # -> Element, Value
