# Grasshopper definition rhino to revit v1.gh (Grasshopper 1.0.7)
# plug-ins: Rhino.Inside for Autodesk Revit

# ---- group: Right-click to select multiple Rhino breps
brep = Brep(<brep referenced from the Rhino model>)

# ---- group: Right-click to select multiple points in Rhino
pt = Point()

# ---- group: Right-click to select multiple courtyard curves in Rhino
crv = Curve()

# ---- group: Revit components
crvdshape = AddCurveDirectShape(Curve=crv, TrackingMode=2)
ptdshape = AddPointDirectShape(Point=pt, TrackingMode=2)

# ---- group: Use a DS Category selector and a DS from geometry component
geodshape = AddGeometryDirectShape(Category=<missing>, Geometry=brep, TrackingMode=2)
