# Grasshopper definition wall_roof_v1.gh (Grasshopper 1.0.7)
# plug-ins: Rhino.Inside for Autodesk Revit

edge = Edge([<edge referenced from the Revit model> x3])
edge_2 = Edge([<edge referenced from the Revit model> x3])
categories = DirectShapeCategories("autodesk.revit.category.local:roofs-1.0.0")
join = JoinCurves(Curves=edge_2, Preserve=False)
join_2 = JoinCurves(Curves=edge, Preserve=False)
flip = FlipCurve(Curve=join_2)  # -> Curve, Flag
loft = Loft(
    Curves=[join, flip.Curve],
    Options={Adjust=False, Closed=False, LoftEnds=0, LoftSimp=0, LoftType=0, Rebuild=10, Refit=0.01})
bygeometry = AddDirectShapeByGeometry(Category=categories, Geometry=loft, TrackingMode=2)  # disabled
