# Grasshopper definition write-sheet-param-humanui_v1.gh (Grasshopper 1.0.7)
# plug-ins: Human UI, Rhino.Inside for Autodesk Revit

tag = TagCategoriesPicker({"Abutment Foundation Tags": -2006208, "Abutment Pile Tags": -2006209, "Abutment Tags": -2006170, "Abutment Wall Tags": -2006210, "Air Terminal Tags": -2008014, "Alignment Tags": -2001015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}, selected="Title Blocks": -2000280)

# ---- group: HumanUI
pan = Panel("Drawn By")
pan_2 = Panel("Checked By")
textbox = CreateTextBox(Label=pan, DefaultText="None", UpdateButton=True, showLabel=True)
textbox_2 = CreateTextBox(Label=pan_2, DefaultText="None", UpdateButton=True, showLabel=True)

# ----
category_filter = ElementCategoryFilter(Categories=tag, Inverted=False)
elements = DocumentElements(Filter=category_filter)

# ---- group: HumanUI
toggle = BooleanToggle(True)
values = ValueListener(Elements=textbox, SomeProperty=True)  # -> Values, Indices
values_2 = ValueListener(Elements=textbox_2, SomeProperty=True)  # -> Values, Indices

# ----
launchwin = LaunchWindow(Show=toggle, Name="Update Revit Sheets", Width=370, Height=200, ChildStatus=0, EnableHorizScroll=False)

# ---- group: HumanUI (continued)
addelems = AddElements(Window=launchwin, Elements=flatten([textbox, textbox_2]), DoVLChecking=True)  # -> AddedElements, ElementNames

# ----
element_parameter = ElementParameter(Element=elements, Parameter=pan_2, Value=values_2.Values)  # -> Element, Value
element_parameter_2 = ElementParameter(Element=elements, Parameter=pan, Value=values.Values)  # -> Element, Value
